# Grasshopper definition 00.1_basic behaviour_2.gh (Grasshopper 0.9.76)
# Copyright: Co-de-iT
# plug-ins: Anemone, Boid

# CURVE BOUNDARY
number_slider = Slider(5, range=0..20)  # disabled
swatch = ColourSwatch(SwatchColor=RGB(0, 0, 0))  # disabled
border_threshold = Slider(10, range=0..10)  # disabled
swatch_2 = ColourSwatch(SwatchColor=RGB(255, 255, 255))  # disabled
button = Button()  # disabled
button_2 = Button()  # disabled

number_slider_2 = Slider(20, range=0..20)  # disabled
Y = UnitY(Factor=number_slider_2)  # disabled
arrive = Point([Point(112.0093927, -3.844683141, 0), Point(1.762594617, 65.21107482, 0), Point(-45.43692704, -47.87142569, 0)])  # disabled
crv = Curve(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)  # disabled
number_slider_3 = Slider(200, range=0..1000)  # disabled
number_slider_4 = Slider(2, range=0..10)  # disabled
maxforce = Slider(0.24, range=0..1)  # disabled
max_vel = Slider(2.349, range=0..10)  # disabled

dots = DotDisplay(Point=arrive, Colour=swatch_2, Size=1)  # disabled
preview = CustomPreview(Geometry=crv, Shader=swatch)  # disabled
offset = Offset(Curve=crv, Distance=border_threshold, Plane=PlaneXY(0, 0, 0), Corners=1)  # disabled
preview_2 = CustomPreview(
    Geometry=offset,
    Shader={ambient=RGB(0, 0, 0), diffuse=RGB(255, 105, 180), emission=RGB(76, 32, 54), shine=0.5, specular=RGB(255, 255, 255), transparency=0})  # disabled

# ----
# reciproCITY
# WANDER + SEEK
# Alessio Erioli
# Aldo Sollazzo
# Eugenio Bettucchi
# DEFINITIONS BY
# 15-17 April 2016
number_slider_5 = Slider(20, range=0..20)  # disabled
Y_2 = UnitY(Factor=number_slider_5)  # disabled
arrive_2 = Point(Point(178.9549649, -11.43568566, 0))  # disabled
number_slider_6 = Slider(385, range=0..1000)  # disabled
number_slider_7 = Slider(2, range=0..10)  # disabled
max_vel_2 = Slider(2.349, range=0..10)  # disabled
maxforce_2 = Slider(0.105, range=0..1)  # disabled

agents = Point([Point(27.66381252, -10.25946277, 0), Point(25.89416457, -24.94754074, 0), Point(17.39985441, -15.21447702, 0), Point(19.16950236, -19.81556169, 0), Point(24.8323758, -12.91393469, 0), Point(31.55703801, -16.45323059, 0), Point(36.33508747, -23.70878718, 0), Point(24.12451662, -28.48683664, 0)])  # disabled

dup = DuplicateData(Data=graft(agents), Number=number_slider, Order=True)  # -> flatten(Data); disabled

lng = ListLength(List=dup)  # disabled

repeat = RepeatData(Data=Y, Length=lng)  # disabled
vec = Vector(repeat)  # disabled

agents_2 = Point([Point(27.66381252, -10.25946277, 0), Point(25.89416457, -24.94754074, 0), Point(17.39985441, -15.21447702, 0), Point(19.16950236, -19.81556169, 0), Point(24.8323758, -12.91393469, 0), Point(31.55703801, -16.45323059, 0), Point(36.33508747, -23.70878718, 0), Point(24.12451662, -28.48683664, 0)])  # disabled

lng_2 = ListLength(List=agents_2)  # disabled
repeat_2 = RepeatData(Data=Y_2, Length=lng_2)  # disabled

vec_2 = Vector(repeat_2)  # disabled

merge = Merge(Data1=simplify(graft(dup)), Data2=simplify(graft(vec)))  # disabled
group = Group(Objects=merge)  # disabled
loop_start = LoopStart(Repeat=number_slider_3, Trigger=button, Data=group)  # -> port, Counter, Data; disabled
ungroup = Ungroup(Group=loop_start.Data)  # disabled
item = ListItem(List=ungroup, Index=0, Wrap=True)  # -> Item, Item1; disabled
amp = Amplitude(Vector=item.Item1, Amplitude=number_slider_4)  # disabled
move = Move(Geometry=item.Item, Motion=amp)  # -> Geometry, Transform; disabled
cp = ClosestPoint(Point=move.Geometry, Cloud=arrive)  # -> ClosestPoint, CPIndex, Distance; disabled
vec2pt = Vector2Pt(PointA=move.Geometry, PointB=cp.ClosestPoint, Unitize=False)  # -> simplify(Vector), Length; disabled
move_2 = Move(Geometry=item.Item, Motion=item.Item1)  # -> Geometry, Transform; disabled
pt = Point(item.Item)  # disabled

# ---- group: WANDER
wandering_angle = Slider(62.935, range=0..90)  # disabled
wandering_strength = Slider(0.789, range=0..1)  # disabled
rad = Radians(Degrees=wandering_angle)  # disabled
lng_3 = ListLength(List=flatten(item.Item))  # disabled
neg = Negative(Value=rad)  # disabled
dom = ConstructDomain(DomainStart=neg, DomainEnd=rad)  # disabled
Z = UnitZ(Factor=1)  # disabled
random = Random(Range=dom, Number=lng_3, Seed=loop_start.Counter)  # -> graft(Random); disabled
vrot = Rotate(Vector=item.Item1, Axis=Z, Angle=random)  # disabled
addition = Addition(A=amp, B=vrot)  # disabled
steer = Steer(vel=item.Item1, des=addition, maxv=max_vel, maxf=wandering_strength)  # disabled

# ---- group: BORDER CONDITION
crv_cp = CurveClosestPoint(Point=item.Item, Curve=crv)  # -> Point, Parameter, Distance; disabled
eval = EvaluateCurve(Curve=crv, Parameter=crv_cp.Parameter)  # -> Point, Tangent, Angle; disabled
Z_2 = UnitZ(Factor=1)  # disabled
smaller = SmallerThan(FirstNumber=crv_cp.Distance, SecondNumber=border_threshold)  # -> SmallerThan, OrEqualTo; disabled
vec2pt_2 = Vector2Pt(PointA=eval.Point, PointB=item.Item, Unitize=False)  # -> Vector, Length; disabled
xprod = CrossProduct(VectorA=eval.Tangent, VectorB=Z_2, Unitize=False)  # -> Vector, Length; disabled
dispatch = Dispatch(List=vec2pt_2.Vector, DispatchPattern=smaller.OrEqualTo)  # -> ListA, ListB; disabled
easing = Slider(0.35, range=0..1)  # disabled
vlen = VectorLength(Vector=dispatch.ListA)  # disabled
subtraction = Subtraction(A=border_threshold, B=vlen)  # disabled
multiplication = Multiplication(A=subtraction, B=easing)  # disabled
amp_2 = Amplitude(Vector=dispatch.ListA, Amplitude=multiplication)  # disabled
pt_2 = Point(Point(0, 0, 0))  # disabled
weave = Weave(Pattern=smaller.OrEqualTo, Stream0=pt_2, Stream1=amp_2, NullGaps=False)  # disabled

# ----
# steer
steer_2 = Steer(vel=item.Item1, des=vec2pt.Vector, maxv=max_vel, maxf=maxforce)  # disabled

addition_2 = Addition(A=item.Item1, B=steer_2, C=steer, D=weave)  # disabled
trmvec = TrimVector(Vector=addition_2, LengthDomain=max_vel)  # disabled
move_3 = Move(Geometry=item.Item, Motion=trmvec)  # -> Geometry, Transform; disabled
merge_2 = Merge(Data1=simplify(move_3.Geometry), Data2=simplify(trmvec))  # disabled
group_2 = Group(Objects=merge_2)  # disabled
loop_end = LoopEnd(port=loop_start.port, Exit=False, Data=simplify(group_2), pausedState=False, state="Constant & Record", TimeOutVal=0)  # disabled
ungroup_2 = Ungroup(Group=loop_end)  # disabled
item_2 = ListItem(List=ungroup_2, Index=0, Wrap=True)  # disabled

# ---- group: WANDER
swatch_3 = ColourSwatch(SwatchColor=RGB(168, 0, 146))  # disabled
vdisex = VectorDisplayEx(Point=pt, Vector=steer, Colour=swatch_3, Width=2)  # disabled

# ---- group: VELOCITY
swatch_4 = ColourSwatch(SwatchColor=RGB(0, 109, 168))  # disabled
vdisex_2 = VectorDisplayEx(Point=pt, Vector=item.Item1, Colour=swatch_4, Width=2)  # disabled

# ---- group: FINAL VECTOR
swatch_5 = ColourSwatch(SwatchColor=RGB(255, 255, 255))  # disabled
vdisex_3 = VectorDisplayEx(Point=pt, Vector=trmvec, Colour=swatch_5, Width=2)  # disabled

# ---- group: BOUNDARY
vdisex_4 = VectorDisplayEx(Point=eval.Point, Vector=amp_2, Colour=RGB(0, 0, 0), Width=2)  # disabled

# ---- group: SEEK
vdisex_5 = VectorDisplayEx(Point=move_2.Geometry, Vector=steer_2, Colour=RGB(0, 0, 0), Width=2)  # disabled

# ----
merge_3 = Merge(Data1=simplify(graft(agents_2)), Data2=simplify(graft(vec_2)))  # disabled
group_3 = Group(Objects=merge_3)  # disabled
loop_start_2 = LoopStart(Repeat=number_slider_6, Trigger=button_2, Data=group_3)  # -> port, Counter, simplify(Data); disabled
ungroup_3 = Ungroup(Group=loop_start_2.Data)  # disabled
item_3 = ListItem(List=ungroup_3, Index=0, Wrap=True)  # -> Item, Item1; disabled
amp_3 = Amplitude(Vector=item_3.Item1, Amplitude=number_slider_7)  # disabled
move_4 = Move(Geometry=item_3.Item, Motion=amp_3)  # -> Geometry, Transform; disabled
cp_2 = ClosestPoint(Point=move_4.Geometry, Cloud=arrive_2)  # -> ClosestPoint, CPIndex, Distance; disabled
vec2pt_3 = Vector2Pt(PointA=move_4.Geometry, PointB=cp_2.ClosestPoint, Unitize=False)  # -> simplify(Vector), Length; disabled
move_5 = Move(Geometry=item_3.Item, Motion=item_3.Item1)  # -> Geometry, Transform; disabled
pt_3 = Point(item_3.Item)  # disabled

# ---- group: WANDER
wandering_angle_2 = Slider(62.935, range=0..90)  # disabled
wandering_strength_2 = Slider(0.789, range=0..1)  # disabled
rad_2 = Radians(Degrees=wandering_angle_2)  # disabled
lng_4 = ListLength(List=flatten(item_3.Item))  # disabled
neg_2 = Negative(Value=rad_2)  # disabled
dom_2 = ConstructDomain(DomainStart=neg_2, DomainEnd=rad_2)  # disabled
Z_3 = UnitZ(Factor=1)  # disabled
random_2 = Random(Range=dom_2, Number=lng_4, Seed=loop_start_2.Counter)  # -> graft(Random); disabled
vrot_2 = Rotate(Vector=item_3.Item1, Axis=Z_3, Angle=random_2)  # disabled
addition_3 = Addition(A=amp_3, B=vrot_2)  # disabled
steer_3 = Steer(vel=item_3.Item1, des=addition_3, maxv=max_vel_2, maxf=wandering_strength_2)  # disabled

# ----
# steer
steer_4 = Steer(vel=item_3.Item1, des=vec2pt_3.Vector, maxv=max_vel_2, maxf=maxforce_2)  # disabled

addition_4 = Addition(A=item_3.Item1, B=steer_4, C=steer_3)  # disabled
trmvec_2 = TrimVector(Vector=addition_4, LengthDomain=max_vel_2)  # disabled
move_6 = Move(Geometry=item_3.Item, Motion=trmvec_2)  # -> Geometry, Transform; disabled
merge_4 = Merge(Data1=move_6.Geometry, Data2=trmvec_2)  # disabled
group_4 = Group(Objects=merge_4)  # disabled
loop_end_2 = LoopEnd(port=loop_start_2.port, Exit=False, Data=group_4, pausedState=False, state="Constant & Record", TimeOutVal=0)  # disabled
ungroup_4 = Ungroup(Group=loop_end_2)  # disabled
item_4 = ListItem(List=ungroup_4, Index=0, Wrap=True)  # disabled

# ---- group: WANDER
swatch_6 = ColourSwatch(SwatchColor=RGB(168, 0, 146))  # disabled
vdisex_6 = VectorDisplayEx(Point=pt_3, Vector=steer_3, Colour=swatch_6, Width=2)  # disabled

# ---- group: VELOCITY
swatch_7 = ColourSwatch(SwatchColor=RGB(0, 109, 168))  # disabled
vdisex_7 = VectorDisplayEx(Point=pt_3, Vector=item_3.Item1, Colour=swatch_7, Width=2)  # disabled

# ---- group: FINAL VECTOR
swatch_8 = ColourSwatch(SwatchColor=RGB(255, 255, 255))  # disabled
vdisex_8 = VectorDisplayEx(Point=pt_3, Vector=trmvec_2, Colour=swatch_8, Width=2)  # disabled

# ---- group: SEEK
vdisex_9 = VectorDisplayEx(Point=move_5.Geometry, Vector=steer_4, Colour=RGB(0, 0, 0), Width=2)  # disabled

# ==== cluster Steer
maxf = ClusterInput()
vel = ClusterInput()
maxv = ClusterInput()
des = ClusterInput()
amp = Amplitude(Vector=des, Amplitude=maxv)
subtraction = Subtraction(A=amp, B=vel)
multiplication = Multiplication(A=subtraction, B=maxf)
vlen = VectorLength(Vector=multiplication)
min = Minimum(A=vlen, B=maxv)
amp_2 = Amplitude(Vector=multiplication, Amplitude=min)
acc = ClusterOutput(amp_2)
