# Grasshopper definition 00_20160415_basic behaviour.gh (Grasshopper 0.9.76)
# Copyright: Co-de-iT
# plug-ins: Anemone, Boid, Noise 4D

crv = Curve(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)
boundary = BoundarySurfaces(Edges=crv)
mesh_uv = MeshSurface(Surface=boundary, UCount=Slider(85, range=0..100), VCount=Slider(16, range=0..100), Overhang=True, Equalize=False)
demesh = DeconstructMesh(Mesh=mesh_uv)  # -> Vertices, Faces, Colours, Normals
perlin = PerlinNoise(Values=demesh.Vertices, Time=Slider(14.47, range=0..21), Scale=Slider(0.0454, range=0.001..0.1))
gradient = Gradient(LowerLimit="-1", UpperLimit=1, Parameter=perlin, stops=[0: RGB(255, 255, 255), 0.735: RGB(0, 0, 0)])
conmesh = ConstructMesh(Vertices=demesh.Vertices, Faces=demesh.Faces, Colours=gradient)

# ----
# DEFINITIONS BY
pt = Point(Point(24.92672781, 10.84129804, 0))  # disabled
# reciproCITY
# ANEMONE
# Alessio Erioli
# Aldo Sollazzo
# Eugenio Bettucchi
number_slider = Slider(100, range=0..100)  # disabled
number_slider_2 = Slider(1, range=0..1)  # disabled
loop_start = LoopStart(Repeat=number_slider, Data_0=pt)  # -> port, Counter, Data_0; disabled
Z = UnitZ(Factor=number_slider_2)  # disabled
move = Move(Geometry=loop_start.Data_0, Motion=Z)  # -> Geometry, Transform; disabled
loop_end = LoopEnd(port=loop_start.port, Exit=False, Data_0=move.Geometry, pausedState=False, state="Constant output")  # disabled

# ----
# SEEK
number_slider_3 = Slider(30, range=0..100)
pop3d = Populate3D(Region={Plane=PlaneXY(0, 0, 0), X=Domain(0, 10), Y=Domain(0, 10), Z=Domain(0, 2)}, Count=number_slider_3, Seed=1)

# ----
# COHESION
number_slider_4 = Slider(30, range=0..100)
pop3d_2 = Populate3D(Region={Plane=PlaneXY(0, 0, 0), X=Domain(0, 10), Y=Domain(0, 10), Z=Domain(0, 2)}, Count=number_slider_4, Seed=1)

# ---- group: PREDATORS VECTOR
# PREDATOR PREY
number_slider_5 = Slider(59, range=0..100)
pop3d_3 = Populate3D(Region={Plane=PlaneXY(0, 0, 0), X=Domain(0, 10), Y=Domain(0, 10), Z=Domain(0, 2)}, Count=number_slider_5, Seed=1)
pt_2 = Point(pop3d_3)

# ---- group: ADHERE AND REPULSE
number_slider_6 = Slider(30, range=0..100)  # disabled
number_slider_7 = Slider(299, range=0..1000)  # disabled
pop3d_4 = Populate3D(Region={Plane=PlaneXY(0, 0, 0), X=Domain(0, 10), Y=Domain(0, 10), Z=Domain(0, 2)}, Count=number_slider_6, Seed=1)  # disabled
loop_start_2 = LoopStart(Repeat=number_slider_7, Data_0=pop3d_4)  # -> port, Counter, Data_0, Data_1; disabled
number_slider_8 = Slider(3, range=0..10)  # disabled
pt_3 = Point(loop_start_2.Data_0)  # disabled
vec = Vector(loop_start_2.Data_1)  # disabled
number_slider_9 = Slider(0.06, range=0..0.1)  # disabled
number_slider_10 = Slider(0.033, range=0..0.1)  # disabled
number_slider_11 = Slider(0.75, range=0..1)  # disabled
align = AlignToTheFlockMembers(AgentMotionVector=vec, FlockMotionVectors=vec, Multiplier=0.1)  # disabled
repulse = RepulseFromTheFlock(AgentLocationPoint=pt_3, LocationPointsOfTheFlock=pt_3, SearchDistance=Domain(0, 1), Multiplier=number_slider_10)  # disabled
multiplication = Multiplication(A=vec, B=number_slider_11)  # disabled
adhere = AhereToTheFlockCenter(
    AgentLocationPoint=pt_3,
    LocationPointsOfTheFlock=pt_3,
    SearchDistance=Domain(0, 0),
    ReferenceAgentsCount=number_slider_8,
    Multiplier=number_slider_9)  # disabled
addition = Addition(A=multiplication, B=adhere, C=repulse, D=align)  # disabled
move_2 = Move(Geometry=pt_3, Motion=addition)  # -> Geometry, Transform; disabled
loop_end_2 = LoopEnd(port=loop_start_2.port, Exit=False, Data_0=move_2.Geometry, Data_1=addition, pausedState=False, state="Constant output")  # -> Data_0, Data_1; disabled

# ---- group: PREY VECTORS / PREY
item = ListItem(List=pop3d_3, Index=0, Wrap=True)  # -> Item, Item1, Item2

# ----
number_slider_12 = Slider(0.2, range=0..1)
# FOLLOW COLOR
number_slider_13 = Slider(44, range=0..100)
popgeo = PopulateGeometry(Geometry=mesh_uv, Count=number_slider_13, Seed=1)
vec_2 = VectorXYZ(XComponent=number_slider_12, YComponent=number_slider_12, ZComponent=0)  # -> Vector, Length
lng = ListLength(List=popgeo)
vec_3 = Vector(vec_2.Vector)
repeat = RepeatData(Data=vec_3, Length=lng)

# ---- group: PREY VECTORS
pt_4 = Point([item.Item, item.Item1, item.Item2])

# ---- group: TARGET POINTS
item_2 = ListItem(List=pop3d, Index=0, Wrap=True)  # -> Item, Item1, Item2
Z_2 = UnitZ(Factor=Slider(14, range=0..100))
move_3 = Move(Geometry=[item_2.Item, item_2.Item1, item_2.Item2], Motion=Z_2)  # -> Geometry, Transform

# ----
lng_2 = ListLength(List=pt_2)
Z_3 = UnitZ(Factor=1)
repeat_2 = RepeatData(Data=Z_3, Length=lng_2)

lng_3 = ListLength(List=pt_4)
rndvec = RandomVector(Number=lng_3, Unit=False, RandomSeed=2, AbsoluteMultiplier=1)

number_slider_14 = Slider(1, range=0..5)
neg = Negative(Value=number_slider_14)
dom = ConstructDomain(DomainStart=number_slider_14, DomainEnd=neg)

maxv = Slider(0.5, range=0..1)
maxf = Slider(0.2, range=0..1)
number_slider_15 = Slider(1, range=0..5)

neg_2 = Negative(Value=Slider(1, range=0..10))
pcharge = PointCharge(Point=move_3.Geometry, Charge=neg_2, Decay=Slider(1, range=0..1))

# ----
# STEER
number_slider_16 = Slider(20, range=0..20)
Y = UnitY(Factor=number_slider_16)
arrive = Point(Point(178.9549649, -11.43568566, 0))
number_slider_17 = Slider(3.9, range=0..10)
maxforce = Slider(0.139, range=0..1)

# ----
# FOLLOW LINE
number_slider_18 = Slider(20, range=0..20)  # disabled
Y_2 = UnitY(Factor=number_slider_18)  # disabled
crv_2 = Curve(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)  # disabled
number_slider_19 = Slider(110, range=0..110)  # disabled
number_slider_20 = Slider(3, range=0..10)  # disabled
Y_3 = UnitY(Factor=1)  # disabled
number_slider_21 = Slider(1.7, range=0..10)  # disabled
maxforce_2 = Slider(0.228, range=0..1)  # disabled
number_slider_22 = Slider(0.15, range=0..1)  # disabled
number_slider_23 = Slider(0.13, range=0..1)  # disabled

# ----
# RANDOM VECTOR
# 15-17 April 2016
# Points
# RANDOM VECTOR LOGIC
# Vectors
# RANDOM VECTOR LOGIC
pt_5 = Point([Point(10.48161163, 21.82657627, 0), Point(38.74231883, 11.7785734, 0), Point(52.67465533, 47.77125877, 0), Point(21.91884066, 75.08682577, 0), Point(81.45071704, 55.00534339, 0)])

lng_4 = ListLength(List=pt_5)
Z_4 = UnitZ(Factor=1)
repeat_3 = RepeatData(Data=Z_4, Length=lng_4)

pt_6 = Point(pop3d_2)

lng_5 = ListLength(List=pt_6)
Z_5 = UnitZ(Factor=1)
repeat_4 = RepeatData(Data=Z_5, Length=lng_5)

# ----
# adhere
# true false
# adhere vectors logic / steer
# magnetic fields
pt_7 = Point(pop3d)

lng_6 = ListLength(List=pt_7)
Z_6 = UnitZ(Factor=1)
repeat_5 = RepeatData(Data=Z_6, Length=lng_6)

agents = Point([Point(27.66381252, -10.25946277, 0), Point(25.89416457, -24.94754074, 0), Point(17.39985441, -15.21447702, 0), Point(19.16950236, -19.81556169, 0), Point(24.8323758, -12.91393469, 0), Point(31.55703801, -16.45323059, 0), Point(36.33508747, -23.70878718, 0), Point(24.12451662, -28.48683664, 0)])

lng_7 = ListLength(List=agents)
repeat_6 = RepeatData(Data=Y, Length=lng_7)

vec_4 = Vector(repeat_6)

agents_2 = Point([Point(27.66381252, -10.25946277, 0), Point(25.89416457, -24.94754074, 0), Point(17.39985441, -15.21447702, 0), Point(19.16950236, -19.81556169, 0), Point(24.8323758, -12.91393469, 0), Point(31.55703801, -16.45323059, 0), Point(36.33508747, -23.70878718, 0), Point(24.12451662, -28.48683664, 0)])  # disabled

lng_8 = ListLength(List=agents_2)  # disabled
repeat_7 = RepeatData(Data=Y_2, Length=lng_8)  # disabled

vec_5 = Vector(repeat_7)  # disabled

loop_start_3 = LoopStart(N=Slider(100, range=0..1000), T=Button(), D0=pt_5, D1=repeat_3)  # -> port, Counter, Data, Data_2
wander = RandomWander(
    AgentMotionVectors=loop_start_3.Data_2,
    AngleSpreadDomain=Domain(0, 3.141592654),
    RandomSeed=loop_start_3.Counter,
    AbsoluteMultiplier=1)

multiplication_2 = Multiplication(A=lng_4, B=Slider(3, range=0..10))
random = Random(Range=dom, Number=multiplication_2, Seed=loop_start_3.Counter)
partition = PartitionList(List=random, Size=Slider(3, range=0..10))
item_3 = ListItem(List=partition, Index=0, Wrap=True)  # -> Item, Item1, Item2
vec_6 = VectorXYZ(XComponent=item_3.Item, YComponent=item_3.Item1, ZComponent=item_3.Item2)  # -> flatten(Vector), Length

amp = Amplitude(Vector=vec_6.Vector, Amplitude=Slider(9, range=0..10))
move_4 = Move(Geometry=loop_start_3.Data, Motion=amp)  # -> Geometry, Transform
loop_end_3 = LoopEnd(
    port=loop_start_3.port,
    Exit=False,
    Data=flatten(move_4.Geometry),
    Data_2=flatten(amp),
    pausedState=False,
    state="Constant & Record",
    TimeOutVal=0)  # -> D0, D1
flip = FlipMatrix(Data=loop_end_3.D0)
intcrv = Interpolate(Vertices=flip, Degree=3, Periodic=False, KnotStyle=1)  # -> Curve, Length, Domain

merge = Merge(Data1=simplify(graft(agents)), Data2=simplify(graft(vec_4)))
group = Group(Objects=merge)
loop_start_4 = LoopStart(Repeat=Slider(5, range=0..110), Trigger=Button(), Data=group)  # -> port, Counter, simplify(Data)
ungroup = Ungroup(Group=loop_start_4.Data)
item_4 = ListItem(List=ungroup, Index=0, Wrap=True)  # -> Item, Item1
amp_2 = Amplitude(Vector=item_4.Item1, Amplitude=Slider(2, range=0..10))
move_5 = Move(Geometry=item_4.Item, Motion=amp_2)  # -> Geometry, Transform
cp = ClosestPoint(Point=move_5.Geometry, Cloud=arrive)  # -> ClosestPoint, CPIndex, Distance
vec2pt = Vector2Pt(PointA=move_5.Geometry, PointB=cp.ClosestPoint, Unitize=False)  # -> simplify(Vector), Length
move_6 = Move(Geometry=item_4.Item, Motion=item_4.Item1)  # -> Geometry, Transform
pt_8 = Point(item_4.Item)

# ----
# steer
steer = Steer(vel=item_4.Item1, des=vec2pt.Vector, maxv=number_slider_17, maxf=maxforce)

addition_2 = Addition(A=item_4.Item1, B=steer)
trmvec = TrimVector(Vector=addition_2, LengthDomain=number_slider_17)
move_7 = Move(Geometry=item_4.Item, Motion=trmvec)  # -> Geometry, Transform
merge_2 = Merge(Data1=move_7.Geometry, Data2=trmvec)
group_2 = Group(Objects=merge_2)
loop_end_4 = LoopEnd(port=loop_start_4.port, Exit=False, Data=group_2, pausedState=False, state="Constant output", TimeOutVal=0)
ungroup_2 = Ungroup(Group=loop_end_4)
item_5 = ListItem(List=ungroup_2, Index=0, Wrap=True)

# ---- group: VELOCITY
vdisex = VectorDisplayEx(Point=pt_8, Vector=item_4.Item1, Colour=ColourSwatch(SwatchColor=RGB(0, 109, 168)), Width=2)

# ---- group: FINAL VECTOR
vdisex_2 = VectorDisplayEx(Point=pt_8, Vector=trmvec, Colour=ColourSwatch(SwatchColor=RGB(255, 255, 255)), Width=2)

# ---- group: STEER
vdisex_3 = VectorDisplayEx(Point=move_6.Geometry, Vector=steer, Colour=RGB(0, 0, 0), Width=2)

# ----
merge_3 = Merge(Data1=simplify(graft(agents_2)), Data2=simplify(graft(vec_5)))  # disabled
group_3 = Group(Objects=merge_3)  # disabled
loop_start_5 = LoopStart(Repeat=number_slider_19, Data=group_3)  # -> port, Counter, simplify(Data); disabled
panel = Panel(loop_start_5.Counter)  # disabled
ungroup_3 = Ungroup(Group=loop_start_5.Data)  # disabled
item_6 = ListItem(List=ungroup_3, Index=0, Wrap=True)  # -> Item, Item1; disabled
amp_3 = Amplitude(Vector=item_6.Item1, Amplitude=number_slider_20)  # disabled
move_8 = Move(Geometry=item_6.Item, Motion=amp_3)  # -> Geometry, Transform; disabled
crv_cp = CurveClosestPoint(Point=move_8.Geometry, Curve=graft(crv_2))  # -> Point, Parameter, Distance; disabled
vec2pt_2 = Vector2Pt(PointA=move_8.Geometry, PointB=crv_cp.Point, Unitize=False)  # -> Vector, Length; disabled
eval = EvaluateCurve(Curve=crv_2, Parameter=crv_cp.Parameter)  # -> Point, Tangent, Angle; disabled
multiplication_3 = Multiplication(A=eval.Tangent, B=number_slider_22)  # disabled
pt_9 = Point(item_6.Item)  # disabled

# ----
# steer
steer_2 = Steer(vel=item_6.Item1, des=vec2pt_2.Vector, maxv=number_slider_21, maxf=maxforce_2)  # disabled

multiplication_4 = Multiplication(A=steer_2, B=number_slider_23)  # disabled
addition_3 = Addition(A=multiplication_4, B=multiplication_3)  # disabled
addition_4 = Addition(A=item_6.Item1, B=addition_3)  # disabled
trmvec_2 = TrimVector(Vector=addition_4, LengthDomain=number_slider_21)  # disabled
move_9 = Move(Geometry=item_6.Item, Motion=trmvec_2)  # -> Geometry, Transform; disabled
merge_4 = Merge(Data1=move_9.Geometry, Data2=trmvec_2)  # disabled
group_4 = Group(Objects=merge_4)  # disabled
loop_end_5 = LoopEnd(port=loop_start_5.port, Exit=False, Data=group_4, pausedState=False, state="Constant output", TimeOutVal=0)  # disabled
ungroup_4 = Ungroup(Group=loop_end_5)  # disabled
item_7 = ListItem(List=ungroup_4, Index=0, Wrap=True)  # disabled

# ---- group: VELOCITY
swatch = ColourSwatch(SwatchColor=RGB(0, 109, 168))  # disabled
vdisex_4 = VectorDisplayEx(Point=pt_9, Vector=item_6.Item1, Colour=swatch, Width=2)  # disabled

# ---- group: FINAL VECTOR
swatch_2 = ColourSwatch(SwatchColor=RGB(255, 255, 255))  # disabled
vdisex_5 = VectorDisplayEx(Point=pt_9, Vector=trmvec_2, Colour=swatch_2, Width=2)  # disabled

# ---- group: STEER
vdisex_6 = VectorDisplayEx(Point=pt_9, Vector=steer_2, Colour=RGB(0, 0, 0), Width=2)  # disabled

# ----
loop_start_6 = LoopStart(Repeat=Slider(135, range=0..1000), Trigger=Button(), Data_0=pt_6, Data_1=repeat_4)  # -> port, Counter, Data_0, Data_1
panel_2 = Panel(loop_start_6.Counter)

# ---- group: ATTRACTOR FIELD
avr = Average(Input=loop_start_6.Data_0)
neg_3 = Negative(Value=Slider(2, range=0..10))
pcharge_2 = PointCharge(Point=avr, Charge=neg_3, Decay=Slider(0.5, range=0..1))
mergef = MergeFields(Fields=pcharge_2)
evf = EvaluateField(Field=mergef, Point=loop_start_6.Data_0)  # -> Tensor, Strength
trmvec_3 = TrimVector(Vector=evf.Tensor, LengthDomain=Slider(0.5, range=0..1))

# ----
rad = Radians(Degrees=Slider(15, range=0..100))
wander_2 = RandomWander(
    AgentMotionVectors=loop_start_6.Data_1,
    AngleSpreadDomain=rad,
    RandomSeed=loop_start_6.Counter,
    AbsoluteMultiplier=Slider(1, range=0..1))

# ---- group: VOID LIBRARY BEHAVIOUR
adhere_2 = AhereToTheFlockCenter(
    AgentLocationPoint=loop_start_6.Data_0,
    LocationPointsOfTheFlock=loop_start_6.Data_0,
    SearchDistance=Domain(0, 0),
    ReferenceAgentsCount=-1,
    Multiplier=Slider(0.08, range=0..0.1))

# ----
addition_5 = Addition(A=wander_2, B=trmvec_3)
move_10 = Move(Geometry=loop_start_6.Data_0, Motion=addition_5)  # -> Geometry, Transform
loop_end_6 = LoopEnd(
    port=loop_start_6.port,
    Exit=False,
    Data_0=flatten(move_10.Geometry),
    Data_1=flatten(addition_5),
    pausedState=False,
    state="Constant & Record")  # -> Data_0, Data_1
viewer = ParamViewer(loop_end_6.Data_0)
flip_2 = FlipMatrix(Data=loop_end_6.Data_0)
viewer_2 = ParamViewer(flip_2)
pline = PolyLine(Vertices=flip_2, Closed=False)

# ----
# adhere vectors logic
# adhere vectors logic
# random vectors logic
number_slider_24 = Slider(37, range=0..50)
loop_start_7 = LoopStart(Repeat=number_slider_24, Data_0=pt_2, Data_1=repeat_2, Data_2=pt_4, Data_3=rndvec)  # -> port, Counter, Data_0, Data_1, Data_2, Data_3
number_slider_25 = Slider(1, range=0..1)
maxv_2 = Slider(1, range=0..1)
maxf_2 = Slider(0.5, range=0..1)
neg_4 = Negative(Value=number_slider_25)
dom_2 = ConstructDomain(DomainStart=neg_4, DomainEnd=number_slider_25)

# ---- group: PREDATORS
pt_10 = Point(loop_start_7.Data_0)
vec_7 = Vector(loop_start_7.Data_1)

# ---- group: PREY
pt_11 = Point(loop_start_7.Data_2)
vec_8 = Vector(loop_start_7.Data_3)

# ----
cps = ClosestPoints(Point=pt_10, Cloud=pt_11, Count=Slider(1, range=0..4))  # -> ClosestPoint, CPIndex, Distance
avr_2 = Average(Input=cps.ClosestPoint)  # -> flatten(ArithmeticMean)
vec2pt_3 = Vector2Pt(PointA=pt_10, PointB=avr_2, Unitize=False)  # -> Vector, Length
steer_3 = Steer(vel=vec_7, des=vec2pt_3.Vector, maxv=maxv_2, maxf=maxf_2)

adhere_3 = AhereToTheFlockCenter(
    AgentLocationPoint=pt_10,
    LocationPointsOfTheFlock=pt_11,
    SearchDistance=Domain(0, 0),
    ReferenceAgentsCount=Slider(1, range=0..4),
    Multiplier=Slider(0.2, range=0..1))

# ---- group: FRICTION//INERTIA
multiplication_5 = Multiplication(A=Slider(1, range=0..1), B=vec_7)

# ---- group: future location
amp_4 = Amplitude(Vector=vec_8, Amplitude=Slider(4, range=0..10))
move_11 = Move(Geometry=pt_11, Motion=amp_4)  # -> Geometry, Transform

# ----
rad_2 = Radians(Degrees=Slider(15, range=0..100))
wander_3 = RandomWander(
    AgentMotionVectors=vec_8,
    AngleSpreadDomain=rad_2,
    RandomSeed=loop_start_7.Counter,
    AbsoluteMultiplier=Slider(1, range=0..1))

trmvec_4 = TrimVector(Vector=steer_3, LengthDomain=Slider(0.4, range=0..5))

loop_start_8 = LoopStart(Repeat=Slider(204, range=0..1000), Data_0=pt_7, Data_1=repeat_5)  # -> port, Counter, Data_0, Data_1
panel_3 = Panel(loop_start_8.Counter)
pt_12 = Point(loop_start_8.Data_0)
vec_9 = Vector(loop_start_8.Data_1)

adhere_4 = AhereToTheFlockCenter(
    AgentLocationPoint=pt_12,
    LocationPointsOfTheFlock=move_3.Geometry,
    SearchDistance=Domain(0, 0),
    ReferenceAgentsCount=number_slider_15,
    Multiplier=Slider(0.08, range=0..0.8))

cps_2 = ClosestPoints(Point=pt_12, Cloud=move_3.Geometry, Count=number_slider_15)  # -> ClosestPoint, CPIndex, Distance
avr_3 = Average(Input=cps_2.ClosestPoint)  # -> flatten(ArithmeticMean)
vec2pt_4 = Vector2Pt(PointA=pt_12, PointB=avr_3, Unitize=False)  # -> Vector, Length
steer_4 = Steer(vel=vec_9, des=vec2pt_4.Vector, maxv=maxv, maxf=maxf)

mergef_2 = MergeFields(Fields=pcharge)
evf_2 = EvaluateField(Field=mergef_2, Point=pt_12)  # -> Tensor, Strength

smaller = SmallerThan(FirstNumber=cps_2.Distance, SecondNumber=Slider(0.6, range=0..1))  # -> flatten(SmallerThan), OrEqualTo
ma = MassAddition(Input=smaller.SmallerThan)  # -> Result, PartialResults
equals = Equality(FirstNumber=ma.Result, SecondNumber=lng_6)  # -> Equality, Inequality

trmvec_5 = TrimVector(Vector=steer_4, LengthDomain=Slider(0.7, range=0..1))
move_12 = Move(Geometry=pt_12, Motion=trmvec_5)  # -> Geometry, Transform
loop_end_7 = LoopEnd(
    port=loop_start_8.port,
    Exit=equals.Equality,
    Data_0=flatten(move_12.Geometry),
    Data_1=flatten(trmvec_5),
    pausedState=False,
    state="Constant & Record")  # -> Data_0, Data_1
viewer_3 = ParamViewer(loop_end_7.Data_0)
flip_3 = FlipMatrix(Data=loop_end_7.Data_0)
viewer_4 = ParamViewer(flip_3)
pline_2 = PolyLine(Vertices=flip_3, Closed=False)

merge_5 = Merge(Data1=simplify(graft(popgeo)), Data2=simplify(graft(repeat)), Data3=simplify(graft(popgeo)))
group_5 = Group(Objects=merge_5)

loop_start_9 = LoopStart(Repeat=Slider(67, range=0..500), Data=simplify(graft(group_5)))  # -> port, Counter, Data
stop = BooleanToggle(False)

ungroup_5 = Ungroup(Group=loop_start_9.Data)  # -> simplify(Objects)
split = SplitList(List=ungroup_5, Index="2")  # -> ListA, ListB
panel_4 = Panel(loop_start_9.Counter)
item_8 = ListItem(List=split.ListA, Index=0, Wrap=True)  # -> Item, Item1
pt_13 = Point(flatten(item_8.Item))
vec_10 = Vector(item_8.Item1)
multiplication_6 = Multiplication(A=item_8.Item1, B=Slider(0, range=0..1))

demesh_2 = DeconstructMesh(Mesh=conmesh)  # -> Vertices, Faces, Colours, Normals
cluster = Cluster(L=demesh_2.Vertices)
visible = FindVisibleAgents(
    AgentLocationPoint=pt_13,
    AgentMotionVector=flatten(vec_10),
    LocationPointsOfTheFlock=demesh_2.Vertices,
    FlockMotionVectors=cluster,
    SearchDistance=Slider(12, range=0..50),
    SearchAngle=Slider(0.71, range=0..1))  # -> simplify(ListOfPoints), ListOfVectors, simplify(ListOfIndices)
cluster_2 = Cluster_3(
    agents=pt_13,
    index_of_visible=visible.ListOfIndices,
    M=conmesh,
    intensity=Slider(1, range=0..1),
    treshold_limit_value_to_follow=Slider(1, range=0..1))  # -> vector, elected_point

addition_6 = Addition(A=cluster_2.vector, B=simplify(multiplication_6))  # -> flatten(Result)
move_13 = Move(Geometry=pt_13, Motion=addition_6)  # -> Geometry, Transform
vec_11 = Vector(graft(addition_6))
tlist = TailList(L=split.ListB, it=simplify(graft(move_13.Geometry)), len=Slider(30, range=0..100))  # -> out, simplify(A); inputs L: list, len: Int32
# ---------- tlist: C# ----------
    Component.Name = "Tail List";
    Component.NickName = "TList";
    Component.Description = "Tail list - L list, it item to add, len tail length";

    if (L.Count() > len) {
      L.RemoveAt(0);
    }
    L.Add(it);
    A = L;
# ---------- end tlist ----------
merge_6 = Merge(Data1=simplify(graft(move_13.Geometry)), Data2=simplify(graft(vec_11)), Data3=simplify(tlist.A))
group_6 = Group(Objects=merge_6)
loop_end_8 = LoopEnd(port=loop_start_9.port, Exit=stop, Data=simplify(group_6), pausedState=False, state="Constant output", TimeOutVal=0)

# ---- group: agents
lng_9 = ListLength(List=pt_13)
repeat_8 = RepeatData(Data=ColourSwatch(SwatchColor=RGB(74, 255, 164)), Length=lng_9)
cloud = CloudDisplay(Points=pt_13, Colours=repeat_8, Size=Slider(1.9, range=0..12), SpriteType=1)

# ---- group: visible points
lng_10 = ListLength(List=visible.ListOfPoints)
repeat_9 = RepeatData(Data=ColourSwatch(SwatchColor=RGBA(113, 250, 75, 195)), Length=lng_10)
cloud_2 = CloudDisplay(Points=visible.ListOfPoints, Colours=repeat_9, Size=Slider(0.8, range=0..12), SpriteType=1)

# ---- group: selected point
lng_11 = ListLength(List=cluster_2.elected_point)
repeat_10 = RepeatData(Data=ColourSwatch(SwatchColor=RGB(255, 144, 79)), Length=lng_11)
cloud_3 = CloudDisplay(Points=cluster_2.elected_point, Colours=repeat_10, Size=Slider(1, range=0..12), SpriteType=1)

# ---- group: show tail
pt_14 = Point(split.ListB)
cluster_3 = Cluster_2(L=pt_14)
cloud_4 = CloudDisplay(Points=simplify(pt_14), Colours=cluster_3, Size=Slider(0.5, range=0..12), SpriteType=1)

# ----
random_2 = Random(Range=Domain(0, 1), Number=Slider(9, range=0..10), Seed=loop_start_7.Counter)

partition_2 = PartitionList(List=random_2, Size=Slider(3, range=0..10))
addition_7 = Addition(A=multiplication_5, B=trmvec_4)
move_14 = Move(Geometry=pt_10, Motion=addition_7)  # -> Geometry, Transform
move_15 = Move(Geometry=pt_11, Motion=vec_8)  # -> Geometry, Transform

item_9 = ListItem(List=partition_2, Index=0, Wrap=True)  # -> Item, Item1, Item2
vec_12 = VectorXYZ(XComponent=item_9.Item, YComponent=item_9.Item1, ZComponent=item_9.Item2)  # -> flatten(Vector), Length

rotate = Rotate(Geometry=move_11.Geometry, Center=pt_11, From=vec_8, To=vec_12.Vector)  # -> Geometry, Transform
vec2pt_5 = Vector2Pt(PointA=pt_11, PointB=rotate.Geometry, Unitize=False)  # -> Vector, Length

number_slider_26 = Slider(1, range=0..1)
steer_5 = Steer(vel=vec_8, des=vec2pt_5.Vector, maxv=number_slider_26, maxf=Slider(1, range=0..1))

move_16 = Move(Geometry=pt_11, Motion=steer_5)  # -> Geometry, Transform
amp_5 = Amplitude(Vector=vec2pt_5.Vector, Amplitude=number_slider_26)
loop_end_9 = LoopEnd(
    port=loop_start_7.port,
    Exit=False,
    Data_0=flatten(move_14.Geometry),
    Data_1=flatten(trmvec_4),
    Data_2=flatten(move_16.Geometry),
    Data_3=flatten(steer_5),
    pausedState=False,
    state="Constant & Record")  # -> Data_0, Data_1, Data_2, Data_3
viewer_5 = ParamViewer(loop_end_9.Data_0)
flip_4 = FlipMatrix(Data=loop_end_9.Data_0)
viewer_6 = ParamViewer(flip_4)
pline_3 = PolyLine(Vertices=flip_4, Closed=False)

# ---- group: STEER LOGIC
vdisex_7 = VectorDisplayEx(Point=pt_11, Vector=vec2pt_5.Vector, Colour=ColourSwatch(SwatchColor=RGB(176, 176, 176)), Width=Slider(1, range=0..1))
vdisex_8 = VectorDisplayEx(Point=pt_11, Vector=vec_8, Colour=ColourSwatch(SwatchColor=RGB(47, 157, 196)), Width=2)
vdisex_9 = VectorDisplayEx(Point=pt_11, Vector=amp_5, Colour=ColourSwatch(SwatchColor=RGB(255, 255, 255)), Width=2)
vdisex_10 = VectorDisplayEx(Point=move_15.Geometry, Vector=steer_5, Colour=ColourSwatch(SwatchColor=RGB(255, 0, 0)), Width=2)

# ==== cluster Steer
maxf = ClusterInput()
vel = ClusterInput()
maxv = ClusterInput()
des = ClusterInput()
amp = Amplitude(Vector=des, Amplitude=maxv)
subtraction = Subtraction(A=amp, B=vel)
multiplication = Multiplication(A=subtraction, B=maxf)
vlen = VectorLength(Vector=multiplication)
min = Minimum(A=vlen, B=maxv)
amp_2 = Amplitude(Vector=multiplication, Amplitude=min)
acc = ClusterOutput(amp_2)

# ==== cluster Cluster
L = ClusterInput()
lng = ListLength(List=L)
vec = Vector(Vector(0, 0, 0))
repeat = RepeatData(Data=vec, Length=lng)
D = ClusterOutput(repeat)

# ==== cluster Cluster_2
L = ClusterInput()

lng = ListLength(List=L)  # -> flatten(Length)
item = ListItem(List=lng, Index=0, Wrap=True)
round = Round(Number=item)  # -> Nearest, Floor, Ceiling
division = Division(A="1", B=round.Ceiling)
series = Series(Start=0, Step=division, Count=round.Ceiling)
graph = GraphMapper(
    series,
    x0=0,
    x1=1,
    y0=0,
    y1=1,
    container_name="Bezier",
    cpx=[0, 0.6374178529, 0.8142894506, 1],
    cpy=[0, 0.1260549426, 0.5961636305, 1])
xyz = ColourXYZ(Alpha=1, X=graph, Y=graph, Z=graph)
series_2 = Series(Start=Slider(0.1, range=0..1), Step=Slider(0.05, range=0..0.1), Count=item)

C = ClusterOutput(xyz)

# ==== cluster Cluster_3
intensity = ClusterInput()
treshold_limit_value_to_follow = ClusterInput()
index_of_visible = ClusterInput()
agents = ClusterInput()
M = ClusterInput()
num = Number(treshold_limit_value_to_follow)
num_2 = Number(intensity)
int = Integer(index_of_visible)
pt = Point(agents)
demesh = DeconstructMesh(Mesh=M)  # -> Vertices, Faces, Colours, Normals

color = ListItem(List=demesh.Colours, Index=int, Wrap=True)  # -> simplify(Item)
vertex = ListItem(List=demesh.Vertices, Index=int, Wrap=True)  # -> simplify(Item)

# ----
# using grayscale so each is the same
graysca = SplitARGB(Colour=color)  # -> Alpha, Red, Green, Blue

sort = SortList(Keys=graysca.Red, ValuesA=vertex)  # -> Keys, ValuesA
item = ListItem(List=sort.Keys, Index=0, Wrap=True)  # -> Item1, Item

item_2 = ListItem(List=sort.ValuesA, Index=0, Wrap=True)  # -> Item1, Item
panel = Panel("""follow color
i = black
-i = white""")

vec2pt = Vector2Pt(PointA=simplify(graft(pt)), PointB=item_2.Item1, Unitize="true")  # -> flatten(Vector), Length
amp = Amplitude(Vector=vec2pt.Vector, Amplitude=num_2)
lng = ListLength(List=amp)
vec = Vector(Vector(0, 0, 0))
larger = LargerThan(FirstNumber=item.Item1, SecondNumber=num)  # -> flatten(LargerThan), OrEqualTo
repeat = RepeatData(Data=vec, Length=lng)
p_n_c = PickNChoose(Pattern=larger.LargerThan, Stream0=amp, Stream1=repeat)  # -> simplify(graft(Result))

vector = ClusterOutput(p_n_c)
elected_point = ClusterOutput(item_2.Item1)
