# Grasshopper definition 00_20160416_basic behaviour_update.gh (Grasshopper 0.9.76)
# Copyright: Co-de-iT
# plug-ins: Anemone, Boid, Noise 4D

# ---- group: ADHERE AND REPULSE
number_slider = Slider(30, range=0..100)  # disabled
number_slider_2 = Slider(299, range=0..1000)  # disabled
pop3d = Populate3D(Region={Plane=PlaneXY(0, 0, 0), X=Domain(0, 10), Y=Domain(0, 10), Z=Domain(0, 2)}, Count=number_slider, Seed=1)  # disabled
loop_start = LoopStart(Repeat=number_slider_2, Data_0=pop3d)  # -> port, Counter, Data_0, Data_1; disabled
number_slider_3 = Slider(3, range=0..10)  # disabled
pt = Point(loop_start.Data_0)  # disabled
vec = Vector(loop_start.Data_1)  # disabled
number_slider_4 = Slider(0.06, range=0..0.1)  # disabled
number_slider_5 = Slider(0.033, range=0..0.1)  # disabled
number_slider_6 = Slider(0.75, range=0..1)  # disabled
align = AlignToTheFlockMembers(AgentMotionVector=vec, FlockMotionVectors=vec, Multiplier=0.1)  # disabled
repulse = RepulseFromTheFlock(AgentLocationPoint=pt, LocationPointsOfTheFlock=pt, SearchDistance=Domain(0, 1), Multiplier=number_slider_5)  # disabled
multiplication = Multiplication(A=vec, B=number_slider_6)  # disabled
adhere = AhereToTheFlockCenter(
    AgentLocationPoint=pt,
    LocationPointsOfTheFlock=pt,
    SearchDistance=Domain(0, 0),
    ReferenceAgentsCount=number_slider_3,
    Multiplier=number_slider_4)  # disabled
addition = Addition(A=multiplication, B=adhere, C=repulse, D=align)  # disabled
move = Move(Geometry=pt, Motion=addition)  # -> Geometry, Transform; disabled
loop_end = LoopEnd(port=loop_start.port, Exit=False, Data_0=move.Geometry, Data_1=addition, pausedState=False, state="Constant output")  # -> Data_0, Data_1; disabled

# ----
number_slider_7 = Slider(16, range=0..100)  # disabled
number_slider_8 = Slider(85, range=0..100)  # disabled
crv = Curve(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)  # disabled
boundary = BoundarySurfaces(Edges=crv)  # disabled
mesh_uv = MeshSurface(Surface=boundary, UCount=number_slider_8, VCount=number_slider_7, Overhang=True, Equalize=False)  # disabled
number_slider_9 = Slider(0.0454, range=0.001..0.1)  # disabled
number_slider_10 = Slider(14.47, range=0..21)  # disabled
demesh = DeconstructMesh(Mesh=mesh_uv)  # -> Vertices, Faces, Colours, Normals; disabled
perlin = PerlinNoise(Values=demesh.Vertices, Time=number_slider_10, Scale=number_slider_9)  # disabled
panel = Panel("-1")  # disabled
gradient = Gradient(LowerLimit=panel, UpperLimit=1, Parameter=perlin, stops=[0: RGB(255, 255, 255), 0.735: RGB(0, 0, 0)])  # disabled
conmesh = ConstructMesh(Vertices=demesh.Vertices, Faces=demesh.Faces, Colours=gradient)  # disabled

# ----
# DEFINITIONS BY
pt_2 = Point(Point(24.92672781, 10.84129804, 0))  # disabled
# reciproCITY
# ANEMONE
# Alessio Erioli
# Aldo Sollazzo
# Eugenio Bettucchi
number_slider_11 = Slider(100, range=0..100)  # disabled
number_slider_12 = Slider(1, range=0..1)  # disabled
loop_start_2 = LoopStart(Repeat=number_slider_11, Data_0=pt_2)  # -> port, Counter, Data_0; disabled
Z = UnitZ(Factor=number_slider_12)  # disabled
move_2 = Move(Geometry=loop_start_2.Data_0, Motion=Z)  # -> Geometry, Transform; disabled
loop_end_2 = LoopEnd(port=loop_start_2.port, Exit=False, Data_0=move_2.Geometry, pausedState=False, state="Constant output")  # disabled

# ----
# PREDATOR PREY
R = Region({Plane=PlaneXY(0, 0, 0), X=Domain(0, 63.89154561), Y=Domain(0, 63.89154561), Z=Domain(0, 12.77830912)})  # disabled

# ---- group: PREDATORS VECTOR
number_slider_13 = Slider(59, range=0..100)  # disabled
pop3d_2 = Populate3D(Region=R, Count=number_slider_13, Seed=1)  # disabled
pt_3 = Point(pop3d_2)  # disabled

# ----
# SEEK
number_slider_14 = Slider(30, range=0..100)  # disabled
pop3d_3 = Populate3D(Region={Plane=PlaneXY(0, 0, 0), X=Domain(0, 10), Y=Domain(0, 10), Z=Domain(0, 2)}, Count=number_slider_14, Seed=1)  # disabled

# ----
# COHESION
number_slider_15 = Slider(30, range=0..100)  # disabled
pop3d_4 = Populate3D(Region={Plane=PlaneXY(0, 0, 0), X=Domain(0, 10), Y=Domain(0, 10), Z=Domain(0, 2)}, Count=number_slider_15, Seed=1)  # disabled

# ---- group: PREY VECTORS / PREY
item = ListItem(List=pop3d_2, Index=0, Wrap=True)  # -> Item, Item1, Item2; disabled

# ----
number_slider_16 = Slider(0.2, range=0..1)  # disabled
# FOLLOW COLOR
number_slider_17 = Slider(44, range=0..100)  # disabled
popgeo = PopulateGeometry(Geometry=mesh_uv, Count=number_slider_17, Seed=1)  # disabled
vec_2 = VectorXYZ(XComponent=number_slider_16, YComponent=number_slider_16, ZComponent=0)  # -> Vector, Length; disabled
lng = ListLength(List=popgeo)  # disabled
vec_3 = Vector(vec_2.Vector)  # disabled
repeat = RepeatData(Data=vec_3, Length=lng)  # disabled

# ---- group: PREY VECTORS
pt_4 = Point([item.Item, item.Item1, item.Item2])  # disabled

# ---- group: TARGET POINTS
number_slider_18 = Slider(14, range=0..100)  # disabled
item_2 = ListItem(List=pop3d_3, Index=0, Wrap=True)  # -> Item, Item1, Item2; disabled
Z_2 = UnitZ(Factor=number_slider_18)  # disabled
move_3 = Move(Geometry=[item_2.Item, item_2.Item1, item_2.Item2], Motion=Z_2)  # -> Geometry, Transform; disabled

# ----
lng_2 = ListLength(List=pt_3)  # disabled
Z_3 = UnitZ(Factor=1)  # disabled
repeat_2 = RepeatData(Data=Z_3, Length=lng_2)  # disabled

lng_3 = ListLength(List=pt_4)  # disabled
rndvec = RandomVector(Number=lng_3, Unit=False, RandomSeed=2, AbsoluteMultiplier=1)  # disabled

number_slider_19 = Slider(1, range=0..5)  # disabled
neg = Negative(Value=number_slider_19)  # disabled
dom = ConstructDomain(DomainStart=number_slider_19, DomainEnd=neg)  # disabled

button = Button()  # disabled

maxv = Slider(0.5, range=0..1)  # disabled
maxf = Slider(0.2, range=0..1)  # disabled
number_slider_20 = Slider(1, range=0..1)  # disabled
number_slider_21 = Slider(1, range=0..5)  # disabled
number_slider_22 = Slider(1, range=0..10)  # disabled

neg_2 = Negative(Value=number_slider_22)  # disabled
pcharge = PointCharge(Point=move_3.Geometry, Charge=neg_2, Decay=number_slider_20)  # disabled

swatch = ColourSwatch(SwatchColor=RGB(0, 221, 255))  # disabled
swatch_2 = ColourSwatch(SwatchColor=RGB(117, 117, 117))  # disabled

# ----
# STEER
number_slider_23 = Slider(20, range=0..20)  # disabled
Y = UnitY(Factor=number_slider_23)  # disabled
arrive = Point(Point(178.9549649, -11.43568566, 0))  # disabled
number_slider_24 = Slider(35, range=0..110)  # disabled
number_slider_25 = Slider(2, range=0..10)  # disabled
number_slider_26 = Slider(3.9, range=0..10)  # disabled
maxforce = Slider(0.139, range=0..1)  # disabled

# ----
# FOLLOW LINE
number_slider_27 = Slider(20, range=0..20)  # disabled
Y_2 = UnitY(Factor=number_slider_27)  # disabled
crv_2 = Curve(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)  # disabled
number_slider_28 = Slider(110, range=0..110)  # disabled
number_slider_29 = Slider(3, range=0..10)  # disabled
Y_3 = UnitY(Factor=1)  # disabled
number_slider_30 = Slider(1.7, range=0..10)  # disabled
maxforce_2 = Slider(0.228, range=0..1)  # disabled
number_slider_31 = Slider(0.15, range=0..1)  # disabled
number_slider_32 = Slider(0.13, range=0..1)  # disabled

# ----
# RANDOM VECTOR
# 15-17 April 2016
# Points
# RANDOM VECTOR LOGIC
# Vectors
# RANDOM VECTOR LOGIC
pt_5 = Point([Point(10.48161163, 21.82657627, 0), Point(38.74231883, 11.7785734, 0), Point(52.67465533, 47.77125877, 0), Point(21.91884066, 75.08682577, 0), Point(81.45071704, 55.00534339, 0)])  # disabled
number_slider_33 = Slider(100, range=0..1000)  # disabled
button_2 = Button()  # disabled
number_slider_34 = Slider(9, range=0..10)  # disabled

lng_4 = ListLength(List=pt_5)  # disabled
Z_4 = UnitZ(Factor=1)  # disabled
repeat_3 = RepeatData(Data=Z_4, Length=lng_4)  # disabled

pt_6 = Point(pop3d_4)  # disabled
number_slider_35 = Slider(209, range=0..1000)  # disabled
button_3 = Button()  # disabled

lng_5 = ListLength(List=pt_6)  # disabled
Z_5 = UnitZ(Factor=1)  # disabled
repeat_4 = RepeatData(Data=Z_5, Length=lng_5)  # disabled

# ----
# adhere
# true false
# adhere vectors logic / steer
# magnetic fields
pt_7 = Point(pop3d_3)  # disabled
number_slider_36 = Slider(204, range=0..1000)  # disabled
number_slider_37 = Slider(0.7, range=0..1)  # disabled

lng_6 = ListLength(List=pt_7)  # disabled
Z_6 = UnitZ(Factor=1)  # disabled
repeat_5 = RepeatData(Data=Z_6, Length=lng_6)  # disabled

agents = Point([Point(27.66381252, -10.25946277, 0), Point(25.89416457, -24.94754074, 0), Point(17.39985441, -15.21447702, 0), Point(19.16950236, -19.81556169, 0), Point(24.8323758, -12.91393469, 0), Point(31.55703801, -16.45323059, 0), Point(36.33508747, -23.70878718, 0), Point(24.12451662, -28.48683664, 0)])  # disabled

lng_7 = ListLength(List=agents)  # disabled
repeat_6 = RepeatData(Data=Y, Length=lng_7)  # disabled

vec_4 = Vector(repeat_6)  # disabled

agents_2 = Point([Point(27.66381252, -10.25946277, 0), Point(25.89416457, -24.94754074, 0), Point(17.39985441, -15.21447702, 0), Point(19.16950236, -19.81556169, 0), Point(24.8323758, -12.91393469, 0), Point(31.55703801, -16.45323059, 0), Point(36.33508747, -23.70878718, 0), Point(24.12451662, -28.48683664, 0)])  # disabled

lng_8 = ListLength(List=agents_2)  # disabled
repeat_7 = RepeatData(Data=Y_2, Length=lng_8)  # disabled

vec_5 = Vector(repeat_7)  # disabled

loop_start_3 = LoopStart(N=number_slider_33, T=button_2, D0=pt_5, D1=repeat_3)  # -> port, Counter, Data, Data_2; disabled
wander = RandomWander(
    AgentMotionVectors=loop_start_3.Data_2,
    AngleSpreadDomain=Domain(0, 3.141592654),
    RandomSeed=loop_start_3.Counter,
    AbsoluteMultiplier=1)  # disabled

number_slider_38 = Slider(3, range=0..10)  # disabled
multiplication_2 = Multiplication(A=lng_4, B=number_slider_38)  # disabled
random = Random(Range=dom, Number=multiplication_2, Seed=loop_start_3.Counter)  # disabled
number_slider_39 = Slider(3, range=0..10)  # disabled
partition = PartitionList(List=random, Size=number_slider_39)  # disabled
item_3 = ListItem(List=partition, Index=0, Wrap=True)  # -> Item, Item1, Item2; disabled
vec_6 = VectorXYZ(XComponent=item_3.Item, YComponent=item_3.Item1, ZComponent=item_3.Item2)  # -> flatten(Vector), Length; disabled

amp = Amplitude(Vector=vec_6.Vector, Amplitude=number_slider_34)  # disabled
move_4 = Move(Geometry=loop_start_3.Data, Motion=amp)  # -> Geometry, Transform; disabled
loop_end_3 = LoopEnd(
    port=loop_start_3.port,
    Exit=False,
    Data=flatten(move_4.Geometry),
    Data_2=flatten(amp),
    pausedState=False,
    state="Constant & Record",
    TimeOutVal=0)  # -> D0, D1; disabled
flip = FlipMatrix(Data=loop_end_3.D0)  # disabled
intcrv = Interpolate(Vertices=flip, Degree=3, Periodic=False, KnotStyle=1)  # -> Curve, Length, Domain; disabled

merge = Merge(Data1=simplify(graft(agents)), Data2=simplify(graft(vec_4)))  # disabled
group = Group(Objects=merge)  # disabled
loop_start_4 = LoopStart(Repeat=number_slider_24, Trigger=button, Data=group)  # -> port, Counter, simplify(Data); disabled
ungroup = Ungroup(Group=loop_start_4.Data)  # disabled
item_4 = ListItem(List=ungroup, Index=0, Wrap=True)  # -> Item, Item1; disabled
amp_2 = Amplitude(Vector=item_4.Item1, Amplitude=number_slider_25)  # disabled
move_5 = Move(Geometry=item_4.Item, Motion=amp_2)  # -> Geometry, Transform; disabled
cp = ClosestPoint(Point=move_5.Geometry, Cloud=arrive)  # -> ClosestPoint, CPIndex, Distance; disabled
vec2pt = Vector2Pt(PointA=move_5.Geometry, PointB=cp.ClosestPoint, Unitize=False)  # -> simplify(Vector), Length; disabled
move_6 = Move(Geometry=item_4.Item, Motion=item_4.Item1)  # -> Geometry, Transform; disabled
pt_8 = Point(item_4.Item)  # disabled

# ----
# steer
steer = Steer(vel=item_4.Item1, des=vec2pt.Vector, maxv=number_slider_26, maxf=maxforce)  # disabled

addition_2 = Addition(A=item_4.Item1, B=steer)  # disabled
trmvec = TrimVector(Vector=addition_2, LengthDomain=number_slider_26)  # disabled
move_7 = Move(Geometry=item_4.Item, Motion=trmvec)  # -> Geometry, Transform; disabled
merge_2 = Merge(Data1=move_7.Geometry, Data2=trmvec)  # disabled
group_2 = Group(Objects=merge_2)  # disabled
loop_end_4 = LoopEnd(port=loop_start_4.port, Exit=False, Data=group_2, pausedState=False, state="Constant & Record", TimeOutVal=0)  # disabled
ungroup_2 = Ungroup(Group=loop_end_4)  # disabled
item_5 = ListItem(List=ungroup_2, Index=0, Wrap=True)  # disabled

# ---- group: VELOCITY
swatch_3 = ColourSwatch(SwatchColor=RGB(0, 109, 168))  # disabled
vdisex = VectorDisplayEx(Point=pt_8, Vector=item_4.Item1, Colour=swatch_3, Width=2)  # disabled

# ---- group: FINAL VECTOR
swatch_4 = ColourSwatch(SwatchColor=RGB(255, 255, 255))  # disabled
vdisex_2 = VectorDisplayEx(Point=pt_8, Vector=trmvec, Colour=swatch_4, Width=2)  # disabled

# ---- group: STEER
vdisex_3 = VectorDisplayEx(Point=move_6.Geometry, Vector=steer, Colour=RGB(0, 0, 0), Width=2)  # disabled

# ----
merge_3 = Merge(Data1=simplify(graft(agents_2)), Data2=simplify(graft(vec_5)))  # disabled
group_3 = Group(Objects=merge_3)  # disabled
loop_start_5 = LoopStart(Repeat=number_slider_28, Data=group_3)  # -> port, Counter, simplify(Data); disabled
panel_2 = Panel(loop_start_5.Counter)  # disabled
ungroup_3 = Ungroup(Group=loop_start_5.Data)  # disabled
item_6 = ListItem(List=ungroup_3, Index=0, Wrap=True)  # -> Item, Item1; disabled
amp_3 = Amplitude(Vector=item_6.Item1, Amplitude=number_slider_29)  # disabled
move_8 = Move(Geometry=item_6.Item, Motion=amp_3)  # -> Geometry, Transform; disabled
crv_cp = CurveClosestPoint(Point=move_8.Geometry, Curve=graft(crv_2))  # -> Point, Parameter, Distance; disabled
vec2pt_2 = Vector2Pt(PointA=move_8.Geometry, PointB=crv_cp.Point, Unitize=False)  # -> Vector, Length; disabled
eval = EvaluateCurve(Curve=crv_2, Parameter=crv_cp.Parameter)  # -> Point, Tangent, Angle; disabled
multiplication_3 = Multiplication(A=eval.Tangent, B=number_slider_31)  # disabled
pt_9 = Point(item_6.Item)  # disabled

# ----
# steer
steer_2 = Steer(vel=item_6.Item1, des=vec2pt_2.Vector, maxv=number_slider_30, maxf=maxforce_2)  # disabled

multiplication_4 = Multiplication(A=steer_2, B=number_slider_32)  # disabled
addition_3 = Addition(A=multiplication_4, B=multiplication_3)  # disabled
addition_4 = Addition(A=item_6.Item1, B=addition_3)  # disabled
trmvec_2 = TrimVector(Vector=addition_4, LengthDomain=number_slider_30)  # disabled
move_9 = Move(Geometry=item_6.Item, Motion=trmvec_2)  # -> Geometry, Transform; disabled
merge_4 = Merge(Data1=move_9.Geometry, Data2=trmvec_2)  # disabled
group_4 = Group(Objects=merge_4)  # disabled
loop_end_5 = LoopEnd(port=loop_start_5.port, Exit=False, Data=group_4, pausedState=False, state="Constant output", TimeOutVal=0)  # disabled
ungroup_4 = Ungroup(Group=loop_end_5)  # disabled
item_7 = ListItem(List=ungroup_4, Index=0, Wrap=True)  # disabled

# ---- group: VELOCITY
swatch_5 = ColourSwatch(SwatchColor=RGB(0, 109, 168))  # disabled
vdisex_4 = VectorDisplayEx(Point=pt_9, Vector=item_6.Item1, Colour=swatch_5, Width=2)  # disabled

# ---- group: FINAL VECTOR
swatch_6 = ColourSwatch(SwatchColor=RGB(255, 255, 255))  # disabled
vdisex_5 = VectorDisplayEx(Point=pt_9, Vector=trmvec_2, Colour=swatch_6, Width=2)  # disabled

# ---- group: STEER
vdisex_6 = VectorDisplayEx(Point=pt_9, Vector=steer_2, Colour=RGB(0, 0, 0), Width=2)  # disabled

# ----
# adhere vectors logic
# adhere vectors logic
# random vectors logic
number_slider_40 = Slider(150, range=0..200)  # disabled
loop_start_6 = LoopStart(Repeat=number_slider_40, Data_0=pt_3, Data_1=repeat_2, Data_2=pt_4, Data_3=rndvec)  # -> port, Counter, Data_0, Data_1, Data_2, Data_3; disabled
number_slider_41 = Slider(1, range=0..1)  # disabled
maxv_2 = Slider(4.39, range=0..5)  # disabled
maxf_2 = Slider(0.289, range=0..1)  # disabled
neg_3 = Negative(Value=number_slider_41)  # disabled
dom_2 = ConstructDomain(DomainStart=neg_3, DomainEnd=number_slider_41)  # disabled
number_slider_42 = Slider(3, range=0..10)  # disabled

# ---- group: PREDATORS
pt_10 = Point(loop_start_6.Data_0)  # disabled
vec_7 = Vector(loop_start_6.Data_1)  # disabled

# ---- group: PREY
pt_11 = Point(loop_start_6.Data_2)  # disabled
vec_8 = Vector(loop_start_6.Data_3)  # disabled

# ----
number_slider_43 = Slider(1, range=0..4)  # disabled
cps = ClosestPoints(Point=pt_10, Cloud=pt_11, Count=number_slider_43)  # -> ClosestPoint, CPIndex, Distance; disabled
avr = Average(Input=cps.ClosestPoint)  # -> flatten(ArithmeticMean); disabled
vec2pt_3 = Vector2Pt(PointA=pt_10, PointB=avr, Unitize=False)  # -> Vector, Length; disabled
steer_3 = Steer(vel=vec_7, des=vec2pt_3.Vector, maxv=maxv_2, maxf=maxf_2)  # disabled

number_slider_44 = Slider(1, range=0..4)  # disabled
number_slider_45 = Slider(0.2, range=0..1)  # disabled
adhere_2 = AhereToTheFlockCenter(
    AgentLocationPoint=pt_10,
    LocationPointsOfTheFlock=pt_11,
    SearchDistance=Domain(0, 0),
    ReferenceAgentsCount=number_slider_44,
    Multiplier=number_slider_45)  # disabled

# ---- group: FRICTION//INERTIA
number_slider_46 = Slider(1, range=0..1)  # disabled
multiplication_5 = Multiplication(A=number_slider_46, B=vec_7)  # disabled

# ---- group: future location
number_slider_47 = Slider(4, range=0..10)  # disabled
amp_4 = Amplitude(Vector=vec_8, Amplitude=number_slider_47)  # disabled
move_10 = Move(Geometry=pt_11, Motion=amp_4)  # -> Geometry, Transform; disabled

# ----
number_slider_48 = Slider(15, range=0..100)  # disabled
number_slider_49 = Slider(1, range=0..1)  # disabled
rad = Radians(Degrees=number_slider_48)  # disabled
wander_2 = RandomWander(AgentMotionVectors=vec_8, AngleSpreadDomain=rad, RandomSeed=loop_start_6.Counter, AbsoluteMultiplier=number_slider_49)  # disabled

lng_9 = ListLength(List=pt_11)  # disabled
multiplication_6 = Multiplication(A=lng_9, B=2)  # disabled

number_slider_50 = Slider(0.3, range=0..5)  # disabled
trmvec_3 = TrimVector(Vector=steer_3, LengthDomain=number_slider_50)  # disabled

loop_start_7 = LoopStart(Repeat=number_slider_35, Trigger=button_3, Data_0=pt_6, Data_1=repeat_4)  # -> port, Counter, Data_0, Data_1; disabled
panel_3 = Panel(loop_start_7.Counter)  # disabled

number_slider_51 = Slider(15, range=0..100)  # disabled
number_slider_52 = Slider(1, range=0..1)  # disabled
rad_2 = Radians(Degrees=number_slider_51)  # disabled
wander_3 = RandomWander(
    AgentMotionVectors=loop_start_7.Data_1,
    AngleSpreadDomain=rad_2,
    RandomSeed=loop_start_7.Counter,
    AbsoluteMultiplier=number_slider_52)  # disabled

# ---- group: VOID LIBRARY BEHAVIOUR
number_slider_53 = Slider(0.08, range=0..0.1)  # disabled
adhere_3 = AhereToTheFlockCenter(
    AgentLocationPoint=loop_start_7.Data_0,
    LocationPointsOfTheFlock=loop_start_7.Data_0,
    SearchDistance=Domain(0, 0),
    ReferenceAgentsCount=-1,
    Multiplier=number_slider_53)  # disabled

# ----
loop_start_8 = LoopStart(Repeat=number_slider_36, Data_0=pt_7, Data_1=repeat_5)  # -> port, Counter, Data_0, Data_1; disabled
pt_12 = Point(loop_start_8.Data_0)  # disabled
vec_9 = Vector(loop_start_8.Data_1)  # disabled
panel_4 = Panel(loop_start_8.Counter)  # disabled

number_slider_54 = Slider(0.08, range=0..0.8)  # disabled
adhere_4 = AhereToTheFlockCenter(
    AgentLocationPoint=pt_12,
    LocationPointsOfTheFlock=move_3.Geometry,
    SearchDistance=Domain(0, 0),
    ReferenceAgentsCount=number_slider_21,
    Multiplier=number_slider_54)  # disabled

cps_2 = ClosestPoints(Point=pt_12, Cloud=move_3.Geometry, Count=number_slider_21)  # -> ClosestPoint, CPIndex, Distance; disabled
avr_2 = Average(Input=cps_2.ClosestPoint)  # -> flatten(ArithmeticMean); disabled
vec2pt_4 = Vector2Pt(PointA=pt_12, PointB=avr_2, Unitize=False)  # -> Vector, Length; disabled
steer_4 = Steer(vel=vec_9, des=vec2pt_4.Vector, maxv=maxv, maxf=maxf)  # disabled

mergef = MergeFields(Fields=pcharge)  # disabled
evf = EvaluateField(Field=mergef, Point=pt_12)  # -> Tensor, Strength; disabled

number_slider_55 = Slider(0.6, range=0..1)  # disabled
smaller = SmallerThan(FirstNumber=cps_2.Distance, SecondNumber=number_slider_55)  # -> flatten(SmallerThan), OrEqualTo; disabled
ma = MassAddition(Input=smaller.SmallerThan)  # -> Result, PartialResults; disabled
equals = Equality(FirstNumber=ma.Result, SecondNumber=lng_6)  # -> Equality, Inequality; disabled

trmvec_4 = TrimVector(Vector=steer_4, LengthDomain=number_slider_37)  # disabled
move_11 = Move(Geometry=pt_12, Motion=trmvec_4)  # -> Geometry, Transform; disabled
loop_end_6 = LoopEnd(
    port=loop_start_8.port,
    Exit=equals.Equality,
    Data_0=flatten(move_11.Geometry),
    Data_1=flatten(trmvec_4),
    pausedState=False,
    state="Constant & Record")  # -> Data_0, Data_1; disabled
viewer = ParamViewer(loop_end_6.Data_0)  # disabled
flip_2 = FlipMatrix(Data=loop_end_6.Data_0)  # disabled
viewer_2 = ParamViewer(flip_2)  # disabled
pline = PolyLine(Vertices=flip_2, Closed=False)  # disabled

merge_5 = Merge(Data1=simplify(graft(popgeo)), Data2=simplify(graft(repeat)), Data3=simplify(graft(popgeo)))  # disabled
number_slider_56 = Slider(67, range=0..500)  # disabled
group_5 = Group(Objects=merge_5)  # disabled
panel_5 = Panel("2")  # disabled
number_slider_57 = Slider(0, range=0..1)  # disabled
number_slider_58 = Slider(30, range=0..100)  # disabled

loop_start_9 = LoopStart(Repeat=number_slider_56, Data=simplify(graft(group_5)))  # -> port, Counter, Data; disabled
stop = BooleanToggle(False)  # disabled

# ---- group: ATTRACTOR FIELD
number_slider_59 = Slider(0.129, range=0..1)  # disabled
avr_3 = Average(Input=loop_start_7.Data_0)  # disabled
number_slider_60 = Slider(0.5, range=0..3)  # disabled
neg_4 = Negative(Value=number_slider_59)  # disabled
pcharge_2 = PointCharge(Point=avr_3, Charge=neg_4, Decay=number_slider_60)  # disabled
number_slider_61 = Slider(0.7, range=0..1)  # disabled
mergef_2 = MergeFields(Fields=pcharge_2)  # disabled
evf_2 = EvaluateField(Field=mergef_2, Point=loop_start_7.Data_0)  # -> Tensor, Strength; disabled

# ---- group: STEER VECTOR
number_slider_62 = Slider(0.25, range=0..1)  # disabled
vec2pt_5 = Vector2Pt(PointA=loop_start_7.Data_0, PointB=avr_3, Unitize=False)  # -> Vector, Length; disabled
steer_5 = Steer(vel=loop_start_7.Data_1, des=vec2pt_5.Vector, maxv=number_slider_61, maxf=number_slider_62)  # disabled

# ----
addition_5 = Addition(A=wander_3, B=steer_5)  # disabled

# ---- group: ATTRACTOR FIELD (continued)
addition_6 = Addition(A=loop_start_7.Data_1, B=addition_5)  # disabled
trmvec_5 = TrimVector(Vector=addition_6, LengthDomain=number_slider_61)  # disabled

# ----
addition_7 = Addition(A=wander_3, B=evf_2.Tensor)  # disabled
move_12 = Move(Geometry=loop_start_7.Data_0, Motion=trmvec_5)  # -> Geometry, Transform; disabled
loop_end_7 = LoopEnd(
    port=loop_start_7.port,
    Exit=False,
    Data_0=flatten(move_12.Geometry),
    Data_1=flatten(trmvec_5),
    pausedState=False,
    state="Constant & Record")  # -> Data_0, Data_1; disabled
viewer_3 = ParamViewer(loop_end_7.Data_0)  # disabled
flip_3 = FlipMatrix(Data=loop_end_7.Data_0)  # disabled
viewer_4 = ParamViewer(flip_3)  # disabled
pline_2 = PolyLine(Vertices=flip_3, Closed=False)  # disabled

ungroup_5 = Ungroup(Group=loop_start_9.Data)  # -> simplify(Objects); disabled
split = SplitList(List=ungroup_5, Index=panel_5)  # -> ListA, ListB; disabled
panel_6 = Panel(loop_start_9.Counter)  # disabled
item_8 = ListItem(List=split.ListA, Index=0, Wrap=True)  # -> Item, Item1; disabled
pt_13 = Point(flatten(item_8.Item))  # disabled
vec_10 = Vector(item_8.Item1)  # disabled
multiplication_7 = Multiplication(A=item_8.Item1, B=number_slider_57)  # disabled

number_slider_63 = Slider(12, range=0..50)  # disabled
number_slider_64 = Slider(0.71, range=0..1)  # disabled
demesh_2 = DeconstructMesh(Mesh=conmesh)  # -> Vertices, Faces, Colours, Normals; disabled
number_slider_65 = Slider(1, range=0..1)  # disabled
cluster = Cluster(L=demesh_2.Vertices)  # disabled
number_slider_66 = Slider(1, range=0..1)  # disabled
visible = FindVisibleAgents(
    AgentLocationPoint=pt_13,
    AgentMotionVector=flatten(vec_10),
    LocationPointsOfTheFlock=demesh_2.Vertices,
    FlockMotionVectors=cluster,
    SearchDistance=number_slider_63,
    SearchAngle=number_slider_64)  # -> simplify(ListOfPoints), ListOfVectors, simplify(ListOfIndices); disabled
cluster_2 = Cluster_3(
    agents=pt_13,
    index_of_visible=visible.ListOfIndices,
    M=conmesh,
    intensity=number_slider_66,
    treshold_limit_value_to_follow=number_slider_65)  # -> vector, elected_point; disabled

addition_8 = Addition(A=cluster_2.vector, B=simplify(multiplication_7))  # -> flatten(Result); disabled
move_13 = Move(Geometry=pt_13, Motion=addition_8)  # -> Geometry, Transform; disabled
vec_11 = Vector(graft(addition_8))  # disabled
tlist = TailList(L=split.ListB, it=simplify(graft(move_13.Geometry)), len=number_slider_58)  # -> out, simplify(A); inputs L: list, len: Int32; disabled
# ---------- tlist: C# ----------
    Component.Name = "Tail List";
    Component.NickName = "TList";
    Component.Description = "Tail list - L list, it item to add, len tail length";

    if (L.Count() > len) {
      L.RemoveAt(0);
    }
    L.Add(it);
    A = L;
# ---------- end tlist ----------
merge_6 = Merge(Data1=simplify(graft(move_13.Geometry)), Data2=simplify(graft(vec_11)), Data3=simplify(tlist.A))  # disabled
group_6 = Group(Objects=merge_6)  # disabled
loop_end_8 = LoopEnd(port=loop_start_9.port, Exit=stop, Data=simplify(group_6), pausedState=False, state="Constant output", TimeOutVal=0)  # disabled

# ---- group: agents
lng_10 = ListLength(List=pt_13)  # disabled
swatch_7 = ColourSwatch(SwatchColor=RGB(74, 255, 164))  # disabled
number_slider_67 = Slider(1.9, range=0..12)  # disabled
repeat_8 = RepeatData(Data=swatch_7, Length=lng_10)  # disabled
cloud = CloudDisplay(Points=pt_13, Colours=repeat_8, Size=number_slider_67, SpriteType=1)  # disabled

# ---- group: visible points
lng_11 = ListLength(List=visible.ListOfPoints)  # disabled
swatch_8 = ColourSwatch(SwatchColor=RGBA(113, 250, 75, 195))  # disabled
number_slider_68 = Slider(0.8, range=0..12)  # disabled
repeat_9 = RepeatData(Data=swatch_8, Length=lng_11)  # disabled
cloud_2 = CloudDisplay(Points=visible.ListOfPoints, Colours=repeat_9, Size=number_slider_68, SpriteType=1)  # disabled

# ---- group: selected point
lng_12 = ListLength(List=cluster_2.elected_point)  # disabled
swatch_9 = ColourSwatch(SwatchColor=RGB(255, 144, 79))  # disabled
number_slider_69 = Slider(1, range=0..12)  # disabled
repeat_10 = RepeatData(Data=swatch_9, Length=lng_12)  # disabled
cloud_3 = CloudDisplay(Points=cluster_2.elected_point, Colours=repeat_10, Size=number_slider_69, SpriteType=1)  # disabled

# ---- group: show tail
pt_14 = Point(split.ListB)  # disabled
number_slider_70 = Slider(0.5, range=0..12)  # disabled
cluster_3 = Cluster_2(L=pt_14)  # disabled
cloud_4 = CloudDisplay(Points=simplify(pt_14), Colours=cluster_3, Size=number_slider_70, SpriteType=1)  # disabled

# ----
random_2 = Random(Range=Domain(0, 1), Number=multiplication_6, Seed=loop_start_6.Counter)  # disabled

partition_2 = PartitionList(List=random_2, Size=number_slider_42)  # disabled
addition_9 = Addition(A=multiplication_5, B=trmvec_3)  # disabled
move_14 = Move(Geometry=pt_10, Motion=addition_9)  # -> Geometry, Transform; disabled
move_15 = Move(Geometry=pt_11, Motion=vec_8)  # -> Geometry, Transform; disabled

item_9 = ListItem(List=partition_2, Index=0, Wrap=True)  # -> Item, Item1, Item2; disabled
vec_12 = VectorXYZ(XComponent=item_9.Item, YComponent=item_9.Item1, ZComponent=item_9.Item2)  # -> flatten(Vector), Length; disabled

rotate = Rotate(Geometry=move_10.Geometry, Center=pt_11, From=vec_8, To=vec_12.Vector)  # -> Geometry, Transform; disabled
vec2pt_6 = Vector2Pt(PointA=pt_11, PointB=rotate.Geometry, Unitize=False)  # -> Vector, Length; disabled

number_slider_71 = Slider(5, range=0..5)  # disabled
number_slider_72 = Slider(0.245, range=0..1)  # disabled
steer_6 = Steer(vel=vec_8, des=vec2pt_6.Vector, maxv=number_slider_71, maxf=number_slider_72)  # disabled

move_16 = Move(Geometry=pt_11, Motion=steer_6)  # -> Geometry, Transform; disabled
amp_5 = Amplitude(Vector=vec2pt_6.Vector, Amplitude=number_slider_71)  # disabled
loop_end_9 = LoopEnd(
    port=loop_start_6.port,
    Exit=False,
    Data_0=flatten(move_14.Geometry),
    Data_1=flatten(trmvec_3),
    Data_2=flatten(move_16.Geometry),
    Data_3=flatten(steer_6),
    pausedState=False,
    state="Constant & Record")  # -> Data_0, Data_1, Data_2, Data_3; disabled
flip_4 = FlipMatrix(Data=loop_end_9.Data_0)  # disabled
viewer_5 = ParamViewer(loop_end_9.Data_0)  # disabled
pline_3 = PolyLine(Vertices=flip_4, Closed=False)  # disabled
viewer_6 = ParamViewer(flip_4)  # disabled

# ---- group: STEER LOGIC
number_slider_73 = Slider(1, range=0..1)  # disabled
swatch_10 = ColourSwatch(SwatchColor=RGB(176, 176, 176))  # disabled
swatch_11 = ColourSwatch(SwatchColor=RGB(47, 157, 196))  # disabled
swatch_12 = ColourSwatch(SwatchColor=RGB(255, 255, 255))  # disabled
swatch_13 = ColourSwatch(SwatchColor=RGB(255, 0, 0))  # disabled
vdisex_7 = VectorDisplayEx(Point=pt_11, Vector=vec2pt_6.Vector, Colour=swatch_10, Width=number_slider_73)  # disabled
vdisex_8 = VectorDisplayEx(Point=pt_11, Vector=vec_8, Colour=swatch_11, Width=2)  # disabled
vdisex_9 = VectorDisplayEx(Point=pt_11, Vector=amp_5, Colour=swatch_12, Width=2)  # disabled
vdisex_10 = VectorDisplayEx(Point=move_15.Geometry, Vector=steer_6, Colour=swatch_13, Width=2)  # disabled

# ----
preview = CustomPreview(Geometry=loop_end_9.Data_2, Shader=swatch_2)  # disabled
preview_2 = CustomPreview(Geometry=pline_3, Shader=swatch)  # disabled

# ----
# RANDOM WALKER
# Points
# RANDOM VECTOR LOGIC
pt_15 = Point([Point(10.48161163, 21.82657627, 0), Point(38.74231883, 11.7785734, 0), Point(52.67465533, 47.77125877, 0), Point(21.91884066, 75.08682577, 0), Point(81.45071704, 55.00534339, 0)])  # disabled
number_slider_74 = Slider(300, range=0..1000)  # disabled
lng_13 = ListLength(List=pt_15)  # disabled
button_4 = Button()  # disabled
loop_start_10 = LoopStart(Repeat=number_slider_74, Trigger=button_4, Data=pt_15)  # -> port, Counter, Data; disabled

seed = Panel("0 to 1000")  # disabled
random_3 = Random(Range=seed, Number=lng_13, Seed=loop_start_10.Counter, Integers=True)  # disabled
range = Panel("-1 to 1")  # disabled
panel_7 = Panel("3")  # disabled
random_4 = Random(Range=range, Number=panel_7, Seed=random_3, Integers=True)  # disabled
number_slider_75 = Slider(10, range=0..10)  # disabled
item_10 = ListItem(List=random_4, Index=0, Wrap=True)  # -> Item, Item1, Item2; disabled
vec_13 = VectorXYZ(XComponent=item_10.Item, YComponent=item_10.Item1, ZComponent=item_10.Item2)  # -> Vector, Length; disabled
multiplication_8 = Multiplication(A=vec_13.Vector, B=number_slider_75)  # -> flatten(Result); disabled

move_17 = Move(Geometry=loop_start_10.Data, Motion=multiplication_8)  # -> Geometry, Transform; disabled
loop_end_10 = LoopEnd(
    port=loop_start_10.port,
    Exit=False,
    Data=flatten(move_17.Geometry),
    pausedState=False,
    state="Constant & Record",
    TimeOutVal=0)  # disabled
flip_5 = FlipMatrix(Data=loop_end_10)  # disabled
pline_4 = PolyLine(Vertices=flip_5, Closed=False)  # -> flatten(Polyline); disabled
lng_14 = ListLength(List=pline_4)  # disabled
range_2 = Range(Domain=Domain(0, 1), Steps=expr("x-1", lng_14))  # disabled
gradient_2 = Gradient(LowerLimit=0, UpperLimit=1, Parameter=range_2, stops=[0.0345: RGB(237, 249, 255), 0.98: RGB(14, 26, 76)])  # disabled
preview_3 = CustomPreview(Geometry=pline_4, Shader=gradient_2)  # disabled

# ==== cluster Steer
maxf = ClusterInput()
vel = ClusterInput()
maxv = ClusterInput()
des = ClusterInput()
amp = Amplitude(Vector=des, Amplitude=maxv)
subtraction = Subtraction(A=amp, B=vel)
multiplication = Multiplication(A=subtraction, B=maxf)
vlen = VectorLength(Vector=multiplication)
min = Minimum(A=vlen, B=maxv)
amp_2 = Amplitude(Vector=multiplication, Amplitude=min)
acc = ClusterOutput(amp_2)

# ==== cluster Cluster
L = ClusterInput()
lng = ListLength(List=L)
vec = Vector(Vector(0, 0, 0))
repeat = RepeatData(Data=vec, Length=lng)
D = ClusterOutput(repeat)

# ==== cluster Cluster_2
L = ClusterInput()

lng = ListLength(List=L)  # -> flatten(Length)
item = ListItem(List=lng, Index=0, Wrap=True)
round = Round(Number=item)  # -> Nearest, Floor, Ceiling
division = Division(A="1", B=round.Ceiling)
series = Series(Start=0, Step=division, Count=round.Ceiling)
graph = GraphMapper(
    series,
    x0=0,
    x1=1,
    y0=0,
    y1=1,
    container_name="Bezier",
    cpx=[0, 0.6374178529, 0.8142894506, 1],
    cpy=[0, 0.1260549426, 0.5961636305, 1])
xyz = ColourXYZ(Alpha=1, X=graph, Y=graph, Z=graph)
series_2 = Series(Start=Slider(0.1, range=0..1), Step=Slider(0.05, range=0..0.1), Count=item)

C = ClusterOutput(xyz)

# ==== cluster Cluster_3
intensity = ClusterInput()
treshold_limit_value_to_follow = ClusterInput()
index_of_visible = ClusterInput()
agents = ClusterInput()
M = ClusterInput()
num = Number(treshold_limit_value_to_follow)
num_2 = Number(intensity)
int = Integer(index_of_visible)
pt = Point(agents)
demesh = DeconstructMesh(Mesh=M)  # -> Vertices, Faces, Colours, Normals

color = ListItem(List=demesh.Colours, Index=int, Wrap=True)  # -> simplify(Item)
vertex = ListItem(List=demesh.Vertices, Index=int, Wrap=True)  # -> simplify(Item)

# ----
# using grayscale so each is the same
graysca = SplitARGB(Colour=color)  # -> Alpha, Red, Green, Blue

sort = SortList(Keys=graysca.Red, ValuesA=vertex)  # -> Keys, ValuesA
item = ListItem(List=sort.Keys, Index=0, Wrap=True)  # -> Item1, Item

item_2 = ListItem(List=sort.ValuesA, Index=0, Wrap=True)  # -> Item1, Item
panel = Panel("""follow color
i = black
-i = white""")

vec2pt = Vector2Pt(PointA=simplify(graft(pt)), PointB=item_2.Item1, Unitize="true")  # -> flatten(Vector), Length
amp = Amplitude(Vector=vec2pt.Vector, Amplitude=num_2)
lng = ListLength(List=amp)
vec = Vector(Vector(0, 0, 0))
larger = LargerThan(FirstNumber=item.Item1, SecondNumber=num)  # -> flatten(LargerThan), OrEqualTo
repeat = RepeatData(Data=vec, Length=lng)
p_n_c = PickNChoose(Pattern=larger.LargerThan, Stream0=amp, Stream1=repeat)  # -> simplify(graft(Result))

vector = ClusterOutput(p_n_c)
elected_point = ClusterOutput(item_2.Item1)
