# Grasshopper definition 04_20160145_output visualization.gh (Grasshopper 0.9.76)
# plug-ins: Human

# ---- group: OUTPUT FROM SIMULATION
# reciproCITY
# IN ORDER TO MAKE IT WORK STRUCTURE SHOULD BE:
# 
# _BRANCHES ARE AGENTS
# _LIST ITEMS ARE THE ITERATIONS
# Alessio Erioli
# Aldo Sollazzo
# Eugenio Bettucchi
# DEFINITIONS BY
# 15-17 April 2016
pt = Point()

# ---- group: TRAIL
number_slider = Slider(20, range=0..100)
pline = PolyLine(Vertices=pt, Closed=False)
smoothpline = SmoothPolyline(Polyline=pline, Strength=1, Times=Slider(10, range=1..20))
range = Range(Domain=Domain(0, 1), Steps=number_slider)
shatter = Shatter(Curve=reparameterize(smoothpline), Parameters=range)  # -> simplify(Segments)
subtraction = Subtraction(A=number_slider, B="1")
prune = PruneTree(Tree=shatter, Minimum="1", Maximum=0)
range_2 = Range(Domain=Domain(0, 1), Steps=subtraction)
gradient = Gradient(
    LowerLimit=0,
    UpperLimit=1,
    Parameter=range_2,
    stops=[0: RGB(0, 0, 0), 0: RGB(0, 0, 0), 0.0493: RGB(0, 50, 0), 0.695: RGB(81, 150, 17), 0.845: RGB(159, 198, 146), 0.968: RGB(170, 235, 41), 1: RGB(221, 255, 53)])
flip = FlipMatrix(Data=prune)
previewlw = CustomPreviewLineweights(Geometry=flip, Shader=graft(gradient), Thickness=Slider(2, range=0..10))

# ---- group: POINT
pt_2 = Point(pt)
lng = ListLength(List=pt_2)  # -> flatten(Length)
item = ListItem(List=lng, Index=0, Wrap=True)
series = Series(Start=0, Step=1, Count=item)
gradient_2 = Gradient(
    LowerLimit=0,
    UpperLimit=item,
    Parameter=series,
    stops=[0: RGB(80, 55, 25), 0.201: RGB(159, 65, 29), 1: RGB(174, 166, 129)])
cloud = CloudDisplay(Points=pt_2, Colours=gradient_2, Size=Slider(1, range=0..1.5), SpriteType=0)

# ---- group: CUSTOM PROXIMITY
pline_2 = PolyLine(Vertices=pt, Closed=False)
dist = Slider(3, range=0..5)  # disabled
explode = Explode(Curve=pline_2, Recursive=True)  # -> Segments, simplify(Vertices)
cptree = ConnectPointTree(d=dist, Ptree=explode.Vertices)  # -> out, P; inputs d: Double, Ptree: tree of Point3d; disabled
# ---------- cptree: C# ----------
    String eol = Environment.NewLine;
    Component.Name = "Connect Point tree";
    Component.NickName = "CPtree";
    Component.Message = "v0.1 _ by Alessio Erioli" + eol + "Co-de-iT";
    Component.Description = "Connects points in a tree"+eol+" excluding their own branch" + eol+
      "d - distance threshold";
    /*
    System.Threading.Tasks.Parallel.ForEach(Ptree.AllData(), p => {
    });
    */

    Point3d p, p1;

    // System.Collections.Concurrent.ConcurrentBag<Line> conn = new System.Collections.Concurrent.ConcurrentBag<Line>();
    DataTree<Point3d> conT = new DataTree<Point3d> ();

    //List <Line> conn = new List<Line>();
    GH_Path pa;
    //System.Threading.Tasks.Parallel.For(0, Ptree.BranchCount, i => {
    for (int i = 0; i < Ptree.BranchCount; i++){
      for(int r = 0; r < Ptree.Branch(i).Count; r++){
        p = Ptree.Branch(i)[r];
        pa = new GH_Path(new int[]{i,r});
        conT.EnsurePath(pa);
        for (int j = i + 1; j < Ptree.BranchCount; j++){
          for(int k = 0; k < Ptree.Branch(j).Count(); k++){
            p1 = Ptree.Branch(j)[k];
            if (p.DistanceTo(p1) < d){
              conT.Add(p1, pa);
              //conn.Add(new Line(p, p1));
            }
          }
        }
      }
    }
    //  });
    P = conT;
# ---------- end cptree ----------

# ---- group: PROXIMITY
pt_3 = Point(flatten(pt))
prox = Proximity3D(Points=pt_3, Group=Slider(3, range=1..10), MinRadius=Slider(10, range=0.05..20), MaxRadius=Slider(30, range=0.05..40))  # -> Links, Topology
crv = Curve(flatten(prox.Links))
len = Length(Curve=crv)
bnd = Bounds(Numbers=len)
dedomain = DeconstructDomain(Domain=bnd)  # -> Start, End
num = Number(len)
gradient_3 = Gradient(
    LowerLimit=dedomain.Start,
    UpperLimit=dedomain.End,
    Parameter=num,
    stops=[0: RGB(220, 0, 40), 0.0874: RGB(0, 192, 192), 0.387: RGB(0, 0, 64), 1: RGB(5, 30, 64), 1: RGB(29, 137, 12)])
bar_graph = BarGraph(len, BarColor=RGB(255, 0, 90))
previewlw_2 = CustomPreviewLineweights(Geometry=crv, Shader=gradient_3, Thickness=Slider(1, range=0..10))

# ----
number_slider_2 = Slider(0.01, range=0..0.01)  # disabled

# ---- group: CUSTOM PROXIMITY / CONNECTION
ln = Line(StartPoint=simplify(graft(explode.Vertices)), EndPoint=cptree.P)  # disabled
len_2 = Length(Curve=ln)  # disabled
bnd_2 = Bounds(Numbers=len_2)  # disabled
dedomain_2 = DeconstructDomain(Domain=bnd_2)  # -> Start, End; disabled
gradient_4 = Gradient(LowerLimit=0, UpperLimit=dedomain_2.End, Parameter=len_2, stops=[0: RGB(255, 255, 255), 1: RGB(0, 0, 0)])  # disabled
previewlw_3 = CustomPreviewLineweights(Geometry=ln, Shader=gradient_4)  # disabled

# ---- group: CUSTOM PROXIMITY / POINT
lng_2 = ListLength(List=cptree.P)  # -> flatten(Length); disabled
bnd_3 = Bounds(Numbers=lng_2)  # disabled
dedomain_3 = DeconstructDomain(Domain=bnd_3)  # -> Start, End; disabled
gradient_5 = Gradient(LowerLimit=0, UpperLimit=dedomain_3.End, Parameter=lng_2, stops=[0: RGB(255, 255, 255), 1: RGB(0, 0, 0)])  # disabled
preview = CustomPreview(Geometry=flatten(explode.Vertices), Shader=gradient_5)  # disabled

# ---- group: COLOR AND THICKNESS THE LINE ACCORDING TO OVERLAPPING SEGMENTS
pline_3 = PolyLine(Vertices=pt, Closed=False)
explode_2 = Explode(Curve=pline_3, Recursive=True)  # -> flatten(Segments), Vertices; disabled
curvepoint = PointOnCurve(explode_2.Segments, parameter=0.5)  # disabled
cullpt = CullDuplicates(Points=flatten(curvepoint), Tolerance=number_slider_2, CullMode=1)  # -> Points, Indices, Valence; disabled
item_2 = ListItem(List=explode_2.Segments, Index=cullpt.Indices, Wrap=True)  # disabled
bnd_4 = Bounds(Numbers=cullpt.Valence)  # disabled
dedomain_4 = DeconstructDomain(Domain=bnd_4)  # -> Start, End; disabled
gradient_6 = Gradient(
    LowerLimit=0,
    UpperLimit=dedomain_4.End,
    Parameter=cullpt.Valence,
    stops=[0: RGB(64, 64, 64), 0.155: RGB(120, 120, 120), 0.25: RGB(128, 128, 128), 0.802: RGB(255, 255, 255)])  # disabled

# ----
number_slider_3 = Slider(4, range=0..100)  # disabled
number_slider_4 = Slider(1, range=0..2)  # disabled
dom = ConstructDomain(DomainStart=number_slider_4, DomainEnd=number_slider_3)  # disabled
remap = RemapNumbers(Value=cullpt.Valence, Source=bnd_4, Target=dom)  # -> Mapped, Clipped; disabled

# ---- group: COLOR AND THICKNESS THE LINE ACCORDING TO OVERLAPPING SEGMENTS (continued)
previewlw_4 = CustomPreviewLineweights(Geometry=item_2, Shader=gradient_6, Thickness=remap.Mapped)  # disabled
