# Grasshopper definition 20160413_DISCRETE VARIABLES.gh (Grasshopper 0.9.76)
# plug-ins: Anemone, Human, Kangaroo Components, Mesh Pipe

# ----
# reciproCITY
# Alessio Erioli
# Aldo Sollazzo
# Eugenio Bettucchi
# DEFINITIONS BY
discrete_direction = Panel("BUILDING A VECTOR RANGE")

# ---- group: base point
# 15-17 April 2016
pt = Point(Point(0.6371048892, 0.331005476, 0))

# ---- group: dimension
number_slider = Slider(200, range=100..400)
number_slider_2 = Slider(200, range=100..400)

# ---- group: resolution
number_slider_3 = Slider(40, range=10..169)
number_slider_4 = Slider(40, range=10..100)

# ----
panel = Panel("ambient")

# ---- group: ambient
rectangle = Rectangle(Plane=pt, XSize=number_slider, YSize=number_slider_2, Radius=0)  # -> Rectangle, Length
mplane = MeshPlane(Boundary=rectangle.Rectangle, WidthCount=number_slider_3, HeightCount=number_slider_4)  # -> Mesh, Area

# ----
# DISCRETE DIRECTION: GENERATING GRID AND AGENTS
demesh = DeconstructMesh(Mesh=mplane.Mesh)  # -> Vertices, Faces, Colours, Normals
pt_2 = Point(demesh.Vertices)

# ---- group: AGENTS GENERATION
boundary = BoundarySurfaces(Edges=rectangle.Rectangle)
edges = BrepEdges(Brep=boundary)  # -> Naked, Interior, NonManifold
item = ListItem(List=edges.Naked, Index=0, Wrap=True)  # -> Item1, Item

crv_cp = CurveClosestPoint(Point=graft(pt_2), Curve=edges.Naked)  # -> Point, Parameter, Distance
number_slider_5 = Slider(26, range=0..100)
sort = SortList(Keys=crv_cp.Distance)  # -> Keys, ValuesA

# ---- group: AGENTS GENERATION / AGENTS LOCATION
item_2 = ListItem(List=sort.Keys, Index=0, Wrap=True)  # -> flatten(Item)
smaller = SmallerThan(FirstNumber=item_2, SecondNumber=number_slider_5)  # -> SmallerThan, OrEqualTo
cull = CullPattern(List=pt_2, CullPattern=smaller.SmallerThan)
reduce = RandomReduce(List=cull, Reduction=Slider(388, range=0..1000), Seed=1)

# ---- group: FIELD LOCATION
md_slider = MDSlider(
    slider_value=Point(0.3501014709, 0.7533016205, 0.5),
    SliderMode=0,
    x_domain=Domain(0, 1),
    y_domain=Domain(0, 1),
    z_domain=Domain(0, 1))
join = JoinCurves(Curves=edges.Naked, Preserve=False)
evalsrf = EvaluateSurface(Surface=reparameterize(join), Point=md_slider)  # -> Point, Normal, Frame

# ----
number_slider_6 = Slider(45, range=0..1000)

Z = UnitZ(Factor=Slider(27, range=0..100))
move = Move(Geometry=evalsrf.Point, Motion=Z)  # -> Geometry, Transform
number_slider_7 = Slider(158, range=0..1000)

# ---- group: SPINNING FORCE HIGHER QUOTE
number_slider_8 = Slider(50, range=0..50)
cir = Circle(Plane=move.Geometry, Radius=Slider(140, range=0..300))
Z_2 = UnitZ(Factor=number_slider_7)
extr = Extrude(Base=cir, Direction=Z_2)
bbox = BoundingBox(Content=extr, Plane=PlaneXY(0, 0, 0))  # -> Box, Box_2
fspin = SpinForce(Plane=move.Geometry, Strength=1, Radius=Slider(49, range=0..100), Decay=Slider(1.155, range=0..4), Bounds=bbox.Box)

# ---- group: VERTICAL VECTOR
number_slider_9 = Slider(52, range=0..100)
Z_3 = UnitZ(Factor=Slider(0.35, range=0..1))
cir_2 = Circle(Plane=evalsrf.Point, Radius=Slider(51, range=0..100))
Z_4 = UnitZ(Factor=number_slider_7)
move_2 = Move(Geometry=evalsrf.Point, Motion=Z_3)  # -> Geometry, Transform
extr_2 = Extrude(Base=cir_2, Direction=Z_4)
ln = Line(StartPoint=evalsrf.Point, EndPoint=move_2.Geometry)
bbox_2 = BoundingBox(Content=extr_2, Plane=PlaneXY(0, 0, 0))  # -> Box, Box_2
fvector = VectorForce(Line=ln, Bounds=bbox_2.Box)

# ---- group: SPINNING VECTOR
cir_3 = Circle(Plane=evalsrf.Point, Radius=Slider(150, range=0..210))
Z_5 = UnitZ(Factor=Slider(16, range=0..40))
extr_3 = Extrude(Base=cir_3, Direction=Z_5)
bbox_3 = BoundingBox(Content=extr_3, Plane=PlaneXY(0, 0, 0))  # -> Box, Box_2
fspin_2 = SpinForce(Plane=evalsrf.Point, Strength=1, Radius=Slider(20, range=0..100), Decay=Slider(1.283, range=0..4), Bounds=bbox_3.Box)

# ---- group: ATTRACTOR VECTOR
neg = Negative(Value=Slider(1, range=0..1))
pcharge = PointCharge(Point=evalsrf.Point, Charge=neg, Decay=Slider(0.68, range=0..1), Bounds=bbox_3.Box)

# ----
number_slider_10 = Slider(2, range=0..10)
number_slider_11 = Slider(5, range=0..5)
sqgrid = Square(Plane=PlaneXY(0, 0, 0), Size=number_slider_11, ExtentX=number_slider_10, ExtentY=number_slider_10)  # -> Cells, flatten(Points)
avr = Average(Input=sqgrid.Points)
explode = Explode(Curve=sqgrid.Cells, Recursive=True)  # -> Segments, flatten(Vertices)
series = Series(Start=0, Step=number_slider_11, Count=Slider(3, range=0..10))
cullpt = CullDuplicates(Points=explode.Vertices, Tolerance=0.1, CullMode=3)  # -> Points, Indices, Valence
Z_6 = UnitZ(Factor=series)
move_3 = Move(Geometry=cullpt.Points, Motion=graft(Z_6))  # -> flatten(Geometry), Transform
avr_2 = Average(Input=move_3.Geometry)
ln_2 = Line(StartPoint=avr_2, EndPoint=move_3.Geometry)
dupln = RemoveDuplicateLines(Lines=ln_2, Tolerance=0.01)
len = Length(Curve=dupln)
toggle = BooleanToggle(False)
sort_2 = SortList(Keys=len, ValuesA=dupln)  # -> Keys, ValuesA
shift = ShiftList(List=sort_2.ValuesA, Shift=1, Wrap=toggle)

shift_2 = ShiftList(List=sort_2.Keys, Shift=1, Wrap=toggle)

amp = Amplitude(Vector=shift, Amplitude=shift_2)
line = LineSDL(Start=avr_2, Direction=amp, Length=shift_2)
group = Group(Objects=line)

pt_3 = Point(reduce)
pt_4 = Point(pt_3)

lng = ListLength(List=pt_3)

range = Range(Domain=Domain(0, 1), Steps=expr("x-1", lng))
gradient = Gradient(LowerLimit=0, UpperLimit=1, Parameter=range, stops=[0: RGB(0, 0, 0), 1: RGB(255, 255, 255)])
rndvecs = RandomVectorS(N=lng, L="1.3", planar=Toggle(True))  # -> out, V; inputs N: Int32, planar: Boolean
# ---------- rndvecs: C# ----------
    String eol = Environment.NewLine;
    Component.Name = "Random Vector(s)";
    Component.NickName = "RndVecs";
    Component.Description = "Generates random vectors in a range of lengths" + eol + "planar forces them to XY plane";
    Component.Params.Input[0].NickName = "N";
    Component.Params.Input[0].Name = "Vectors number";
    Component.Params.Input[1].NickName = "L";
    Component.Params.Input[1].Name = "Lengths range";
    Component.Params.Input[2].NickName = "planar";
    Component.Params.Input[2].Name = "planar vectors";
    rnd = new Random();
    List<Vector3d> vecs = new List<Vector3d>();
    Vector3d vn;
    for (int i = 0; i < N; i++){
      vn = new Vector3d(1 - 2 * rnd.NextDouble(), 1 - 2 * rnd.NextDouble(), (!planar) ? 1 - 2 * rnd.NextDouble() : 0);
      vn.Unitize();
      vn *= L.ParameterAt(rnd.NextDouble());
      vecs.Add(vn);
    }
    V = vecs;
# ---------- rndvecs: C# additional code ----------
  Random rnd;
# ---------- end rndvecs ----------

vec = Vector(flatten(rndvecs.V))
col = Colour(flatten(gradient))

merge = Merge(Data1=simplify(graft(pt_3)), Data2=simplify(graft(vec)), Data3=simplify(graft(col)), Data4=simplify(graft(pt_4)))

group_2 = Group(Objects=merge)

loop_start = LoopStart(Repeat=number_slider_6, Trigger=Button(), Data=group_2)  # -> port, Counter, Data
panel_2 = Panel(loop_start.Counter)

ungroup = Ungroup(Group=loop_start.Data)  # -> simplify(Objects)
split = SplitList(List=ungroup, Index="3")  # -> ListA, ListB
list_item = ListItem(List=split.ListA, Index=0, Wrap=True)  # -> Item, Item1, Item2

# ---- group: MERGE VECTOR FIELDS
mergef = MergeFields(Fields=flatten([pcharge, fvector, fspin_2, fspin]))
pt_5 = Point(simplify(list_item.Item))
evf = EvaluateField(Field=mergef, Point=simplify(pt_5))  # -> Tensor, Strength

# ---- group: DISCRETIZATION APPLIED TO ALL AGENTS
vec2pt = Vector2Pt(PointA=avr_2, PointB=flatten(list_item.Item), Unitize=False)  # -> Vector, Length
move_4 = Move(Geometry=group, Motion=graft(vec2pt.Vector))  # -> simplify(Geometry), Transform
ungroup_2 = Ungroup(Group=move_4.Geometry)  # -> simplify(Objects)
len_2 = Length(Curve=ungroup_2)
amp_2 = Amplitude(Vector=ungroup_2, Amplitude=len_2)

# ----
addition = Addition(A=evf.Tensor)

# ---- group: DISCRETIZATION APPLIED TO ALL AGENTS
angle = Angle(VectorA=addition, VectorB=amp_2)  # -> Angle, Reflex
sort_3 = SortList(Keys=simplify(angle.Angle), ValuesA=amp_2)  # -> Keys, ValuesA
item_3 = ListItem(List=sort_3.ValuesA, Index=0, Wrap=True)

# ----
item_4 = ListItem(List=amp_2, Index=Slider(9, range=0..10), Wrap=True)

# ---- group: VERTICAL VECTOR
boxprop = BoxProperties(Box=bbox.Box)  # -> Center, Diagonal, Area, Volume, Degeneracy
pt_6 = Point(list_item.Item)
pdecon = Deconstruct(Point=pt_6)  # -> XComponent, YComponent, ZComponent
pdecon_2 = Deconstruct(Point=boxprop.Center)  # -> XComponent, YComponent, ZComponent
smaller_2 = SmallerThan(FirstNumber=pdecon.ZComponent, SecondNumber=pdecon_2.ZComponent)  # -> simplify(SmallerThan), OrEqualTo

# ---- group: VERTICAL VECTOR / VECTOR REPLACING CONDITION
p_n_c = PickNChoose(Pattern=smaller_2.SmallerThan, Stream0=item_4, Stream1=item_3)

# ----
col_2 = Colour(list_item.Item2)
equals = Equality(FirstNumber=loop_start.Counter, SecondNumber=number_slider_6)  # -> Equality, Inequality

move_5 = Move(Geometry=list_item.Item, Motion=p_n_c)  # -> Geometry, Transform

merge_2 = Merge(Data1=simplify(split.ListB), Data2=simplify(move_5.Geometry))

merge_3 = Merge(Data1=simplify(move_5.Geometry), Data2=simplify(addition), Data3=simplify(col_2), Data4=simplify(merge_2))
group_3 = Group(Objects=merge_3)

loop_end = LoopEnd(port=loop_start.port, Exit=False, Data=simplify(group_3), pausedState=False, state="Constant output", TimeOutVal=0)

# ---- group: GENERATING TRAIL FROM RECORDED HISTORY
ungroup_3 = Ungroup(Group=loop_end)  # -> simplify(Objects)

# ----
split_2 = SplitList(List=ungroup_3, Index="3")  # -> ListA, ListB
pline = PolyLine(Vertices=split_2.ListB, Closed=False)  # -> simplify(Polyline)
item_5 = ListItem(List=split_2.ListA, Index=0, Wrap=True)  # -> Item, Item1, Item2
pt_7 = Point(item_5.Item)
gate = StreamGate(Stream=pline, Gate=equals.Equality)  # -> Target0, Target1
preview = CustomPreview(Geometry=gate.Target0, Shader=ColourSwatch(SwatchColor=RGB(46, 170, 219)))

# ---- group: MESHING TRAIL
mpipe = MeshPipe(
    Curve=gate.Target1,
    Radius=Slider(2, range=0..2.5),
    Accuracy=0.2,
    Rotation=0,
    Segments=Slider(4, range=0..10),
    Caps=Slider(0, range=0..1))

# ---- group: COLOR THE LINE ACCORDING TO OVERLAPPING SEGMENTS
explode_2 = Explode(Curve=gate.Target1, Recursive=True)  # -> flatten(Segments), Vertices
curvepoint = PointOnCurve(explode_2.Segments, parameter=0.5)
cullpt_2 = CullDuplicates(Points=flatten(curvepoint), Tolerance=Slider(0.01, range=0..0.01), CullMode=1)  # -> Points, Indices, Valence
item_6 = ListItem(List=explode_2.Segments, Index=cullpt_2.Indices, Wrap=True)
bnd = Bounds(Numbers=cullpt_2.Valence)
dedomain = DeconstructDomain(Domain=bnd)  # -> Start, End
gradient_2 = Gradient(
    LowerLimit=0,
    UpperLimit=dedomain.End,
    Parameter=cullpt_2.Valence,
    stops=[0.0886: RGB(71, 71, 71), 0.36: RGB(128, 128, 128), 0.802: RGB(255, 255, 255)])
number_slider_12 = Slider(3, range=0..10)
swatch = ColourSwatch(SwatchColor=RGB(255, 255, 255))

# ----
dom = ConstructDomain(DomainStart=Slider(1, range=0..2), DomainEnd=Slider(4, range=0..100))
remap = RemapNumbers(Value=cullpt_2.Valence, Source=bnd, Target=dom)  # -> Mapped, Clipped

# ---- group: COLOR THE LINE ACCORDING TO OVERLAPPING SEGMENTS (continued)
previewlw = CustomPreviewLineweights(Geometry=item_6, Shader=gradient_2, Thickness=remap.Mapped)
