# Grasshopper definition 20160413_DISCRETE VARIABLES_interconnected.gh (Grasshopper 0.9.76)
# plug-ins: Heteroptera, Anemone, Human, Kangaroo Components, Weaverbird, Mesh Pipe

# ----
# reciproCITY
# Alessio Erioli
# Aldo Sollazzo
# Eugenio Bettucchi
# DEFINITIONS BY
discrete_direction = Panel("BUILDING A VECTOR RANGE")

# ---- group: base point
# 15-17 April 2016
pt = Point(Point(0.6371048892, 0.331005476, 0))

# ---- group: dimension
number_slider = Slider(200, range=100..400)
number_slider_2 = Slider(200, range=100..400)

# ---- group: resolution
number_slider_3 = Slider(40, range=10..169)
number_slider_4 = Slider(40, range=10..100)

# ----
panel = Panel("ambient")

# ---- group: ambient
rectangle = Rectangle(Plane=pt, XSize=number_slider, YSize=number_slider_2, Radius=0)  # -> Rectangle, Length
mplane = MeshPlane(Boundary=rectangle.Rectangle, WidthCount=number_slider_3, HeightCount=number_slider_4)  # -> Mesh, Area

# ----
# DISCRETE DIRECTION: GENERATING GRID AND AGENTS
demesh = DeconstructMesh(Mesh=mplane.Mesh)  # -> Vertices, Faces, Colours, Normals
pt_2 = Point(demesh.Vertices)

# ---- group: AGENTS GENERATION
boundary = BoundarySurfaces(Edges=rectangle.Rectangle)
edges = BrepEdges(Brep=boundary)  # -> Naked, Interior, NonManifold
item = ListItem(List=edges.Naked, Index=0, Wrap=True)  # -> Item1, Item

crv_cp = CurveClosestPoint(Point=graft(pt_2), Curve=edges.Naked)  # -> Point, Parameter, Distance
number_slider_5 = Slider(26, range=0..100)
sort = SortList(Keys=crv_cp.Distance)  # -> Keys, ValuesA

# ---- group: AGENTS GENERATION / AGENTS LOCATION
item_2 = ListItem(List=sort.Keys, Index=0, Wrap=True)  # -> flatten(Item)
smaller = SmallerThan(FirstNumber=item_2, SecondNumber=number_slider_5)  # -> SmallerThan, OrEqualTo
cull = CullPattern(List=pt_2, CullPattern=smaller.SmallerThan)
reduce = RandomReduce(List=cull, Reduction=Slider(388, range=0..1000), Seed=1)

# ---- group: FIELD LOCATION
md_slider = MDSlider(
    slider_value=Point(0.3501014709, 0.7533016205, 0.5),
    SliderMode=0,
    x_domain=Domain(0, 1),
    y_domain=Domain(0, 1),
    z_domain=Domain(0, 1))
join = JoinCurves(Curves=edges.Naked, Preserve=False)
evalsrf = EvaluateSurface(Surface=reparameterize(join), Point=md_slider)  # -> Point, Normal, Frame

# ----
number_slider_6 = Slider(45, range=0..1000)

Z = UnitZ(Factor=Slider(27, range=0..100))
move = Move(Geometry=evalsrf.Point, Motion=Z)  # -> Geometry, Transform
number_slider_7 = Slider(158, range=0..1000)

# ---- group: SPINNING FORCE HIGHER QUOTE
number_slider_8 = Slider(50, range=0..50)
cir = Circle(Plane=move.Geometry, Radius=Slider(140, range=0..300))
Z_2 = UnitZ(Factor=number_slider_7)
extr = Extrude(Base=cir, Direction=Z_2)
bbox = BoundingBox(Content=extr, Plane=PlaneXY(0, 0, 0))  # -> Box, Box_2
fspin = SpinForce(Plane=move.Geometry, Strength=1, Radius=Slider(49, range=0..100), Decay=Slider(1.155, range=0..4), Bounds=bbox.Box)

# ---- group: VERTICAL VECTOR
number_slider_9 = Slider(52, range=0..100)
Z_3 = UnitZ(Factor=Slider(0.35, range=0..1))
cir_2 = Circle(Plane=evalsrf.Point, Radius=Slider(51, range=0..100))
Z_4 = UnitZ(Factor=number_slider_7)
move_2 = Move(Geometry=evalsrf.Point, Motion=Z_3)  # -> Geometry, Transform
extr_2 = Extrude(Base=cir_2, Direction=Z_4)
ln = Line(StartPoint=evalsrf.Point, EndPoint=move_2.Geometry)
bbox_2 = BoundingBox(Content=extr_2, Plane=PlaneXY(0, 0, 0))  # -> Box, Box_2
fvector = VectorForce(Line=ln, Bounds=bbox_2.Box)

# ---- group: SPINNING VECTOR
cir_3 = Circle(Plane=evalsrf.Point, Radius=Slider(150, range=0..210))
Z_5 = UnitZ(Factor=Slider(16, range=0..40))
extr_3 = Extrude(Base=cir_3, Direction=Z_5)
bbox_3 = BoundingBox(Content=extr_3, Plane=PlaneXY(0, 0, 0))  # -> Box, Box_2
fspin_2 = SpinForce(Plane=evalsrf.Point, Strength=1, Radius=Slider(20, range=0..100), Decay=Slider(1.283, range=0..4), Bounds=bbox_3.Box)

# ---- group: ATTRACTOR VECTOR
neg = Negative(Value=Slider(1, range=0..1))
pcharge = PointCharge(Point=evalsrf.Point, Charge=neg, Decay=Slider(0.68, range=0..1), Bounds=bbox_3.Box)

# ----
ang = Slider(-90, range=-90..90)
ang_2 = Slider(-30, range=-100..100)
rad = Radians(Degrees=ang)
rad_2 = Radians(Degrees=ang_2)
dom = ConstructDomain(DomainStart=Slider(0, range=0..30), DomainEnd=Slider(8, range=0..100))
dom_2 = ConstructDomain(DomainStart=rad, DomainEnd=rad_2)
Z_6 = UnitZ(Factor=1)
X = UnitX(Factor=1)

number_slider_10 = Slider(2, range=0..10)
number_slider_11 = Slider(5, range=0..5)
sqgrid = Square(Plane=PlaneXY(0, 0, 0), Size=number_slider_11, ExtentX=number_slider_10, ExtentY=number_slider_10)  # -> Cells, flatten(Points)
avr = Average(Input=sqgrid.Points)
explode = Explode(Curve=sqgrid.Cells, Recursive=True)  # -> Segments, flatten(Vertices)
series = Series(Start=0, Step=number_slider_11, Count=Slider(3, range=0..10))
cullpt = CullDuplicates(Points=explode.Vertices, Tolerance=0.1, CullMode=3)  # -> Points, Indices, Valence
Z_7 = UnitZ(Factor=series)
move_3 = Move(Geometry=cullpt.Points, Motion=graft(Z_7))  # -> flatten(Geometry), Transform
avr_2 = Average(Input=move_3.Geometry)
ln_2 = Line(StartPoint=avr_2, EndPoint=move_3.Geometry)
dupln = RemoveDuplicateLines(Lines=ln_2, Tolerance=0.01)
len = Length(Curve=dupln)
toggle = BooleanToggle(False)
sort_2 = SortList(Keys=len, ValuesA=dupln)  # -> Keys, ValuesA
shift = ShiftList(List=sort_2.ValuesA, Shift=1, Wrap=toggle)

shift_2 = ShiftList(List=sort_2.Keys, Shift=1, Wrap=toggle)

amp = Amplitude(Vector=shift, Amplitude=shift_2)
line = LineSDL(Start=avr_2, Direction=amp, Length=shift_2)
group = Group(Objects=line)

col = Colour(flatten([RGB(11, 196, 239), RGB(2, 61, 71), RGB(7, 92, 109), RGB(8, 179, 228), RGB(0, 30, 48), RGB(2, 135, 246), RGB(2, 49, 80), RGB(1, 32, 46), RGB(4, 80, 155), RGB(3, 107, 151)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]))
pt_3 = Point(reduce)
pt_4 = Point(pt_3)

lng = ListLength(List=pt_3)
rnd_vector = RandomVector(Number=lng, Lenght="1.3", isflat=True)

vec = Vector(flatten(rnd_vector))

merge = Merge(Data1=simplify(graft(pt_3)), Data2=simplify(graft(vec)), Data3=simplify(graft(col)), Data4=simplify(graft(pt_4)))

group_2 = Group(Objects=merge)

loop_start = LoopStart(Repeat=number_slider_6, Trigger=Button(), Data=group_2)  # -> port, Counter, Data
panel_2 = Panel(loop_start.Counter)

ungroup = Ungroup(Group=loop_start.Data)  # -> simplify(Objects)
split = SplitList(List=ungroup, Index="3")  # -> ListA, ListB
list_item = ListItem(List=split.ListA, Index=0, Wrap=True)  # -> Item, Item1, Item2

# ---- group: MERGE VECTOR FIELDS
mergef = MergeFields(Fields=flatten([pcharge, fvector, fspin_2, fspin]))
pt_5 = Point(simplify(list_item.Item))
evf = EvaluateField(Field=mergef, Point=simplify(pt_5))  # -> Tensor, Strength

# ---- group: DISCRETIZATION APPLIED TO ALL AGENTS
vec2pt = Vector2Pt(PointA=avr_2, PointB=flatten(list_item.Item), Unitize=False)  # -> Vector, Length
move_4 = Move(Geometry=group, Motion=graft(vec2pt.Vector))  # -> simplify(Geometry), Transform
ungroup_2 = Ungroup(Group=move_4.Geometry)  # -> simplify(Objects)
len_2 = Length(Curve=ungroup_2)
amp_2 = Amplitude(Vector=ungroup_2, Amplitude=len_2)

# ----
addition = Addition(A=evf.Tensor)

# ---- group: DISCRETIZATION APPLIED TO ALL AGENTS
angle = Angle(VectorA=addition, VectorB=amp_2)  # -> Angle, Reflex
sort_3 = SortList(Keys=simplify(angle.Angle), ValuesA=amp_2)  # -> Keys, ValuesA
item_3 = ListItem(List=sort_3.ValuesA, Index=0, Wrap=True)

# ----
item_4 = ListItem(List=amp_2, Index=Slider(9, range=0..10), Wrap=True)

# ---- group: VERTICAL VECTOR
boxprop = BoxProperties(Box=bbox.Box)  # -> Center, Diagonal, Area, Volume, Degeneracy
pt_6 = Point(list_item.Item)
pdecon = Deconstruct(Point=pt_6)  # -> XComponent, YComponent, ZComponent
pdecon_2 = Deconstruct(Point=boxprop.Center)  # -> XComponent, YComponent, ZComponent
smaller_2 = SmallerThan(FirstNumber=pdecon.ZComponent, SecondNumber=pdecon_2.ZComponent)  # -> simplify(SmallerThan), OrEqualTo

# ---- group: VERTICAL VECTOR / VECTOR REPLACING CONDITION
p_n_c = PickNChoose(Pattern=smaller_2.SmallerThan, Stream0=item_4, Stream1=item_3)

# ----
col_2 = Colour(list_item.Item2)
equals = Equality(FirstNumber=loop_start.Counter, SecondNumber=number_slider_6)  # -> Equality, Inequality

move_5 = Move(Geometry=list_item.Item, Motion=p_n_c)  # -> Geometry, Transform

merge_2 = Merge(Data1=simplify(split.ListB), Data2=simplify(move_5.Geometry))

merge_3 = Merge(Data1=simplify(move_5.Geometry), Data2=simplify(addition), Data3=simplify(col_2), Data4=simplify(merge_2))
group_3 = Group(Objects=merge_3)

loop_end = LoopEnd(port=loop_start.port, Exit=False, Data=simplify(group_3), pausedState=False, state="Constant output", TimeOutVal=0)

# ---- group: GENERATING TRAIL FROM RECORDED HISTORY
ungroup_3 = Ungroup(Group=loop_end)  # -> simplify(Objects)

# ----
split_2 = SplitList(List=ungroup_3, Index="3")  # -> ListA, ListB
pline = PolyLine(Vertices=split_2.ListB, Closed=False)  # -> simplify(Polyline)
crv = Curve(flatten(pline))
item_5 = ListItem(List=split_2.ListA, Index=0, Wrap=True)  # -> Item, Item1, Item2
reduce_2 = RandomReduce(List=crv, Reduction="350", Seed=1)
pt_7 = Point(item_5.Item)
explode_2 = Explode(Curve=crv, Recursive=True)  # -> Segments, simplify(Vertices)
gate = StreamGate(Stream=pline, Gate=equals.Equality)  # -> Target0, Target1
preview = CustomPreview(Geometry=pline, Shader=ColourSwatch(SwatchColor=RGB(46, 170, 219)))

# ---- group: MESHING TRAIL
mpipe = MeshPipe(
    Curve=gate.Target1,
    Radius=Slider(2, range=0..2.5),
    Accuracy=0.2,
    Rotation=0,
    Segments=Slider(4, range=0..10),
    Caps=Slider(0, range=0..1))

# ----
c_script = CSharpScript(d=dom, a=dom_2, Ptree=explode_2.Vertices)  # -> out, P, T; inputs Ptree: tree of Point3d
# ---------- c_script: C# ----------
    /*
    System.Threading.Tasks.Parallel.ForEach(Ptree.AllData(), p => {
    });
    */

    Point3d p, p1;
    Vector3d v;
    GH_Path pa;
    double ang, amin, amax,dist, dmin, dmax;
    amin = a.ParameterAt(0);
    amax = a.ParameterAt(1);
    dmin = d.ParameterAt(0);
    dmax = d.ParameterAt(1);

    // System.Collections.Concurrent.ConcurrentBag<Line> conn = new System.Collections.Concurrent.ConcurrentBag<Line>();
    DataTree<Vector3d> vecs = new DataTree<Vector3d>();
    DataTree<Point3d> conT = new DataTree<Point3d> ();
    DataTree<String> topo = new DataTree<String> ();

    // create vectors


    for (int i = 0; i < Ptree.BranchCount; i++){
      for (int j = 0; j < Ptree.Branch(i).Count - 1; j++){
        v = Vector3d.Subtract((Vector3d) Ptree.Branch(i)[j + 1], (Vector3d) Ptree.Branch(i)[j]);
        v.Unitize();
        vecs.Add(v, new GH_Path(Ptree.Path(i)));
      }

      vecs.Add(vecs.Branch(i)[vecs.Branch(i).Count - 1], new GH_Path(Ptree.Path(i)));
    }

    //List <Line> conn = new List<Line>();

    //System.Threading.Tasks.Parallel.For(0, Ptree.BranchCount, i => {
    for (int i = 0; i < Ptree.BranchCount; i++){
      for(int r = 0; r < Ptree.Branch(i).Count; r++){
        p = Ptree.Branch(i)[r];
        pa = new GH_Path(new int[]{i,r});
        conT.EnsurePath(pa);
        for (int j = i + 1; j < Ptree.BranchCount; j++){
          for(int k = 0; k < Ptree.Branch(j).Count(); k++){
            p1 = Ptree.Branch(j)[k];
            v = Vector3d.Subtract((Vector3d) p1, (Vector3d) p);
            dist = v.Length;
            v.Unitize();
            //ang = Vector3d.VectorAngle(vecs.Branch(j)[k], v);
            ang = signAng(vecs.Branch(j)[k], v);
            //dist = p.DistanceTo(p1);
            if (dist != 0 && ang > amin && ang < amax && dist > dmin && dist < dmax){
              conT.Add(p1, pa);
              topo.Add(Ptree.Path(j).ToString(false) + "," + Convert.ToString(k), pa);
              //conn.Add(new Line(p, p1));
            }
          }
        }
      }
    }
    //  });
    P = conT;
    T = topo;
# ---------- c_script: C# additional code ----------
  double signAng(Vector3d a, Vector3d b){
    return Math.Atan2((b.Y - a.Y), (b.X - a.X));
  }
# ---------- end c_script ----------
prox = Proximity3D(
    Points=flatten(explode_2.Vertices),
    Group=Slider(1, range=1..2),
    MinRadius=Slider(8, range=0..100),
    MaxRadius=Slider(12, range=0..100))  # -> Links, Topology
prox_2 = Proximity3D(Points=explode_2.Vertices, Group=5, MinRadius=Slider(12.452, range=0..100))  # -> Links, Topology
ln_3 = Line(StartPoint=graft(explode_2.Vertices), EndPoint=c_script.P)
preview_2 = CustomPreview(
    Geometry=prox_2.Links,
    Shader={ambient=RGB(0, 0, 0), diffuse=RGB(255, 105, 180), emission=RGB(76, 32, 54), shine=0.5, specular=RGB(255, 255, 255), transparency=0})

# ---- group: MESHING TRAIL / CLEAN MESH
mjoin = MeshJoin(Meshes=mpipe)
wbjoin = WeaverbirdsJoinMeshesAndWeld(Mesh=mjoin, Weld=False)

# ----
vangsign = VectorAngleWithSign(V1=prox.Links, V2=X)  # -> out, A; inputs V1: Vector3d, V2: Vector3d
# ---------- vangsign: C# ----------
    Component.Name = "Vector Angle with sign";
    Component.NickName = "VAngSign";
    Component.Description = "Computes angle with sign between vectors \n \n v 0.1 (c) Co-de-iT";
    Component.Message = "Angle with Sign \n v 0.1 (c) Co-de-iT";

    V1.Unitize();
    V2.Unitize();
    A = System.Math.Atan2(V2.Y, V2.X) - System.Math.Atan2(V1.Y, V1.X);
# ---------- end vangsign ----------
bar_graph = BarGraph(vangsign.A, BarColor=RGB(255, 0, 90))
larger = LargerThan(FirstNumber=vangsign.A, SecondNumber=0)  # -> LargerThan, OrEqualTo
dispatch = Dispatch(List=prox.Links, DispatchPattern=larger.LargerThan)  # -> ListA, ListB
preview_3 = CustomPreview(
    Geometry=dispatch.ListA,
    Shader={ambient=RGB(0, 0, 0), diffuse=RGB(255, 105, 180), emission=RGB(76, 32, 54), shine=0.5, specular=RGB(255, 255, 255), transparency=0})

# ---- group: COLOR THE LINE ACCORDING TO OVERLAPPING SEGMENTS
explode_3 = Explode(Curve=gate.Target1, Recursive=True)  # -> flatten(Segments), Vertices
curvepoint = PointOnCurve(explode_3.Segments, parameter=0.5)
cullpt_2 = CullDuplicates(Points=flatten(curvepoint), Tolerance=Slider(0.01, range=0..0.01), CullMode=1)  # -> Points, Indices, Valence
item_6 = ListItem(List=explode_3.Segments, Index=cullpt_2.Indices, Wrap=True)
bnd = Bounds(Numbers=cullpt_2.Valence)
dedomain = DeconstructDomain(Domain=bnd)  # -> Start, End
gradient = Gradient(
    LowerLimit=0,
    UpperLimit=dedomain.End,
    Parameter=cullpt_2.Valence,
    stops=[0: RGB(64, 64, 64), 0.155: RGB(120, 120, 120), 0.25: RGB(128, 128, 128), 0.802: RGB(255, 255, 255)])
number_slider_12 = Slider(3, range=0..10)
swatch = ColourSwatch(SwatchColor=RGB(255, 255, 255))

# ----
dom_3 = ConstructDomain(DomainStart=Slider(1, range=0..2), DomainEnd=Slider(4, range=0..100))
remap = RemapNumbers(Value=cullpt_2.Valence, Source=bnd, Target=dom_3)  # -> Mapped, Clipped

# ---- group: COLOR THE LINE ACCORDING TO OVERLAPPING SEGMENTS (continued)
previewlw = CustomPreviewLineweights(Geometry=item_6, Shader=gradient, Thickness=remap.Mapped)
