# Grasshopper definition 20160413_GENERATIVE DIJKSTRA.gh (Grasshopper 0.9.76)
# plug-ins: Anemone, Human, Kangaroo Components, Boid, Weaverbird, Noise 4D, Mesh Pipe, Shortest Walk in Gh

# ---- group: base point
# reciproCITY
# Alessio Erioli
# Aldo Sollazzo
# Eugenio Bettucchi
# DEFINITIONS BY
# EXPLANATION: IN THIS EXAMPLE AGENTS HAS FLOCKING BEHAVIOUR PLUS THEY READ ENVIRONMENT COLOR AND TRANSLATE IT INTO RULES. IN THIS CASE AS THE BRIGHTNESS VALUE INCREASE THEY INCREMENT THEIR HEIGHT. THE TRANSLATION HAPPEN VERTICALLY BECAUSE THE MESH IS PLANAR, BUT THE RULES TAKE THE NORMAL AS VECTOR TO MOVE.
pt = Point(Point(0, 0, 0))

# ---- group: dimension
# 15-17 April 2016
number_slider = Slider(280, range=100..400)
number_slider_2 = Slider(161, range=100..400)

# ----
panel = Panel("ambient")

# ---- group: resolution
number_slider_3 = Slider(30, range=10..30)
number_slider_4 = Slider(30, range=10..30)

# ---- group: ambient
# color mesh generation
rectangle = Rectangle(Plane=pt, XSize=number_slider, YSize=number_slider_2, Radius=0)  # -> Rectangle, Length
mplane = MeshPlane(Boundary=rectangle.Rectangle, WidthCount=number_slider_3, HeightCount=number_slider_4)  # -> Mesh, Area

# ----
demesh = DeconstructMesh(Mesh=mplane.Mesh)  # -> Vertices, Faces, Colours, Normals
perlin = PerlinNoise(Values=demesh.Vertices, Time=Slider(2.27, range=0..10), Scale=Slider(0.0162, range=0..0.1))
gradient = Gradient(LowerLimit="-1", UpperLimit=1, Parameter=perlin, stops=[0: RGB(255, 255, 255), 0.672: RGB(0, 0, 0)])
agents = Slider(100, range=0..100)
popgeo = PopulateGeometry(Geometry=mplane.Mesh, Count=agents, Seed=1)
conmesh = ConstructMesh(Vertices=demesh.Vertices, Faces=demesh.Faces, Colours=gradient)
mblur = BlurMesh(Mesh=conmesh, Iterations=Slider(1, range=0..10))

vec = VectorXYZ(XComponent=0, YComponent=0, ZComponent=0)  # -> Vector, Length
iterations = Slider(100, range=0..100)

# ---- group: POINTS / VECTORS / MESH
pt_2 = Point(flatten(popgeo))
mesh = Mesh(mblur)

# ----
lng = ListLength(List=pt_2)
repeat = RepeatData(Data=vec.Vector, Length=lng)  # -> simplify(Data)

# ---- group: POINTS / VECTORS / MESH (continued)
vec_2 = Vector(repeat)

# ----
merge = Merge(Data1=simplify(graft(pt_2)), Data2=simplify(graft(vec_2)))

group = Group(Objects=merge)

# ---- group: READ COLOR
mesh_2 = Mesh(mesh)
demesh_2 = DeconstructMesh(Mesh=mesh_2)  # -> Vertices, Faces, Colours, Normals

# ----
stop = BooleanToggle(True)
loop_start = LoopStart(Repeat=iterations, Data=group)  # -> port, Counter, Data
panel_2 = Panel(loop_start.Counter)
ungroup = Ungroup(Group=loop_start.Data)
item = ListItem(List=ungroup, Index=0, Wrap=True)  # -> Item, Item1

pt_3 = Point(flatten(item.Item))
vec_3 = Vector(item.Item1)

# ---- group: READ COLOR
pt_4 = Point(pt_3)
pdecon = Deconstruct(Point=pt_4)  # -> XComponent, YComponent, ZComponent
pt_5 = ConstructPoint(XCoordinate=pdecon.XComponent, YCoordinate=pdecon.YComponent, ZCoordinate=0)

# ---- group: VECTORS
pt_6 = Point(pt_3)

# ---- group: VECTORS / SEPARATION
dom = ConstructDomain(DomainStart=0, DomainEnd=Slider(10, range=0..100))
repulse = RepulseFromTheFlock(AgentLocationPoint=pt_6, LocationPointsOfTheFlock=pt_6, SearchDistance=dom, Multiplier=Slider(0.2, range=0..1))

# ---- group: VECTORS / COHESION
dom_2 = ConstructDomain(DomainStart=0, DomainEnd=Slider(20, range=0..100))
adhere = AhereToTheFlockCenter(
    AgentLocationPoint=pt_6,
    LocationPointsOfTheFlock=pt_6,
    SearchDistance=dom_2,
    ReferenceAgentsCount=Slider(20, range=0..100),
    Multiplier=Slider(0.04, range=0..1))

# ---- group: READ COLOR
closest_mesh_vertex = Slider(40, range=0..40)
cps = ClosestPoints(Point=pt_5, Cloud=demesh_2.Vertices, Count=closest_mesh_vertex)  # -> simplify(ClosestPoint), CPIndex, Distance

color = ListItem(List=demesh_2.Colours, Index=cps.CPIndex, Wrap=True)  # -> simplify(Item)
vertex = ListItem(List=demesh_2.Vertices, Index=cps.CPIndex, Wrap=True)  # -> simplify(Item)
normal = ListItem(List=demesh_2.Normals, Index=cps.CPIndex, Wrap=True)  # -> simplify(Item)

# using grayscale so each is the same
graysca = SplitARGB(Colour=color)  # -> Alpha, Red, Green, Blue

sort = SortList(Keys=graysca.Red, ValuesA=vertex, ValuesB=normal)  # -> Keys, ValuesA, ValuesB
item_2 = ListItem(List=sort.Keys, Index=0, Wrap=True)  # -> Item1, Item

# ---- group: VECTORS / MOVE IN THE DIRECTION OF DETECTED COLOR
panel_3 = Panel("""follow color
i = black
-i = white""")
item_3 = ListItem(List=sort.ValuesA, Index=0, Wrap=True)  # -> Item1, Item

# ---- group: VECTORS / MOVE NORMAL TO MESH RELATED TO DETECTED COLOR
move_normal_from_mesh = Slider(0.933, range=0..2)
item_4 = ListItem(List=sort.ValuesB, Index=0, Wrap=True)  # -> Item1, Item
multiplication = Multiplication(A=item_2.Item1, B=move_normal_from_mesh)
amp = Amplitude(Vector=item_4.Item1, Amplitude=multiplication)  # -> flatten(Vector)

# ---- group: VECTORS / MOVE IN THE DIRECTION OF DETECTED COLOR
pt_7 = Point(pt_4)
meshcp = MeshClosestPoint(Point=pt_7, Mesh=mesh_2)  # -> Point, Index, Parameter
color_influence = Slider(1, range=0..1)
vec2pt = Vector2Pt(PointA=simplify(graft(meshcp.Point)), PointB=item_3.Item1, Unitize="true")  # -> flatten(Vector), Length
amp_2 = Amplitude(Vector=vec2pt.Vector, Amplitude=color_influence)

# ---- group: COLOR TRESHOLD
tolerance_for_stop_follow_color = Slider(0.95, range=0..1)
lng_2 = ListLength(List=amp_2)
vec_4 = Vector(Vector(0, 0, 0))
larger = LargerThan(FirstNumber=item_2.Item1, SecondNumber=tolerance_for_stop_follow_color)  # -> flatten(LargerThan), OrEqualTo
repeat_2 = RepeatData(Data=vec_4, Length=lng_2)
p_n_c = PickNChoose(Pattern=larger.LargerThan, Stream0=amp_2, Stream1=repeat_2)

# ----
addition = Addition(A=simplify(graft(p_n_c)), B=simplify(graft(amp)), C=simplify(graft(adhere)), D=simplify(graft(repulse)))  # -> flatten(Result)
vec_5 = Vector(addition)

pt_8 = Point(pt_3)
move = Move(Geometry=pt_8, Motion=vec_5)  # -> Geometry, Transform
merge_2 = Merge(Data1=graft(move.Geometry), Data2=graft(vec_5))
group_2 = Group(Objects=merge_2)
loop_end = LoopEnd(port=loop_start.port, Exit=stop, Data=flatten(group_2), pausedState=False, state="Constant & Record", TimeOutVal=0)  # -> simplify(Data)

# ---- group: motion vector
vdis = VectorDisplay(Anchor=pt_3, Vector=vec_5)

# ----
flip = FlipMatrix(Data=loop_end)
ungroup_2 = Ungroup(Group=flip)  # -> simplify(Objects)
item_5 = ListItem(List=ungroup_2, Index=0, Wrap=True)
pshift = ShiftPaths(Data=item_5, Offset=-1)
pline = PolyLine(Vertices=pshift, Closed=False)
dam = DataDam(DataA=pshift, BufferDelay=10000000, BufferMode=0)
clean = CleanTree(RemoveNulls=True, RemoveInvalid=True, RemoveEmpty=True, Tree=dam)

# ---- group: GRID / OCTREE
oct = OcTree(Points=flatten(clean), Square=Toggle(True), Group=Slider(10, range=0..10))  # -> Boxes, Points
smesh = SimpleMesh(Brep=oct.Boxes)
mjoin = MeshJoin(Meshes=smesh)
diag = Diagonalize(Mesh=mjoin)
wbedges = WeaverbirdsMeshEdges(MeshOrPolylines=mjoin)
wbedges_2 = WeaverbirdsMeshEdges(MeshOrPolylines=diag)

# ---- group: PATH TO APPROXIMATE
pline_2 = PolyLine(Vertices=clean, Closed=False)
redpline = Reduce(Polyline=pline_2, Tolerance=Slider(1, range=0..10))  # -> flatten(Polyline), Reduction
end = EndPoints(Curve=pline_2)  # -> Start, End

# ---- group: PATH TO APPROXIMATE / SIMPLIFIED PATH
explode = Explode(Curve=redpline.Polyline, Recursive=True)  # -> simplify(Segments), Vertices

# ---- group: PATH TO APPROXIMATE / SIMPLIFIED PATH STRAIGHT
ln = Line(StartPoint=end.Start, EndPoint=end.End)  # -> flatten(Line)

# ----
shortwalk = ShortestWalk(Curves=wbedges_2, WantedPath=ln)  # -> ShortestWalk, Succession, Direction, Length

# ---- group: DETECT OVERLAP
explode_2 = Explode(Curve=shortwalk.ShortestWalk, Recursive=True)  # -> flatten(Segments), Vertices
curvepoint = PointOnCurve(explode_2.Segments, parameter=0.5)
cullpt = CullDuplicates(Points=curvepoint, Tolerance=0.1, CullMode=1)  # -> Points, Indices, Valence
bnd = Bounds(Numbers=cullpt.Valence)
item_6 = ListItem(List=explode_2.Segments, Index=cullpt.Indices, Wrap=True)
dom_3 = ConstructDomain(DomainStart=Slider(0.3, range=0..5), DomainEnd=Slider(3.4, range=0..10))
remap = RemapNumbers(Value=cullpt.Valence, Source=bnd, Target=dom_3)  # -> Mapped, Clipped
previewlw = CustomPreviewLineweights(Geometry=item_6, Shader=ColourSwatch(SwatchColor=RGB(255, 255, 255)), Thickness=remap.Mapped)

# ----
bbox = BoundingBox(Content=flatten(oct.Boxes), Plane=PlaneXY(0, 0, 0), UnionBox=True)  # -> Box, Box_2
wires = BrepWireframe(Brep=bbox.Box, Density=-1)
dash = DashPattern(Curve=wires, Pattern=Slider(2, range=0..2))  # -> Dashes, Gaps
dash_2 = DashPattern(Curve=wbedges, Pattern=Slider(0.6, range=0..2))  # -> Dashes, Gaps
preview = CustomPreview(Geometry=dash.Dashes, Shader=ColourSwatch(SwatchColor=RGB(191, 191, 191)))
preview_2 = CustomPreview(Geometry=dash_2.Dashes, Shader=ColourSwatch(SwatchColor=RGB(48, 48, 48)))

mpipe = MeshPipe(Curve=item_6, Radius=remap.Mapped, Accuracy=0.2, Rotation=0, Segments=Slider(3, range=0..10), Caps=2)
