# Grasshopper definition 20160405_RADBASED_03.gh (Grasshopper 0.9.76)
# plug-ins: MeshEdit Components, Anemone, Kangaroo Components, Boid

follow_color = Slider(1, range=0..1)
closest_mesh_vertex = Slider(40, range=0..40)
tolerance_for_stop_follow_color = Slider(0.75, range=0..1)

mesh = Mesh([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])
mjoin = MeshJoin(Meshes=mesh)
demesh = DeconstructMesh(Mesh=mjoin)  # -> Vertices, Faces, Colours, Normals
argb = SplitARGB(Colour=demesh.Colours)  # -> Alpha, Red, Green, Blue
pt = Point(demesh.Colours)
pdecon = Deconstruct(Point=pt)  # -> XComponent, YComponent, ZComponent
bnd = Bounds(Numbers=pdecon.ZComponent)
dedomain = DeconstructDomain(Domain=bnd)  # -> Start, End
gradient = Gradient(
    LowerLimit=dedomain.Start,
    UpperLimit=dedomain.End,
    Parameter=pdecon.ZComponent,
    stops=[0: RGB(255, 255, 255), 1: RGB(0, 0, 0)])
conmesh = ConstructMesh(Vertices=demesh.Vertices, Faces=demesh.Faces, Colours=gradient)

mesh_2 = Mesh(conmesh)
demesh_2 = DeconstructMesh(Mesh=mesh_2)  # -> Vertices, Faces, Colours, Normals

crv = Curve(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)
number_slider = Slider(100, range=0..100)
pop2d = Populate2D(Region=crv, Count=Slider(50, range=0..100), Seed=1)  # -> graft(Population)
lng = ListLength(List=flatten(pop2d))
repeat = RepeatData(Data=Slider(0, range=0..10), Length=lng)
vec = VectorXYZ(XComponent=repeat, YComponent=0, ZComponent=0)  # -> unitize(graft(Vector)), Length

loop_start = LoopStart(N=Slider(100, range=0..1000), D0=simplify(pop2d), D1=simplify(vec.Vector))  # -> port, Counter, Data, Data_2
panel = Panel(loop_start.Counter)
item = ListItem(List=loop_start.Data, Index="-1", Wrap=True)

repulse = RepulseFromTheFlock(
    AgentLocationPoint=flatten(item),
    LocationPointsOfTheFlock=demesh.Vertices,
    SearchDistance=Slider(6, range=0..40),
    Multiplier=Slider(1, range=0..2))  # -> simplify(graft(VectorAwayFromTheClosestAgent))

adhere = AhereToTheFlockCenter(
    AgentLocationPoint=flatten(item),
    LocationPointsOfTheFlock=flatten(item),
    SearchDistance=Slider(20, range=0.2..20),
    ReferenceAgentsCount="20",
    Multiplier=Slider(0.1, range=0..1))  # -> simplify(graft(VectorToTheCenterOfTheFlock))

repulse_2 = RepulseFromTheFlock(
    AgentLocationPoint=flatten(item),
    LocationPointsOfTheFlock=flatten(item),
    SearchDistance=Slider(2, range=0..10),
    Multiplier=Slider(0.6, range=0..1))  # -> graft(VectorAwayFromTheClosestAgent)

pt_2 = Point(item)
cps = ClosestPoints(Point=pt_2, Cloud=demesh_2.Vertices, Count=closest_mesh_vertex)  # -> simplify(ClosestPoint), CPIndex, Distance

color = ListItem(List=demesh_2.Colours, Index=cps.CPIndex, Wrap=True)  # -> simplify(Item)
vertex = ListItem(List=demesh_2.Vertices, Index=cps.CPIndex, Wrap=True)  # -> simplify(Item)

# ----
# using grayscale so each is the same
graysca = SplitARGB(Colour=color)  # -> Alpha, Red, Green, Blue

sort = SortList(Keys=graysca.Red, ValuesA=vertex)  # -> Keys, ValuesA, ValuesB
item_2 = ListItem(List=sort.Keys, Index=0, Wrap=True)  # -> Item1, Item

panel_2 = Panel("""follow color
i = black
-i = white""")
item_3 = ListItem(List=sort.ValuesA, Index=0, Wrap=True)  # -> Item1, Item

pt_3 = Point(pt_2)
vec2pt = Vector2Pt(PointA=simplify(graft(pt_3)), PointB=item_3.Item1, Unitize="true")  # -> flatten(Vector), Length
amp = Amplitude(Vector=vec2pt.Vector, Amplitude=follow_color)
lng_2 = ListLength(List=amp)
vec_2 = Vector(Vector(0, 0, 0))
larger = LargerThan(FirstNumber=item_2.Item1, SecondNumber=tolerance_for_stop_follow_color)  # -> flatten(LargerThan), OrEqualTo
repeat_2 = RepeatData(Data=vec_2, Length=lng_2)
p_n_c = PickNChoose(Pattern=larger.LargerThan, Stream0=amp, Stream1=repeat_2)  # -> graft(Result)

lng_3 = ListLength(List=loop_start.Data_2)

X = UnitX(Factor=Slider(1.5, range=0..10))

repeat_3 = RepeatData(Data=X, Length=lng_3)  # -> simplify(Data)

addition = Addition(A=repulse_2, B=repulse, C=repeat_3, D=adhere, E=p_n_c)  # -> simplify(Result)
move = Move(Geometry=item, Motion=addition)  # -> Geometry, Transform
tlist = TailList(L=loop_start.Data, it=move.Geometry, len=Slider(15, range=0..100))  # -> out, A; inputs L: list, len: Int32
# ---------- tlist: C# ----------
    Component.Name = "Tail List";
    Component.NickName = "TList";
    Component.Description = "Tail list - L list, it item to add, len tail length";

    if (L.Count() > len) {
      L.RemoveAt(0);
    }
    L.Add(it);
    A = L;
# ---------- end tlist ----------
loop_end = LoopEnd(
    port=loop_start.port,
    Exit=False,
    Data=simplify(tlist.A),
    Data_2=simplify(addition),
    pausedState=False,
    state="Constant output",
    TimeOutVal=0)  # -> D0, D1

pt_4 = Point(loop_end.D0)
rec = DataRecorder(pt_4, DataLimit=-10, RecordData=True)
dam = DataDam(DataA=rec, BufferDelay=10000000, BufferMode=0)
duppt = RemoveDuplicatePts(Points=dam, Tolerance=0.01)

explode = MeshExplode(Mesh=mjoin, Interpolate=False)
demesh_3 = DeconstructMesh(Mesh=explode)  # -> Vertices, Faces, Colours, Normals
avr = Average(Input=demesh_3.Vertices)  # -> flatten(ArithmeticMean)
lng_4 = ListLength(List=avr)
pt_5 = Point(flatten(duppt))
lng_5 = ListLength(List=pt_5)
vec_3 = Vector(Vector(0, 0, 0))
vec_4 = Vector(Vector(0, 0, 0))
repeat_4 = RepeatData(Data=vec_3, Length=lng_4)
repeat_5 = RepeatData(Data=vec_4, Length=lng_5)
dom = ConstructDomain(DomainStart=0, DomainEnd=Slider(10, range=0..10))
visible = FindVisibleAgents(
    AgentLocationPoint=avr,
    AgentMotionVector=repeat_4,
    LocationPointsOfTheFlock=pt_5,
    FlockMotionVectors=repeat_5,
    SearchDistance=dom,
    SearchAngle=Domain(0, 0))  # -> simplify(ListOfPoints), ListOfVectors, ListOfIndices

lng_6 = ListLength(List=visible.ListOfPoints)  # -> flatten(Length)

bnd_2 = Bounds(Numbers=lng_6)
dedomain_2 = DeconstructDomain(Domain=bnd_2)  # -> Start, End
gradient_2 = Gradient(
    LowerLimit=dedomain_2.Start,
    UpperLimit=dedomain_2.End,
    Parameter=lng_6,
    stops=[0: RGB(255, 255, 255), 0.735: RGB(0, 0, 0)])
conmesh_2 = ConstructMesh(Vertices=simplify(demesh_3.Vertices), Faces=simplify(demesh_3.Faces), Colours=graft(gradient_2))  # -> flatten(Mesh)
mjoin_2 = MeshJoin(Meshes=conmesh_2)
disjoint = DisjointMesh(Mesh=mjoin_2)
mblur = BlurMesh(Mesh=disjoint, Iterations=Slider(10, range=0..10))

max_point_size = Slider(0.25, range=0..5)
lng_7 = ListLength(List=loop_end.D0)
range = Range(Domain=Domain(0, 1), Steps=expr("x-1", lng_7))
gradient_3 = Gradient(LowerLimit=0, UpperLimit=1, Parameter=range, stops=[0.178: RGB(255, 130, 160), 0.826: RGB(220, 0, 40)])
multiplication = Multiplication(A=range, B=max_point_size)
addition_2 = Addition(A=multiplication, B=1)
cloud = CloudDisplay(Points=graft(loop_end.D0), Colours=graft(gradient_3), Size=graft(addition_2), SpriteType=0)

pline = PolyLine(Vertices=duppt, Closed=False)
smoothpline = SmoothPolyline(Polyline=pline, Strength=Slider(1, range=0..10), Times=Slider(6, range=0..10))

smaller = SmallerThan(FirstNumber=gradient_2, SecondNumber=Slider(1.67, range=0..2))  # -> SmallerThan, OrEqualTo
cull = CullPattern(List=graft(explode), CullPattern=graft(smaller.SmallerThan))
clean = CleanTree(RemoveNulls=True, RemoveInvalid=True, RemoveEmpty=True, Tree=cull)  # -> simplify(Tree)
mjoin_3 = MeshJoin(Meshes=flatten(clean))
weldvertices = MeshWeldVertices(Mesh=mjoin_3, Tolerance=0.01)  # -> RuntimeMessage, Mesh
demesh_4 = DeconstructMesh(Mesh=weldvertices.Mesh)  # -> Vertices, Faces, Colours, Normals
item_4 = ListItem(List=pt_5, Index=visible.ListOfIndices, Wrap=True)  # -> flatten(Item)
pt_6 = Point(demesh_4.Vertices)
merge = Merge(Data1=pt_6, Data2=item_4)  # -> flatten(Result)
duppt_2 = RemoveDuplicatePts(Points=merge, Tolerance=0.01)
prox = Proximity3D(Points=duppt_2, Group=Slider(4, range=0..10), MinRadius=Slider(29, range=0..100), MaxRadius=Slider(42, range=0..100))  # -> flatten(Links), Topology
len = Length(Curve=prox.Links)
bnd_3 = Bounds(Numbers=len)
dedomain_3 = DeconstructDomain(Domain=bnd_3)  # -> Start, End
gradient_4 = Gradient(
    LowerLimit=dedomain_3.Start,
    UpperLimit=dedomain_3.End,
    Parameter=len,
    stops=[0: RGB(47, 204, 183), 0.0913: RGB(153, 112, 112), 0.242: RGB(0, 4, 120)])
bar_graph = BarGraph(len, BarColor=RGB(255, 0, 90))
preview = CustomPreview(Geometry=prox.Links, Shader=gradient_4)
