# Grasshopper definition 20160414_DRONE DEPOSITION.gh (Grasshopper 0.9.76)
# Copyright: Co-de-iT
# plug-ins: MeshEdit Components, Anemone, Human, Boid, Weaverbird

# ----
# 15-17 April 2016
mesh = Mesh([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])
mjoin = MeshJoin(Meshes=mesh)
demesh = DeconstructMesh(Mesh=mjoin)  # -> Vertices, Faces, Colours, Normals
argb = SplitARGB(Colour=demesh.Colours)  # -> Alpha, Red, Green, Blue
pt = Point(demesh.Colours)
pdecon = Deconstruct(Point=pt)  # -> XComponent, YComponent, ZComponent
bnd = Bounds(Numbers=pdecon.ZComponent)
dedomain = DeconstructDomain(Domain=bnd)  # -> Start, End
gradient = Gradient(
    LowerLimit=dedomain.Start,
    UpperLimit=dedomain.End,
    Parameter=pdecon.ZComponent,
    stops=[0: RGB(255, 255, 255), 1: RGB(0, 0, 0)])
conmesh = ConstructMesh(Vertices=demesh.Vertices, Faces=demesh.Faces, Colours=gradient)

X = UnitX(Factor=1)

# ----
# reciproCITY
# Alessio Erioli
# Aldo Sollazzo
# Eugenio Bettucchi
# DEFINITIONS BY
number_slider = Slider(10, range=0..100)
crv = Curve(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)
pop2d = Populate2D(Region=crv, Count=number_slider, Seed=1)  # -> graft(Population)
lng = ListLength(List=flatten(pop2d))
repeat = RepeatData(Data=X, Length=lng)  # -> graft(Data)

pt_2 = ConstructPoint(XCoordinate=0, YCoordinate=0, ZCoordinate=0)
ln = Line(StartPoint=pt_2, EndPoint=pop2d)

merge = Merge(Data1=repeat, Data2=ln)  # -> simplify(Result)
number_slider_2 = Slider(80, range=0..1000)
group = Group(Objects=merge)
loop_start = LoopStart(Repeat=number_slider_2, Trigger=Button(), Data=simplify(group))  # -> port, Counter, simplify(Data)
panel = Panel(loop_start.Counter)

ungroup = Ungroup(Group=loop_start.Data)  # -> simplify(Objects)
item = ListItem(List=ungroup, Index=0, Wrap=True)  # -> Item, Item1
explode = Explode(Curve=item.Item1, Recursive=True)  # -> Segments, Vertices
item_2 = ListItem(List=explode.Vertices, Index="-1", Wrap=True)  # -> simplify(Item)

tolerance_for_stop_follow_color = Slider(0.75, range=0..1)
follow_color = Slider(1, range=0..1)
max_vel = Slider(2, range=0..10)
closest_mesh_vertex = Slider(40, range=0..40)

mesh_2 = Mesh(conmesh)
demesh_2 = DeconstructMesh(Mesh=mesh_2)  # -> Vertices, Faces, Colours, Normals

vec = Vector(item.Item)

# ---- group: FUTURE LOCATION
amp = Amplitude(Vector=vec, Amplitude=Slider(4, range=0..10))
move = Move(Geometry=item_2, Motion=amp)  # -> Geometry, Transform

# ----
X_2 = UnitX(Factor=Slider(1.5, range=0..10))
lng_2 = ListLength(List=vec)
repeat_2 = RepeatData(Data=X_2, Length=lng_2)  # -> simplify(Data)

# ----
# FOLLOW MESH COLOR
pt_3 = Point(move.Geometry)
cps = ClosestPoints(Point=pt_3, Cloud=demesh_2.Vertices, Count=closest_mesh_vertex)  # -> simplify(ClosestPoint), CPIndex, Distance

color = ListItem(List=demesh_2.Colours, Index=cps.CPIndex, Wrap=True)  # -> simplify(Item); disabled
vertex = ListItem(List=demesh_2.Vertices, Index=cps.CPIndex, Wrap=True)  # -> simplify(Item); disabled

# ----
# using grayscale so each is the same
graysca = SplitARGB(Colour=color)  # -> Alpha, Red, Green, Blue; disabled

sort = SortList(Keys=graysca.Red, ValuesA=vertex)  # -> Keys, ValuesA, ValuesB; disabled
item_3 = ListItem(List=sort.Keys, Index=0, Wrap=True)  # -> Item1, Item; disabled

item_4 = ListItem(List=cps.ClosestPoint, Index=0, Wrap=True)
pt_4 = Point(simplify(item_4))
vec2pt = Vector2Pt(PointA=item_2, PointB=pt_4, Unitize=False)  # -> simplify(Vector), Length
maxforce = Slider(0.672, range=0..1)

item_5 = ListItem(List=sort.ValuesA, Index=0, Wrap=True)  # -> Item1, Item; disabled
panel_2 = Panel("""follow color
i = black
-i = white""")  # disabled

# ----
# MOVE NORMAL TO MESH VERTEX
item_6 = ListItem(List=demesh_2.Normals, Index=cps.CPIndex, Wrap=True)
item_7 = ListItem(List=cps.Distance, Index=0, Wrap=True)
item_8 = ListItem(List=item_6, Index=0, Wrap=True)
treshold = Slider(4, range=0..10)
maxforce_2 = Slider(0.512, range=0..1)
smaller = SmallerThan(FirstNumber=item_7, SecondNumber=treshold)  # -> simplify(SmallerThan), OrEqualTo
steer = Steer(vel=vec, des=item_8, maxv=max_vel, maxf=maxforce_2)
vec_2 = Vector(Vector(0, 0, 0))
p_n_c = PickNChoose(Pattern=smaller.SmallerThan, Stream0=vec_2, Stream1=steer)

panel_3 = Panel("true")  # disabled
pt_5 = Point(pt_3)  # disabled
vec2pt_2 = Vector2Pt(PointA=simplify(graft(pt_5)), PointB=item_5.Item1, Unitize=panel_3)  # -> flatten(Vector), Length; disabled
amp_2 = Amplitude(Vector=vec2pt_2.Vector, Amplitude=follow_color)  # disabled
lng_3 = ListLength(List=amp_2)  # disabled
vec_3 = Vector(Vector(0, 0, 0))  # disabled
larger = LargerThan(FirstNumber=item_3.Item1, SecondNumber=tolerance_for_stop_follow_color)  # -> flatten(LargerThan), OrEqualTo; disabled
repeat_3 = RepeatData(Data=vec_3, Length=lng_3)  # disabled
p_n_c_2 = PickNChoose(Pattern=larger.LargerThan, Stream0=amp_2, Stream1=repeat_3)  # -> graft(Result); disabled

follow = ValueList({"brightest": 0, "darkest": 1}, selected="brightest")
cluster = Cluster(
    agents=pt_3,
    index_of_visible=cps.CPIndex,
    M=mesh_2,
    intensity=follow_color,
    treshold_limit_value_to_follow=tolerance_for_stop_follow_color,
    b_1_w_0=follow)  # -> vector, elected_point

# ----
# steer
steer_2 = Steer(vel=vec, des=vec2pt.Vector, maxv=max_vel, maxf=maxforce)

# ----
# acceleration
addition = Addition(A=simplify(steer_2), B=simplify(cluster.vector), C=simplify(repeat_2), D=simplify(p_n_c))
multiplication = Multiplication(A=addition, B=Slider(0.25, range=0..1))
addition_2 = Addition(A=vec, B=multiplication)
trmvec = TrimVector(Vector=addition_2, LengthDomain=max_vel)
move_2 = Move(Geometry=item_2, Motion=trmvec)  # -> simplify(Geometry), Transform
ins = InsertItems(List=simplify(explode.Vertices), Item=move_2.Geometry, Indices="-1", Wrap=True)  # -> simplify(List)
pline = PolyLine(Vertices=ins, Closed=False)

merge_2 = Merge(Data1=simplify(trmvec), Data2=simplify(pline))
group_2 = Group(Objects=merge_2)

# ---- group: STEER LOGIC
move_3 = Move(Geometry=item_2, Motion=Vector(0, 0, 10))  # -> Geometry, Transform
amp_3 = Amplitude(Vector=vec2pt.Vector, Amplitude=max_vel)
vdis = VectorDisplay(Anchor=item_2)
vdis_2 = VectorDisplay(Anchor=item_2, Vector=amp_3)
vdis_3 = VectorDisplay(Anchor=move_3.Geometry, Vector=steer_2)

# ----
loop_end = LoopEnd(port=loop_start.port, Exit=False, Data=simplify(group_2), pausedState=False, state="Constant output", TimeOutVal=0)
ungroup_2 = Ungroup(Group=loop_end)

# ---- group: TRAIL
item_9 = ListItem(List=ungroup_2, Index=0, Wrap=True)  # -> Item, Item1

# ----
explode_2 = Explode(Curve=item_9.Item1, Recursive=True)  # -> Segments, simplify(Vertices)

# ---- group: calculate after loop end
equals = Equality(FirstNumber=number_slider_2, SecondNumber=panel)  # -> Equality, Inequality
gate = StreamGate(Stream=explode_2.Vertices, Gate=equals.Equality)  # -> Target0, Target1

# ----
gate_2 = StreamGate(Stream=mjoin, Gate=equals.Equality)  # -> Target0, Target1

explode_3 = MeshExplode(Mesh=gate_2.Target1, Interpolate=False)
cullpt = CullDuplicates(Points=flatten(gate.Target1), Tolerance=0.1, CullMode=1)  # -> Points, Indices, Valence
demesh_3 = DeconstructMesh(Mesh=explode_3)  # -> Vertices, Faces, Colours, Normals
avr = Average(Input=demesh_3.Vertices)  # -> flatten(ArithmeticMean)
lng_4 = ListLength(List=avr)
lng_5 = ListLength(List=cullpt.Points)
vec_4 = Vector(Vector(0, 0, 0))
vec_5 = Vector(Vector(0, 0, 0))
repeat_4 = RepeatData(Data=vec_4, Length=lng_4)
repeat_5 = RepeatData(Data=vec_5, Length=lng_5)
dom = ConstructDomain(DomainStart=0, DomainEnd=Slider(10, range=0..10))
visible = FindVisibleAgents(
    AgentLocationPoint=avr,
    AgentMotionVector=repeat_4,
    LocationPointsOfTheFlock=cullpt.Points,
    FlockMotionVectors=repeat_5,
    SearchDistance=dom,
    SearchAngle=Domain(0, 0))  # -> simplify(ListOfPoints), ListOfVectors, ListOfIndices

cull_i = CullIndex(List=explode_2.Vertices, Indices=0, Wrap=True)
mesh_3 = Mesh(gate_2.Target0)
pline_2 = PolyLine(Vertices=cull_i, Closed=False)

lng_6 = ListLength(List=visible.ListOfPoints)  # -> flatten(Length)

bnd_2 = Bounds(Numbers=lng_6)
dedomain_2 = DeconstructDomain(Domain=bnd_2)  # -> Start, End
gradient_2 = Gradient(
    LowerLimit=dedomain_2.Start,
    UpperLimit=dedomain_2.End,
    Parameter=lng_6,
    stops=[0: RGB(255, 255, 255), 0.735: RGB(0, 0, 0)])
conmesh_2 = ConstructMesh(Vertices=simplify(demesh_3.Vertices), Faces=simplify(demesh_3.Faces), Colours=graft(gradient_2))  # -> flatten(Mesh)

smaller_2 = SmallerThan(FirstNumber=gradient_2, SecondNumber=Slider(2, range=0..2))  # -> SmallerThan, OrEqualTo
cull = CullPattern(List=graft(explode_3), CullPattern=graft(smaller_2.SmallerThan))
clean = CleanTree(RemoveNulls=True, RemoveInvalid=True, RemoveEmpty=True, Tree=cull)  # -> simplify(Tree)
wbjoin = WeaverbirdsJoinMeshesAndWeld(Mesh=flatten(clean), Weld=True)
demesh_4 = DeconstructMesh(Mesh=wbjoin)  # -> Vertices, Faces, Colours, Normals

wbjoin_2 = WeaverbirdsJoinMeshesAndWeld(Mesh=conmesh_2, Weld=True)

disjoint = DisjointMesh(Mesh=wbjoin_2)

# ---- group: CUSTOM PROXIMITY
pt_6 = Point(explode_2.Vertices)
dist = Slider(5, range=0..5)

# ----
tstat = TreeStatistics(Tree=pt_6)  # -> Paths, Length, Count
flatten = FlattenTree(Tree=demesh_4.Vertices, Path="{0}")
item_10 = ListItem(List=tstat.Paths, Index=0, Wrap=True)
replace = ReplacePaths(Data=flatten, Search=item_10, Replace=tstat.Count)
merge_3 = Merge(Data1=pt_6, Data2=replace)

# ---- group: CUSTOM PROXIMITY (continued)
cptree = ConnectPointTree(d=dist, Ptree=merge_3)  # -> out, P; inputs d: Double, Ptree: tree of Point3d
# ---------- cptree: C# ----------
    String eol = Environment.NewLine;
    Component.Name = "Connect Point tree";
    Component.NickName = "CPtree";
    Component.Message = "v0.1 _ by Alessio Erioli" + eol + "Co-de-iT";
    Component.Description = "Connects points in a tree"+eol+" excluding their own branch" + eol+
      "d - distance threshold";
    /*
    System.Threading.Tasks.Parallel.ForEach(Ptree.AllData(), p => {
    });
    */

    Point3d p, p1;

    // System.Collections.Concurrent.ConcurrentBag<Line> conn = new System.Collections.Concurrent.ConcurrentBag<Line>();
    DataTree<Point3d> conT = new DataTree<Point3d> ();

    //List <Line> conn = new List<Line>();
    GH_Path pa;
    //System.Threading.Tasks.Parallel.For(0, Ptree.BranchCount, i => {
    for (int i = 0; i < Ptree.BranchCount; i++){
      for(int r = 0; r < Ptree.Branch(i).Count; r++){
        p = Ptree.Branch(i)[r];
        pa = new GH_Path(new int[]{i,r});
        conT.EnsurePath(pa);
        for (int j = i + 1; j < Ptree.BranchCount; j++){
          for(int k = 0; k < Ptree.Branch(j).Count(); k++){
            p1 = Ptree.Branch(j)[k];
            if (p.DistanceTo(p1) < d){
              conT.Add(p1, pa);
              //conn.Add(new Line(p, p1));
            }
          }
        }
      }
    }
    //  });
    P = conT;
# ---------- end cptree ----------

# ----
prox = Proximity3D(Points=flatten(pt_6), Group=5, MinRadius=Slider(3, range=0..10), MaxRadius=Slider(8, range=0..10))  # -> Links, Topology

# ---- group: CUSTOM PROXIMITY / CONNECTION
ln_2 = Line(StartPoint=simplify(graft(pt_6)), EndPoint=cptree.P)  # -> flatten(Line)
len = Length(Curve=ln_2)
len_2 = Length(Curve=ln_2)
bnd_3 = Bounds(Numbers=len)
bnd_4 = Bounds(Numbers=len_2)
dedomain_3 = DeconstructDomain(Domain=bnd_3)  # -> Start, End
dedomain_4 = DeconstructDomain(Domain=bnd_4)  # -> Start, End
gradient_3 = Gradient(LowerLimit=0, UpperLimit=dedomain_3.End, Parameter=len, stops=[0: RGB(255, 255, 255), 1: RGB(0, 0, 0)])
gradient_4 = Gradient(
    LowerLimit=dedomain_4.Start,
    UpperLimit=dedomain_4.End,
    Parameter=len_2,
    stops=[0: RGB(47, 204, 183), 0.0913: RGB(153, 112, 112), 0.242: RGB(0, 4, 120)])
previewlw = CustomPreviewLineweights(Geometry=ln_2, Shader=gradient_3)
preview = CustomPreview(Geometry=ln_2, Shader=gradient_4)

# ---- group: CUSTOM PROXIMITY / POINT
lng_7 = ListLength(List=cptree.P)  # -> flatten(Length)
bnd_5 = Bounds(Numbers=lng_7)
dedomain_5 = DeconstructDomain(Domain=bnd_5)  # -> Start, End
gradient_5 = Gradient(LowerLimit=0, UpperLimit=dedomain_5.End, Parameter=lng_7, stops=[0: RGB(255, 255, 255), 1: RGB(0, 0, 0)])
preview_2 = CustomPreview(Geometry=flatten(pt_6), Shader=gradient_5)

# ==== cluster Steer
maxf = ClusterInput()
vel = ClusterInput()
maxv = ClusterInput()
des = ClusterInput()
amp = Amplitude(Vector=des, Amplitude=maxv)
subtraction = Subtraction(A=amp, B=vel)
multiplication = Multiplication(A=subtraction, B=maxf)
vlen = VectorLength(Vector=multiplication)
min = Minimum(A=vlen, B=maxv)
amp_2 = Amplitude(Vector=multiplication, Amplitude=min)
acc = ClusterOutput(amp_2)

# ==== cluster Cluster
agents = ClusterInput()
index_of_visible = ClusterInput()
M = ClusterInput()
intensity = ClusterInput()
treshold_limit_value_to_follow = ClusterInput()
b_1_w_0 = ClusterInput()
num = Number(treshold_limit_value_to_follow)
num_2 = Number(intensity)
int = Integer(index_of_visible)
pt = Point(agents)
demesh = DeconstructMesh(Mesh=M)  # -> Vertices, Faces, Colours, Normals

color = ListItem(List=demesh.Colours, Index=int, Wrap=True)
vertex = ListItem(List=demesh.Vertices, Index=int, Wrap=True)

# ----
# using grayscale so each is the same
graysca = SplitARGB(Colour=color)  # -> Alpha, Red, Green, Blue

sort = SortList(Keys=graysca.Red, ValuesA=vertex)  # -> Keys, ValuesA

panel = Panel("""follow color
i = black
-i = white""")
item = ListItem(List=sort.Keys, Index=0, Wrap=True)  # -> Item1, Item
item_2 = ListItem(List=sort.ValuesA, Index=0, Wrap=True)  # -> Item1, Item

filter = StreamFilter(Gate=b_1_w_0, Stream0=item_2.Item1, Stream1=item_2.Item)
pshift = ShiftPaths(Data=filter, Offset=-1)
elected_point = ClusterOutput(pshift)

larger = LargerThan(FirstNumber=item.Item1, SecondNumber=num)  # -> LargerThan, OrEqualTo
vec2pt = Vector2Pt(PointA=pt, PointB=pshift, Unitize="true")  # -> Vector, Length
amp = Amplitude(Vector=vec2pt.Vector, Amplitude=num_2)
lng = ListLength(List=amp)
vec = Vector(Vector(0, 0, 0))
repeat = RepeatData(Data=vec, Length=lng)  # -> simplify(Data)

pshift_2 = ShiftPaths(Data=larger.LargerThan, Offset=-1)

p_n_c = PickNChoose(Pattern=pshift_2, Stream0=amp, Stream1=repeat)

vector = ClusterOutput(p_n_c)
