# Grasshopper definition 00_template.gh (Grasshopper 0.9.76)
# Copyright: Co-de-iT
# plug-ins: Anemone, Boid

# ... more data
data = Data()
# <title>
# 
# <description>
# 
# code by <author>
# 
# v <version>
# 
# © Co-de-iT 2016 _ Creative Commons Attribution-NonCommercial-ShareAlike 4.0 International License
# reciproCITY
# tutors
# Aldo Sollazzo
# Alessio Erioli
# agents setup
# IaaC . 15-17.04.2016
# loc
pt = Point()
# vel
vec = Vector()
# col (or other agent data)
col = Colour()
# t(r)ail
# < NB: always add the trail (or tail) as LAST
# first point in trail is (almost)
# always the start location
pt_2 = Point(pt)
# environmental data setup
# colored mesh
mesh = Mesh()
# other geometry
geo = Geometry()
# spatialized data from file
data_2 = Data()
lng = ListLength(List=data)
lng_2 = ListLength(List=pt)
lng_3 = ListLength(List=vec)
lng_4 = ListLength(List=col)
# fields
merge = Merge(Data1=simplify(graft(pt)), Data2=simplify(graft(vec)), Data3=simplify(graft(col)), Data5=simplify(graft(pt_2)))
merge_2 = Merge(Data1=lng_2, Data2=lng_3, Data3=lng_4)  # -> flatten(Result)
group = Group(Objects=graft(merge))
lng_5 = ListLength(List=merge_2)

# ----
# agents shared parameters
maxspeed = Slider(1.5, range=0..3)

iterations = Slider(0, range=0..200)
button = Button()
exit = Button()
loop_start = LoopStart(N=iterations, T=button, D0=group)  # -> port, Counter, Data, Data_2
ungroup = Ungroup(Group=loop_start.Data)  # -> simplify(Objects)
split = SplitList(List=ungroup, Index=lng_5)  # -> ListA, TRAil

# ----
# fields
item = ListItem(List=split.ListA, Index=0, Wrap=True)  # -> Item, Item1, Item2

# ----
# custom
# behavior
# 02
vec_2 = Vector()
# custom
# behavior
# 01
vec_3 = Vector()
maxforce = Slider(0.384, range=0..1)
# modification to other fields
# (i.e. color, etc.)
# custom
# behavior
# NN
influence_intensity = Slider(0, range=0..1)
maxforce_2 = Slider(0.384, range=0..1)
# modification to other fields
# (i.e. color, etc.)
influence_intensity_2 = Slider(0, range=0..1)
# steer
steer = Steer(vel=item.Item1, des=vec_2, maxv=maxspeed, maxf=maxforce)
# steer
steer_2 = Steer(vel=item.Item1, des=vec_3, maxv=maxspeed, maxf=maxforce_2)
multiplication = Multiplication(A=steer, B=influence_intensity)
multiplication_2 = Multiplication(A=steer_2, B=influence_intensity_2)
# acceleration
addition = Addition(A=multiplication_2, B=multiplication)
# update velocity
addition_2 = Addition(Vel=item.Item1, Acc=addition)
# limit to maxvel
trmvec = TrimVector(Vector=addition_2, LengthDomain=maxspeed)
# move
move = Move(Geometry=item.Item, Motion=trmvec)  # -> Geometry, Transform
tail_length = Slider(12, range=2..50)
# constrain to geometry
# (or border condition)
meshcp = MeshClosestPoint(Point=move.Geometry)  # -> Point, Index, Parameter
# add to tail
t_rec = TailRecorder(L=simplify(split.TRAil), it=simplify(meshcp.Point), len=tail_length)  # -> out, Lo; inputs L: list, len: Int32
# ---------- t_rec: C# ----------
    String eol = Environment.NewLine;
    Component.Name = "Tail Recorder";
    Component.NickName = "T-Rec";
    Component.Description = "Tail recorder" + eol + "L - list of tail points" + eol + "it - item to add" + eol + "len - tail max length";

    if (L.Count() > len) {
      L.RemoveAt(0);
    }
    L.Add(it);
    Lo = L;
# ---------- end t_rec ----------
# update agent
merge_3 = Merge(Data1=simplify(meshcp.Point), Data2=simplify(trmvec), Data4=simplify(t_rec.Lo))
group_2 = Group(Objects=merge_3)
loop_end = LoopEnd(port=loop_start.port, Exit=exit, Data=group_2, pausedState=False, state="Constant output", TimeOutVal=0)  # -> D0, D1
ungroup_2 = Ungroup(Group=loop_end.D0)
split_2 = SplitList(List=ungroup_2, Index=lng_5)  # -> ListA, TRAil

# ==== cluster Steer
maxf = ClusterInput()
vel = ClusterInput()
maxv = ClusterInput()
des = ClusterInput()
amp = Amplitude(Vector=des, Amplitude=maxv)
subtraction = Subtraction(A=amp, B=vel)
multiplication = Multiplication(A=subtraction, B=maxf)
vlen = VectorLength(Vector=multiplication)
min = Minimum(A=vlen, B=maxv)
amp_2 = Amplitude(Vector=multiplication, Amplitude=min)
acc = ClusterOutput(amp_2)
