# Grasshopper definition 20160411_respawn.gh (Grasshopper 0.9.76)
# plug-ins: Anemone

mesh = Mesh(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)
mesh_2 = Mesh(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)
# <title>
# 
# <description>
# 
# code by <author>
# 
# v <version>
# 
# © Co-de-iT 2016 _ Creative Commons Attribution-NonCommercial-ShareAlike 4.0 International License
# reciproCITY
# respawn: Agents differ from paticles in one very important characteristic: they can store internal states.
# 
# Under certain conditions, agents can "die" (become inactive) and, at will, be "respawned". The logic is as follows:
# 
# . use a flag to store the alive/dead agent state
# . if dead ignore
# . if alive, check for respawn condition
# . if so, change state from alive to dead and generate a new one
# . else, update agent
# tutors
# Aldo Sollazzo
# Alessio Erioli
# IaaC . 15-17.04.2016
# agents
facen = FaceNormals(Mesh=mesh)  # -> Centers, Normals
reduction_factor = Slider(0.944, range=0..1)
# field
reduction_factor_2 = Slider(0.944, range=0..1)
demesh = DeconstructMesh(Mesh=mesh)  # -> Vertices, Faces, Colours, Normals
lng = ListLength(List=facen.Centers)
lng_2 = ListLength(List=demesh.Vertices)
multiplication = Multiplication(A=lng, B=reduction_factor)
multiplication_2 = Multiplication(A=lng_2, B=reduction_factor_2)
reduce = RandomReduce(List=facen.Centers, Reduction=multiplication, Seed=1)
reduce_2 = RandomReduce(List=demesh.Vertices, Reduction=multiplication_2, Seed=1)

number_slider = Slider(13, range=1..20)
expression = Expression(x=number_slider, Expression="Format(\"{{<{0}}}\", x)")
pt = Point(simplify(graft(reduce)))
pt_2 = Point(Point(0, 0, 0))
split = SplitTree(Data=pt, Masks=flatten(expression))  # -> Positive, Negative
viewer = ParamViewer(split.Negative)
dpath = DeconstructPath(Branch=viewer)  # -> flatten(Indices)
expression_2 = Expression(x=dpath, Expression="Format(\"{{{0}}}\", x)")
addition = Addition(A=dpath, B=1)  # -> flatten(Result)
replace = ReplacePaths(Data=pt_2, Search="{*}", Replace=number_slider)
# insert branch in data tree
replace_2 = ReplacePaths(Data=split.Negative, Search=expression_2, Replace=addition)
merge = Merge(Data1=split.Positive, Data2=replace, Data3=replace_2)

medges = MeshEdges(Mesh=mesh)  # -> NakedEdges, InteriorEdges, NonManifoldEdges
lng_3 = ListLength(List=reduce)
# flag point
# use points as boolean flags: groups take only geometry so we use geometry as information
# 
# 0,0,1 > agent is alive
# 0,0,0 > agent is dead
pt_3 = Point(Point(0, 0, 1))
fspin = SpinForce(Plane=reduce_2, Strength=Slider(20, range=0..20), Radius=Slider(5, range=0..30), Decay=2)
repeat = RepeatData(Data=pt_3, Length=lng_3)
mergef = MergeFields(Fields=fspin)
# show boundaries
join = JoinCurves(Curves=medges.NakedEdges, Preserve=False)

data = Data()
data_2 = Data()
# append branch  to data tree
tstat = TreeStatistics(Tree=data)  # -> Paths, Length, Count
replace_3 = ReplacePaths(Data=data_2, Search="{*}", Replace=tstat.Count)
merge_2 = Merge(Data1=data, Data2=replace_3)

# ----
# in order to pass the trajectory as a polyline we must generate a line by using a dummy first point (that will be culled after the loop).
ln = Line(StartPoint=pt_3, EndPoint=reduce)
evf = EvaluateField(Field=mergef, Point=demesh.Vertices)  # -> Tensor, Strength
bnd = Bounds(Numbers=evf.Strength)
dom = ConstructDomain(DomainStart=Slider(1.089, range=0..5), DomainEnd=Slider(4.462, range=0..5))
# . agent location
# . alive/dead status
# . trajectory as polyline
merge_3 = Merge(Data1=simplify(graft(reduce)), Data2=simplify(graft(repeat)), Data3=simplify(graft(ln)))
remap = RemapNumbers(Value=evf.Strength, Source=bnd, Target=dom)  # -> Mapped, Clipped
amp = Amplitude(Vector=evf.Tensor, Amplitude=remap.Mapped)
group = Group(Objects=merge_3)  # -> simplify(Group)
velocity = Slider(1.5, range=0..10)
number_slider_2 = Slider(150, range=0..1000)
button = Button()
exit = Button()
vdisex = VectorDisplayEx(Point=demesh.Vertices, Vector=amp, Colour=RGB(0, 0, 0), Width=1)
loop_start = LoopStart(Repeat=number_slider_2, Trigger=button, Particles=group)  # -> port, Counter, Particles; disabled
ungroup = Ungroup(Group=loop_start.Particles)
expression_3 = Expression(x=loop_start.Counter, y=number_slider_2, Expression="Format(\"{0} %\",round(x/y*100,1))")
# loc
# alive?
# trail as polyline
item = ListItem(List=ungroup, Index=0, Wrap=True)  # -> Item, Item1, Item2
panel = Panel(expression_3)

# ---- group: is agent alive?
pdecon = Deconstruct(Point=item.Item1)  # -> XComponent, YComponent, ZComponent
dispatch = Dispatch(List=item.Item2, DispatchPattern=pdecon.ZComponent)  # -> ListA, ListB
dispatch_2 = Dispatch(List=item.Item, DispatchPattern=pdecon.ZComponent)  # -> ListA, ListB
dispatch_3 = Dispatch(List=item.Item1, DispatchPattern=pdecon.ZComponent)  # -> ListA, ListB

# ---- group: respawn check
meshcp = MeshClosestPoint(Point=dispatch_2.ListA, Mesh=mesh)  # -> Point, Index, Parameter
crv_cp = CurveClosestPoint(Point=graft(meshcp.Point), Curve=join)  # -> Point, Parameter, Distance
edge_thres = Slider(1.5, range=0..10)
sort = SortList(Keys=crv_cp.Distance)  # -> Keys, ValuesA
item_2 = ListItem(List=sort.Keys, Index=0, Wrap=True)
smaller = SmallerThan(FirstNumber=item_2, SecondNumber=edge_thres)  # -> SmallerThan, simplify(OrEqualTo)
dispatch_4 = Dispatch(List=dispatch_2.ListA, DispatchPattern=smaller.OrEqualTo)  # -> ListA, ListB
dispatch_5 = Dispatch(List=dispatch_3.ListA, DispatchPattern=smaller.OrEqualTo)  # -> ListA, ListB
dispatch_6 = Dispatch(List=dispatch.ListA, DispatchPattern=smaller.OrEqualTo)  # -> ListA, ListB

# ----
clean = CleanTree(RemoveNulls=True, RemoveInvalid=True, RemoveEmpty=True, Tree=dispatch_4.ListB)
clean_2 = CleanTree(RemoveNulls=True, RemoveInvalid=True, RemoveEmpty=True, Tree=dispatch_5.ListB)
clean_3 = CleanTree(RemoveNulls=True, RemoveInvalid=True, RemoveEmpty=True, Tree=dispatch_6.ListB)

# ---- group: move (field)
evf_2 = EvaluateField(Field=mergef, Point=clean)  # -> Tensor, Strength
amp_2 = Amplitude(Vector=evf_2.Tensor, Amplitude=velocity)
move = Move(Geometry=clean, Motion=amp_2)  # -> Geometry, Transform

# ----
explode = Explode(Curve=clean_3, Recursive=True)  # -> Segments, Vertices

# ---- group: constrain to mesh and add to trajectory
meshcp_2 = MeshClosestPoint(Point=move.Geometry, Mesh=mesh)  # -> Point, Index, Parameter
merge_4 = Merge(Data1=simplify(explode.Vertices), Data2=simplify(meshcp_2.Point))
pline = PolyLine(Vertices=merge_4, Closed=False)

# ----
lng_4 = ListLength(List=flatten(dispatch_5.ListA))
pt_4 = Point(Point(0, 0, 0))
repeat_2 = RepeatData(Data=pt_4, Length=lng_4)  # -> flatten(Data)
pt_5 = Point(flatten(dispatch_4.ListA))
crv = Curve(flatten(dispatch_6.ListA))
merge_5 = Merge(Data1=graft(pt_5), Data2=graft(repeat_2), Data3=graft(crv))
# killed agents
group_2 = Group(Objects=merge_5)  # -> flatten(Group)

merge_6 = Merge(Data1=dispatch_2.ListB, Data2=dispatch_3.ListB, Data3=dispatch.ListB)
clean_4 = CleanTree(RemoveNulls=True, RemoveInvalid=True, RemoveEmpty=Toggle(True), Tree=merge_6)
# inactive agents
group_3 = Group(Objects=clean_4)  # -> flatten(Group)

merge_7 = Merge(Data1=simplify(move.Geometry), Data2=simplify(clean_2), Data3=simplify(pline))
# updated agents
group_4 = Group(Objects=merge_7)  # -> flatten(Group)

# ---- group: respawn
subtraction = Subtraction(A=lng_2, B="1")
lng_5 = ListLength(List=flatten(dispatch_4.ListA))
random = Random(Range=subtraction, Number=lng_5, Seed=loop_start.Counter, Integers=True)
item_3 = ListItem(List=demesh.Vertices, Index=random, Wrap=True)  # -> flatten(Item)
lng_6 = ListLength(List=item_3)
pt_6 = Point(Point(0, 0, 1))
repeat_3 = RepeatData(Data=pt_6, Length=lng_6)  # -> flatten(Data)

# ----
ln_2 = Line(StartPoint=pt_6, EndPoint=item_3)  # -> flatten(Line)

# ---- group: respawn (continued)
merge_8 = Merge(Data1=simplify(graft(item_3)), Data2=simplify(graft(repeat_3)), Data3=simplify(graft(ln_2)))
# respawned agents
group_5 = Group(Objects=merge_8)  # -> flatten(Group)

# ----
merge_9 = Merge(Data1=group_3, Data2=group_5, Data3=group_2, Data4=group_4)  # -> simplify(graft(Result))
loop_end = LoopEnd(port=loop_start.port, Exit=exit, Particles=simplify(merge_9), pausedState=False, state="Constant output", TimeOutVal=0)
ungroup_2 = Ungroup(Group=loop_end)
item_4 = ListItem(List=ungroup_2, Index=0, Wrap=True)  # -> Item, Item1, Item2
explode_2 = Explode(Curve=item_4.Item2, Recursive=True)  # -> Segments, Vertices
cull_i = CullIndex(List=explode_2.Vertices, Indices=0, Wrap=True)
pline_2 = PolyLine(Vertices=cull_i, Closed=False)
clean_5 = CleanTree(RemoveNulls=True, RemoveInvalid=True, RemoveEmpty=True, Tree=pline_2)
smoothpline = SmoothPolyline(Polyline=clean_5, Strength=1, Times=Slider(5, range=1..30))  # -> flatten(Polyline)
