# Grasshopper definition 20160404_stigmergy_01_EU_AE.gh (Grasshopper 0.9.76)
# Copyright: Co-de-iT
# plug-ins: Anemone, Human, Kangaroo Components, Boid, Weaverbird, Mesh Pipe, Shortest Walk in Gh

maxspeed = Slider(1, range=0..3)

agent = Slider(100, range=0..100)
iter = Slider(46, range=0..100)
vision_rad = Slider(45, range=0..100)
vision_ang = Slider(75, range=0..90)
follow_tail = Slider(1, range=0..1)

button = Button()
rndvec = RandomVector(Number=agent, Unit=True, RandomSeed=2, AbsoluteMultiplier=1)
devec = DeconstructVector(Vector=rndvec)  # -> XComponent, YComponent, ZComponent
exit = Button()
_4field = Curve(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)
vec = VectorXYZ(XComponent=devec.XComponent, YComponent=devec.YComponent, ZComponent=devec.ZComponent)  # -> unitize(Vector), Length
pop2d = Populate2D(Region=_4field, Count=agent, Seed=2)
loop_start = LoopStart(N=Slider(117, range=0..200), T=button, D0=graft(pop2d), D1=vec.Vector)  # -> port, Counter, Data, Data_2
panel = Panel(loop_start.Counter)
item = ListItem(List=loop_start.Data, Index=0, Wrap=True)  # -> flatten(Item1), Item
avr = Average(Input=item.Item1)
lng = ListLength(List=item.Item1)
fspin = SpinForce(Plane=avr, Strength="-1", Radius=Slider(16, range=0..100), Decay=Slider(2, range=1..3))
vec_2 = Vector(Vector(0, 0, 0))
rad = Radians(Degrees=vision_ang)
repeat = RepeatData(Data=vec_2, Length=lng)
mergef = MergeFields(Fields=fspin)
visible = FindVisibleAgents(
    AgentLocationPoint=item.Item1,
    AgentMotionVector=loop_start.Data_2,
    LocationPointsOfTheFlock=item.Item1,
    FlockMotionVectors=repeat,
    SearchDistance=vision_rad,
    SearchAngle=rad)  # -> ListOfPoints, ListOfVectors, ListOfIndices
evf = EvaluateField(Field=mergef, Point=item.Item1)  # -> Tensor, Strength

# ----
# updated cluster
# cleaned up some redundancies and structured to work as modular element
cluster = Cluster_2(agent_location=item.Item1, agent_vector_global=unitize(loop_start.Data_2), visible_tail=visible.ListOfPoints)

field_intensity = Slider(1, range=0..1)
tail_intensity = Slider(0.539, range=0..1)
steer = Steer(vel=loop_start.Data_2, des=cluster, maxv=maxspeed, maxf=follow_tail)
steer_2 = Steer(vel=loop_start.Data_2, des=evf.Tensor, maxv=maxspeed, maxf=Slider(1, range=0..1))
multiplication = Multiplication(A=steer_2, B=field_intensity)
multiplication_2 = Multiplication(A=steer, B=tail_intensity)
addition = Addition(A=loop_start.Data_2, B=multiplication_2, C=multiplication)
trmvec = TrimVector(Vector=addition, LengthDomain=maxspeed)
move = Move(Geometry=item.Item1, Motion=trmvec)  # -> Geometry, Transform
t_rec = TailRecorder(L=simplify(loop_start.Data), it=simplify(graft(move.Geometry)), len=Slider(25, range=0..100))  # -> out, simplify(Lo); inputs L: list, len: Int32
# ---------- t_rec: C# ----------
    String eol = Environment.NewLine;
    Component.Name = "Tail Recorder";
    Component.NickName = "T-Rec";
    Component.Description = "Tail recorder" + eol + "L - list of tail points" + eol + "it - item to add" + eol + "len - tail max length";

    if (L.Count() > len) {
      L.RemoveAt(0);
    }
    L.Add(it);
    Lo = L;
# ---------- end t_rec ----------
cluster_2 = Cluster(L=loop_start.Data)
loop_end = LoopEnd(
    port=loop_start.port,
    Exit=exit,
    Data=t_rec.Lo,
    Data_2=flatten(trmvec),
    pausedState=False,
    state="Constant & Record",
    TimeOutVal=0)  # -> D0, D1
cloud = CloudDisplay(Points=loop_start.Data, Colours=cluster_2, Size=Slider(0.4, range=0..12), SpriteType=1)
group = Group(Objects=loop_end.D0)  # disabled
repeat_2 = RepeatData(Data=iter, Length=agent)  # disabled
series = Series(Start=0, Step=1, Count=agent)  # disabled
trim = TrimTree(Tree=group, Depth=1)  # disabled
merge = Merge(Data1=graft(repeat_2), Data2=graft(series))  # -> simplify(Result); disabled
flip = FlipMatrix(Data=trim)  # disabled
ungroup = Ungroup(Group=flip)  # disabled
path = ConstructPath(Indices=merge)  # disabled
branch = TreeBranch(Tree=loop_end.D0, Path=path, MaintainPaths=True)  # -> simplify(Branch); disabled
trim_2 = TrimTree(Tree=ungroup, Depth=1)  # disabled
number_slider = Slider(10, range=0..10)  # disabled
toggle = BooleanToggle(True)  # disabled
duppt = RemoveDuplicatePts(Points=trim_2, Tolerance=0.01)  # -> simplify(UniquePoints); disabled
number_slider_2 = Slider(1, range=0..10)  # disabled
oct = OcTree(Points=flatten(duppt), Square=toggle, Group=number_slider)  # -> Boxes, Points; disabled
pline = PolyLine(Vertices=duppt, Closed=False)  # disabled
redpline = Reduce(Polyline=pline, Tolerance=number_slider_2)  # -> Polyline, Reduction; disabled
end = EndPoints(Curve=pline)  # -> Start, End; disabled
smesh = SimpleMesh(Brep=oct.Boxes)  # disabled
explode = Explode(Curve=redpline.Polyline, Recursive=True)  # -> simplify(flatten(Segments)), Vertices; disabled
ln = Line(StartPoint=end.Start, EndPoint=end.End)  # -> flatten(Line); disabled
diag = Diagonalize(Mesh=smesh)  # disabled
wires = BrepWireframe(Brep=oct.Boxes, Density=-1)  # -> flatten(Wireframe); disabled
wbedges = WeaverbirdsMeshEdges(MeshOrPolylines=diag)  # disabled
shortwalk = ShortestWalk(Curves=[wires, wbedges], WantedPath=explode.Segments)  # -> ShortestWalk, Succession, Direction, Length; disabled
explode_2 = Explode(Curve=shortwalk.ShortestWalk, Recursive=True)  # -> flatten(Segments), Vertices; disabled
curvepoint = PointOnCurve(explode_2.Segments, parameter=0.5)  # disabled
number_slider_3 = Slider(1.27, range=0..10)  # disabled
number_slider_4 = Slider(0.3, range=0..1)  # disabled
cullpt = CullDuplicates(Points=curvepoint, Tolerance=0.1, CullMode=1)  # -> Points, Indices, Valence; disabled
number_slider_5 = Slider(4, range=0..10)  # disabled
number_slider_6 = Slider(0.1, range=0..1)  # disabled
bnd = Bounds(Numbers=cullpt.Valence)  # disabled
item_2 = ListItem(List=explode_2.Segments, Index=cullpt.Indices, Wrap=True)  # disabled
dom = ConstructDomain(DomainStart=number_slider_4, DomainEnd=number_slider_3)  # disabled
swatch = ColourSwatch(SwatchColor=RGB(255, 255, 255))  # disabled
remap = RemapNumbers(Value=cullpt.Valence, Source=bnd, Target=dom)  # -> Mapped, Clipped; disabled
mpipe = MeshPipe(Curve=item_2, Radius=remap.Mapped, Accuracy=number_slider_6, Rotation=0, Segments=number_slider_5, Caps=1)  # disabled
previewlw = CustomPreviewLineweights(Geometry=item_2, Shader=swatch, Thickness=cullpt.Valence)  # disabled
group_2 = Group(Objects=mpipe)  # disabled

# ==== cluster Cluster
L = ClusterInput()

lng = ListLength(List=L)  # -> flatten(Length)
item = ListItem(List=lng, Index=0, Wrap=True)
round = Round(Number=item)  # -> Nearest, Floor, Ceiling
division = Division(A="1", B=round.Ceiling)
series = Series(Start=0, Step=division, Count=round.Ceiling)
graph = GraphMapper(
    series,
    x0=0,
    x1=1,
    y0=0,
    y1=1,
    container_name="Bezier",
    cpx=[0, 0.6374178529, 0.8142894506, 1],
    cpy=[0, 0.1260549426, 0.5961636305, 1])
xyz = ColourXYZ(Alpha=1, X=graph, Y=graph, Z=graph)

range = Range(Domain=Domain(0, 1), Steps=expr("x-1", item))
C = ClusterOutput(xyz)

# ==== cluster Steer
maxf = ClusterInput()
vel = ClusterInput()
maxv = ClusterInput()
des = ClusterInput()
amp = Amplitude(Vector=des, Amplitude=maxv)
subtraction = Subtraction(A=amp, B=vel)
multiplication = Multiplication(A=subtraction, B=maxf)
vlen = VectorLength(Vector=multiplication)
min = Minimum(A=vlen, B=maxv)
amp_2 = Amplitude(Vector=multiplication, Amplitude=min)
acc = ClusterOutput(amp_2)

# ==== cluster Cluster_2
agent_location = ClusterInput()
agent_vector_global = ClusterInput()
visible_tail = ClusterInput()
motion_vector = Vector(agent_vector_global)
# visible tail points for each agent
pt = Point(simplify(visible_tail))
pt_2 = Point(agent_location)
# get non-empty branches
clean = CleanTree(RemoveNulls=True, RemoveInvalid=True, RemoveEmpty=True, Tree=pt)  # -> simplify(Tree)
# get indices of non-empty branches
viewer = ParamViewer(clean)
dpath = DeconstructPath(Branch=viewer)  # -> flatten(Indices)
# corresponding agents for each
# non-empty branch
branch = TreeBranch(Tree=simplify(graft(pt_2)), Path=viewer, MaintainPaths=True)
# corresponding velocity for each
# non-empty branch
item = ListItem(List=motion_vector, Index=dpath, Wrap=True)
vec2pt = Vector2Pt(PointA=branch, PointB=clean, Unitize=False)  # -> Vector, Length; disabled
# vector to closest point in tail
cp = ClosestPoint(Point=branch, Cloud=clean)  # -> ClosestPoint, CPIndex, Distance
sort = SortList(Keys=vec2pt.Length, ValuesA=vec2pt.Vector, ValuesB=clean)  # -> Keys, ValuesA, ValuesB; disabled
vec2pt_2 = Vector2Pt(PointA=branch, PointB=cp.ClosestPoint, Unitize=False)  # -> Vector, Length

# ---- group: vec
item_2 = ListItem(List=sort.ValuesA, Index=0, Wrap=True)  # disabled

# ----
angle = Angle(VectorA=simplify(graft(item)), VectorB=vec2pt_2.Vector)  # -> Angle, Reflex
# angle between vectors
deg = Degrees(Radians=angle.Angle)
vlen = VectorLength(Vector=item)

# ----
# rotation axis
pl = PlaneNormal(Origin=branch, ZAxis=simplify(graft(item)))
pl_2 = PlaneNormal(Origin=branch, ZAxis=vec2pt_2.Vector)
ppx = PlanePlane(PlaneA=pl_2, PlaneB=pl)
# VERY small discrepancies
# between these two, but enough
# to make the system diverge
amp = Amplitude(Vector=vec2pt_2.Vector, Amplitude=simplify(graft(vlen)))  # -> flatten(Vector)
vrot = Rotate(Vector=simplify(graft(item)), Axis=ppx, Angle=degrees(deg))  # -> flatten(Vector)

replace = ReplaceItems(List=motion_vector, Item=vrot, Indices=dpath, Wrap=False)
vector = ClusterOutput(replace)
