# Grasshopper definition 20160405_basic stigmergy_02-notrail.gh (Grasshopper 0.9.76)
# Copyright: Co-de-iT
# plug-ins: Heteroptera, Anemone, Human, Boid, Noise 4D

# reciproCITY
# basic stigmergy example
# (environment read/write)
# tutors
# Aldo Sollazzo
# Alessio Erioli
# IaaC . 15-17.04.2016
number_slider = Slider(3, range=1..5)

noise_scale = Slider(0.016, range=0..0.05)
# noise map
mplane = MeshPlane(Boundary={Plane=PlaneXY(0, 0, 0), Size=Domain2(u=0..200, v=0..100)}, WidthCount=100, HeightCount=50)  # -> Mesh, Area
demesh = DeconstructMesh(Mesh=mplane.Mesh)  # -> Vertices, Faces, Colours, Normals
perlin = PerlinNoise(Values=demesh.Vertices, Time=0, Scale=noise_scale)
gradient = Gradient(LowerLimit="-1", UpperLimit=1, Parameter=perlin, stops=[0: RGB(255, 255, 255), 1: RGB(0, 0, 0)])
Z = UnitZ(Factor=-1)
move = Move(Geometry=demesh.Vertices, Motion=Z)  # -> Geometry, Transform
conmesh = ConstructMesh(Vertices=demesh.Vertices, Faces=demesh.Faces, Colours=gradient)

pt = Point(flatten([Point(97.23026444, 47.18736088, 0), Point(102.9208052, 48.59891617, 0), Point(109.1723951, 44.36547091, 0), Point(101.5460938, 37.88936513, 0), Point(111.4122517, 36.20139809, 0), Point(112.988691, 52.15460782, 0), Point(89.47101574, 41.51944567, 0), Point(97.70682141, 55.38789412, 0)]))
# <title>
# 
# <description>
# 
# code by <author>
# 
# v <version>
# 
# © Co-de-iT 2016 _ Creative Commons Attribution-NonCommercial-ShareAlike 4.0 International License
# loc
dup = DuplicateData(Data=pt, Number=number_slider, Order=True)
lng = ListLength(List=dup)
wheel = ColourWheel(
    lng,
    ColourGrips_Style=10,
    ColourGrips_Grip=[3.410431301, 3.141592654, 1.570796327, 4.71238898],
    ColourGrips_Lum=[0.0534287417, 0.560828417],
    ColourGrips_Range=[0.2307165557, 0.2307165557, 0.2307165557, 0.2307165557],
    ColourGrips_Sat=[1, 0.8651205502])
rnd_vector = RandomVector(Number=lng, Lenght="1.0 to 3.0", isflat=True)
# vel
vec = Vector(flatten(rnd_vector))
# col
col = Colour(flatten(wheel))
# tail
# < NB: always add the trail (or tail) as LAST
pt_2 = Point(dup)
demesh_2 = DeconstructMesh(Mesh=conmesh)  # -> Vertices, Faces, Colours, Normals
# fields
merge = Merge(Data1=simplify(graft(dup)), Data2=simplify(graft(vec)), Data3=simplify(graft(col)), Data4=simplify(graft(pt_2)))
evaporation_rate = Slider(0.97952, range=0..1)
maxforce = Slider(0.772, range=0..1)
futloc = Slider(2.5, range=0..3)
ph_strength = Slider(0.238, range=0..1)
maxspeed = Slider(1.5, range=0..3)
wandering_threshold = Slider(0.15, range=0..1)
wandering_angle = Slider(49.21, range=0..90)
group = Group(Objects=merge)
loop_start = LoopStart(N=Slider(230, range=0..1000), T=Button(), D0=group, D1=demesh_2.Colours)  # -> port, Counter, Data, Data_2
panel = Panel(loop_start.Counter)
ungroup = Ungroup(Group=loop_start.Data)  # -> simplify(Objects)
split = SplitList(List=ungroup, Index="3")  # -> ListA, ListB

# ----
# loc
# vel
# col
item = ListItem(List=split.ListA, Index=0, Wrap=True)  # -> Item, Item1, Item2

# ----
# read environment
amp = Amplitude(Vector=item.Item1, Amplitude=futloc)
# future location
move_2 = Move(Geometry=item.Item, Motion=amp)  # -> Geometry, Transform
samples = Slider(5, range=3..10)
cps = ClosestPoints(Point=move_2.Geometry, Cloud=demesh_2.Vertices, Count=samples)  # -> ClosestPoint, CPIndex, Distance
item_2 = ListItem(List=loop_start.Data_2, Index=cps.CPIndex, Wrap=True)
max_angle = Slider(90, range=0..90)
rad = Radians(Degrees=wandering_angle)
ahsv = SplitAHSV(Colour=item_2)  # -> Alpha, Hue, Saturation, Value
sort = SortList(Keys=ahsv.Value, ValuesA=cps.ClosestPoint, ValuesB=cps.CPIndex)  # -> Keys, ValuesA, ValuesB
neg = Negative(Value=rad)
perlin_2 = PerlinNoise(Values=item.Item, Time=0, Scale=noise_scale)
dom = ConstructDomain(DomainStart=neg, DomainEnd=rad)
multiplication = Multiplication(A=perlin_2, B=max_angle)
Z_2 = UnitZ(Factor=1)
item_3 = ListItem(List=simplify(sort.Keys), Index=0, Wrap=True)  # -> Item1, Item
lng_2 = ListLength(List=flatten(item_3.Item1))
# brightest
item_4 = ListItem(List=simplify(sort.ValuesA), Index=0, Wrap=True)  # -> Item1, Item
# darkest
item_5 = ListItem(List=simplify(sort.ValuesB), Index=0, Wrap=True)  # -> Item1, Item
smaller = SmallerThan(FirstNumber=item_3.Item1, SecondNumber=wandering_threshold)  # -> simplify(SmallerThan), OrEqualTo
random = Random(Range=dom, Number=lng_2, Seed=loop_start.Counter)  # -> simplify(graft(Random))
vrot = Rotate(Vector=item.Item1, Axis=Z_2, Angle=degrees(multiplication))  # -> simplify(Vector)
Z_3 = UnitZ(Factor=1)
vec2pt = Vector2Pt(PointA=item.Item, PointB=item_4.Item1, Unitize=False)  # -> Vector, Length
vrot_2 = Rotate(Vector=item.Item1, Axis=Z_3, Angle=random)
maxforce_2 = Slider(0.384, range=0..1)
noise_intensity = Slider(0.296, range=0..1)
weave = Weave(Pattern=smaller.SmallerThan, Stream0=vec2pt.Vector, Stream1=vrot_2, NullGaps=False)
color_intensity = Slider(1, range=0..1)
# steer
steer = Steer(vel=item.Item1, des=vrot, maxv=maxspeed, maxf=maxforce_2)
cp = ClosestPoint(Point=item.Item, Cloud=demesh_2.Vertices)  # -> ClosestPoint, CPIndex, Distance
steer_2 = Steer(vel=item.Item1, des=weave, maxv=maxspeed, maxf=maxforce)
dispatch = Dispatch(List=item.Item, DispatchPattern=smaller.SmallerThan)  # -> ListA, ListB
tail_length = Slider(12, range=2..50)
# write to environment
item_6 = ListItem(List=loop_start.Data_2, Index=cp.CPIndex, Wrap=True)  # -> simplify(Item1), Item
# wanderers
pt_3 = Point(dispatch.ListA)
ahsv_2 = SplitAHSV(Colour=item_6.Item1)  # -> Alpha, Hue, Saturation, Value
multiplication_2 = Multiplication(A=steer_2, B=color_intensity)
multiplication_3 = Multiplication(A=steer, B=noise_intensity)
addition = Addition(A=ahsv_2.Value, B=ph_strength)
addition_2 = Addition(A=item.Item1, B=multiplication_3, C=multiplication_2)
min = Minimum(A=addition, B="1")
trmvec = TrimVector(Vector=addition_2, LengthDomain=maxspeed)
frgb = ColourRGBF(Alpha=1, Red=min, Green=min, Blue=min)
move_3 = Move(Geometry=item.Item, Motion=trmvec)  # -> Geometry, Transform
replace = ReplaceItems(List=flatten(loop_start.Data_2), Item=flatten(frgb), Indices=flatten(cp.CPIndex), Wrap=False)
meshcp = MeshClosestPoint(Point=move_3.Geometry, Mesh=conmesh)  # -> Point, Index, Parameter
multiplication_4 = Multiplication(A=replace, B=evaporation_rate)
# add to tail
tlist = TailList(L=simplify(split.ListB), it=simplify(meshcp.Point), len=tail_length)  # -> out, Lo; inputs L: list, len: Int32
# ---------- tlist: C# ----------
    Component.Name = "Tail List";
    Component.NickName = "TList";
    Component.Description = "Tail list - L list, it item to add, len tail length";

    if (L.Count() > len) {
      L.RemoveAt(0);
    }
    L.Add(it);
    Lo = L;
# ---------- end tlist ----------
merge_2 = Merge(Data1=simplify(meshcp.Point), Data2=simplify(trmvec), Data3=simplify(item.Item2), Data4=simplify(tlist.Lo))
merge_3 = Merge(Data2=simplify(meshcp.Point))  # disabled
group_2 = Group(Objects=merge_2)
loop_paused = LoopPaused(
    port=loop_start.port,
    Exit=False,
    Data=simplify(group_2),
    Data_2=simplify(multiplication_4),
    pausedState=True,
    state="Constant output",
    TimeOutVal=0)  # -> D0, D1
ungroup_2 = Ungroup(Group=loop_paused.D0)
split_2 = SplitList(List=ungroup_2, Index="3")  # -> ListA, ListB
conmesh_2 = ConstructMesh(Vertices=demesh_2.Vertices, Faces=demesh_2.Faces, Colours=loop_paused.D1)
interval = Slider(2, range=1..10)
interval_2 = Slider(2, range=1..10)  # disabled
repeat = RepeatData(Data="0", Length=expr("x-1", interval))
panel_2 = Panel("0")  # disabled
panel_3 = Panel("1")  # disabled
merge_4 = Merge(Data1="1", Data2=repeat)  # -> flatten(Result)
repeat_2 = RepeatData(Data=panel_2, Length=expr("x-1", interval_2))  # disabled
item_7 = ListItem(List=split_2.ListA, Index=0, Wrap=True)  # -> Item, Item1, Item2
viewer = ParamViewer(split_2.ListB)
cull = CullPattern(List=split_2.ListB, CullPattern=merge_4)
merge_5 = Merge(Data1=panel_3, Data2=repeat_2)  # -> flatten(Result); disabled
cull_2 = CullPattern(List=split_2.ListB, CullPattern=merge_5)  # disabled
lng_3 = ListLength(List=viewer)
number_slider_2 = Slider(1.311, range=0..3)
number_slider_3 = Slider(8, range=1..30)  # disabled
repeat_3 = RepeatData(Data=ColourSwatch(SwatchColor=RGB(0, 0, 0)), Length=lng_3)  # -> graft(Data)
pline = PolyLine(Vertices=cull_2, Closed=False)  # disabled
lng_4 = ListLength(List=cull)
merge_6 = Merge(Data1=simplify(repeat_3), Data2=simplify(item_7.Item2))
range = Range(Domain=Domain(0, 1), Steps=expr("x-1", lng_4))
smoothpline = SmoothPolyline(Polyline=pline, Strength=1, Times=number_slider_3)  # disabled
addition_3 = Addition(A=number_slider_2, B=1)
col_2 = Colour(merge_6)
number_slider_4 = Slider(1, range=1..3)  # disabled
expression = Expression(x=range, y=number_slider_2, Expression="1+x*y")
cloud = CloudDisplay(Points=item_7.Item, Colours=item_7.Item2, Size=addition_3, SpriteType=0)
interp = InterpolateData(Data=col_2, Parameter=range, Interpolation=2)
swatch = ColourSwatch(SwatchColor=RGB(113, 162, 189))  # disabled
cloud_2 = CloudDisplay(Points=graft(cull), Colours=graft(interp), Size=graft(expression), SpriteType=0)
previewlw = CustomPreviewLineweights(Geometry=smoothpline, Shader=swatch, Thickness=number_slider_4, Absolute=False)  # disabled

# ==== cluster Steer
maxf = ClusterInput()
vel = ClusterInput()
maxv = ClusterInput()
des = ClusterInput()
amp = Amplitude(Vector=des, Amplitude=maxv)
subtraction = Subtraction(A=amp, B=vel)
multiplication = Multiplication(A=subtraction, B=maxf)
vlen = VectorLength(Vector=multiplication)
min = Minimum(A=vlen, B=maxv)
amp_2 = Amplitude(Vector=multiplication, Amplitude=min)
acc = ClusterOutput(amp_2)
