# Grasshopper definition live class_01.gh (Grasshopper 0.9.76)
# plug-ins: Anemone, Boid, Noise 4D

pt = Point([<point referenced from the Rhino model> x7])
lng = ListLength(List=pt)
X = UnitX(Factor=1)
repeat = RepeatData(Data=X, Length=lng)
loop_start = LoopStart(N=Slider(47, range=0..100), D0=pt, D1=repeat)  # -> port, Counter, Data, Data_2
panel = Panel(loop_start.Counter)
random = Random(Range=Domain(0, 1), Number=Slider(3, range=0..10), Seed=loop_start.Counter)
item = ListItem(List=random, Index=0, Wrap=True)  # -> Item, Item1, Item2
vec = VectorXYZ(XComponent=item.Item, YComponent=item.Item1, ZComponent=item.Item2)  # -> Vector, Length
panel_2 = Panel(vec.Vector)
wander = RandomWander(
    AgentMotionVectors=loop_start.Data_2,
    AngleSpreadDomain=Domain(0, 3.141592654),
    RandomSeed=loop_start.Counter,
    AbsoluteMultiplier=1)
move = Move(Geometry=loop_start.Data, Motion=wander)  # -> Geometry, Transform
vdis = VectorDisplay(Anchor=loop_start.Data, Vector=vec.Vector)
loop_end = LoopEnd(
    port=loop_start.port,
    Exit=False,
    Data=simplify(move.Geometry),
    Data_2=simplify(wander),
    pausedState=False,
    state="Constant & Record",
    TimeOutVal=0)  # -> D0, D1

pt_2 = Point(<point referenced from the Rhino model>)
loop_start_2 = LoopStart(Repeat=Slider(2, range=0..10), Data=pt_2)  # -> port, Counter, Data
X_2 = UnitX(Factor=1)
pt_3 = Point(loop_start_2.Data)
move_2 = Move(Geometry=pt_3, Motion=X_2)  # -> Geometry, Transform
vdis_2 = VectorDisplay(Anchor=pt_3, Vector=X_2)
loop_end_2 = LoopEnd(port=loop_start_2.port, Exit=False, Data=move_2.Geometry, pausedState=False, state="Constant output", TimeOutVal=0)

pt_4 = Point(<point referenced from the Rhino model>)
pt_5 = Point(<point referenced from the Rhino model>)

# ---- group: agents loc
pt_6 = Point([Point(20.68818885, 53.49454698, 0), Point(-38.80058976, 67.49558319, 0), Point(-54.48116538, 34.24542258, 0), Point(-59.7869193, -44.62384536, 0), Point(33.4946372, -9.046844048, 0), Point(-0.8606321336, 40.27865894, 0), Point(25.64940053, 81.05544307, 0), Point(59.30986533, 46.72674309, 0), Point(-65.54670763, 59.3505721, 0)])

# ----
vec2pt = Vector2Pt(PointA=pt_5, PointB=pt_4, Unitize=False)  # -> Vector, Length
move_3 = Move(Geometry=pt_5, Motion=vec2pt.Vector)  # -> Geometry, Transform

# ---- group: goals
pt_7 = Point([Point(50.29443987, 10.14195328, 187.0951493), Point(-47.76228293, 25.33262355, 187.0951493), Point(-11.75215075, 94.67648612, 187.0951493)])

# ----
pt_8 = Point(simplify(loop_end.D0))
flip = FlipMatrix(Data=simplify(pt_8))
viewer = ParamViewer(pt_8)
viewer_2 = ParamViewer(flip)
pline = PolyLine(Vertices=flip, Closed=False)

# ----
# goal
# s = d-v
# des
# v
# d = des.limit(maxVel)
# current position
# s = steer.scale(maxForce)
# steer
# v
initial_vel = Slider(0, range=0..10)
Z = UnitZ(Factor=initial_vel)
lng_2 = ListLength(List=pt_6)
max_vel = Slider(3.5, range=0..10)
n_of_goals = Slider(2, range=1..3)

# ---- group: agents vel
repeat_2 = RepeatData(Data=Z, Length=lng_2)

# ----
number_slider = Slider(30, range=0..100)  # disabled
pop3d = Populate3D(Region={Plane=PlaneXY(0, 0, 0), X=Domain(0, 10), Y=Domain(0, 10), Z=Domain(0, 2)}, Count=number_slider, Seed=1)  # disabled
pt_9 = Point(pop3d)  # disabled
lng_3 = ListLength(List=pt_9)  # disabled
X_3 = UnitX(Factor=1)  # disabled
number_slider_2 = Slider(42, range=0..110)  # disabled
repeat_3 = RepeatData(Data=X_3, Length=lng_3)  # disabled
button = Button()  # disabled
loop_start_3 = LoopStart(N=number_slider_2, T=button, D0=pt_9, D1=repeat_3)  # -> port, Counter, Data, Data_2; disabled
number_slider_3 = Slider(2, range=0..10)  # disabled
number_slider_4 = Slider(0.5, range=0..1)  # disabled
avr = Average(Input=loop_start_3.Data)  # disabled
neg = Negative(Value=number_slider_3)  # disabled
number_slider_5 = Slider(14, range=0..100)  # disabled
number_slider_6 = Slider(1, range=0..1)  # disabled
pcharge = PointCharge(Point=avr, Charge=neg, Decay=number_slider_4)  # disabled
rad = Radians(Degrees=number_slider_5)  # disabled
number_slider_7 = Slider(0.5, range=0..1)  # disabled
mergef = MergeFields(Fields=pcharge)  # disabled
wander_2 = RandomWander(
    AgentMotionVectors=loop_start_3.Data_2,
    AngleSpreadDomain=rad,
    RandomSeed=loop_start_3.Counter,
    AbsoluteMultiplier=number_slider_6)  # disabled
evf = EvaluateField(Field=mergef, Point=loop_start_3.Data)  # -> Tensor, Strength; disabled
trmvec = TrimVector(Vector=evf.Tensor, LengthDomain=number_slider_7)  # disabled
number_slider_8 = Slider(0.4, range=0..1)  # disabled
swatch = ColourSwatch(SwatchColor=RGB(255, 0, 0))  # disabled
swatch_2 = ColourSwatch(SwatchColor=RGB(234, 255, 0))  # disabled
swatch_3 = ColourSwatch(SwatchColor=RGB(255, 255, 255))  # disabled
vdisex = VectorDisplayEx(Point=loop_start_3.Data, Vector=wander_2, Colour=swatch, Width=2)  # disabled

number_slider_9 = Slider(0.08, range=0..0.1)  # disabled
adhere = AhereToTheFlockCenter(
    AgentLocationPoint=loop_start_3.Data,
    LocationPointsOfTheFlock=loop_start_3.Data,
    SearchDistance=Domain(0, 0),
    ReferenceAgentsCount=-1,
    Multiplier=number_slider_9)  # disabled

addition = Addition(A=adhere, B=wander_2)  # disabled
trmvec_2 = TrimVector(Vector=addition, LengthDomain=number_slider_8)  # disabled
vdisex_2 = VectorDisplayEx(Point=loop_start_3.Data, Vector=addition, Colour=swatch_3, Width=2)  # disabled
vdisex_3 = VectorDisplayEx(Point=loop_start_3.Data, Vector=trmvec_2, Colour=swatch_2, Width=2)  # disabled
move_4 = Move(Geometry=loop_start_3.Data, Motion=addition)  # -> Geometry, Transform; disabled
loop_end_3 = LoopEnd(
    port=loop_start_3.port,
    Exit=False,
    Data=flatten(move_4.Geometry),
    Data_2=flatten(addition),
    pausedState=False,
    state="Constant & Record",
    TimeOutVal=0)  # -> D0, D1; disabled
flip_2 = FlipMatrix(Data=simplify(loop_end_3.D0))  # disabled
pline_2 = PolyLine(Vertices=flip_2, Closed=False)  # disabled
viewer_3 = ParamViewer(flip_2)  # disabled

# ---- group: ENVIRONMENT SETUP
crv = Curve(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)
time = ValueList({"fixed": 0, "dynamic": 1}, selected="dynamic")
time_2 = Slider(3.914, range=0..20)
time_scale = Slider(0.03, range=0..1)
mplane = MeshPlane(Boundary=crv, WidthCount=Slider(67, range=2..100), HeightCount=Slider(64, range=2..100))  # -> Mesh, Area
demesh = DeconstructMesh(Mesh=mplane.Mesh)  # -> Vertices, Faces, Colours, Normals

# ----
merge = Merge(Data1=simplify(graft(pt_6)), Data2=simplify(graft(repeat_2)), Data3=simplify(graft(pt_6)))
group = Group(Objects=merge)
loop_start_4 = LoopStart(Repeat=Slider(250, range=0..300), Trigger=Button(), Data=group)  # -> port, Counter, Data
ungroup = Ungroup(Group=loop_start_4.Data)

# ---- group: ENVIRONMENT SETUP (continued)
multiplication = Multiplication(A=loop_start_4.Counter, B=time_scale)
filter = StreamFilter(Gate=time, Stream0=time_2, Stream1=multiplication)
perlin = PerlinNoise(Values=demesh.Vertices, Time=filter, Scale=Slider(0.008, range=0..0.1))
gradient = Gradient(LowerLimit="-1", UpperLimit=1, Parameter=perlin, stops=[0: RGB(255, 255, 255), 1: RGB(0, 0, 0)])
conmesh = ConstructMesh(Vertices=demesh.Vertices, Faces=demesh.Faces, Colours=gradient)

# ---- group: get n. of fields before trail
lng_4 = ListLength(List=merge)  # -> flatten(Length)
item_2 = ListItem(List=lng_4, Index=0, Wrap=True)
subtraction = Subtraction(A=item_2, B=1)

# ----
split = SplitList(List=ungroup, Index=subtraction)  # -> ListA, ListB
item_3 = ListItem(List=split.ListA, Index=0, Wrap=True)  # -> Item, Item1

# ---- group: vel
vec_2 = Vector(item_3.Item1)

# ---- group: FIND FUTURE LOCATION
future_location = Slider(5, range=0..5)
amp = Amplitude(Vector=vec_2, Amplitude=future_location)

# ---- group: loc
pt_10 = Point(item_3.Item)

# ---- group: FIND FUTURE LOCATION / fut loc
move_5 = Move(Geometry=pt_10, Motion=amp)  # -> Geometry, Transform

# ---- group: SEEK COLOR
# brighter
# darker
samples = Slider(20, range=3..50)
demesh_2 = DeconstructMesh(Mesh=conmesh)  # -> Vertices, Faces, Colours, Normals
cps = ClosestPoints(Point=move_5.Geometry, Cloud=demesh_2.Vertices, Count=samples)  # -> ClosestPoint, CPIndex, Distance
item_4 = ListItem(List=demesh_2.Colours, Index=cps.CPIndex, Wrap=True)
ahsv = SplitAHSV(Colour=item_4)  # -> Alpha, Hue, Saturation, Value; disabled
argb = SplitARGB(Colour=item_4)  # -> Alpha, Red, Green, Blue
preview = CustomPreview(Geometry=cps.ClosestPoint, Shader=item_4)
sort = SortList(Keys=argb.Red, ValuesA=cps.ClosestPoint)  # -> Keys, ValuesA
item_5 = ListItem(List=sort.ValuesA, Index=0, Wrap=True)  # -> Item1, Item

# ---- group: desired
vec2pt_2 = Vector2Pt(PointA=pt_10, PointB=item_5.Item1, Unitize=False)  # -> Vector, Length

# ---- group: acceleration
trmvec_3 = TrimVector(Vector=vec2pt_2.Vector, LengthDomain=max_vel)
max_force = Slider(0.306, range=0..1)
subtraction_2 = Subtraction(A=trmvec_3, B=vec_2)
multiplication_2 = Multiplication(A=subtraction_2, B=max_force)

# ---- group: UPDATE SPEED
addition_2 = Addition(A=vec_2, B=multiplication_2)

# ---- group: LIMIT vs SET AMPLITUDE
amp_2 = Amplitude(Vector=addition_2, Amplitude=max_vel)
trmvec_4 = TrimVector(Vector=addition_2, LengthDomain=max_vel)

# ----
cps_2 = ClosestPoints(Point=move_5.Geometry, Cloud=pt_7, Count=n_of_goals)  # -> ClosestPoint, CPIndex, Distance
avr_2 = Average(Input=cps_2.ClosestPoint)
move_6 = Move(Geometry=pt_10, Motion=amp_2)  # -> Geometry, Transform
meshcp = MeshClosestPoint(Point=move_6.Geometry, Mesh=conmesh)  # -> Point, Index, Parameter

# ---- group: uptdate trail
merge_2 = Merge(Data1=simplify(split.ListB), Data2=simplify(meshcp.Point))

# ----
merge_3 = Merge(Data1=simplify(meshcp.Point), Data2=simplify(amp_2), Data3=simplify(merge_2))
group_2 = Group(Objects=merge_3)
loop_end_4 = LoopEnd(port=loop_start_4.port, Exit=False, Data=simplify(group_2), pausedState=False, state="Constant output", TimeOutVal=0)
ungroup_2 = Ungroup(Group=loop_end_4)
split_2 = SplitList(List=ungroup_2, Index=subtraction)  # -> ListA, ListB
pt_11 = Point(split_2.ListB)
pline_3 = PolyLine(Vertices=split_2.ListB, Closed=False)
cloud = CloudDisplay(Points=pt_11, Colours=ColourSwatch(SwatchColor=RGB(120, 13, 13)), Size=1, SpriteType=0)
