# Grasshopper definition live class_02.gh (Grasshopper 0.9.76)
# plug-ins: Anemone, Boid, Noise 4D

crv = Curve(<curve referenced from the Rhino model>)
boundary = BoundarySurfaces(Edges=crv)
mesh_uv = MeshSurface(Surface=boundary, UCount=Slider(85, range=0..100), VCount=Slider(51, range=0..100), Overhang=True, Equalize=False)
demesh = DeconstructMesh(Mesh=mesh_uv)  # -> Vertices, Faces, Colours, Normals
perlin = PerlinNoise(Values=demesh.Vertices, Time=Slider(100, range=0..100), Scale=Slider(0.01, range=0..1))
gradient = Gradient(LowerLimit="-1", UpperLimit=1, Parameter=perlin, stops=[0: RGB(255, 255, 255), 1: RGB(0, 0, 0)])
conmesh = ConstructMesh(Vertices=demesh.Vertices, Faces=demesh.Faces, Colours=gradient)

# ---- group: locations
popgeo = PopulateGeometry(Geometry=mesh_uv, Count=Slider(32, range=0..100), Seed=1)

# ---- group: vectors
number_slider = Slider(0.2, range=0..1)
vec = VectorXYZ(XComponent=number_slider, YComponent=number_slider, ZComponent=0)  # -> Vector, Length
lng = ListLength(List=popgeo)
repeat = RepeatData(Data=vec.Vector, Length=lng)

# ----
merge = Merge(Data1=simplify(graft(popgeo)), Data2=simplify(graft(repeat)), Data3=simplify(graft(popgeo)))
group = Group(Objects=merge)

loop_start = LoopStart(Repeat=Slider(221, range=0..300), Trigger=Toggle(True), Data=group)  # -> port, Counter, Data

ungroup = Ungroup(Group=loop_start.Data)
split = SplitList(List=ungroup, Index=Slider(2, range=0..10))  # -> ListA, ListB
item = ListItem(List=split.ListA, Index=0, Wrap=True)  # -> Item, Item1
demesh_2 = DeconstructMesh(Mesh=conmesh)  # -> Vertices, Faces, Colours, Normals
vec_2 = Vector(flatten(item.Item1))
pt = Point(flatten(item.Item))
cluster = Cluster(L=demesh_2.Vertices)
visible = FindVisibleAgents(
    AgentLocationPoint=pt,
    AgentMotionVector=vec_2,
    LocationPointsOfTheFlock=demesh_2.Vertices,
    FlockMotionVectors=cluster,
    SearchDistance=Slider(12, range=0..100),
    SearchAngle=Slider(0.8, range=0..1))  # -> ListOfPoints, ListOfVectors, simplify(ListOfIndices)
multiplication = Multiplication(A=item.Item1, B=Slider(0.05, range=0..0.1))
cluster_2 = Cluster_2(pt=pt, data=visible.ListOfIndices, mesh=conmesh, threshold=Slider(0.8, range=0..1), A=Slider(1, range=0..1))
panel = Panel(cluster_2)
addition = Addition(A=cluster_2, B=multiplication)  # -> flatten(Result)
move = Move(Geometry=pt, Motion=addition)  # -> Geometry, Transform
tlist = TailList(L=split.ListB, it=simplify(graft(move.Geometry)), len=Slider(100, range=0..100))  # -> out, simplify(A); inputs L: list, len: Int32
# ---------- tlist: C# ----------
    Component.Name = "Tail List";
    Component.NickName = "TList";
    Component.Description = "Tail list - L list, it item to add, len tail length";

    if (L.Count() > len) {
      L.RemoveAt(0);
    }
    L.Add(it);
    A = L;
# ---------- end tlist ----------
pt_2 = Point(move.Geometry)
vec_3 = Vector(addition)
merge_2 = Merge(Data1=simplify(graft(pt_2)), Data2=simplify(graft(vec_3)), Data3=simplify(tlist.A))
group_2 = Group(Objects=merge_2)
cloud = CloudDisplay(Points=tlist.A, Colours=RGB(255, 20, 147), Size=Slider(4, range=0..10), SpriteType=0)
loop_end = LoopEnd(port=loop_start.port, Exit=False, Data=group_2, pausedState=False, state="Constant output", TimeOutVal=0)
ungroup_2 = Ungroup(Group=loop_end)
item_2 = ListItem(List=ungroup_2, Index=0, Wrap=True)  # -> Item, Item1, Item2

# ==== cluster Cluster
L = ClusterInput()
vec = VectorXYZ(XComponent="0", YComponent="0", ZComponent="0")  # -> Vector, Length
lng = ListLength(List=L)
repeat = RepeatData(Data=vec.Vector, Length=lng)
D = ClusterOutput(repeat)

# ==== cluster Cluster_2
threshold = ClusterInput()
mesh = ClusterInput()
A = ClusterInput()
pt = ClusterInput()
data = ClusterInput()
mesh_2 = Mesh(mesh)
data_2 = Data(data)
pt_2 = Point(pt)
demesh = DeconstructMesh(Mesh=mesh_2)  # -> Vertices, Faces, Colours, Normals
item = ListItem(List=demesh.Colours, Index=data_2, Wrap=True)  # -> simplify(Item)
item_2 = ListItem(List=demesh.Vertices, Index=data_2, Wrap=True)  # -> simplify(Item)
argb = SplitARGB(Colour=item)  # -> Alpha, Red, Green, Blue
ahsv = SplitAHSV(Colour=item)  # -> Alpha, Hue, Saturation, Value
sort = SortList(Keys=argb.Red, ValuesA=item_2)  # -> Keys, ValuesA
item_3 = ListItem(List=sort.ValuesA, Index=0, Wrap=True)  # -> Item1, Item
item_4 = ListItem(List=sort.Keys, Index=0, Wrap=True)  # -> Item1, Item
vec2pt = Vector2Pt(PointA=simplify(graft(pt_2)), PointB=item_3.Item1, Unitize=False)  # -> flatten(Vector), Length
number_slider = Slider(0, range=0..100)
larger = LargerThan(FirstNumber=item_4.Item1, SecondNumber=threshold)  # -> flatten(LargerThan), OrEqualTo
number_slider_2 = Slider(1.5, range=0..10)
vec = VectorXYZ(XComponent=number_slider, YComponent=number_slider, ZComponent=number_slider)  # -> Vector, Length
amp = Amplitude(Vector=vec2pt.Vector, Amplitude=A)
lng = ListLength(List=amp)
repeat = RepeatData(Data=vec.Vector, Length=lng)
p_n_c = PickNChoose(Pattern=larger.LargerThan, Stream0=amp, Stream1=repeat)  # -> simplify(graft(Result))
R = ClusterOutput(p_n_c)
