# Grasshopper definition live class_02_afternoon.gh (Grasshopper 0.9.76)
# plug-ins: Anemone, Kangaroo Components, Noise 4D

pt = ConstructPoint(XCoordinate=0, YCoordinate=0, ZCoordinate=0)
number_slider = Slider(150, range=0..1000)
rectangle = Rectangle(Plane=pt, XSize=number_slider, YSize=number_slider, Radius=0)  # -> Rectangle, Length
# WORKSHOP NAME
# DATE
# PLACE
mplane = MeshPlane(Boundary=rectangle.Rectangle, WidthCount=Slider(25, range=0..100), HeightCount=Slider(24, range=0..100))  # -> Mesh, Area
demesh = DeconstructMesh(Mesh=mplane.Mesh)  # -> Vertices, Faces, Colours, Normals
perlin = PerlinNoise(Values=demesh.Vertices, Time=Slider(2.7, range=0..10), Scale=Slider(0.017, range=0..0.1))
multiplication = Multiplication(A=perlin, B=Slider(25, range=0..100))
gradient = Gradient(LowerLimit="-1", UpperLimit=1, Parameter=perlin, stops=[0: RGB(255, 255, 255), 1: RGB(0, 0, 0)])
amp = Amplitude(Vector=demesh.Normals, Amplitude=multiplication)
move = Move(Geometry=demesh.Vertices, Motion=amp)  # -> Geometry, Transform

conmesh = ConstructMesh(Vertices=move.Geometry, Faces=demesh.Faces, Colours=gradient)
medges = MeshEdges(Mesh=conmesh)  # -> NakedEdges, InteriorEdges, NonManifoldEdges
crv = Curve(medges.NakedEdges)
join = JoinCurves(Curves=crv, Preserve=False)
divide = DivideCurve(Curve=join, Count=Slider(25, range=0..100), Kinks=False)  # -> Points, Tangents, Parameters
prox = Proximity3D(Points=divide.Points, Group=5, MinRadius=Slider(176, range=0..1000), MaxRadius=Slider(196, range=0..1000))  # -> flatten(Links), Topology
number_slider_2 = Slider(25, range=0..100)
dupln = RemoveDuplicateLines(Lines=prox.Links, Tolerance=0.01)
divide_2 = DivideCurve(Curve=dupln, Count=number_slider_2, Kinks=False)  # -> Points, Tangents, Parameters
loop_start = LoopStart(Repeat=Slider(19, range=0..100), Data=divide_2.Points)  # -> port, Counter, Data
mesh = Mesh(conmesh)
pt_2 = Point(flatten(loop_start.Data))

# ---- group: CLOTHED POINTS
toggle = BooleanToggle(False)
shift = ShiftList(List=loop_start.Data, Shift=1, Wrap=toggle)
shift_2 = ShiftList(List=reverse(shift), Shift=1, Wrap=toggle)  # -> reverse(List)

# ----
demesh_2 = DeconstructMesh(Mesh=mesh)  # -> Vertices, Faces, Colours, Normals
spring_stiffness = Slider(0.1, range=0..0.1)
rest_length = Slider(0.125, range=0..1)
cps = ClosestPoints(Point=pt_2, Cloud=demesh_2.Vertices, Count=Slider(12, range=0..100))  # -> ClosestPoint, simplify(CPIndex), Distance

pt_3 = Point(reverse(loop_start.Data))
toggle_2 = BooleanToggle(False)
shift_3 = ShiftList(List=pt_3, Shift=1, Wrap=toggle_2)
shift_4 = ShiftList(List=pt_3, Shift="-1", Wrap=toggle_2)
vec2pt = Vector2Pt(PointA=shift_4, PointB=shift_3, Unitize=False)  # -> Vector, Length
subtraction = Subtraction(A=vec2pt.Length, B=rest_length)
amp_2 = Amplitude(Vector=vec2pt.Vector, Amplitude=subtraction)
multiplication_2 = Multiplication(A=spring_stiffness, B=amp_2)
shift_5 = ShiftList(List=multiplication_2, Shift=1, Wrap="false")

pt_4 = Point(loop_start.Data)
toggle_3 = BooleanToggle(False)
shift_6 = ShiftList(List=pt_4, Shift=1, Wrap=toggle_3)
shift_7 = ShiftList(List=pt_4, Shift="-1", Wrap=toggle_3)
vec2pt_2 = Vector2Pt(PointA=shift_7, PointB=shift_6, Unitize=False)  # -> Vector, Length
subtraction_2 = Subtraction(A=vec2pt_2.Length, B=rest_length)
amp_3 = Amplitude(Vector=vec2pt_2.Vector, Amplitude=subtraction_2)
multiplication_3 = Multiplication(A=spring_stiffness, B=amp_3)
shift_8 = ShiftList(List=multiplication_3, Shift=1, Wrap="false")

cluster = Cluster(
    agents=pt_2,
    index_of_visible=cps.CPIndex,
    M=mesh,
    intensity=Slider(0.8, range=0..1),
    treshold_limit_value_to_follow=Slider(1, range=0..1),
    b_1_w_0="0")  # -> flatten(vector), elected_point
addition = Addition(A=number_slider_2, B=Slider(1, range=0..1))
partition = PartitionList(List=cluster.vector, Size=addition)
panel = Panel("""0
-1""")
cull_i = CullIndex(List=partition, Indices=panel, Wrap=True)
addition_2 = Addition(A=simplify(shift_8), B=simplify(shift_5), C=simplify(cull_i))
move_2 = Move(Geometry=simplify(shift_2), Motion=simplify(addition_2))  # -> Geometry, Transform
item = ListItem(List=loop_start.Data, Index=0, Wrap=True)
meshcp = MeshClosestPoint(Point=move_2.Geometry, Mesh=mesh)  # -> Point, Index, Parameter
item_2 = ListItem(List=reverse(loop_start.Data), Index=0, Wrap=True)
merge = Merge(Data1=simplify(item), Data2=simplify(meshcp.Point), Data3=simplify(item_2))  # -> simplify(Result)
flatten = FlattenTree(Tree=merge, Path="{0}")

# ---- group: LAPCIAN SMOOTHING
prox_2 = Proximity3D(Points=flatten, Group="5")  # -> Links, Topology
panel_2 = Panel(prox_2.Topology)
item_3 = ListItem(List=flatten, Index=prox_2.Topology, Wrap=True)
avr = Average(Input=item_3)  # -> flatten(ArithmeticMean)
vec2pt_3 = Vector2Pt(PointA=flatten, PointB=avr, Unitize=False)  # -> Vector, Length
multiplication_4 = Multiplication(A=vec2pt_3.Vector, B=Slider(0.25, range=0..1))
move_3 = Move(Geometry=flatten, Motion=multiplication_4)  # -> Geometry, Transform

# ----
number_slider_3 = Slider(0, range=0..100)
item_4 = ListItem(List=merge, Index=0, Wrap=True)
unflatten = UnflattenTree(Tree=move_3.Geometry, Guide=merge)  # -> simplify(Tree)
panel_3 = Panel(unflatten)

# ---- group: original starting point
replace = ReplaceItems(List=unflatten, Item=item_4, Indices=number_slider_3, Wrap=False)

# ----
item_5 = ListItem(List=reverse(merge), Index=0, Wrap=True)

# ---- group: original end point
replace_2 = ReplaceItems(List=reverse(replace), Item=item_5, Indices=number_slider_3, Wrap=False)

# ----
loop_end = LoopEnd(port=loop_start.port, Exit=False, Data=simplify(replace_2), pausedState=False, state="Constant output", TimeOutVal=0)
pline = PolyLine(Vertices=loop_end, Closed=False)

# ==== cluster Cluster
intensity = ClusterInput()
treshold_limit_value_to_follow = ClusterInput()
b_1_w_0 = ClusterInput()
index_of_visible = ClusterInput()
agents = ClusterInput()
M = ClusterInput()
num = Number(treshold_limit_value_to_follow)
num_2 = Number(intensity)
int = Integer(index_of_visible)
pt = Point(agents)
demesh = DeconstructMesh(Mesh=M)  # -> Vertices, Faces, Colours, Normals

color = ListItem(List=demesh.Colours, Index=int, Wrap=True)  # -> simplify(Item)
vertex = ListItem(List=demesh.Vertices, Index=int, Wrap=True)  # -> simplify(Item)

# ----
# using grayscale so each is the same
graysca = SplitARGB(Colour=color)  # -> Alpha, Red, Green, Blue

sort = SortList(Keys=graysca.Red, ValuesA=vertex)  # -> Keys, ValuesA
item = ListItem(List=sort.Keys, Index=0, Wrap=True)  # -> Item1, Item

item_2 = ListItem(List=sort.ValuesA, Index=0, Wrap=True)  # -> Item1, Item
panel = Panel("""follow color
i = black
-i = white""")

filter = StreamFilter(Gate=b_1_w_0, Stream0=item_2.Item1, Stream1=item_2.Item)

vec2pt = Vector2Pt(PointA=simplify(graft(pt)), PointB=filter, Unitize="true")  # -> flatten(Vector), Length
amp = Amplitude(Vector=vec2pt.Vector, Amplitude=num_2)
lng = ListLength(List=amp)
vec = Vector(Vector(0, 0, 0))
larger = LargerThan(FirstNumber=item.Item1, SecondNumber=num)  # -> flatten(LargerThan), OrEqualTo
repeat = RepeatData(Data=vec, Length=lng)
p_n_c = PickNChoose(Pattern=larger.LargerThan, Stream0=amp, Stream1=repeat)  # -> simplify(graft(Result))

vector = ClusterOutput(p_n_c)
elected_point = ClusterOutput(filter)
