# Grasshopper definition Abdullah Ibrahim_Maryan ewais.gh (Grasshopper 0.9.76)
# plug-ins: Anemone, Boid, Noise 4D

Z = UnitZ(Factor=Slider(2.95, range=0..10))
crv = Curve(<curve referenced from the Rhino model>)
mplane = MeshPlane(Boundary=crv, WidthCount=Slider(67, range=2..100), HeightCount=Slider(64, range=2..100))  # -> Mesh, Area
demesh = DeconstructMesh(Mesh=mplane.Mesh)  # -> Vertices, Faces, Colours, Normals
perlin = PerlinNoise(Values=demesh.Vertices, Time=Slider(7.662, range=0..20), Scale=Slider(0.017, range=0..0.1))
number_slider = Slider(2, range=1..3)
amp = Amplitude(Vector=demesh.Normals, Amplitude=perlin)
gradient = Gradient(LowerLimit="-1", UpperLimit=1, Parameter=perlin, stops=[0: RGB(255, 255, 255), 1: RGB(0, 0, 0)])
multiplication = Multiplication(A=amp, B=Slider(10, range=0..10))
move = Move(Geometry=demesh.Vertices, Motion=multiplication)  # -> Geometry, Transform
conmesh = ConstructMesh(Vertices=move.Geometry, Faces=demesh.Faces, Colours=gradient)
popgeo = PopulateGeometry(Geometry=conmesh, Count=Slider(30, range=0..100), Seed=1)

# ---- group: agents loc
pt = Point(popgeo)

# ----
lng = ListLength(List=pt)

# ---- group: agents vel
repeat = RepeatData(Data=Z, Length=lng)

# ----
merge = Merge(Data1=simplify(graft(pt)), Data2=simplify(graft(repeat)), Data3=simplify(graft(pt)))
group = Group(Objects=merge)
loop_start = LoopStart(Repeat=Slider(55, range=0..300), Trigger=Button(), Data=group)  # -> port, Counter, Data
panel = Panel(loop_start.Counter)
ungroup = Ungroup(Group=loop_start.Data)
split = SplitList(List=ungroup, Index=number_slider)  # -> ListA, ListB
item = ListItem(List=split.ListA, Index=0, Wrap=True)  # -> Item, Item1

# ---- group: loc
pt_2 = Point(item.Item)

# ---- group: vel
vec = Vector(item.Item1)

# ----
amp_2 = Amplitude(Vector=vec, Amplitude=Slider(2.802, range=0..5))

# ---- group: fut loc
move_2 = Move(Geometry=pt_2, Motion=amp_2)  # -> Geometry, Transform

# ----
demesh_2 = DeconstructMesh(Mesh=conmesh)  # -> Vertices, Faces, Colours, Normals
cps = ClosestPoints(Point=move_2.Geometry, Cloud=demesh_2.Vertices, Count=Slider(15, range=3..50))  # -> ClosestPoint, CPIndex, Distance
item_2 = ListItem(List=demesh_2.Colours, Index=cps.CPIndex, Wrap=True)
ahsv = SplitAHSV(Colour=item_2)  # -> Alpha, Hue, Saturation, Value
sort = SortList(Keys=ahsv.Value, ValuesA=cps.ClosestPoint)  # -> Keys, ValuesA
cloud = CloudDisplay(Points=cps.ClosestPoint, Colours=RGB(255, 20, 147), Size=item_2, SpriteType=0)
max_vel = Slider(1.023, range=0..10)
item_3 = ListItem(List=sort.ValuesA, Index=0, Wrap=True)  # -> Item1, Item
vec2pt = Vector2Pt(PointA=simplify(move_2.Geometry), PointB=simplify(item_3.Item1), Unitize=False)  # -> Vector, Length
max_force = Slider(0.029, range=0..1)
trmvec = TrimVector(Vector=vec2pt.Vector, LengthDomain=max_vel)
subtraction = Subtraction(A=trmvec, B=vec)
multiplication_2 = Multiplication(A=subtraction, B=max_force)
addition = Addition(A=simplify(vec), B=simplify(multiplication_2))  # -> simplify(Result)
trmvec_2 = TrimVector(Vector=addition, LengthDomain=max_vel)
amp_3 = Amplitude(Vector=addition, Amplitude=max_vel)
move_3 = Move(Geometry=simplify(pt_2), Motion=amp_3)  # -> Geometry, Transform
panel_2 = Panel(amp_3)
vdis = VectorDisplay(Anchor=pt_2, Vector=amp_3)
meshcp = MeshClosestPoint(Point=move_3.Geometry, Mesh=conmesh)  # -> Point, Index, Parameter

# ---- group: uptdate trail
merge_2 = Merge(Data1=simplify(split.ListB), Data2=simplify(meshcp.Point))

# ----
merge_3 = Merge(Data1=simplify(meshcp.Point), Data2=simplify(amp_3), Data3=simplify(merge_2))
group_2 = Group(Objects=merge_3)
loop_end = LoopEnd(port=loop_start.port, Exit=False, Data=simplify(group_2), pausedState=False, state="Constant output", TimeOutVal=0)
ungroup_2 = Ungroup(Group=loop_end)
split_2 = SplitList(List=ungroup_2, Index=number_slider)  # -> ListA, ListB
pt_3 = Point(split_2.ListB)
