# Grasshopper definition AndresMora_&_SureshkumarKumaravel.gh (Grasshopper 0.9.76)
# Copyright: Co-de-iT
# plug-ins: Anemone, Boid

Y = UnitY(Factor=Slider(20, range=0..20))
Y_2 = UnitY(Factor=Slider(20, range=0..20))
toggle_speed = ValueList({"decreasing speed": 0, "fixed": 1}, selected="decreasing speed")

agents = Point([Point(113.2101522, -4.088512022, 0), Point(115.8137199, -10.07671762, 0), Point(111.3876549, -14.76313939, 0), Point(122.322639, -19.97027469, 0), Point(131.174769, -25.95848028, 0), Point(135.8611908, -10.33707438, 0), Point(123.8847796, -7.733506732, 0), Point(124.9262066, 3.461834162, 0), Point(144.452964, 1.378980042, 0), Point(150.1808128, -3.567798493, 0), Point(131.6954825, -6.431722907, 0), Point(130.1333419, -16.06492321, 0), Point(142.6304667, -15.54420968, 0), Point(136.9026178, -25.17740999, 0), Point(116.8551469, -30.12418852, 0), Point(111.3876549, -14.76313939, 0), Point(118.4172875, -20.23063145, 0)])

dup = DuplicateData(Data=graft(agents), Number=Slider(5, range=0..20), Order=True)  # -> flatten(Data)
lng = ListLength(List=dup)

repeat = RepeatData(Data=Y, Length=lng)
vec = Vector(repeat)

merge = Merge(Data1=simplify(graft(dup)), Data2=simplify(graft(vec)))
group = Group(Objects=merge)

agents_2 = Point([Point(101.4257175, -65.6295086, 66.07610143), Point(147.4852889, 33.87453667, 66.02267898)])

lng_2 = ListLength(List=agents_2)
repeat_2 = RepeatData(Data=Y_2, Length=lng_2)

vec_2 = Vector(repeat_2)

merge_2 = Merge(Data1=simplify(graft(agents_2)), Data2=simplify(graft(vec_2)))
group_2 = Group(Objects=merge_2)
loop_start = LoopStart(N=Slider(113, range=0..500), T=Button(), D0=group, D1=group_2)  # -> port, Counter, Data, Data_2

# ---- group: Predator
border_threshold = Slider(10, range=0..10)
crv = Curve(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)
offset = Offset(Curve=crv, Distance=border_threshold, Plane=PlaneXY(0, 0, 0), Corners=1)
preview = CustomPreview(
    Geometry=offset,
    Shader={ambient=RGB(0, 0, 0), diffuse=RGB(255, 105, 180), emission=RGB(76, 32, 54), shine=0.5, specular=RGB(255, 255, 255), transparency=0})
ungroup = Ungroup(Group=loop_start.Data)
item = ListItem(List=ungroup, Index=0, Wrap=True)  # -> Item, Item1
amp = Amplitude(Vector=item.Item1, Amplitude=Slider(2, range=0..10))
move = Move(Geometry=item.Item, Motion=amp)  # -> Geometry, Transform
maxforce = Slider(0.101, range=-1..1)
max_vel = Slider(2.349, range=0..10)
move_2 = Move(Geometry=item.Item, Motion=item.Item1)  # -> Geometry, Transform
pt = Point(item.Item)

# ---- group: Predator / WANDER
wandering_angle = Slider(62.935, range=0..90)
wandering_strength = Slider(0.789, range=0..1)
rad = Radians(Degrees=wandering_angle)
lng_3 = ListLength(List=flatten(item.Item))
neg = Negative(Value=rad)
dom = ConstructDomain(DomainStart=neg, DomainEnd=rad)
Z = UnitZ(Factor=1)
random = Random(Range=dom, Number=lng_3, Seed=loop_start.Counter)  # -> graft(Random)
vrot = Rotate(Vector=item.Item1, Axis=Z, Angle=random)
addition = Addition(A=amp, B=vrot)
steer = Steer(vel=item.Item1, des=addition, maxv=max_vel, maxf=wandering_strength)

# ---- group: Predator / BORDER CONDITION
crv_cp = CurveClosestPoint(Point=item.Item, Curve=crv)  # -> Point, Parameter, Distance
eval = EvaluateCurve(Curve=crv, Parameter=crv_cp.Parameter)  # -> Point, Tangent, Angle
Z_2 = UnitZ(Factor=1)
smaller = SmallerThan(FirstNumber=crv_cp.Distance, SecondNumber=border_threshold)  # -> SmallerThan, OrEqualTo
vec2pt = Vector2Pt(PointA=eval.Point, PointB=item.Item, Unitize=False)  # -> Vector, Length
xprod = CrossProduct(VectorA=eval.Tangent, VectorB=Z_2, Unitize=False)  # -> Vector, Length
dispatch = Dispatch(List=vec2pt.Vector, DispatchPattern=smaller.OrEqualTo)  # -> ListA, ListB
easing = Slider(0.35, range=0..1)
vlen = VectorLength(Vector=dispatch.ListA)
subtraction = Subtraction(A=border_threshold, B=vlen)
multiplication = Multiplication(A=subtraction, B=easing)
amp_2 = Amplitude(Vector=dispatch.ListA, Amplitude=multiplication)
pt_2 = Point(Point(0, 0, 0))
weave = Weave(Pattern=smaller.OrEqualTo, Stream0=pt_2, Stream1=amp_2, NullGaps=False)

# ---- group: Predator / WANDER
vdisex = VectorDisplayEx(Point=pt, Vector=steer, Colour=ColourSwatch(SwatchColor=RGB(168, 0, 146)), Width=2)

# ---- group: Predator / VELOCITY
vdisex_2 = VectorDisplayEx(Point=pt, Vector=item.Item1, Colour=ColourSwatch(SwatchColor=RGB(0, 109, 168)), Width=2)

# ---- group: Prey
ungroup_2 = Ungroup(Group=loop_start.Data_2)
item_2 = ListItem(List=ungroup_2, Index=0, Wrap=True)  # -> Item, Item1
crv_2 = Curve(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)
amp_3 = Amplitude(Vector=item_2.Item1, Amplitude=Slider(1, range=0..10))
move_3 = Move(Geometry=item_2.Item, Motion=amp_3)  # -> Geometry, Transform
Y_3 = UnitY(Factor=1)
crv_cp_2 = CurveClosestPoint(Point=move_3.Geometry, Curve=graft(crv_2))  # -> Point, Parameter, flatten(Distance)
eval_2 = EvaluateCurve(Curve=crv_2, Parameter=crv_cp_2.Parameter)  # -> Point, Tangent, Angle
vec2pt_2 = Vector2Pt(PointA=move_3.Geometry, PointB=crv_cp_2.Point, Unitize=False)  # -> Vector, Length
item_3 = ListItem(List=crv_cp_2.Distance, Index=0, Wrap=True)  # -> Item, Item1
maxforce_2 = Slider(0.171, range=0..1)
multiplication_2 = Multiplication(A=eval_2.Tangent, B=Slider(0.1, range=0..1))
pt_3 = Point(item_2.Item)

# ---- group: Prey / Decreases Speed according to height
addition_2 = Addition(A=item_3.Item, B=item_3.Item1)
division = Division(A=addition_2, B=Slider(2, range=0..10))
multiplication_3 = Multiplication(A=division, B=Slider(0.05, range=0..1))

# ---- group: Prey / Toggles between speed
filter = StreamFilter(Gate=toggle_speed, Stream0=multiplication_3, Stream1=Slider(1, range=0..1))

# ---- group: Prey
# steer
steer_2 = Steer(vel=item_2.Item1, des=vec2pt_2.Vector, maxv=filter, maxf=maxforce_2)

multiplication_4 = Multiplication(A=steer_2, B=Slider(0.1, range=0..1))
addition_3 = Addition(A=multiplication_4, B=multiplication_2)
addition_4 = Addition(A=item_2.Item1, B=addition_3)
trmvec = TrimVector(Vector=addition_4, LengthDomain=filter)
move_4 = Move(Geometry=item_2.Item, Motion=trmvec)  # -> Geometry, Transform
pt_4 = Point(flatten(move_4.Geometry))
item_4 = ListItem(List=pt_4, Index=Slider(0, range=0..1), Wrap=True)  # -> Item, Item1, Item2
item_5 = ListItem(List=pt_4, Index=Slider(1, range=0..1), Wrap=True)  # -> Item, Item1, Item2
pt_5 = Point(item_4.Item)
pt_6 = Point(item_5.Item)
ln = Line(StartPoint=pt_5, EndPoint=pt_6)
merge_3 = Merge(Data1=move_4.Geometry, Data2=trmvec)
group_3 = Group(Objects=merge_3)

# ---- group: Prey / VELOCITY
vdisex_3 = VectorDisplayEx(Point=pt_3, Vector=item_2.Item1, Colour=ColourSwatch(SwatchColor=RGB(0, 109, 168)), Width=2)

# ---- group: Prey / FINAL VECTOR
vdisex_4 = VectorDisplayEx(Point=pt_3, Vector=trmvec, Colour=ColourSwatch(SwatchColor=RGB(255, 255, 255)), Width=2)

# ---- group: Prey / STEER
vdisex_5 = VectorDisplayEx(Point=pt_3, Vector=steer_2, Colour=RGB(0, 0, 0), Width=2)

# ---- group: Predator (continued)
cp = ClosestPoint(Point=move.Geometry, Cloud=pt_4)  # -> ClosestPoint, CPIndex, Distance
pt_7 = Point(cp.ClosestPoint)
vec2pt_3 = Vector2Pt(PointA=move.Geometry, PointB=cp.ClosestPoint, Unitize=False)  # -> simplify(Vector), Length

# steer
steer_3 = Steer(vel=item.Item1, des=vec2pt_3.Vector, maxv=max_vel, maxf=maxforce)

addition_5 = Addition(A=item.Item1, B=steer_3, C=steer, D=weave)
trmvec_2 = TrimVector(Vector=addition_5, LengthDomain=max_vel)
move_5 = Move(Geometry=item.Item, Motion=trmvec_2)  # -> Geometry, Transform
merge_4 = Merge(Data1=simplify(move_5.Geometry), Data2=simplify(trmvec_2))
group_4 = Group(Objects=merge_4)

# ----
loop_end = LoopEnd(
    port=loop_start.port,
    Exit=False,
    Data=simplify(group_4),
    Data_2=group_3,
    pausedState=False,
    state="Constant & Record",
    TimeOutVal=0)  # -> D0, D1
ungroup_3 = Ungroup(Group=loop_end.D0)
item_6 = ListItem(List=ungroup_3, Index=0, Wrap=True)

# ---- group: Predator / FINAL VECTOR
vdisex_6 = VectorDisplayEx(Point=pt, Vector=trmvec_2, Colour=ColourSwatch(SwatchColor=RGB(255, 255, 255)), Width=2)

# ---- group: Predator / SEEK
vdisex_7 = VectorDisplayEx(Point=move_2.Geometry, Vector=steer_3, Colour=RGB(0, 0, 0), Width=2)

# ==== cluster Steer
maxf = ClusterInput()
vel = ClusterInput()
maxv = ClusterInput()
des = ClusterInput()
amp = Amplitude(Vector=des, Amplitude=maxv)
subtraction = Subtraction(A=amp, B=vel)
multiplication = Multiplication(A=subtraction, B=maxf)
vlen = VectorLength(Vector=multiplication)
min = Minimum(A=vlen, B=maxv)
amp_2 = Amplitude(Vector=multiplication, Amplitude=min)
acc = ClusterOutput(amp_2)
