# Grasshopper definition James Abbas.gh (Grasshopper 0.9.76)
# Copyright: Co-de-iT
# plug-ins: Anemone, Boid

pt = Point([Point(60.04656827, 153.2856053, 0), Point(-82.08419314, 74.26133678, 0), Point(-22.44579209, 18.40927146, 0), Point(-4.280179054, -60.40202007, 0), Point(48.78408414, -167.9796893, 0), Point(125.5601491, -124.8864264, 0), Point(80.04503006, -35.5160727, 0)])
# CURVE BOUNDARY
number_slider = Slider(5, range=0..20)
Y = UnitY(Factor=Slider(20, range=0..20))
dup = DuplicateData(Data=graft(pt), Number=number_slider, Order=True)  # -> flatten(Data)
lng = ListLength(List=dup)

agents = Point([Point(27.66381252, -10.25946277, 0), Point(25.89416457, -24.94754074, 0), Point(17.39985441, -15.21447702, 0), Point(19.16950236, -19.81556169, 0), Point(24.8323758, -12.91393469, 0), Point(31.55703801, -16.45323059, 0), Point(36.33508747, -23.70878718, 0), Point(24.12451662, -28.48683664, 0)])
repeat = RepeatData(Data=Y, Length=lng)
vec = Vector(repeat)

border_threshold = Slider(7.494, range=0..10)
crv = Curve(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)
merge = Merge(Data1=simplify(graft(dup)), Data2=simplify(graft(vec)))
arrive = Point(Point(27.49895507, -26.61973736, 0))
offset = Offset(Curve=crv, Distance=border_threshold, Plane=PlaneXY(0, 0, 0), Corners=1)
group = Group(Objects=merge)
preview = CustomPreview(
    Geometry=offset,
    Shader={ambient=RGB(0, 0, 0), diffuse=RGB(255, 105, 180), emission=RGB(76, 32, 54), shine=0.5, specular=RGB(255, 255, 255), transparency=0})
crv_2 = Curve(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)
loop_start = LoopStart(Repeat=Slider(200, range=0..1000), Trigger=Button(), Data=group)  # -> port, Counter, Data
ungroup = Ungroup(Group=loop_start.Data)
item = ListItem(List=ungroup, Index=0, Wrap=True)  # -> Item, Item1
crv_cp = CurveClosestPoint(Point=item.Item, Curve=crv_2)  # -> Point, Parameter, Distance

crv_cp_2 = CurveClosestPoint(Point=item.Item, Curve=crv)  # -> Point, Parameter, Distance
eval = EvaluateCurve(Curve=crv, Parameter=crv_cp_2.Parameter)  # -> Point, Tangent, Angle
Z = UnitZ(Factor=1)
smaller = SmallerThan(FirstNumber=crv_cp_2.Distance, SecondNumber=border_threshold)  # -> SmallerThan, OrEqualTo
vec2pt = Vector2Pt(PointA=eval.Point, PointB=item.Item, Unitize=False)  # -> Vector, Length
xprod = CrossProduct(VectorA=eval.Tangent, VectorB=Z, Unitize=False)  # -> Vector, Length
dispatch = Dispatch(List=vec2pt.Vector, DispatchPattern=smaller.OrEqualTo)  # -> ListA, ListB
easing = Slider(0.55, range=0..1)
vlen = VectorLength(Vector=dispatch.ListA)
subtraction = Subtraction(A=border_threshold, B=vlen)
multiplication = Multiplication(A=subtraction, B=easing)
amp = Amplitude(Vector=dispatch.ListA, Amplitude=multiplication)
pt_2 = Point(Point(0, 0, 0))
weave = Weave(Pattern=smaller.OrEqualTo, Stream0=pt_2, Stream1=amp, NullGaps=False)

eval_2 = EvaluateCurve(Curve=crv_2, Parameter=crv_cp.Parameter)  # -> Point, Tangent, Angle
Z_2 = UnitZ(Factor=1)
vec2pt_2 = Vector2Pt(PointA=eval_2.Point, PointB=item.Item, Unitize=False)  # -> Vector, Length
smaller_2 = SmallerThan(FirstNumber=crv_cp.Distance, SecondNumber=border_threshold)  # -> SmallerThan, OrEqualTo
amp_2 = Amplitude(Vector=item.Item1, Amplitude=Slider(2, range=0..10))
xprod_2 = CrossProduct(VectorA=eval_2.Tangent, VectorB=Z_2, Unitize=False)  # -> Vector, Length
move = Move(Geometry=item.Item, Motion=amp_2)  # -> Geometry, Transform
dispatch_2 = Dispatch(List=vec2pt_2.Vector, DispatchPattern=smaller_2.OrEqualTo)  # -> ListA, ListB
cp = ClosestPoint(Point=move.Geometry, Cloud=arrive)  # -> ClosestPoint, CPIndex, Distance
easing_2 = Slider(0.55, range=0..1)
vlen_2 = VectorLength(Vector=dispatch_2.ListA)
subtraction_2 = Subtraction(A=border_threshold, B=vlen_2)
vec2pt_3 = Vector2Pt(PointA=move.Geometry, PointB=cp.ClosestPoint, Unitize=False)  # -> simplify(Vector), Length
maxforce = Slider(0.282, range=0..1)
multiplication_2 = Multiplication(A=subtraction_2, B=easing_2)
max_vel = Slider(2.349, range=0..10)

# ---- group: WANDER
wandering_strength = Slider(0.789, range=0..1)
wandering_angle = Slider(62.935, range=0..90)
rad = Radians(Degrees=wandering_angle)
lng_2 = ListLength(List=flatten(item.Item))
neg = Negative(Value=rad)
dom = ConstructDomain(DomainStart=neg, DomainEnd=rad)
Z_3 = UnitZ(Factor=1)
random = Random(Range=dom, Number=lng_2, Seed=loop_start.Counter)  # -> graft(Random)
vrot = Rotate(Vector=item.Item1, Axis=Z_3, Angle=random)
addition = Addition(A=amp_2, B=vrot)
steer = Steer(vel=item.Item1, des=addition, maxv=max_vel, maxf=wandering_strength)

# ----
amp_3 = Amplitude(Vector=dispatch_2.ListA, Amplitude=multiplication_2)
pt_3 = Point(Point(0, 0, 0))
weave_2 = Weave(Pattern=smaller_2.OrEqualTo, Stream0=pt_3, Stream1=amp_3, NullGaps=False)

# ----
# steer
steer_2 = Steer(vel=item.Item1, des=vec2pt_3.Vector, maxv=max_vel, maxf=maxforce)

addition_2 = Addition(A=item.Item1, B=steer_2, C=steer, D=weave, E=weave_2)
trmvec = TrimVector(Vector=addition_2, LengthDomain=max_vel)
move_2 = Move(Geometry=item.Item, Motion=trmvec)  # -> Geometry, Transform
merge_2 = Merge(Data1=simplify(move_2.Geometry), Data2=simplify(trmvec))
group_2 = Group(Objects=merge_2)
loop_end = LoopEnd(port=loop_start.port, Exit=False, Data=simplify(group_2), pausedState=False, state="Constant & Record", TimeOutVal=0)
move_3 = Move(Geometry=item.Item, Motion=item.Item1)  # -> Geometry, Transform
pt_4 = Point(item.Item)
ungroup_2 = Ungroup(Group=loop_end)

# ---- group: WANDER
vdisex = VectorDisplayEx(Point=pt_4, Vector=steer, Colour=ColourSwatch(SwatchColor=RGB(168, 0, 146)), Width=2)

# ---- group: VELOCITY
vdisex_2 = VectorDisplayEx(Point=pt_4, Vector=item.Item1, Colour=ColourSwatch(SwatchColor=RGB(0, 109, 168)), Width=2)

# ----
item_2 = ListItem(List=ungroup_2, Index=0, Wrap=True)

# ---- group: FINAL VECTOR
vdisex_3 = VectorDisplayEx(Point=pt_4, Vector=trmvec, Colour=ColourSwatch(SwatchColor=RGB(255, 255, 255)), Width=2)

# ---- group: SEEK
vdisex_4 = VectorDisplayEx(Point=move_3.Geometry, Vector=steer_2, Colour=RGB(0, 0, 0), Width=2)

# ----
pt_5 = Point(flatten(item_2))
pline = PolyLine(Vertices=pt_5, Closed=False)

# ==== cluster Steer
maxf = ClusterInput()
vel = ClusterInput()
maxv = ClusterInput()
des = ClusterInput()
amp = Amplitude(Vector=des, Amplitude=maxv)
subtraction = Subtraction(A=amp, B=vel)
multiplication = Multiplication(A=subtraction, B=maxf)
vlen = VectorLength(Vector=multiplication)
min = Minimum(A=vlen, B=maxv)
amp_2 = Amplitude(Vector=multiplication, Amplitude=min)
acc = ClusterOutput(amp_2)
