# Grasshopper definition Session 2.1 Workshop.gh (Grasshopper 0.9.76)
# Copyright: Co-de-iT
# plug-ins: Anemone, Boid

number_slider = Slider(50, range=0..50)

# ---- group: Bounding Box
crv = Curve(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)

# ---- group: Void Zone Detractors
pt = Point([Point(33.9301863, 69.96429801, 0), Point(64.84152508, 58.69999659, 0), Point(36.81175178, 28.05061832, 0)])

# ----
boundary = BoundarySurfaces(Edges=crv)
mesh_uv = MeshSurface(Surface=boundary, UCount=number_slider, VCount=number_slider, Overhang=True, Equalize=False)
demesh = DeconstructMesh(Mesh=mesh_uv)  # -> Vertices, Faces, Colours, Normals
viewer = ParamViewer(demesh.Vertices)
cps = ClosestPoints(Point=demesh.Vertices, Cloud=pt, Count=Slider(1, range=0..1))  # -> ClosestPoint, CPIndex, simplify(Distance)

# ---- group: Vector Multiplier
multiplication = Multiplication(A=cps.Distance, B=Slider(2.2564, range=0..20))

# ---- group: Inverse Relationship
expression = Expression(x=cps.Distance, Expression="1/x")

# ----
number_slider_2 = Slider(38.4, range=0..500)
bar_graph = BarGraph(multiplication, BarColor=RGB(255, 0, 90))
flatten = FlattenTree(Tree=multiplication, Path="{0}")
dom = ConstructDomain(DomainStart="3", DomainEnd="5")
smaller = SmallerThan(FirstNumber=flatten, SecondNumber=number_slider_2)  # -> SmallerThan, OrEqualTo
flatten_2 = FlattenTree(Tree=demesh.Vertices, Path="{0}")
smaller_2 = SmallerThan(FirstNumber=number_slider_2, SecondNumber=flatten)  # -> SmallerThan, OrEqualTo
bnd = Bounds(Numbers=flatten)
remap = RemapNumbers(Value=flatten, Source=bnd, Target=dom)  # -> Mapped, Clipped
panel = Panel(bnd)

# ---- group: List of Vector Amplitudes
cull = CullPattern(List=flatten, CullPattern=smaller_2.SmallerThan)

# ---- group: List of Goals
cull_2 = CullPattern(List=flatten_2, CullPattern=smaller.SmallerThan)

# ---- group: List of Agents
cull_3 = CullPattern(List=flatten_2, CullPattern=smaller_2.SmallerThan)

# ----
cull_4 = CullPattern(List=remap.Mapped, CullPattern=smaller_2.SmallerThan)
preview = CustomPreview(
    Geometry=cull_2,
    Shader={ambient=RGB(0, 0, 0), diffuse=RGB(255, 105, 180), emission=RGB(76, 32, 54), shine=0.5, specular=RGB(255, 255, 255), transparency=0})
tag = TextTag3D(Location=cull_3, Text=cull, Size=Slider(0.25, range=0..1), Justification=7)
preview_2 = CustomPreview(Geometry=cull_3, Shader=ColourSwatch(SwatchColor=RGB(255, 255, 255)))
vec2pt = Vector2Pt(PointA=cull_3, PointB=pt, Unitize=False)  # -> Vector, Length
Y = UnitY(Factor=cull)
amp = Amplitude(Vector=vec2pt.Vector, Amplitude=cull)
merge = Merge(Data1=simplify(graft(cull_3)), Data2=simplify(graft(amp)), Data4=simplify(graft(cull_3)))
group = Group(Objects=merge)
loop_start = LoopStart(Repeat=Slider(33, range=0..100), Trigger=Button(), Data=simplify(group))  # -> port, Counter, Data
pt_2 = Point(cull_2)
ungroup = Ungroup(Group=loop_start.Data)
panel_2 = Panel(loop_start.Counter)
split = SplitList(List=ungroup, Index=Slider(2, range=0..10))  # -> ListA, ListB
item = ListItem(List=split.ListA, Index=0, Wrap=True)  # -> Item, Item1
pt_3 = Point(item.Item)
vec = Vector(item.Item1)
move = Move(Geometry=pt_3, Motion=vec)  # -> Geometry, Transform
cps_2 = ClosestPoints(Point=move.Geometry, Cloud=pt_2, Count=Slider(1, range=0..1))  # -> ClosestPoint, CPIndex, Distance
maxforce = Slider(0.058, range=0..1)
number_slider_3 = Slider(1.1, range=0..10)
vec2pt_2 = Vector2Pt(PointA=move.Geometry, PointB=cps_2.ClosestPoint, Unitize=False)  # -> simplify(Vector), Length
steer = Steer(vel=vec, des=vec2pt_2.Vector, maxv=number_slider_3, maxf=maxforce)
addition = Addition(A=vec, B=steer)
trmvec = TrimVector(Vector=addition, LengthDomain=number_slider_3)
move_2 = Move(Geometry=pt_3, Motion=trmvec)  # -> Geometry, Transform
vdis = VectorDisplay(Anchor=pt_3, Vector=trmvec)
merge_2 = Merge(Data1=simplify(move_2.Geometry), Data2=simplify(trmvec))
group_2 = Group(Objects=merge_2)
running = Running(port=loop_start.port, Exit=False, Data=group_2, pausedState=False, state="Constant output", TimeOutVal=0)
ungroup_2 = Ungroup(Group=running)
item_2 = ListItem(List=ungroup_2, Index=0, Wrap=True)
pt_4 = Point(item_2)

# ==== cluster Steer
maxf = ClusterInput()
vel = ClusterInput()
maxv = ClusterInput()
des = ClusterInput()
amp = Amplitude(Vector=des, Amplitude=maxv)
subtraction = Subtraction(A=amp, B=vel)
multiplication = Multiplication(A=subtraction, B=maxf)
vlen = VectorLength(Vector=multiplication)
min = Minimum(A=vlen, B=maxv)
amp_2 = Amplitude(Vector=multiplication, Amplitude=min)
acc = ClusterOutput(amp_2)
