# Grasshopper definition michel azzi , mohamad elatab.gh (Grasshopper 0.9.76)
# Copyright: Co-de-iT
# plug-ins: Anemone, Boid

crv = Curve(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)
end = EndPoints(Curve=crv)  # -> Start, End
project = Project(Geometry=end.End, Plane=PlaneXY(0, 0, 0))  # -> Geometry, Transform
project_2 = Project(Geometry=end.Start, Plane=PlaneXY(0, 0, 0))  # -> Geometry, Transform
pt = Point(Point(145.5769248, 73.85669694, 0))
pt_2 = Point(Point(-2.36462933, -22.07525394, 0))
amp = Amplitude(Vector=end.End, Amplitude=Slider(0, range=0..100))
move = Move(Geometry=crv, Motion=amp)  # -> Geometry, Transform
pipe = Pipe(Curve=crv, Radius=Slider(10, range=0..10), Caps=0)
crv_2 = Curve(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)
end_2 = EndPoints(Curve=crv_2)  # -> Start, End
project_3 = Project(Geometry=end_2.End, Plane=PlaneXY(0, 0, 0))  # -> Geometry, Transform
project_4 = Project(Geometry=end_2.Start, Plane=PlaneXY(0, 0, 0))  # -> Geometry, Transform
pt_3 = Point(project_3.Geometry)
pt_4 = Point(project_4.Geometry)
amp_2 = Amplitude(Vector=end_2.End, Amplitude=Slider(0, range=0..100))

# ---- group: the agent that will follow the trajectory
pt_5 = Point(Point(145.5769248, 346, 0))

# ---- group: the points that will follow the main agent
pt_6 = Point([Point(84, 574, 0), Point(136, 538, 0), Point(182, 635, 0), Point(116, 558, 0), Point(88, 468, 0), Point(162, 473, 0), Point(187, 543, 0), Point(157, 620, 0), Point(133, 648, 0), Point(91, 666, 0), Point(41, 631, 0), Point(44, 553, 0), Point(116, 558, 0), Point(144, 494, 0), Point(163, 573, 0), Point(121, 599, 0), Point(122, 492, 0)])

# ----
move_2 = Move(Geometry=crv_2, Motion=amp_2)  # -> Geometry, Transform
pipe_2 = Pipe(Curve=crv_2, Radius=Slider(10, range=0..10), Caps=0)
lng = ListLength(List=pt_5)
Y = UnitY(Factor=Slider(20, range=0..20))
lng_2 = ListLength(List=pt_6)
Y_2 = UnitY(Factor=Slider(12, range=0..20))
repeat = RepeatData(Data=Y, Length=lng)

# ---- group: the agent that will follow the trajectory
pt_7 = Point(Point(145.5769248, 346, 0))

# ----
repeat_2 = RepeatData(Data=Y_2, Length=lng_2)

# ---- group: the points that will follow the main agent
pt_8 = Point([Point(84, 574, 0), Point(136, 538, 0), Point(182, 635, 0), Point(116, 558, 0), Point(88, 468, 0), Point(162, 473, 0), Point(187, 543, 0), Point(157, 620, 0), Point(133, 648, 0), Point(91, 666, 0), Point(41, 631, 0), Point(44, 553, 0), Point(116, 558, 0), Point(144, 494, 0), Point(163, 573, 0), Point(121, 599, 0), Point(122, 492, 0)])

# ----
vec = Vector(repeat)
vec_2 = Vector(repeat_2)
lng_3 = ListLength(List=pt_7)
Y_3 = UnitY(Factor=Slider(20, range=0..20))
lng_4 = ListLength(List=pt_8)
Y_4 = UnitY(Factor=Slider(12, range=0..20))
merge = Merge(Data1=simplify(graft(pt_5)), Data2=simplify(vec), Data3=pt_6, Data4=vec_2)  # -> simplify(flatten(Result))
repeat_3 = RepeatData(Data=Y_3, Length=lng_3)
repeat_4 = RepeatData(Data=Y_4, Length=lng_4)
number_slider = Slider(1000, range=0..1000)

# ---- group: the trajectory curve
crv_3 = Curve(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)

# ----
vec_3 = Vector(repeat_3)
vec_4 = Vector(repeat_4)
group = Group(Objects=merge)
flip = FlipCurve(Curve=crv_3)  # -> Curve, Flag
loop_start = LoopStart(Repeat=0, Trigger=Toggle(True), Data=group)  # -> port, Counter, simplify(Data)
merge_2 = Merge(Data1=simplify(graft(pt_7)), Data2=simplify(vec_3))  # -> simplify(flatten(Result))

# ---- group: the trajectory curve
crv_4 = Curve(<curve referenced from the Rhino model>)

# ----
ungroup = Ungroup(Group=loop_start.Data)
panel = Panel("""1
17
1
17""")
group_2 = Group(Objects=merge_2)
panel_2 = Panel(ungroup)
item = ListItem(List=ungroup, Index=0, Wrap=True)
item_2 = ListItem(List=ungroup, Index=Slider(18, range=0..100), Wrap=True)
loop_start_2 = LoopStart(Repeat=Slider(1000, range=0..1000), Trigger=Toggle(False), Data=group_2)  # -> port, Counter, simplify(Data)
partition = PartitionList(List=ungroup, Size=panel)  # -> simplify(Chunks)
amp_3 = Amplitude(Vector=item_2, Amplitude=Slider(3, range=0..10))
ungroup_2 = Ungroup(Group=loop_start_2.Data)
move_3 = Move(Geometry=item, Motion=amp_3)  # -> Geometry, Transform
panel_3 = Panel(item_2)
panel_4 = Panel(item)
item_3 = ListItem(List=ungroup_2, Index=0, Wrap=True)
item_4 = ListItem(List=ungroup_2, Index=Slider(18, range=0..100), Wrap=True)
crv_cp = CurveClosestPoint(Point=move_3.Geometry, Curve=graft(flip.Curve))  # -> Point, Parameter, Distance
branch = TreeBranch(Tree=partition, Path=Slider(3, range=0..10), MaintainPaths=True)
branch_2 = TreeBranch(Tree=partition, Path=Slider(1, range=0..1), MaintainPaths=True)
vec2pt = Vector2Pt(PointA=move_3.Geometry, PointB=crv_cp.Point, Unitize=False)  # -> Vector, Length
amp_4 = Amplitude(Vector=item_4, Amplitude=Slider(3, range=0..10))
number_slider_2 = Slider(6.7, range=0..10)
maxforce = Slider(0.465, range=0..1)
move_4 = Move(Geometry=item_3, Motion=amp_4)  # -> Geometry, Transform
panel_5 = Panel(item_4)
panel_6 = Panel(item_3)
eval = EvaluateCurve(Curve=flip.Curve, Parameter=crv_cp.Parameter)  # -> Point, Tangent, Angle
crv_cp_2 = CurveClosestPoint(Point=move_4.Geometry, Curve=graft(crv_4))  # -> Point, Parameter, Distance

# ----
# steer
steer = Steer(vel=item_2, des=vec2pt.Vector, maxv=number_slider_2, maxf=maxforce)

vec2pt_2 = Vector2Pt(PointA=move_4.Geometry, PointB=crv_cp_2.Point, Unitize=False)  # -> Vector, Length
number_slider_3 = Slider(6.7, range=0..10)
maxforce_2 = Slider(0.465, range=0..1)
multiplication = Multiplication(A=steer, B=Slider(0.13, range=0..1))
multiplication_2 = Multiplication(A=eval.Tangent, B=Slider(0.15, range=0..1))
eval_2 = EvaluateCurve(Curve=crv_4, Parameter=crv_cp_2.Parameter)  # -> Point, Tangent, Angle
addition = Addition(A=multiplication, B=multiplication_2)

# ----
# steer
steer_2 = Steer(vel=item_4, des=vec2pt_2.Vector, maxv=number_slider_3, maxf=maxforce_2)

addition_2 = Addition(A=item_2, B=addition)
trmvec = TrimVector(Vector=addition_2, LengthDomain=number_slider_2)
multiplication_3 = Multiplication(A=steer_2, B=Slider(0.13, range=0..1))
multiplication_4 = Multiplication(A=eval_2.Tangent, B=Slider(0.15, range=0..1))
move_5 = Move(Geometry=item, Motion=trmvec)  # -> Geometry, Transform
addition_3 = Addition(A=multiplication_3, B=multiplication_4)
merge_3 = Merge(Data1=move_5.Geometry, Data2=trmvec)
addition_4 = Addition(A=item_4, B=addition_3)
group_3 = Group(Objects=merge_3)
trmvec_2 = TrimVector(Vector=addition_4, LengthDomain=number_slider_3)
loop_end = LoopEnd(port=loop_start.port, Exit=False, Data=group_3, pausedState=False, state="Constant output", TimeOutVal=0)
move_6 = Move(Geometry=item_3, Motion=trmvec_2)  # -> Geometry, Transform
ungroup_3 = Ungroup(Group=loop_end)
merge_4 = Merge(Data1=move_6.Geometry, Data2=trmvec_2)
item_5 = ListItem(List=ungroup_3, Index=0, Wrap=True)
group_4 = Group(Objects=merge_4)
loop_end_2 = LoopEnd(port=loop_start_2.port, Exit=False, Data=group_4, pausedState=False, state="Constant output", TimeOutVal=0)
ungroup_4 = Ungroup(Group=loop_end_2)
pt_9 = Point(item)
item_6 = ListItem(List=ungroup_4, Index=0, Wrap=True)

# ---- group: VELOCITY
vdisex = VectorDisplayEx(Point=pt_9, Vector=item_2, Colour=ColourSwatch(SwatchColor=RGB(0, 109, 168)), Width=2)

# ---- group: FINAL VECTOR
vdisex_2 = VectorDisplayEx(Point=pt_9, Vector=trmvec, Colour=ColourSwatch(SwatchColor=RGB(255, 255, 255)), Width=2)

# ---- group: STEER
vdisex_3 = VectorDisplayEx(Point=pt_9, Vector=steer, Colour=RGB(0, 0, 0), Width=2)

# ----
pt_10 = Point(item_3)

# ---- group: VELOCITY
vdisex_4 = VectorDisplayEx(Point=pt_10, Vector=item_4, Colour=ColourSwatch(SwatchColor=RGB(0, 109, 168)), Width=2)

# ---- group: FINAL VECTOR
vdisex_5 = VectorDisplayEx(Point=pt_10, Vector=trmvec_2, Colour=ColourSwatch(SwatchColor=RGB(255, 255, 255)), Width=2)

# ---- group: STEER
vdisex_6 = VectorDisplayEx(Point=pt_10, Vector=steer_2, Colour=RGB(0, 0, 0), Width=2)

# ==== cluster Steer
maxf = ClusterInput()
vel = ClusterInput()
maxv = ClusterInput()
des = ClusterInput()
amp = Amplitude(Vector=des, Amplitude=maxv)
subtraction = Subtraction(A=amp, B=vel)
multiplication = Multiplication(A=subtraction, B=maxf)
vlen = VectorLength(Vector=multiplication)
min = Minimum(A=vlen, B=maxv)
amp_2 = Amplitude(Vector=multiplication, Amplitude=min)
acc = ClusterOutput(amp_2)
