# Grasshopper definition Peter Magnus Submission.gh (Grasshopper 0.9.76)
# Copyright: Co-de-iT
# plug-ins: Anemone, Boid

pt = Point(Point(0, 0, 0))
msphere = MeshSphere(Base=pt, Radius=Slider(37, range=-1..200), UCount=Slider(65, range=0..100), VCount=Slider(63, range=0..100))

demesh = DeconstructMesh(Mesh=msphere)  # -> Vertices, Faces, Colours, Normals
Z = UnitZ(Factor=1)
Y = UnitY(Factor=1)

number_slider = Slider(0.2, range=0..1)
# PREDATOR PREY
popgeo = PopulateGeometry(Geometry=msphere, Count=Slider(20, range=0..100), Seed=1)
vec = VectorXYZ(XComponent=number_slider, YComponent=number_slider, ZComponent=0)  # -> Vector, Length
lng = ListLength(List=popgeo)
vec_2 = Vector(vec.Vector)
repeat = RepeatData(Data=vec_2, Length=lng)

rev = Reverse(Vector=Y)
xprod = CrossProduct(VectorA=Y, VectorB=Z, Unitize=False)  # -> Vector, Length
angle = Angle(VectorA=demesh.Normals, VectorB=xprod.Vector)  # -> Angle, Reflex
dprod = DotProduct(VectorA=demesh.Normals, VectorB=xprod.Vector, Unitize=False)
bnd = Bounds(Numbers=angle.Angle)
dedomain = DeconstructDomain(Domain=bnd)  # -> Start, End
gradient = Gradient(
    LowerLimit=dedomain.End,
    UpperLimit=dedomain.Start,
    Parameter=angle.Angle,
    stops=[0: RGB(255, 255, 255), 1: RGB(0, 0, 0)])
gradient_2 = Gradient(LowerLimit="-1", UpperLimit=1, Parameter=dprod, stops=[0.306: RGB(255, 255, 255), 1: RGB(0, 0, 0)])
merge = Merge(Data1=simplify(graft(popgeo)), Data2=simplify(graft(repeat)), Data3=simplify(graft(popgeo)))
conmesh = ConstructMesh(Vertices=demesh.Vertices, Faces=demesh.Faces, Colours=demesh.Normals)
# FOLLOW COLOR
number_slider_2 = Slider(113, range=0..500)
group = Group(Objects=merge)

loop_start = LoopStart(Repeat=number_slider_2, Trigger=Button(), Data=simplify(graft(group)))  # -> port, Counter, Data
# adhere vectors logic
# adhere vectors logic
stop = BooleanToggle(False)

ungroup = Ungroup(Group=loop_start.Data)  # -> simplify(Objects)
split = SplitList(List=ungroup, Index="2")  # -> ListA, ListB
panel = Panel(loop_start.Counter)
item = ListItem(List=split.ListA, Index=0, Wrap=True)  # -> Item, Item1
vec_3 = Vector(item.Item1)
pt_2 = Point(flatten(item.Item))
panel_2 = Panel("""0 = WHITE
1 = BLACK""")
multiplication = Multiplication(A=item.Item1, B=Slider(0.06, range=0..1))

# ---- group: agents
lng_2 = ListLength(List=pt_2)
repeat_2 = RepeatData(Data=ColourSwatch(SwatchColor=RGB(74, 255, 164)), Length=lng_2)
cloud = CloudDisplay(Points=pt_2, Colours=repeat_2, Size=Slider(1.9, range=0..12), SpriteType=1)

# ---- group: show tail
pt_3 = Point(split.ListB)
cluster = Cluster_2(L=pt_3)
cloud_2 = CloudDisplay(Points=simplify(pt_3), Colours=cluster, Size=Slider(0.5, range=0..12), SpriteType=1)

# ----
# COHESION
number_slider_3 = Slider(5, range=0..100)
pop3d = Populate3D(Region={Plane=PlaneXY(0, 0, 0), X=Domain(0, 10), Y=Domain(0, 10), Z=Domain(0, 2)}, Count=number_slider_3, Seed=1)

# ---- group: ATTRACTOR POINTS
pt_4 = Point([<point referenced from the Rhino model> x3])

# ----
pt_5 = Point(pop3d)
Y_2 = UnitY(Factor=1)

lng_3 = ListLength(List=pt_5)
Z_2 = UnitZ(Factor=1)
repeat_3 = RepeatData(Data=Y_2, Length=lng_3)

loop_start_2 = LoopStart(N=Slider(91, range=-1..500), T=Button(), D0=pt_5, D1=repeat_3)  # -> port, Counter, Data, Data_2

# ---- group: agent location
pt_6 = Point(loop_start_2.Data)

# ---- group: MAIN AGENT
item_2 = ListItem(List=pt_6, Index=0, Wrap=True)

# ----
dist = Distance(PointA=item_2, PointB=pt_4)
sort = SortList(Keys=dist, ValuesA=pt_4)  # -> Keys, ValuesA

# ---- group: closest
item_3 = ListItem(List=sort.ValuesA, Index=0, Wrap=True)

# ----
shift = ShiftList(List=sort.ValuesA, Shift="1", Wrap=False)
item_4 = ListItem(List=shift, Index=0, Wrap=True)

panel_3 = Panel(loop_start_2.Counter)

dist_2 = Distance(PointA=item_2, PointB=item_3)
smaller = SmallerThan(FirstNumber=dist_2, SecondNumber="10")  # -> SmallerThan, OrEqualTo

p_n_c = PickNChoose(Pattern=smaller.SmallerThan, Stream0=item_3, Stream1=item_4)

rad = Radians(Degrees=Slider(15, range=0..100))
wander = RandomWander(
    AgentMotionVectors=loop_start_2.Data_2,
    AngleSpreadDomain=rad,
    RandomSeed=loop_start_2.Counter,
    AbsoluteMultiplier=Slider(1, range=0..1))

pt_7 = Point(p_n_c)
pt_8 = Point(pt_7)

# ---- group: VOID LIBRARY BEHAVIOUR
adhere = AhereToTheFlockCenter(
    AgentLocationPoint=loop_start_2.Data,
    LocationPointsOfTheFlock=loop_start_2.Data,
    SearchDistance=Domain(0, 0),
    ReferenceAgentsCount=-1,
    Multiplier=Slider(0.07, range=0..0.1))

# ----
vdis = VectorDisplay(Anchor=loop_start_2.Data, Vector=wander)

demesh_2 = DeconstructMesh(Mesh=conmesh)  # -> Vertices, Faces, Colours, Normals
cluster_2 = Cluster(L=demesh_2.Vertices)
visible = FindVisibleAgents(
    AgentLocationPoint=pt_2,
    AgentMotionVector=flatten(vec_3),
    LocationPointsOfTheFlock=demesh_2.Vertices,
    FlockMotionVectors=cluster_2,
    SearchDistance=Slider(40, range=0..50),
    SearchAngle=Slider(0.37, range=0..1))  # -> simplify(ListOfPoints), ListOfVectors, simplify(ListOfIndices); disabled

cps = ClosestPoints(Point=pt_2, Cloud=demesh_2.Vertices, Count=Slider(7, range=0..10))  # -> ClosestPoint, CPIndex, Distance

cluster_3 = Cluster_3(
    agents=pt_2,
    index_of_visible=cps.CPIndex,
    M=conmesh,
    intensity=Slider(1, range=0..1),
    treshold_limit_value_to_follow=Slider(0.91, range=0..1),
    G="1")  # -> simplify(graft(forced_vector)), vector, elected_point

addition = Addition(A=cluster_3.forced_vector, B=simplify(multiplication))  # -> flatten(Result)
vdis_2 = VectorDisplay(Anchor=item.Item, Vector=cluster_3.vector)
panel_4 = Panel(cluster_3.forced_vector)
move = Move(Geometry=pt_2, Motion=addition)  # -> Geometry, Transform
vec_4 = Vector(graft(addition))
tlist = TailList(L=split.ListB, it=simplify(graft(move.Geometry)), len=Slider(30, range=0..100))  # -> out, simplify(A); inputs L: list, len: Int32
# ---------- tlist: C# ----------
    Component.Name = "Tail List";
    Component.NickName = "TList";
    Component.Description = "Tail list - L list, it item to add, len tail length";

    if (L.Count() > len) {
      L.RemoveAt(0);
    }
    L.Add(it);
    A = L;
# ---------- end tlist ----------
merge_2 = Merge(Data1=simplify(graft(move.Geometry)), Data2=simplify(graft(vec_4)), Data3=simplify(tlist.A))
group_2 = Group(Objects=merge_2)
loop_end = LoopEnd(port=loop_start.port, Exit=stop, Data=simplify(group_2), pausedState=False, state="Constant output", TimeOutVal=0)

# ---- group: visible points
lng_4 = ListLength(List=cps.ClosestPoint)
repeat_4 = RepeatData(Data=ColourSwatch(SwatchColor=RGBA(113, 250, 75, 195)), Length=lng_4)
cloud_3 = CloudDisplay(Points=cps.ClosestPoint, Colours=repeat_4, Size=Slider(0.8, range=0..12), SpriteType=1)

# ---- group: selected point
lng_5 = ListLength(List=cluster_3.elected_point)
repeat_5 = RepeatData(Data=ColourSwatch(SwatchColor=RGB(255, 144, 79)), Length=lng_5)
cloud_4 = CloudDisplay(Points=cluster_3.elected_point, Colours=repeat_5, Size=Slider(1, range=0..12), SpriteType=1)

# ----
# FOLLOW LINE
number_slider_4 = Slider(20, range=0..20)
Y_3 = UnitY(Factor=number_slider_4)
crv = Curve(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)
Y_4 = UnitY(Factor=1)
number_slider_5 = Slider(1.7, range=0..10)
maxforce = Slider(0.228, range=0..1)

agents = Point([Point(27.66381252, -10.25946277, 0), Point(25.89416457, -24.94754074, 0), Point(17.39985441, -15.21447702, 0), Point(19.16950236, -19.81556169, 0), Point(24.8323758, -12.91393469, 0), Point(31.55703801, -16.45323059, 0), Point(36.33508747, -23.70878718, 0), Point(24.12451662, -28.48683664, 0)])

lng_6 = ListLength(List=agents)
repeat_6 = RepeatData(Data=Y_3, Length=lng_6)

vec_5 = Vector(repeat_6)

merge_3 = Merge(Data1=simplify(graft(agents)), Data2=simplify(graft(vec_5)))
group_3 = Group(Objects=merge_3)
loop_start_3 = LoopStart(Repeat=Slider(122, range=0..130), Data=group_3)  # -> port, Counter, simplify(Data)
panel_5 = Panel(loop_start_3.Counter)
ungroup_2 = Ungroup(Group=loop_start_3.Data)
item_5 = ListItem(List=ungroup_2, Index=0, Wrap=True)  # -> Item, Item1
amp = Amplitude(Vector=item_5.Item1, Amplitude=Slider(3, range=0..10))
move_2 = Move(Geometry=item_5.Item, Motion=amp)  # -> Geometry, Transform
crv_cp = CurveClosestPoint(Point=move_2.Geometry, Curve=graft(crv))  # -> Point, Parameter, Distance
vec2pt = Vector2Pt(PointA=move_2.Geometry, PointB=crv_cp.Point, Unitize=False)  # -> Vector, Length
eval = EvaluateCurve(Curve=crv, Parameter=crv_cp.Parameter)  # -> Point, Tangent, Angle
multiplication_2 = Multiplication(A=eval.Tangent, B=Slider(0.15, range=0..1))
pt_9 = Point(item_5.Item)

# ----
# steer
steer = Steer(vel=item_5.Item1, des=vec2pt.Vector, maxv=number_slider_5, maxf=maxforce)

multiplication_3 = Multiplication(A=steer, B=Slider(0.13, range=0..1))
addition_2 = Addition(A=multiplication_3, B=multiplication_2)
addition_3 = Addition(A=item_5.Item1, B=addition_2)
trmvec = TrimVector(Vector=addition_3, LengthDomain=number_slider_5)
move_3 = Move(Geometry=item_5.Item, Motion=trmvec)  # -> Geometry, Transform
merge_4 = Merge(Data1=move_3.Geometry, Data2=trmvec)
group_4 = Group(Objects=merge_4)
loop_end_2 = LoopEnd(port=loop_start_3.port, Exit=False, Data=group_4, pausedState=False, state="Constant output", TimeOutVal=0)
ungroup_3 = Ungroup(Group=loop_end_2)
item_6 = ListItem(List=ungroup_3, Index=0, Wrap=True)

# ---- group: VELOCITY
vdisex = VectorDisplayEx(Point=pt_9, Vector=item_5.Item1, Colour=ColourSwatch(SwatchColor=RGB(0, 109, 168)), Width=2)

# ---- group: FINAL VECTOR
vdisex_2 = VectorDisplayEx(Point=pt_9, Vector=trmvec, Colour=ColourSwatch(SwatchColor=RGB(255, 255, 255)), Width=2)

# ---- group: STEER
vdisex_3 = VectorDisplayEx(Point=pt_9, Vector=steer, Colour=RGB(0, 0, 0), Width=2)

# ---- group: ATTRACTOR FIELD
avr = Average(Input=loop_start_2.Data)
neg = Negative(Value=Slider(2.609, range=0..3))
pcharge = PointCharge(Point=pt_8, Charge=neg, Decay=Slider(0.5, range=0..3))
mergef = MergeFields(Fields=pcharge)
number_slider_6 = Slider(2.5, range=0..10)
evf = EvaluateField(Field=mergef, Point=loop_start_2.Data)  # -> Tensor, Strength

# ---- group: STEER VECTOR
vec2pt_2 = Vector2Pt(PointA=loop_start_2.Data, PointB=pt_8, Unitize=False)  # -> Vector, Length
steer_2 = Steer(vel=loop_start_2.Data_2, des=vec2pt_2.Vector, maxv=number_slider_6, maxf=Slider(0.25, range=0..1))

# ----
addition_4 = Addition(A=wander, B=steer_2)
addition_5 = Addition(A=wander, B=evf.Tensor)

# ---- group: ATTRACTOR FIELD (continued)
addition_6 = Addition(A=loop_start_2.Data_2, B=addition_4)
trmvec_2 = TrimVector(Vector=addition_6, LengthDomain=number_slider_6)

# ----
move_4 = Move(Geometry=loop_start_2.Data, Motion=trmvec_2)  # -> Geometry, Transform
loop_end_3 = LoopEnd(
    port=loop_start_2.port,
    Exit=False,
    Data=flatten(move_4.Geometry),
    Data_2=flatten(trmvec_2),
    pausedState=False,
    state="Constant output",
    TimeOutVal=0)  # -> D0, D1
vdis_3 = VectorDisplay(Anchor=loop_start_2.Data, Vector=trmvec_2)
viewer = ParamViewer(loop_end_3.D0)
flip = FlipMatrix(Data=loop_end_3.D0)
viewer_2 = ParamViewer(flip)
pline = PolyLine(Vertices=loop_end_3.D0, Closed=False)

# ==== cluster Steer
maxf = ClusterInput()
vel = ClusterInput()
maxv = ClusterInput()
des = ClusterInput()
amp = Amplitude(Vector=des, Amplitude=maxv)
subtraction = Subtraction(A=amp, B=vel)
multiplication = Multiplication(A=subtraction, B=maxf)
vlen = VectorLength(Vector=multiplication)
min = Minimum(A=vlen, B=maxv)
amp_2 = Amplitude(Vector=multiplication, Amplitude=min)
acc = ClusterOutput(amp_2)

# ==== cluster Cluster
L = ClusterInput()
lng = ListLength(List=L)
vec = Vector(Vector(0, 0, 0))
repeat = RepeatData(Data=vec, Length=lng)
D = ClusterOutput(repeat)

# ==== cluster Cluster_2
L = ClusterInput()

lng = ListLength(List=L)  # -> flatten(Length)
item = ListItem(List=lng, Index=0, Wrap=True)
round = Round(Number=item)  # -> Nearest, Floor, Ceiling
division = Division(A="1", B=round.Ceiling)
series = Series(Start=0, Step=division, Count=round.Ceiling)
graph = GraphMapper(
    series,
    x0=0,
    x1=1,
    y0=0,
    y1=1,
    container_name="Bezier",
    cpx=[0, 0.6374178529, 0.8142894506, 1],
    cpy=[0, 0.1260549426, 0.5961636305, 1])
xyz = ColourXYZ(Alpha=1, X=graph, Y=graph, Z=graph)
series_2 = Series(Start=Slider(0.1, range=0..1), Step=Slider(0.05, range=0..0.1), Count=item)

C = ClusterOutput(xyz)

# ==== cluster Cluster_3
intensity = ClusterInput()
treshold_limit_value_to_follow = ClusterInput()
G = ClusterInput()
index_of_visible = ClusterInput()
agents = ClusterInput()
M = ClusterInput()
num = Number(treshold_limit_value_to_follow)
num_2 = Number(intensity)
int = Integer(index_of_visible)
pt = Point(agents)
demesh = DeconstructMesh(Mesh=M)  # -> Vertices, Faces, Colours, Normals

color = ListItem(List=demesh.Colours, Index=int, Wrap=True)  # -> simplify(Item)
vertex = ListItem(List=demesh.Vertices, Index=int, Wrap=True)  # -> simplify(Item)

# ----
# using grayscale so each is the same
graysca = SplitARGB(Colour=color)  # -> Alpha, Red, Green, Blue

sort = SortList(Keys=graysca.Red, ValuesA=vertex)  # -> Keys, ValuesA
item = ListItem(List=sort.Keys, Index=0, Wrap=True)  # -> Item1, Item

item_2 = ListItem(List=sort.ValuesA, Index=0, Wrap=True)  # -> Item1, Item
panel = Panel("""follow color
i = black
-i = white""")

filter = StreamFilter(Gate=G, Stream0=item_2.Item1, Stream1=item_2.Item)
X = UnitX(Factor=1)
amp = Amplitude(Vector=X, Amplitude=Slider(0, range=0..10))

vec2pt = Vector2Pt(PointA=simplify(graft(pt)), PointB=filter, Unitize="true")  # -> flatten(Vector), Length
amp_2 = Amplitude(Vector=vec2pt.Vector, Amplitude=num_2)
lng = ListLength(List=amp_2)
larger = LargerThan(FirstNumber=item.Item1, SecondNumber=num)  # -> flatten(LargerThan), OrEqualTo
repeat = RepeatData(Data=amp, Length=lng)
p_n_c = PickNChoose(Pattern=larger.LargerThan, Stream0=amp_2, Stream1=repeat)  # -> simplify(graft(Result))

forced_vector = ClusterOutput(amp_2)
vector = ClusterOutput(p_n_c)
elected_point = ClusterOutput(item_2.Item1)
