# Grasshopper definition Pranay,siddhart.gh (Grasshopper 0.9.76)
# Copyright: Co-de-iT
# plug-ins: Anemone, Boid

crv = Curve([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])
agents1 = Point(Point(-23, 33, 0))

# ----
# reciproCITY
# ANEMONE
# Alessio Erioli
# Aldo Sollazzo
# Eugenio Bettucchi
# DEFINITIONS BY
# RANDOM WALKER
# RANDOM VECTOR
# 15-17 April 2016
# Points
# Points
# RANDOM VECTOR LOGIC
# Vectors
# RANDOM VECTOR LOGIC
# RANDOM VECTOR LOGIC
# COHESION
# STEER
# steer
# FOLLOW LINE
# SEEK
# adhere
# true false
# adhere vectors logic / steer
# magnetic fields
# PREDATOR PREY
# adhere vectors logic
# adhere vectors logic
# random vectors logic
# FOLLOW COLOR
# ADHERE & REPULSE
number_slider = Slider(20, range=0..20)
Y = UnitY(Factor=number_slider)
lng = ListLength(List=agents1)
repeat = RepeatData(Data=Y, Length=lng)
crv_2 = Curve(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)
Y_2 = UnitY(Factor=1)
number_slider_2 = Slider(1, range=0..10)
maxforce = Slider(0.388, range=0..1)

vec = Vector(repeat)
agents = Point([Point(27.66381252, -10.25946277, 0), Point(25.89416457, -24.94754074, 0), Point(17.39985441, -15.21447702, 0), Point(19.16950236, -19.81556169, 0), Point(24.8323758, -12.91393469, 0), Point(31.55703801, -16.45323059, 0), Point(36.33508747, -23.70878718, 0), Point(24.12451662, -28.48683664, 0)])

merge = Merge(Data1=simplify(graft(agents1)), Data2=simplify(graft(vec)))
group = Group(Objects=merge)
loop_start = LoopStart(Repeat=Slider(110, range=0..110), Data=group)  # -> port, Counter, simplify(Data)
panel = Panel(loop_start.Counter)
ungroup = Ungroup(Group=loop_start.Data)
item = ListItem(List=ungroup, Index=0, Wrap=True)  # -> Item, Item1
amp = Amplitude(Vector=item.Item1, Amplitude=Slider(3, range=0..10))
move = Move(Geometry=item.Item, Motion=amp)  # -> Geometry, Transform
crv_cp = CurveClosestPoint(Point=move.Geometry, Curve=simplify(graft(crv)))  # -> simplify(Point), simplify(Parameter), simplify(Distance)
pt = Point(item.Item)

bang = ExplodeTree(Data=crv_cp.Distance)  # -> Branch0, Branch1, Branch2, Branch3, Branch4
bang_2 = ExplodeTree(Data=crv_cp.Parameter)  # -> Branch0, Branch1, Branch2, Branch3, Branch4
bang_3 = ExplodeTree(Data=crv_cp.Point)  # -> Branch0, Branch1, Branch2, Branch3, Branch4
smaller = SmallerThan(FirstNumber=bang.Branch0, SecondNumber=bang.Branch1)  # -> SmallerThan, OrEqualTo
filter = StreamFilter(
    Gate=smaller.SmallerThan,
    Stream0=bang_2.Branch0,
    Stream1=bang_2.Branch1,
    Stream2=bang_2.Branch2,
    Stream3=bang_2.Branch3,
    Stream4=bang_2.Branch4)
filter_2 = StreamFilter(
    Gate=smaller.SmallerThan,
    Stream0=bang_3.Branch0,
    Stream1=bang_3.Branch1,
    Stream2=bang_3.Branch2,
    Stream3=bang_3.Branch3,
    Stream4=bang_3.Branch4)

# ---- group: VELOCITY
vdisex = VectorDisplayEx(Point=pt, Vector=item.Item1, Colour=ColourSwatch(SwatchColor=RGB(0, 109, 168)), Width=2)

# ----
vec2pt = Vector2Pt(PointA=move.Geometry, PointB=filter_2, Unitize=False)  # -> Vector, Length
eval = EvaluateCurve(Curve=crv, Parameter=filter)  # -> Point, Tangent, Angle
multiplication = Multiplication(A=eval.Tangent, B=Slider(0.15, range=0..1))

# ----
# steer
steer = Steer(vel=item.Item1, des=vec2pt.Vector, maxv=number_slider_2, maxf=maxforce)

multiplication_2 = Multiplication(A=steer, B=Slider(0.13, range=0..1))
addition = Addition(A=multiplication_2, B=multiplication)
addition_2 = Addition(A=item.Item1, B=addition)
trmvec = TrimVector(Vector=addition_2, LengthDomain=number_slider_2)
move_2 = Move(Geometry=item.Item, Motion=trmvec)  # -> Geometry, Transform
merge_2 = Merge(Data1=move_2.Geometry, Data2=trmvec)
group_2 = Group(Objects=merge_2)
loop_end = LoopEnd(port=loop_start.port, Exit=False, Data=group_2, pausedState=False, state="Constant output", TimeOutVal=0)
ungroup_2 = Ungroup(Group=loop_end)
item_2 = ListItem(List=ungroup_2, Index=0, Wrap=True)

# ---- group: FINAL VECTOR
vdisex_2 = VectorDisplayEx(Point=pt, Vector=trmvec, Colour=ColourSwatch(SwatchColor=RGB(255, 255, 255)), Width=2)

# ---- group: STEER
vdisex_3 = VectorDisplayEx(Point=pt, Vector=steer, Colour=RGB(0, 0, 0), Width=2)

# ==== cluster Steer
maxf = ClusterInput()
vel = ClusterInput()
maxv = ClusterInput()
des = ClusterInput()
amp = Amplitude(Vector=des, Amplitude=maxv)
subtraction = Subtraction(A=amp, B=vel)
multiplication = Multiplication(A=subtraction, B=maxf)
vlen = VectorLength(Vector=multiplication)
min = Minimum(A=vlen, B=maxv)
amp_2 = Amplitude(Vector=multiplication, Amplitude=min)
acc = ClusterOutput(amp_2)
