# Grasshopper definition RanaAbdulmajeed.gh (Grasshopper 0.9.76)
# Copyright: Co-de-iT
# plug-ins: Anemone, Boid

# Alessio Erioli
# Aldo Sollazzo
# Eugenio Bettucchi
# DEFINITIONS BY
# CURVE BOUNDARY
number_slider = Slider(12, range=0..20)
Y = UnitY(Factor=Slider(10, range=0..20))
border_threshold = Slider(5.727, range=0..10)
arrive = Point(Point(73.05543853, 212.5013826, 0))
crv = Curve(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)
offset = Offset(Curve=crv, Distance=border_threshold, Plane=PlaneXY(0, 0, 0), Corners=1)
preview = CustomPreview(
    Geometry=offset,
    Shader={ambient=RGB(0, 0, 0), diffuse=RGB(255, 105, 180), emission=RGB(76, 32, 54), shine=0.5, specular=RGB(255, 255, 255), transparency=0})
maxforce = Slider(0.748, range=0..1)
max_vel = Slider(6.749, range=0..10)

agents = Point([Point(27.66381252, -10.25946277, 0), Point(25.89416457, -24.94754074, 0), Point(17.39985441, -15.21447702, 0), Point(19.16950236, -19.81556169, 0), Point(24.8323758, -12.91393469, 0), Point(31.55703801, -16.45323059, 0), Point(36.33508747, -23.70878718, 0), Point(24.12451662, -28.48683664, 0)])

dup = DuplicateData(Data=graft(agents), Number=number_slider, Order=True)  # -> flatten(Data)
lng = ListLength(List=dup)

repeat = RepeatData(Data=Y, Length=lng)
vec = Vector(repeat)

merge = Merge(Data1=simplify(graft(dup)), Data2=simplify(graft(vec)), Data3=simplify(graft(dup)))
group = Group(Objects=merge)
loop_start = LoopStart(Repeat=Slider(160, range=0..1000), Trigger=Button(), Data=group)  # -> port, Counter, Data
ungroup = Ungroup(Group=loop_start.Data)
split = SplitList(List=ungroup, Index="2")  # -> ListA, ListB
item = ListItem(List=split.ListA, Index=0, Wrap=True)  # -> Item, Item1

# ---- group: BORDER CONDITION
crv_cp = CurveClosestPoint(Point=item.Item, Curve=crv)  # -> Point, Parameter, Distance
eval = EvaluateCurve(Curve=crv, Parameter=crv_cp.Parameter)  # -> Point, Tangent, Angle
Z = UnitZ(Factor=1)
smaller = SmallerThan(FirstNumber=crv_cp.Distance, SecondNumber=border_threshold)  # -> SmallerThan, OrEqualTo
vec2pt = Vector2Pt(PointA=eval.Point, PointB=item.Item, Unitize=False)  # -> Vector, Length
xprod = CrossProduct(VectorA=eval.Tangent, VectorB=Z, Unitize=False)  # -> Vector, Length
dispatch = Dispatch(List=vec2pt.Vector, DispatchPattern=smaller.OrEqualTo)  # -> ListA, ListB
easing = Slider(0.485, range=0..1)
vlen = VectorLength(Vector=dispatch.ListA)
subtraction = Subtraction(A=border_threshold, B=vlen)
multiplication = Multiplication(A=subtraction, B=easing)
amp = Amplitude(Vector=dispatch.ListA, Amplitude=multiplication)
pt = Point(Point(0, 0, 0))
weave = Weave(Pattern=smaller.OrEqualTo, Stream0=pt, Stream1=amp, NullGaps=False)

# ----
amp_2 = Amplitude(Vector=item.Item1, Amplitude=Slider(2, range=0..10))

# ---- group: WANDER
wandering_strength = Slider(0.253, range=0..1)
wandering_angle = Slider(46.195, range=0..90)
rad = Radians(Degrees=wandering_angle)
lng_2 = ListLength(List=flatten(item.Item))
neg = Negative(Value=rad)
dom = ConstructDomain(DomainStart=neg, DomainEnd=rad)
Z_2 = UnitZ(Factor=1)
random = Random(Range=dom, Number=lng_2, Seed=loop_start.Counter)  # -> graft(Random)
vrot = Rotate(Vector=item.Item1, Axis=Z_2, Angle=random)
addition = Addition(A=amp_2, B=vrot)
steer = Steer(vel=item.Item1, des=addition, maxv=max_vel, maxf=wandering_strength)

# ----
move = Move(Geometry=item.Item, Motion=amp_2)  # -> Geometry, Transform
cp = ClosestPoint(Point=move.Geometry, Cloud=arrive)  # -> ClosestPoint, CPIndex, Distance
vec2pt_2 = Vector2Pt(PointA=move.Geometry, PointB=cp.ClosestPoint, Unitize=False)  # -> simplify(Vector), Length

# ----
# steer
steer_2 = Steer(vel=item.Item1, des=vec2pt_2.Vector, maxv=max_vel, maxf=maxforce)

addition_2 = Addition(A=item.Item1, B=steer_2, C=steer, D=weave)
trmvec = TrimVector(Vector=addition_2, LengthDomain=max_vel)
move_2 = Move(Geometry=item.Item, Motion=trmvec)  # -> Geometry, Transform
merge_2 = Merge(Data1=split.ListB, Data2=move_2.Geometry)
merge_3 = Merge(Data1=simplify(move_2.Geometry), Data2=simplify(trmvec), Data3=simplify(merge_2))
group_2 = Group(Objects=merge_3)
loop_end = LoopEnd(port=loop_start.port, Exit=False, Data=simplify(group_2), pausedState=False, state="Constant output", TimeOutVal=0)
move_3 = Move(Geometry=item.Item, Motion=item.Item1)  # -> Geometry, Transform
pt_2 = Point(item.Item)
data = Data(flatten(loop_end))
ungroup_2 = Ungroup(Group=loop_end)
split_2 = SplitList(List=ungroup_2, Index="2")  # -> ListA, ListB

# ---- group: WANDER
vdisex = VectorDisplayEx(Point=pt_2, Vector=steer, Colour=ColourSwatch(SwatchColor=RGB(168, 0, 146)), Width=2)

# ---- group: VELOCITY
vdisex_2 = VectorDisplayEx(Point=pt_2, Vector=item.Item1, Colour=ColourSwatch(SwatchColor=RGB(0, 109, 168)), Width=2)

# ---- group: FINAL VECTOR
vdisex_3 = VectorDisplayEx(Point=pt_2, Vector=trmvec, Colour=ColourSwatch(SwatchColor=RGB(255, 255, 255)), Width=2)

# ----
item_2 = ListItem(List=split_2.ListA, Index=0, Wrap=True)  # -> Item, Item1
pline = PolyLine(Vertices=split_2.ListB, Closed=False)

# ---- group: SEEK
vdisex_4 = VectorDisplayEx(Point=move_3.Geometry, Vector=steer_2, Colour=RGB(0, 0, 0), Width=2)

# ----
item_3 = ListItem(List=data, Index=Slider(14, range=0..95), Wrap=True)

# ==== cluster Steer
maxf = ClusterInput()
vel = ClusterInput()
maxv = ClusterInput()
des = ClusterInput()
amp = Amplitude(Vector=des, Amplitude=maxv)
subtraction = Subtraction(A=amp, B=vel)
multiplication = Multiplication(A=subtraction, B=maxf)
vlen = VectorLength(Vector=multiplication)
min = Minimum(A=vlen, B=maxv)
amp_2 = Amplitude(Vector=multiplication, Amplitude=min)
acc = ClusterOutput(amp_2)
