# Grasshopper definition Sidharth & Pranay.gh (Grasshopper 0.9.76)
# Copyright: Co-de-iT
# plug-ins: Anemone, Kangaroo Components, Boid

# Input Curve
crv = Curve([<curve referenced from the Rhino model> x6])

divide = DivideCurve(Curve=crv, Count=10, Kinks=False)  # -> Points, Tangents, Parameters
end = EndPoints(Curve=crv)  # -> Start, End
pline = PolyLine(Vertices=divide.Points, Closed=False)
pt = Point([end.Start, end.End])
explode = Explode(Curve=pline, Recursive=True)  # -> Segments, Vertices

Y = UnitY(Factor=Slider(20, range=0..20))
arrive = Point(Point(-3, -23.75, 0))

# ----
# Elasticity
slider = Slider(0.86, range=0..2)
len = Length(Curve=explode.Segments)
multiplication = Multiplication(A=len, B=slider)
springs = SpringsFromLine(
    Connection=explode.Segments,
    Stiffness=1000,
    Damping=10,
    RestLength=multiplication,
    Cutoff=0,
    CompressionFail=0,
    TensileFail=0,
    Plasticity=0)

# ----
# Attraction
slider_2 = Slider(-108.001, range=-500..500.001)
inter = InterconnectPoints(Pts=flatten(explode.Vertices))
plaw = PowerLaw(Connection=inter, Exponents=-1, Strength=slider_2, Cutoff=Slider(14.75, range=0..100))

border_threshold = Slider(10, range=0..10)
crv_2 = Curve(pline)
offset = Offset(Curve=crv_2, Distance=border_threshold, Plane=PlaneXY(0, 0, 0), Corners=1)
preview = CustomPreview(
    Geometry=offset,
    Shader={ambient=RGB(0, 0, 0), diffuse=RGB(255, 105, 180), emission=RGB(76, 32, 54), shine=0.5, specular=RGB(255, 255, 255), transparency=0})
button = Button()  # disabled
maxforce = Slider(0.055, range=0..1)
max_vel = Slider(2.57, range=0..10)
number_slider = Slider(53, range=0..100)

# ----
# WANDER + SEEK
# FOLLOW LINE
number_slider_2 = Slider(20, range=0..20)  # disabled
Y_2 = UnitY(Factor=number_slider_2)  # disabled
arrive_2 = Point(graft(Point(579831.8681, 679763.6306, 0)))  # disabled
number_slider_3 = Slider(385, range=0..1000)  # disabled
number_slider_4 = Slider(2, range=0..10)  # disabled
max_vel_2 = Slider(2.349, range=0..10)  # disabled
maxforce_2 = Slider(0.329, range=0..1)  # disabled

agents = Point([Point(583146.4774, 703245.2324, 0), Point(582659.204, 702339.937, 0), Point(582328.209, 701747.906, 0), Point(582016.1746, 700874.6513, 0)])

# ----
# CURVE BOUNDARY
dup = DuplicateData(Data=graft(agents), Number=Slider(5, range=0..20), Order=True)  # -> flatten(Data)
lng = ListLength(List=dup)

repeat = RepeatData(Data=Y, Length=lng)
vec = Vector(repeat)

merge = Merge(Data1=simplify(graft(dup)), Data2=simplify(graft(vec)))
group = Group(Objects=merge)
loop_start = LoopStart(Repeat=Slider(72, range=0..1000), Trigger=Button(), Data=group)  # -> port, Counter, Data
ungroup = Ungroup(Group=loop_start.Data)
item = ListItem(List=ungroup, Index=0, Wrap=True)  # -> Item, Item1

# ---- group: BORDER CONDITION
crv_cp = CurveClosestPoint(Point=item.Item, Curve=crv_2)  # -> Point, Parameter, Distance
eval = EvaluateCurve(Curve=crv_2, Parameter=crv_cp.Parameter)  # -> Point, Tangent, Angle
Z = UnitZ(Factor=1)
smaller = SmallerThan(FirstNumber=crv_cp.Distance, SecondNumber=border_threshold)  # -> SmallerThan, OrEqualTo
vec2pt = Vector2Pt(PointA=eval.Point, PointB=item.Item, Unitize=False)  # -> Vector, Length
xprod = CrossProduct(VectorA=eval.Tangent, VectorB=Z, Unitize=False)  # -> Vector, Length
dispatch = Dispatch(List=vec2pt.Vector, DispatchPattern=smaller.OrEqualTo)  # -> ListA, ListB
easing = Slider(0.35, range=0..1)
vlen = VectorLength(Vector=dispatch.ListA)
subtraction = Subtraction(A=border_threshold, B=vlen)
multiplication_2 = Multiplication(A=subtraction, B=easing)
amp = Amplitude(Vector=dispatch.ListA, Amplitude=multiplication_2)
pt_2 = Point(Point(0, 0, 0))
weave = Weave(Pattern=smaller.OrEqualTo, Stream0=pt_2, Stream1=amp, NullGaps=False)

# ----
amp_2 = Amplitude(Vector=item.Item1, Amplitude=Slider(2, range=0..10))

# ---- group: WANDER
wandering_angle = Slider(62.935, range=0..90)
wandering_strength = Slider(0.789, range=0..1)
rad = Radians(Degrees=wandering_angle)
lng_2 = ListLength(List=flatten(item.Item))
neg = Negative(Value=rad)
dom = ConstructDomain(DomainStart=neg, DomainEnd=rad)
Z_2 = UnitZ(Factor=1)
random = Random(Range=dom, Number=lng_2, Seed=loop_start.Counter)  # -> graft(Random)
vrot = Rotate(Vector=item.Item1, Axis=Z_2, Angle=random)
addition = Addition(A=amp_2, B=vrot)
steer = Steer(vel=item.Item1, des=addition, maxv=number_slider, maxf=wandering_strength)

# ----
move = Move(Geometry=item.Item, Motion=amp_2)  # -> Geometry, Transform
cp = ClosestPoint(Point=move.Geometry, Cloud=arrive)  # -> ClosestPoint, CPIndex, Distance
vec2pt_2 = Vector2Pt(PointA=move.Geometry, PointB=cp.ClosestPoint, Unitize=False)  # -> simplify(Vector), Length

# ----
# steer
steer_2 = Steer(vel=item.Item1, des=vec2pt_2.Vector, maxv=number_slider, maxf=maxforce)

addition_2 = Addition(A=item.Item1, B=steer_2, C=steer, D=weave)
trmvec = TrimVector(Vector=addition_2, LengthDomain=number_slider)
move_2 = Move(Geometry=item.Item, Motion=trmvec)  # -> Geometry, Transform
merge_2 = Merge(Data1=simplify(move_2.Geometry), Data2=simplify(trmvec))
group_2 = Group(Objects=merge_2)
loop_end = LoopEnd(port=loop_start.port, Exit=False, Data=simplify(group_2), pausedState=False, state="Constant & Record", TimeOutVal=0)
move_3 = Move(Geometry=item.Item, Motion=item.Item1)  # -> Geometry, Transform
pt_3 = Point(item.Item)
ungroup_2 = Ungroup(Group=loop_end)
item_2 = ListItem(List=ungroup_2, Index=0, Wrap=True)

# ---- group: WANDER
vdisex = VectorDisplayEx(Point=pt_3, Vector=steer, Colour=ColourSwatch(SwatchColor=RGB(168, 0, 146)), Width=2)

# ---- group: VELOCITY
vdisex_2 = VectorDisplayEx(Point=pt_3, Vector=item.Item1, Colour=ColourSwatch(SwatchColor=RGB(0, 109, 168)), Width=2)

# ---- group: FINAL VECTOR
vdisex_3 = VectorDisplayEx(Point=pt_3, Vector=trmvec, Colour=ColourSwatch(SwatchColor=RGB(255, 255, 255)), Width=2)

# ---- group: SEEK
vdisex_4 = VectorDisplayEx(Point=move_3.Geometry, Vector=steer_2, Colour=RGB(0, 0, 0), Width=2)

# ----
agents_2 = Point([Point(585790.833, 710431.83, 0), Point(585515.8495, 709730.7908, 0), Point(585287.6654, 709141.4, 0), Point(584953.876, 708298.146, 0), Point(584736.3811, 707743.6793, 0)])  # disabled

lng_3 = ListLength(List=agents_2)  # disabled
repeat_2 = RepeatData(Data=Y_2, Length=lng_3)  # disabled

vec_2 = Vector(repeat_2)  # disabled

merge_3 = Merge(Data1=simplify(graft(agents_2)), Data2=simplify(graft(vec_2)))  # disabled
group_3 = Group(Objects=merge_3)  # disabled
loop_start_2 = LoopStart(Repeat=number_slider_3, Trigger=button, Data=group_3)  # -> port, Counter, simplify(Data); disabled
ungroup_3 = Ungroup(Group=loop_start_2.Data)  # disabled
item_3 = ListItem(List=ungroup_3, Index=0, Wrap=True)  # -> Item, Item1; disabled
amp_3 = Amplitude(Vector=item_3.Item1, Amplitude=number_slider_4)  # disabled
move_4 = Move(Geometry=item_3.Item, Motion=amp_3)  # -> Geometry, Transform; disabled
cp_2 = ClosestPoint(Point=move_4.Geometry, Cloud=arrive_2)  # -> ClosestPoint, CPIndex, Distance; disabled
vec2pt_3 = Vector2Pt(PointA=move_4.Geometry, PointB=cp_2.ClosestPoint, Unitize=False)  # -> simplify(Vector), Length; disabled
move_5 = Move(Geometry=item_3.Item, Motion=item_3.Item1)  # -> Geometry, Transform; disabled
pt_4 = Point(item_3.Item)  # disabled

# ---- group: WANDER
wandering_angle_2 = Slider(62.935, range=0..90)  # disabled
wandering_strength_2 = Slider(0.789, range=0..1)  # disabled
rad_2 = Radians(Degrees=wandering_angle_2)  # disabled
lng_4 = ListLength(List=flatten(item_3.Item))  # disabled
neg_2 = Negative(Value=rad_2)  # disabled
dom_2 = ConstructDomain(DomainStart=neg_2, DomainEnd=rad_2)  # disabled
Z_3 = UnitZ(Factor=1)  # disabled
random_2 = Random(Range=dom_2, Number=lng_4, Seed=loop_start_2.Counter)  # -> graft(Random); disabled
vrot_2 = Rotate(Vector=item_3.Item1, Axis=Z_3, Angle=random_2)  # disabled
addition_3 = Addition(A=amp_3, B=vrot_2)  # disabled
steer_3 = Steer(vel=item_3.Item1, des=addition_3, maxv=max_vel_2, maxf=wandering_strength_2)  # disabled

# ----
# steer
steer_4 = Steer(vel=item_3.Item1, des=vec2pt_3.Vector, maxv=max_vel_2, maxf=maxforce_2)  # disabled

addition_4 = Addition(A=item_3.Item1, B=steer_4, C=steer_3)  # disabled
trmvec_2 = TrimVector(Vector=addition_4, LengthDomain=max_vel_2)  # disabled
move_6 = Move(Geometry=item_3.Item, Motion=trmvec_2)  # -> Geometry, Transform; disabled
merge_4 = Merge(Data1=move_6.Geometry, Data2=trmvec_2)  # disabled
group_4 = Group(Objects=merge_4)  # disabled
loop_end_2 = LoopEnd(port=loop_start_2.port, Exit=False, Data=group_4, pausedState=False, state="Constant & Record", TimeOutVal=0)  # disabled
ungroup_4 = Ungroup(Group=loop_end_2)  # disabled
item_4 = ListItem(List=ungroup_4, Index=0, Wrap=True)  # disabled

# ---- group: WANDER
swatch = ColourSwatch(SwatchColor=RGB(168, 0, 146))  # disabled
vdisex_5 = VectorDisplayEx(Point=pt_4, Vector=steer_3, Colour=swatch, Width=2)  # disabled

# ---- group: VELOCITY
swatch_2 = ColourSwatch(SwatchColor=RGB(0, 109, 168))  # disabled
vdisex_6 = VectorDisplayEx(Point=pt_4, Vector=item_3.Item1, Colour=swatch_2, Width=2)  # disabled

# ---- group: FINAL VECTOR
swatch_3 = ColourSwatch(SwatchColor=RGB(255, 255, 255))  # disabled
vdisex_7 = VectorDisplayEx(Point=pt_4, Vector=trmvec_2, Colour=swatch_3, Width=2)  # disabled

# ---- group: SEEK
vdisex_8 = VectorDisplayEx(Point=move_5.Geometry, Vector=steer_4, Colour=RGB(0, 0, 0), Width=2)  # disabled

# ==== cluster Steer
maxf = ClusterInput()
vel = ClusterInput()
maxv = ClusterInput()
des = ClusterInput()
amp = Amplitude(Vector=des, Amplitude=maxv)
subtraction = Subtraction(A=amp, B=vel)
multiplication = Multiplication(A=subtraction, B=maxf)
vlen = VectorLength(Vector=multiplication)
min = Minimum(A=vlen, B=maxv)
amp_2 = Amplitude(Vector=multiplication, Amplitude=min)
acc = ClusterOutput(amp_2)
