# Grasshopper definition 20160331_record tail method.gh (Grasshopper 0.9.76)
# Copyright: Co-de-iT
# plug-ins: Anemone, Noise 4D

pt = Point(graft([Point(97.23026444, 47.18736088, 0), Point(102.9208052, 48.59891617, 0), Point(109.1723951, 44.36547091, 0), Point(101.5460938, 37.88936513, 0), Point(111.4122517, 36.20139809, 0), Point(112.988691, 52.15460782, 0), Point(89.47101574, 41.51944567, 0), Point(97.70682141, 55.38789412, 0)]))
step = Slider(1.361, range=1..10)
tail_length = Slider(50, range=2..50)
max_angle = Slider(27.25, range=0..90)
noise_scale = Slider(0.016, range=0..0.05)
lng = ListLength(List=flatten(pt))
X = UnitX(Factor=step)
repeat = RepeatData(Data=X, Length=lng)  # -> graft(Data)
loop_start = LoopStart(N=Slider(200, range=0..200), T=Button(), D0=pt, D1=repeat)  # -> port, Counter, Data, Data_2
Z = UnitZ(Factor=-1)
item = ListItem(List=loop_start.Data, Index="-1", Wrap=True)
perlin = PerlinNoise(Values=item, Time=0, Scale=noise_scale)
multiplication = Multiplication(A=perlin, B=max_angle)
Z_2 = UnitZ(Factor=1)
vrot = Rotate(Vector=loop_start.Data_2, Axis=Z_2, Angle=degrees(multiplication))  # -> simplify(Vector)
move = Move(Geometry=item, Motion=vrot)  # -> Geometry, Transform
# a better method for recording and displaying the tail
tlist = TailList(L=loop_start.Data, it=move.Geometry, len=tail_length)  # -> out, A; inputs L: list, len: Int32
# ---------- tlist: C# ----------
    Component.Name = "Tail List";
    Component.NickName = "TList";
    Component.Description = "Tail list - L list, it item to add, len tail length";

    if (L.Count() > len) {
      L.RemoveAt(0);
    }
    L.Add(it);
    A = L;
# ---------- end tlist ----------
vdisex = VectorDisplayEx(Point=move.Geometry, Vector=vrot, Colour=RGB(0, 0, 0), Width=2)
loop_end = LoopEnd(
    port=loop_start.port,
    Exit=False,
    Data=simplify(tlist.A),
    Data_2=simplify(vrot),
    pausedState=False,
    state="Constant output",
    TimeOutVal=0)  # -> D0, D1
lng_2 = ListLength(List=loop_end.D0)
max_point_size = Slider(0.5, range=0..5)
range = Range(Domain=Domain(0, 1), Steps=expr("x-1", lng_2))
gradient = Gradient(LowerLimit=0, UpperLimit=1, Parameter=range, stops=[0.32: RGB(0, 0, 0), 1: RGB(255, 255, 255)])
multiplication_2 = Multiplication(A=range, B=max_point_size)
addition = Addition(A=multiplication_2, B=1)
cloud = CloudDisplay(Points=graft(loop_end.D0), Colours=graft(gradient), Size=graft(addition), SpriteType=0)

# ----
# noise display
mplane = MeshPlane(Boundary={Plane=PlaneXY(0, 0, 0), Size=Domain2(u=0..200, v=0..100)}, WidthCount=100, HeightCount=50)  # -> Mesh, Area
demesh = DeconstructMesh(Mesh=mplane.Mesh)  # -> Vertices, Faces, Colours, Normals
perlin_2 = PerlinNoise(Values=demesh.Vertices, Time=0, Scale=noise_scale)
remap = RemapNumbers(Value=perlin_2, Source="-1 to 1", Target=Domain(0, 1))  # -> Mapped, Clipped
gradient_2 = Gradient(LowerLimit=0, UpperLimit=1, Parameter=remap.Mapped, stops=[0: RGB(255, 130, 160), 1: RGB(220, 0, 40)])

move_2 = Move(Geometry=demesh.Vertices, Motion=Z)  # -> Geometry, Transform

conmesh = ConstructMesh(Vertices=move_2.Geometry, Faces=demesh.Faces, Colours=gradient_2)
