# Grasshopper definition 20160401_noise particles_streamlines.gh (Grasshopper 0.9.76)
# Copyright: Co-de-iT
# plug-ins: Anemone, Human, Noise 4D

# WS_title
# ws subtitle
# tutor: Alessio Erioli
# Place . Dates
crv = Curve(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)
number_slider = Slider(21, range=10..200)
noise_scale = Slider(4.802, range=0..10)
noise_time = Slider(0.666, range=0..10)
points = Slider(0.116, range=0..1)
mplane = MeshPlane(Boundary=crv, WidthCount=number_slider, HeightCount=number_slider)  # -> Mesh, Area
demesh = DeconstructMesh(Mesh=mplane.Mesh)  # -> Vertices, Faces, Colours, Normals
# <title>
# 
# <description>
# 
# code by <author>
# 
# v <version>
# 
# © Co-de-iT 2016 _ Creative Commons Attribution-NonCommercial-ShareAlike 4.0 International License
pdecon = Deconstruct(Point=demesh.Vertices)  # -> XComponent, YComponent, ZComponent
lng = ListLength(List=demesh.Faces)
sort = SortList(Keys=pdecon.YComponent, ValuesA=demesh.Vertices)  # -> Keys, ValuesA

division = Division(A=noise_scale, B=100)
perlin = PerlinNoise(Values=demesh.Vertices, Time=noise_time, Scale=division)
# display noise
gradient = Gradient(LowerLimit="-1", UpperLimit=1, Parameter=perlin, stops=[0: RGB(0, 0, 0), 1: RGB(255, 255, 255)])
conmesh = ConstructMesh(Vertices=demesh.Vertices, Faces=demesh.Faces, Colours=gradient)

multiplication = Multiplication(A=lng, B=points)
subset = SubList(List=sort.ValuesA, Domain=number_slider, Wrap=True)  # -> List, Index
maxang = Slider(85.466, range=0..90)
step = Slider(0.506, range=0..1)
multiplication_2 = Multiplication(A=number_slider, B=Slider(0, range=0..1))
reduce = RandomReduce(List=subset.List, Reduction=multiplication_2, Seed=1)  # -> graft(List)
reduce_2 = RandomReduce(List=demesh.Vertices, Reduction=multiplication, Seed=1)  # -> graft(List)

Y = UnitY(Factor=step)
lng_2 = ListLength(List=reduce_2)
repeat = RepeatData(Data=Y, Length=lng_2)

rad = Radians(Degrees=maxang)
loop_start = LoopStart(N=Slider(50, range=1..200), T=Button(), D0=reduce_2, D1=repeat)  # -> port, Counter, Data, Data_2
panel = Panel(loop_start.Counter)
item = ListItem(List=loop_start.Data, Index="-1", Wrap=True)
item_2 = ListItem(List=loop_start.Data_2, Index="-1", Wrap=True)
vdisex = VectorDisplayEx(Point=item, Vector=item_2, Colour=RGB(0, 0, 0), Width=2)

perlin_2 = PerlinNoise(Values=item, Time=noise_time, Scale=division)
multiplication_3 = Multiplication(A=perlin_2, B=rad)
Y_2 = UnitY(Factor=step)
Z = UnitZ(Factor=1)
vrot = Rotate(Vector=Y_2, Axis=Z, Angle=multiplication_3)
move = Move(Geometry=item, Motion=vrot)  # -> Geometry, Transform

start_at_frame = Slider(3, range=0..10)
min_distance = Slider(0.469, range=0..3)
cull_i = CullIndex(List=loop_start.Data, Indices="-1", Wrap=True)
cp = ClosestPoint(Point=item, Cloud=flatten(cull_i))  # -> ClosestPoint, CPIndex, Distance
smaller = SmallerThan(FirstNumber=cp.Distance, SecondNumber=min_distance)  # -> SmallerThan, OrEqualTo
larger = LargerThan(FirstNumber=loop_start.Counter, SecondNumber=start_at_frame)  # -> LargerThan, OrEqualTo
and = GateAnd(A=larger.OrEqualTo, B=smaller.SmallerThan)
dispatch = Dispatch(List=vrot, DispatchPattern=and)  # -> ListA, ListB
dispatch_2 = Dispatch(List=move.Geometry, DispatchPattern=and)  # -> ListA, ListB

massbool = MassBool(V=flatten(and))  # -> out, A; inputs V: list of Boolean, type: Int32
# ---------- massbool: C# ----------
    Component.Name = "MassBool";
    Component.Description = "Mass boolean operator - type is 0 for AND and 1 for OR operators";
    
    bool r;
    if (type == 0) {
      Component.Message = "Massive AND";
      r = true;
    }else{
      Component.Message = "Massive OR";
      r = false;
    }


    for (int i = 0; i < V.Count; i++){
      if (type == 0) {
        r = r && V[i];
      }
      else{
        r = r || V[i];
      }
    }
    A = r;
# ---------- end massbool ----------
merge = Merge(Data1=simplify(loop_start.Data), Data2=simplify(dispatch_2.ListB))  # -> simplify(Result)
merge_2 = Merge(Data1=simplify(loop_start.Data_2), Data2=simplify(dispatch.ListB))  # -> simplify(Result)
loop_end = LoopEnd(
    port=loop_start.port,
    Exit=massbool.A,
    Data=merge,
    Data_2=merge_2,
    pausedState=False,
    state="Constant output",
    TimeOutVal=0)  # -> D0, D1
vdisex_2 = VectorDisplayEx(Point=loop_end.D0, Vector=loop_end.D1, Colour=RGB(0, 0, 0), Width=2)
pline = PolyLine(Vertices=loop_end.D0, Closed=False)
previewlw = CustomPreviewLineweights(Geometry=pline, Shader=ColourSwatch(SwatchColor=RGB(255, 0, 0)), Thickness=Slider(2, range=1..3), Absolute=False)
