# Grasshopper definition 20160401_record tail method + group.gh (Grasshopper 0.9.76)
# Copyright: Co-de-iT
# plug-ins: Heteroptera, Anemone, Noise 4D

# WS_title
# ws subtitle
# tutor: Alessio Erioli
# Place . Dates
# simple record tail
pt = Point(graft([Point(97.23026444, 47.18736088, 0), Point(102.9208052, 48.59891617, 0), Point(109.1723951, 44.36547091, 0), Point(101.5460938, 37.88936513, 0), Point(111.4122517, 36.20139809, 0), Point(112.988691, 52.15460782, 0), Point(89.47101574, 41.51944567, 0), Point(97.70682141, 55.38789412, 0)]))
step = Slider(1.361, range=1..10)
tail_length = Slider(50, range=2..50)
max_angle = Slider(27.25, range=0..90)
noise_scale = Slider(0.016, range=0..0.05)
# <title>
# 
# <description>
# 
# code by <author>
# 
# v <version>
# 
# © Co-de-iT 2016 _ Creative Commons Attribution-NonCommercial-ShareAlike 4.0 International License
number_slider = Slider(200, range=0..200)
lng = ListLength(List=flatten(pt))
X = UnitX(Factor=step)
# loc
pt_2 = Point(flatten([Point(97.23026444, 47.18736088, 0), Point(102.9208052, 48.59891617, 0), Point(109.1723951, 44.36547091, 0), Point(101.5460938, 37.88936513, 0), Point(111.4122517, 36.20139809, 0), Point(112.988691, 52.15460782, 0), Point(89.47101574, 41.51944567, 0), Point(97.70682141, 55.38789412, 0)]))
# group method
lng_2 = ListLength(List=pt_2)
wheel = ColourWheel(
    lng_2,
    ColourGrips_Style=10,
    ColourGrips_Grip=[0.1973955598, 3.141592654, 1.570796327, 4.71238898],
    ColourGrips_Lum=[0.3878572674, 0.9384816979],
    ColourGrips_Range=[0.2307165557, 0.2307165557, 0.2307165557, 0.2307165557],
    ColourGrips_Sat=[0.2, 1])
legend = Legend(Colour=wheel, Tags=["One Fish", "Two Fish", "Red Fish", "Blue Fish"], LegendType=1)
rnd_vector = RandomVector(Number=lng_2, Lenght="1.0 to 3.0", isflat=True)
# vel
vec = Vector(flatten(rnd_vector))
# col
col = Colour(flatten(wheel))
# trail
# < NB: always the trail as LAST
pt_3 = Point(pt_2)
repeat = RepeatData(Data=X, Length=lng)  # -> graft(Data)
loop_start = LoopStart(N=number_slider, T=Button(), D0=pt, D1=repeat)  # -> port, Counter, Data, Data_2; disabled
# fields
merge = Merge(Data1=simplify(graft(pt_2)), Data2=simplify(graft(vec)), Data3=simplify(graft(col)), Data4=simplify(graft(pt_3)))
item = ListItem(List=loop_start.Data, Index="-1", Wrap=True)
perlin = PerlinNoise(Values=item, Time=0, Scale=noise_scale)
group = Group(Objects=merge)
multiplication = Multiplication(A=perlin, B=max_angle)
Z = UnitZ(Factor=1)
Z_2 = UnitZ(Factor=-1)
loop_start_2 = LoopStart(Repeat=Slider(63, range=0..100), Trigger=Button(), Data=group)  # -> port, Counter, Data
max_angle_2 = Slider(48.13, range=0..90)
noise_scale_2 = Slider(0.019, range=0..0.05)
vrot = Rotate(Vector=loop_start.Data_2, Axis=Z, Angle=degrees(multiplication))  # -> simplify(Vector)
ungroup = Ungroup(Group=loop_start_2.Data)

# ----
# noise display
mplane = MeshPlane(Boundary={Plane=PlaneXY(0, 0, 0), Size=Domain2(u=0..200, v=0..100)}, WidthCount=100, HeightCount=50)  # -> Mesh, Area
demesh = DeconstructMesh(Mesh=mplane.Mesh)  # -> Vertices, Faces, Colours, Normals
perlin_2 = PerlinNoise(Values=demesh.Vertices, Time=0, Scale=noise_scale_2)
gradient = Gradient(LowerLimit="-1", UpperLimit=1, Parameter=perlin_2, stops=[0.0345: RGB(237, 249, 255), 0.98: RGB(14, 26, 76)])
Z_3 = UnitZ(Factor=-1)
move = Move(Geometry=demesh.Vertices, Motion=Z_3)  # -> Geometry, Transform
conmesh = ConstructMesh(Vertices=move.Geometry, Faces=demesh.Faces, Colours=gradient)

move_2 = Move(Geometry=item, Motion=vrot)  # -> Geometry, Transform
split = SplitList(List=ungroup, Index="3")  # -> ListA, ListB
# a better method for recording and displaying the tail
tlist = TailList(L=loop_start.Data, it=move_2.Geometry, len=tail_length)  # -> out, Lo; inputs L: list, len: Int32
# ---------- tlist: C# ----------
    Component.Name = "Tail List";
    Component.NickName = "TList";
    Component.Description = "Tail list - L list, it item to add, len tail length";

    if (L.Count() > len) {
      L.RemoveAt(0);
    }
    L.Add(it);
    Lo = L;
# ---------- end tlist ----------
vdisex = VectorDisplayEx(Point=move_2.Geometry, Vector=vrot, Colour=RGB(0, 0, 0), Width=2)
item_2 = ListItem(List=split.ListA, Index=0, Wrap=True)  # -> Item, Item1, Item2
loop_end = LoopEnd(
    port=loop_start.port,
    Exit=False,
    Data=simplify(tlist.Lo),
    Data_2=simplify(vrot),
    pausedState=False,
    state="Constant output",
    TimeOutVal=0)  # -> D0, D1
perlin_3 = PerlinNoise(Values=item_2.Item, Time=0, Scale=noise_scale_2)
multiplication_2 = Multiplication(A=perlin_3, B=max_angle_2)
Z_4 = UnitZ(Factor=1)
vrot_2 = Rotate(Vector=item_2.Item1, Axis=Z_4, Angle=degrees(multiplication_2))  # -> simplify(Vector)
move_3 = Move(Geometry=item_2.Item, Motion=vrot_2)  # -> Geometry, Transform
# add to trail
merge_2 = Merge(Data1=split.ListB, Data2=move_3.Geometry)
merge_3 = Merge(Data1=simplify(move_3.Geometry), Data2=simplify(vrot_2), Data3=simplify(item_2.Item2), Data4=simplify(merge_2))
group_2 = Group(Objects=merge_3)
lng_3 = ListLength(List=loop_end.D0)
max_point_size = Slider(0.5, range=0..5)
range = Range(Domain=Domain(0, 1), Steps=expr("x-1", lng_3))
loop_end_2 = LoopEnd(port=loop_start_2.port, Exit=False, Data=simplify(group_2), pausedState=False, state="Constant output", TimeOutVal=0)
gradient_2 = Gradient(LowerLimit=0, UpperLimit=1, Parameter=range, stops=[0.32: RGB(0, 0, 0), 1: RGB(255, 255, 255)])
multiplication_3 = Multiplication(A=range, B=max_point_size)
ungroup_2 = Ungroup(Group=loop_end_2)
addition = Addition(A=multiplication_3, B=1)
split_2 = SplitList(List=ungroup_2, Index="3")  # -> ListA, ListB
viewer = ParamViewer(split_2.ListB)
cloud = CloudDisplay(Points=graft(loop_end.D0), Colours=graft(gradient_2), Size=graft(addition), SpriteType=0)
item_3 = ListItem(List=split_2.ListA, Index=0, Wrap=True)  # -> Item, Item1, Item2
lng_4 = ListLength(List=viewer)
repeat_2 = RepeatData(Data=ColourSwatch(SwatchColor=RGB(0, 0, 0)), Length=lng_4)  # -> graft(Data)
lng_5 = ListLength(List=split_2.ListB)
number_slider_2 = Slider(0.66, range=0..3)
merge_4 = Merge(Data1=simplify(repeat_2), Data2=simplify(item_3.Item2))
range_2 = Range(Domain=Domain(0, 1), Steps=expr("x-1", lng_5))
col_2 = Colour(merge_4)
expression = Expression(x=range_2, y=number_slider_2, Expression="1+x*y")
interp = InterpolateData(Data=col_2, Parameter=range_2, Interpolation=2)
addition_2 = Addition(A=number_slider_2, B=1)
cloud_2 = CloudDisplay(Points=graft(split_2.ListB), Colours=graft(interp), Size=graft(expression), SpriteType=0)
cloud_3 = CloudDisplay(Points=item_3.Item, Colours=item_3.Item2, Size=addition_2, SpriteType=0)

# ----
# noise display
mplane_2 = MeshPlane(Boundary={Plane=PlaneXY(0, 0, 0), Size=Domain2(u=0..200, v=0..100)}, WidthCount=100, HeightCount=50)  # -> Mesh, Area
demesh_2 = DeconstructMesh(Mesh=mplane_2.Mesh)  # -> Vertices, Faces, Colours, Normals
perlin_4 = PerlinNoise(Values=demesh_2.Vertices, Time=0, Scale=noise_scale)
gradient_3 = Gradient(LowerLimit="-1", UpperLimit=1, Parameter=perlin_4, stops=[0: RGB(255, 130, 160), 1: RGB(220, 0, 40)])

move_4 = Move(Geometry=demesh_2.Vertices, Motion=Z_2)  # -> Geometry, Transform

conmesh_2 = ConstructMesh(Vertices=move_4.Geometry, Faces=demesh_2.Faces, Colours=gradient_3)
