# Grasshopper definition 20160405_basic read-write.gh (Grasshopper 0.9.76)
# Copyright: Co-de-iT
# plug-ins: Noise 4D

noise_scale = Slider(0.016, range=0..0.05)
# noise map
mplane = MeshPlane(Boundary={Plane=PlaneXY(0, 0, 0), Size=Domain2(u=0..200, v=0..100)}, WidthCount=100, HeightCount=50)  # -> Mesh, Area
demesh = DeconstructMesh(Mesh=mplane.Mesh)  # -> Vertices, Faces, Colours, Normals
perlin = PerlinNoise(Values=demesh.Vertices, Time=0, Scale=noise_scale)
gradient = Gradient(LowerLimit="-1", UpperLimit=1, Parameter=perlin, stops=[0: RGB(255, 255, 255), 1: RGB(0, 0, 0)])
# WORKSHOP NAME
# DATE
# PLACE
Z = UnitZ(Factor=-1)
# reciproCITY
# Alessio Erioli
# Aldo Sollazzo
# Eugenio Bettucchi
# 15-17 April 2016
move = Move(Geometry=demesh.Vertices, Motion=Z)  # -> Geometry, Transform
conmesh = ConstructMesh(Vertices=demesh.Vertices, Faces=demesh.Faces, Colours=gradient)

number_slider = Slider(29, range=2..100)
division = Division(A=Slider(150, range=0..150), B=number_slider)
pt = Point(Point(29.88660596, 220.276864, 0))
series = Series(Start=0, Step=division, Count=expr("x+1", number_slider))
sqgrid = Square(Plane=pt, Size=division, ExtentX=number_slider, ExtentY=number_slider)  # -> Cells, Points
Z_2 = UnitZ(Factor=series)
move_2 = Move(Geometry=graft(sqgrid.Points), Motion=Z_2)  # -> graft(Geometry), Transform
pt_2 = Point([Point(132.1766168, 302.1609443, 113.3891299), Point(94.29055768, 260.2008342, 62.28281269), Point(68.25661883, 319.6484653, 18.78711808)])
dist = Distance(PointA=move_2.Geometry, PointB=pt_2)
expression = Expression(x=dist, Expression="1/(x+0.1)")
avr = Average(Input=expression)
multiplication = Multiplication(A=avr, B=Slider(650, range=0..1000))
sin = Sine(Value=multiplication)
bnd = Bounds(Numbers=flatten(sin))
dedomain = DeconstructDomain(Domain=bnd)  # -> Start, End
ahsv = SplitAHSV(Colour=gradient)  # -> Alpha, Hue, Saturation, Value
gradient_2 = Gradient(
    LowerLimit=dedomain.Start,
    UpperLimit=dedomain.End,
    Parameter=sin,
    stops=[0.0345: RGB(237, 249, 255), 0.98: RGB(14, 26, 76)])
pt_3 = Point(flatten(move_2.Geometry))
data = Data(flatten(sin))
cloud = CloudDisplay(Points=flatten(move_2.Geometry), Colours=flatten(gradient_2), Size=Slider(1.287, range=0..5), SpriteType=0)
file_path = Panel("C:\Users\Alessio\Documents\GitHub\GH_ws_IaaC_2016\WIP\@ data\pt_bright.csv")
crv = Curve([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])
file_path_2 = Panel("C:\Users\Alessio\Documents\GitHub\GH_ws_IaaC_2016\WIP\@ data\pt_field.csv")  # disabled
pdecon = Deconstruct(Point=pt_3)  # -> XComponent, YComponent, ZComponent; disabled
pdecon_2 = Deconstruct(Point=demesh.Vertices)  # -> XComponent, YComponent, ZComponent
# write to .csv file
expression_2 = Expression(
    x=pdecon.XComponent,
    y=pdecon.YComponent,
    z=pdecon.ZComponent,
    c=data,
    Expression="Format(\"{0},{1},{2},{3}\", x, y,z,c)")  # disabled
divide = DivideCurve(Curve=crv, Count=Slider(27, range=2..50), Kinks=False)  # -> Points, Tangents, Parameters
panel = Panel("C:\Users\Alessio\Documents\GitHub\GH_ws_IaaC_2016\WIP\@ data\pts.csv")
file = ReadFile(File=file_path, PerLineParse=True)
# write to .csv file
expression_3 = Expression(
    x=pdecon_2.XComponent,
    y=pdecon_2.YComponent,
    z=pdecon_2.ZComponent,
    c=ahsv.Value,
    Expression="Format(\"{0},{1},{2},{3}\", x, y,z,c)")
number_slider_2 = Slider(2, range=2..4)  # disabled
pdecon_3 = Deconstruct(Point=divide.Points)  # -> XComponent, YComponent, ZComponent
split = TextSplit(Text=file, Separators=",")
file_2 = ReadFile(File=file_path_2, PerLineParse=True)  # disabled
panel_2 = Panel(",")  # disabled
# read from .csv file
expression_4 = Expression(x=ahsv.Value, y=Slider(2, range=2..4), Expression="round(x,y)")
# write curves/polylines points to .csv file
expression_5 = Expression(x=pdecon_3.XComponent, y=pdecon_3.YComponent, z=pdecon_3.ZComponent, Expression="Format(\"{0} {1} {2}\", x, y,z)")
item = ListItem(List=split, Index=0, Wrap=True)  # -> Item, Item1, Item2, Item3
split_2 = TextSplit(Text=file_2, Separators=panel_2)  # disabled
# read curves/polylines points from .csv file
file_3 = ReadFile(File=panel, PerLineParse=True)
item_2 = ListItem(List=split_2, Index=0, Wrap=True)  # -> Item, Item1, Item2, Item3; disabled
num = Number(item_2.Item3)  # disabled
# read from .csv file
expression_6 = Expression(x=num, y=number_slider_2, Expression="round(x,y)")  # disabled
split_3 = TextSplit(Text=file_3, Separators=",")
points_and_color_values = Panel(expression_2)  # disabled
pt_4 = ConstructPoint(XCoordinate=item.Item, YCoordinate=item.Item1, ZCoordinate=item.Item2)  # -> flatten(Point)
hsl = ColourHSL(Alpha=1, Hue=0, Saturation=0, Luminance=item.Item3)  # -> flatten(Colour)
split_4 = TextSplit(Text=split_3, Separators=" ")
points_and_color_values_2 = Panel(expression_3)
pt_5 = ConstructPoint(XCoordinate=item_2.Item, YCoordinate=item_2.Item1, ZCoordinate=item_2.Item2)  # -> flatten(Point); disabled
number_slider_3 = Slider(0.4, range=0..1)  # disabled
tag = TextTag3D(Location=demesh.Vertices, Text=expression_4, Size=Slider(0.4, range=0..1), Justification=7)  # disabled
item_3 = ListItem(List=split_4, Index=0, Wrap=True)  # -> Item, Item1, Item2

# ---- group: add point separator
lng = ListLength(List=expression_5)  # -> expr("x-1", Length)
split_5 = SplitList(List=expression_5, Index=lng)  # -> ListA, ListB
concat = Concatenate(FragmentA=split_5.ListA, FragmentB=",")

# ----
cloud_2 = CloudDisplay(Points=pt_4, Colours=hsl, Size=1, SpriteType=0)
pt_6 = ConstructPoint(XCoordinate=item_3.Item, YCoordinate=item_3.Item1, ZCoordinate=item_3.Item2)
tag_2 = TextTag3D(Location=demesh.Vertices, Text=expression_6, Size=number_slider_3, Justification=7)  # disabled
pshift = ShiftPaths(Data=pt_6, Offset=-1)
pline = PolyLine(Vertices=pshift, Closed=False)
merge = Merge(Data1=concat, Data2=split_5.ListB)
cloud_3 = CloudDisplay(Points=pshift, Colours=ColourSwatch(SwatchColor=RGB(255, 255, 255)), Size=1, SpriteType=0)
preview = CustomPreview(Geometry=pline, Shader=ColourSwatch(SwatchColor=RGB(3, 3, 3)))
join = TextJoin(Text=merge)  # -> flatten(Result)
polyline_points = Panel(join)
