# Grasshopper definition 20160405_basic stigmergy.gh (Grasshopper 0.9.76)
# Copyright: Co-de-iT
# plug-ins: Human UI, Anemone, Human, Boid, Noise 4D

# reciproCITY
# tutors
# Aldo Sollazzo
# Alessio Erioli
# IaaC . 15-17.04.2016
number_slider = Slider(4, range=1..5)
seed = Slider(33, range=0..100)
noise_scale = Slider(0.016, range=0..0.05)
# basic stigmergy example
# (environment read/write)
pt = Point(flatten([Point(97.23026444, 47.18736088, 0), Point(102.9208052, 48.59891617, 0), Point(109.1723951, 44.36547091, 0), Point(101.5460938, 37.88936513, 0), Point(111.4122517, 36.20139809, 0), Point(112.988691, 52.15460782, 0), Point(89.47101574, 41.51944567, 0), Point(97.70682141, 55.38789412, 0)]))
# <title>
# 
# <description>
# 
# code by <author>
# 
# v <version>
# 
# © Co-de-iT 2016 _ Creative Commons Attribution-NonCommercial-ShareAlike 4.0 International License
# loc
dup = DuplicateData(Data=pt, Number=number_slider, Order=True)
lng = ListLength(List=dup)
wheel = ColourWheel(
    lng,
    ColourGrips_Style=10,
    ColourGrips_Grip=[3.410431301, 3.141592654, 1.570796327, 4.71238898],
    ColourGrips_Lum=[0.0534287417, 0.560828417],
    ColourGrips_Range=[0.2307165557, 0.2307165557, 0.2307165557, 0.2307165557],
    ColourGrips_Sat=[1, 0.8651205502])
addition = Addition(A=seed, B=1)
random = Random(Range="1.0 to 3.0", Number=lng, Seed=seed)
random_2 = Random(Range="0 to Pi*2", Number=lng, Seed=addition)
Z = UnitZ(Factor=1)
X = UnitX(Factor=random)
number_slider_2 = Slider(820, range=100..1000)  # disabled
number_slider_3 = Slider(1750, range=0..2000)  # disabled
number_slider_4 = Slider(25, range=10..200)  # disabled
vrot = Rotate(Vector=X, Axis=Z, Angle=random_2)

# ----
# noise map
mplane = MeshPlane(Boundary={Plane=PlaneXY(0, 0, 0), Size=Domain2(u=0..200, v=0..100)}, WidthCount=100, HeightCount=50)  # -> Mesh, Area
demesh = DeconstructMesh(Mesh=mplane.Mesh)  # -> Vertices, Faces, Colours, Normals
perlin = PerlinNoise(Values=demesh.Vertices, Time=0, Scale=noise_scale)
gradient = Gradient(LowerLimit="-1", UpperLimit=1, Parameter=perlin, stops=[0: RGB(255, 255, 255), 1: RGB(0, 0, 0)])
Z_2 = UnitZ(Factor=-1)
move = Move(Geometry=demesh.Vertices, Motion=Z_2)  # -> Geometry, Transform
conmesh = ConstructMesh(Vertices=demesh.Vertices, Faces=demesh.Faces, Colours=gradient)

# ----
# to UI
# vel
vec = Vector(flatten(vrot))
# col
col = Colour(flatten(wheel))
# trail
# < NB: always the trail as LAST
pt_2 = Point(dup)
pt_3 = ConstructPoint(XCoordinate=number_slider_3, YCoordinate=number_slider_2, ZCoordinate=0)  # disabled
number_slider_5 = Slider(65, range=10..200)  # disabled
number_slider_6 = Slider(132, range=10..200)  # disabled
pt_4 = Point(pt_3)  # disabled
toggle = BooleanToggle(False)  # disabled
launchxpwin = LaunchTransparentWindow(Show=toggle, Name="Control Window", Width=number_slider_6, Height=number_slider_5, ChildStatus=0)  # disabled
toggle_2 = BooleanToggle(False)  # disabled
swatch = ColourSwatch(SwatchColor=RGBA(255, 255, 255, 0))  # disabled
demesh_2 = DeconstructMesh(Mesh=conmesh)  # -> Vertices, Faces, Colours, Normals
winprops = SetWindowProperties(Window=launchxpwin, StartingLocation=pt_4, ShowTitleBar=toggle_2, BackgroundColor=swatch)  # disabled
# fields
merge = Merge(Data1=simplify(graft(dup)), Data2=simplify(graft(vec)), Data3=simplify(graft(col)), Data4=simplify(graft(pt_2)))
number_slider_7 = Slider(360, range=0..1000)
evaporation_rate = Slider(0.97952, range=0..1)
maxforce = Slider(0.772, range=0..1)
futloc = Slider(2.5, range=0..3)
ph_strength = Slider(0.238, range=0..1)
maxspeed = Slider(1.5, range=0..3)
group = Group(Objects=merge)
loop_start = LoopStart(N=number_slider_7, T=Button(), D0=group, D1=demesh_2.Colours)  # -> port, Counter, Data, Data_2
expression = Expression(x=number_slider_7, y=loop_start.Counter, Expression="round(y/x*100)")
label = CreateLabel(LabelText=expression, LabelSize=number_slider_4, Justification=1)  # disabled
addelems = AddElements(Window=launchxpwin, Elements=flatten(label))  # -> AddedElements, ElementNames; disabled
ungroup = Ungroup(Group=loop_start.Data)  # -> simplify(Objects)
panel = Panel(expression)
split = SplitList(List=ungroup, Index="3")  # -> ListA, ListB
# loc
# vel
# col
item = ListItem(List=split.ListA, Index=0, Wrap=True)  # -> Item, Item1, Item2
# read environment
amp = Amplitude(Vector=item.Item1, Amplitude=futloc)
# future location
move_2 = Move(Geometry=item.Item, Motion=amp)  # -> Geometry, Transform

# ----
# obnoxious time-consuming method
# brightest
# darkest
# Left, Center, Right
stig_angle = Slider(44.422, range=0..90)  # disabled
neg = Negative(Value=stig_angle)  # disabled
merge_2 = Merge(Data1=stig_angle, Data2=neg)  # disabled
mesh = Mesh(conmesh)  # disabled
c_script = CSharpScript(P=move_2.Geometry, M=mesh)  # -> out, Pt, N, C, bC; inputs P: Point3d, M: Mesh; disabled
# ---------- c_script: C# ----------
    MeshPoint pm = M.ClosestMeshPoint(P, 1000);
    int fi = pm.FaceIndex;
    double[] cw = pm.T;
    double[] rgb = {0,0,0};
    Vector3d n = new Vector3d();
    int[] vi = {M.Faces[fi].A, M.Faces[fi].B, M.Faces[fi].C};
    for (int i = 0; i < 3; i++){
      rgb[0] += M.VertexColors[vi[i]].R * cw[i];
      rgb[1] += M.VertexColors[vi[i]].G * cw[i];
      rgb[2] += M.VertexColors[vi[i]].B * cw[i];
      n = Vector3d.Add(n, Vector3d.Multiply(M.Normals[vi[i]], cw[i]));
    }
    n.Unitize();
    Pt = pm.Point;
    N = n;
    C = Color.FromArgb((int) rgb[0], (int) rgb[1], (int) rgb[2]);
    bC = cw; // baricentric coordinates
# ---------- end c_script ----------
rad = Radians(Degrees=merge_2)  # disabled
vrot_2 = Rotate(Vector=item.Item1, Axis=c_script.N, Angle=rad)  # -> simplify(Vector); disabled
move_3 = Move(Geometry=item.Item, Motion=vrot_2)  # -> Geometry, Transform; disabled
c_script_2 = CSharpScript(P=move_3.Geometry, M=mesh)  # -> out, Pt, N, C, bC; inputs P: Point3d, M: Mesh; disabled; same code as c_script
swatch_2 = ColourSwatch(SwatchColor=RGB(255, 0, 0))  # disabled
swatch_3 = ColourSwatch(SwatchColor=RGB(0, 0, 0))  # disabled
swatch_4 = ColourSwatch(SwatchColor=RGB(0, 64, 255))  # disabled
panel_2 = Panel("1")  # disabled
merge_3 = Merge(Data1=swatch_2, Data2=swatch_3, Data3=swatch_4)  # disabled
ins = InsertItems(List=vrot_2, Item=item.Item1, Indices=panel_2, Wrap=True)  # -> simplify(List); disabled
ins_2 = InsertItems(List=c_script_2.C, Item=c_script.C, Indices=panel_2, Wrap=True)  # -> simplify(List); disabled
ahsv = SplitAHSV(Colour=ins_2)  # -> Alpha, Hue, Saturation, Value; disabled
sort = SortList(Keys=ahsv.Value, ValuesA=ins, ValuesB=ins_2)  # -> Keys, ValuesA, ValuesB; disabled
item_2 = ListItem(List=sort.ValuesA, Index=0, Wrap=True)  # -> Item1, Item; disabled
item_3 = ListItem(List=sort.ValuesB, Index=0, Wrap=True)  # -> Item1, Item; disabled
vdisex = VectorDisplayEx(Point=item.Item, Vector=item_2.Item, Colour=RGB(0, 0, 0), Width=2)  # disabled
maxforce_2 = Slider(0.204, range=0..1)  # disabled
panel_3 = Panel(item_3.Item)  # disabled
steer = Steer(vel=item.Item1, des=item_2.Item, maxv=maxspeed, maxf=maxforce_2)  # disabled

samples = Slider(5, range=3..10)
cps = ClosestPoints(Point=move_2.Geometry, Cloud=demesh_2.Vertices, Count=samples)  # -> ClosestPoint, CPIndex, Distance
item_4 = ListItem(List=loop_start.Data_2, Index=cps.CPIndex, Wrap=True)
max_angle = Slider(90, range=0..90)
ahsv_2 = SplitAHSV(Colour=item_4)  # -> Alpha, Hue, Saturation, Value
sort_2 = SortList(Keys=ahsv_2.Value, ValuesA=cps.ClosestPoint, ValuesB=cps.CPIndex)  # -> Keys, ValuesA, ValuesB
perlin_2 = PerlinNoise(Values=item.Item, Time=0, Scale=noise_scale)
multiplication = Multiplication(A=perlin_2, B=max_angle)
Z_3 = UnitZ(Factor=1)
# brightest
item_5 = ListItem(List=simplify(sort_2.ValuesA), Index=0, Wrap=True)  # -> Item1, Item
# darkest
item_6 = ListItem(List=simplify(sort_2.ValuesB), Index=0, Wrap=True)  # -> Item1, Item
vrot_3 = Rotate(Vector=item.Item1, Axis=Z_3, Angle=degrees(multiplication))  # -> simplify(Vector)
vec2pt = Vector2Pt(PointA=item.Item, PointB=item_5.Item1, Unitize=False)  # -> Vector, Length
maxforce_3 = Slider(0.384, range=0..1)
noise_intensity = Slider(0.296, range=0..1)
color_intensity = Slider(1, range=0..1)
# steer
steer_2 = Steer(vel=item.Item1, des=vrot_3, maxv=maxspeed, maxf=maxforce_3)
cp = ClosestPoint(Point=item.Item, Cloud=demesh_2.Vertices)  # -> ClosestPoint, CPIndex, Distance
steer_3 = Steer(vel=item.Item1, des=vec2pt.Vector, maxv=maxspeed, maxf=maxforce)
# write to environment
item_7 = ListItem(List=loop_start.Data_2, Index=cp.CPIndex, Wrap=True)  # -> simplify(Item1), Item
panel_4 = Panel("0")  # disabled
ahsv_3 = SplitAHSV(Colour=item_7.Item1)  # -> Alpha, Hue, Saturation, Value
multiplication_2 = Multiplication(A=steer_3, B=color_intensity)
multiplication_3 = Multiplication(A=steer_2, B=noise_intensity)
c_script_3 = CSharpScript(D=loop_start.Data_2, B=item_6.Item1, i=panel_4)  # -> out, A; inputs D: tree, B: Int32, i: Int32; disabled
# ---------- c_script_3: C# ----------
    D.Branch(B)[i] = It;
    A = D;
# ---------- end c_script_3 ----------
addition_2 = Addition(A=ahsv_3.Value, B=ph_strength)
addition_3 = Addition(A=item.Item1, B=multiplication_3, C=multiplication_2)
min = Minimum(A=addition_2, B="1")
trmvec = TrimVector(Vector=addition_3, LengthDomain=maxspeed)
frgb = ColourRGBF(Alpha=1, Red=min, Green=min, Blue=min)
move_4 = Move(Geometry=item.Item, Motion=trmvec)  # -> Geometry, Transform
replace = ReplaceItems(List=flatten(loop_start.Data_2), Item=flatten(frgb), Indices=flatten(cp.CPIndex), Wrap=False)
meshcp = MeshClosestPoint(Point=move_4.Geometry, Mesh=conmesh)  # -> Point, Index, Parameter
multiplication_4 = Multiplication(A=replace, B=evaporation_rate)
# add to trail
merge_4 = Merge(Data1=simplify(split.ListB), Data2=simplify(meshcp.Point))
merge_5 = Merge(Data1=simplify(meshcp.Point), Data2=simplify(trmvec), Data3=simplify(item.Item2), Data4=simplify(merge_4))
group_2 = Group(Objects=merge_5)
loop_end = LoopEnd(
    port=loop_start.port,
    Exit=False,
    Data=simplify(group_2),
    Data_2=simplify(multiplication_4),
    pausedState=False,
    state="Constant output",
    TimeOutVal=0)  # -> D0, D1
ungroup_2 = Ungroup(Group=loop_end.D0)
split_2 = SplitList(List=ungroup_2, Index="3")  # -> ListA, ListB
conmesh_2 = ConstructMesh(Vertices=demesh_2.Vertices, Faces=demesh_2.Faces, Colours=loop_end.D1)
interval = Slider(2, range=1..10)
repeat = RepeatData(Data="0", Length=expr("x-1", interval))
item_8 = ListItem(List=split_2.ListA, Index=0, Wrap=True)  # -> Item, Item1, Item2
viewer = ParamViewer(split_2.ListB)  # disabled
pt_5 = Point(simplify(Tree({0;0;0}: [Point(97.23026444, 47.18736088, 0), Point(96.28469784, 47.70753404, 0), Point(95.41822798, 48.33944886, 0), Point(94.63165, 49.06017975, 0), Point(93.92112451, 49.85000906, 0), Point(93.27970611, 50.69260348, 0)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], {1;0;0}: [Point(102.9208052, 48.59891617, 0), Point(101.6910592, 51.14497733, 0), Point(100.9683424, 53.86983016, 0), Point(100.7355789, 56.66985326, 0), Point(100.9403933, 59.46335448, 0), Point(101.5077609, 62.1998654, 0)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], {2;0;0}: [Point(109.1723951, 44.36547091, 0), Point(111.7151123, 43.24581129, 0), Point(113.9625161, 41.6268334, 0), Point(115.8275562, 39.59864468, 0), Point(117.2945606, 37.28372849, 0), Point(118.4145668, 34.79428699, 0)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], {3;0;0}: [Point(101.5460938, 37.88936513, 0), Point(102.5977191, 40.03966742, 0), Point(103.9850057, 41.99242298, 0), Point(105.672013, 43.70023531, 0), Point(107.6284609, 45.10361929, 0), Point(109.8138482, 46.13072701, 0)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], {4;0;0}: [Point(111.4122517, 36.20139809, 0), Point(111.4837779, 35.03524941, 0), Point(111.3681942, 33.87479605, 0), Point(111.0763756, 32.74609339, 0), Point(110.6191687, 31.6721766, 0), Point(110.0068144, 30.67495047, 0)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], {5;0;0}: [Point(112.988691, 52.15460782, 0), Point(111.3457986, 51.97181153, 0), Point(109.7111583, 52.20156842, 0), Point(108.1868268, 52.82590211, 0), Point(106.8672394, 53.80177684, 0), Point(105.8284318, 55.06125869, 0)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], {6;0;0}: [Point(89.47101574, 41.51944567, 0), Point(90.32328517, 40.42167124, 0), Point(91.22157999, 39.36228512, 0), Point(92.14890709, 38.32736106, 0), Point(93.08747849, 37.29930559, 0), Point(94.01778943, 36.25773333, 0)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], {7;0;0}: [Point(97.70682141, 55.38789412, 0), Point(96.38190855, 54.44925129, 0), Point(94.98059808, 53.63654663, 0), Point(93.52305714, 52.93720456, 0), Point(92.02662827, 52.33160627, 0), Point(90.50530688, 51.79428803, 0)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])))
merge_6 = Merge(Data1="1", Data2=repeat)  # -> flatten(Result)
swatch_5 = ColourSwatch(SwatchColor=RGB(0, 0, 0))  # disabled
lng_2 = ListLength(List=viewer)  # disabled
number_slider_8 = Slider(0.596, range=0..3)
item_9 = TreeItem(Tree=pt_5, Path="0", Index=0, Wrap=True)
cull = CullPattern(List=split_2.ListB, CullPattern=merge_6)
repeat_2 = RepeatData(Data=swatch_5, Length=lng_2)  # -> graft(Data); disabled
c_script_4 = CSharpScript(P=item_9, D=pt_5)  # -> out, A; inputs P: Point3d, D: tree of Point3d
# ---------- c_script_4: C# ----------
    DataTree <Double> dist = new DataTree<double>();
    double dt;
    GH_Path p;


    for (int ib = 0; ib < D.BranchCount - 1; ib++){
      for (int i = 0; i < D.Branch(ib).Count; i++){
        for (int jb = ib + 1; jb < D.BranchCount; jb++){
         // System.Threading.Tasks.Parallel.For(0, D.Branch(jb).Count, j => {
            for (int j = 0; j < D.Branch(jb).Count; j++){
            dt = distSq(D.Branch(ib)[i], D.Branch(jb)[j]);
            p = new GH_Path(new int[]{ib,i,jb});
            dist.Add(dt, p);
            }
        }
      }
    }
    A = dist;
# ---------- c_script_4: C# additional code ----------
  double distSq(Point3d a, Point3d b){
    return (Math.Pow((a.X + b.X), 2) + Math.Pow((a.Y + b.Y), 2) + Math.Pow((a.Z + b.Z), 2));
  }
# ---------- end c_script_4 ----------
lng_3 = ListLength(List=split_2.ListB)  # disabled
lng_4 = ListLength(List=c_script_4.A)
pline = PolyLine(Vertices=cull, Closed=False)
merge_7 = Merge(Data1=simplify(repeat_2), Data2=simplify(item_8.Item2))  # disabled
range = Range(Domain=Domain(0, 1), Steps=expr("x-1", lng_3))  # disabled
series = Series(Start=0, Step=1, Count=lng_4)
item_10 = ListItem(Index=0, Wrap=True)
addition_4 = Addition(A=number_slider_8, B=1)
col_2 = Colour(merge_7)  # disabled
expression_2 = Expression(x=range, y=number_slider_8, Expression="1+x*y")  # disabled
int = Integer(series)
smoothpline = SmoothPolyline(Polyline=pline, Strength=1, Times=Slider(8, range=1..30))
cloud = CloudDisplay(Points=item_8.Item, Colours=item_8.Item2, Size=addition_4, SpriteType=0)
interp = InterpolateData(Data=col_2, Parameter=range, Interpolation=2)  # disabled
sort_3 = SortList(Keys=c_script_4.A, ValuesA=int)  # -> Keys, ValuesA
cloud_2 = CloudDisplay(Points=graft(split_2.ListB), Colours=graft(interp), Size=graft(expression_2), SpriteType=0)  # disabled
item_11 = ListItem(List=sort_3.ValuesA, Index=0, Wrap=True)
pshift = ShiftPaths(Data=item_11, Offset=-2)
previewlw = CustomPreviewLineweights(
    Geometry=smoothpline,
    Shader=ColourSwatch(SwatchColor=RGB(113, 162, 189)),
    Thickness=Slider(1, range=1..3),
    Absolute=False)
panel_5 = Panel(pshift)

# ==== cluster Steer
maxf = ClusterInput()
vel = ClusterInput()
maxv = ClusterInput()
des = ClusterInput()
amp = Amplitude(Vector=des, Amplitude=maxv)
subtraction = Subtraction(A=amp, B=vel)
multiplication = Multiplication(A=subtraction, B=maxf)
vlen = VectorLength(Vector=multiplication)
min = Minimum(A=vlen, B=maxv)
amp_2 = Amplitude(Vector=multiplication, Amplitude=min)
acc = ClusterOutput(amp_2)
