# Grasshopper definition 20160401_RADBASED_00.gh (Grasshopper 0.9.76)
# plug-ins: Python Interpreter, Boid

# ----
# Environmental Analysis
# - Sunlight Hours
# - Radiation
# - Real time radiation
# - View/Optimization study
number_slider = Slider(30, range=0..100)
orientationstudypar = Ladybug_OrientationStudyParameters(divisionAngle=number_slider, totalAngle=Slider(180, range=0..1000), runTheStudy=Toggle(True))  # -> orientationStudyPar; plug-in component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

# ---- group: IMPORT WEATHER DATA
path = FilePath("C:\Users\Utente\Desktop\iaac_git\GH_ws_IaaC_2016\WIP\RADBASED\data\ESP_Barcelona.081810_SWEC.epw")
importepw = Ladybug_ImportEpw(epwFile=path)  # -> readMe, latitude, location, dryBulbTemperature, dewPointTemperature, relativeHumidity, windSpeed, windDirection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; plug-in component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

# ----
python = PythonScript(reset=Button())  # -> read_me
# ---------- python: Python ----------
import scriptcontext as sc

if `sc.doc.ModelUnitSystem`!= 'Rhino.UnitSystem.Meters':
    print 'Change the units to METERS!'
else:
    print 'Good to go!'
# ---------- end python ----------
panel = Panel(python)

ladybug = Ladybug_Ladybug()  # -> Vviiiiiiiiiizzz; plug-in component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
cluster = Cluster()

separatebynormal = Honeybee_SeparateByNormal(geometry=cluster)  # -> simplify(lookingUp), simplify(lookingDown), simplify(lookingSide); plug-in component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
brep = Brep(flatten(separatebynormal.lookingDown))
brep_2 = Brep(separatebynormal.lookingSide)
bbox = BoundingBox(Content=brep, Plane=PlaneXY(0, 0, 0), UnionBox=True)  # -> Box, Box_2
area = Area(Geometry=bbox.Box)  # -> Area, Centroid

series = Series(Start=Slider(1, range=0..1), Step=1, Count=Slider(24, range=0..100))

# ---- group: GENERATE SKY
gencumulativeskymtx = Ladybug_GenCumulativeSkyMtx(epwFile=path, skyDensity=0, useOldRes=True, runIt=Toggle(True))  # -> readMe, cumulativeSkyMtx; plug-in component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

# ----
sunpath = Ladybug_SunPath(
    location=importepw.location,
    hour=12,
    day=series,
    month=12,
    timeStep=1,
    centerPt=area.Centroid,
    dailyOrAnnualSunPath=True)  # -> readMe, sunVectors, sunAltitudes, sunAzimuths, port, sunSpheresMesh, sunPathCrvs, legend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; plug-in component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

# ---- group: SKY
selectskymtx = Ladybug_selectSkyMtx(cumulativeSkyMtx=gencumulativeskymtx.cumulativeSkyMtx, removeDiffuse=False, removeDirect=False)  # -> readMe, selectedSkyMtx; plug-in component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

# ---- group: context blds
test_geometries = Brep(cluster)

# ---- group: sunlight hrs
toggle = BooleanToggle(True)
toggle_2 = BooleanToggle(True)
toggle_3 = BooleanToggle(False)

number_slider_2 = Slider(0.01, range=0..0.01)
number_slider_3 = Slider(4, range=0..10)

brep_3 = Brep(cluster)
sunlighthoursanalysis = Ladybug_SunlightHoursAnalysis(
    geometry=flatten(brep_3),
    context=flatten(test_geometries),
    gridSize=number_slider_3,
    disFromBase=number_slider_2,
    sunVectors=flatten(sunpath.sunVectors),
    timeStep=1,
    parallel=toggle,
    runIt=toggle_2,
    bakeIt=toggle_3)  # -> readMe, contextMesh, analysisMesh, testPts, testVec, port, sunlightHoursResult, sunlightHoursMesh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; plug-in component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
mesh = Mesh(sunlighthoursanalysis.sunlightHoursMesh)

# ----
pt = Point(area.Centroid)
pl = PlaneNormal(Origin=pt, ZAxis=Vector(0, 0, 1))
viewrose = Ladybug_viewRose(context=test_geometries, plane=pl, radius=Slider(240, range=0..1000))  # -> readMe, viewRose, blocked, visibleAngle; plug-in component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

# ---- group: radiation analysis
geometry = Brep(brep_3)
brep_4 = Brep(test_geometries)
radiationanalysis = Ladybug_RadiationAnalysis(
    north=0,
    geometry=flatten(geometry),
    context=flatten(brep_4),
    gridSize=Slider(4, range=0..10),
    disFromBase=Slider(0.02, range=0..0.1),
    selectedSkyMtx=flatten(selectskymtx.selectedSkyMtx),
    parallel=Toggle(True),
    runIt=Toggle(True))  # -> readMe, contextMesh, analysisMesh, testPts, testVec, port, radiationResult, radiationMesh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; plug-in component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

# ----
mesh_2 = Mesh(radiationanalysis.radiationMesh)
pt_2 = ConstructPoint(XCoordinate=0, YCoordinate=0, ZCoordinate=0)
Z = UnitZ(Factor=1)
contour = Contour(Shape=mesh_2, Point=pt_2, Direction=Vector(0, 0, 1), Distance=Z)  # -> flatten(Contours)
curvepoint = PointOnCurve(contour, parameter=0.5)
pdecon = Deconstruct(Point=curvepoint)  # -> XComponent, YComponent, ZComponent
lng = ListLength(List=geometry)
sort = SortList(Keys=pdecon.ZComponent, ValuesA=contour)  # -> Keys, ValuesA
split = SplitList(List=sort.ValuesA, Index=lng)  # -> ListA, ListB
crv = Curve(split.ListA)
bbox_2 = BoundingBox(Content=crv, Plane=PlaneXY(0, 0, 0), UnionBox=True)  # -> Box, Box_2
pop2d = Populate2D(Region=bbox_2.Box, Count=Slider(290, range=0..1000), Seed=1)
divlength = DivideLength(Curve=crv, Length=Slider(2, range=0..10))  # -> Points, Tangents, Parameters
incurves = PointInCurves(Point=pop2d, Curves=crv)  # -> Relationship, Index, Point
hull = ConvexHull(Points=flatten(divlength.Points), Plane=PlaneXY(0, 0, 0))  # -> Hull, HullZ, Indices
cull = CullPattern(List=pop2d, CullPattern=invert(incurves.Relationship))
mesh_3 = Mesh(hull.Hull)
popgeo = PopulateGeometry(Geometry=mesh_3, Count=100, Seed=1)
repulse = RepulseFromTheFlock(
    AgentLocationPoint=cull,
    LocationPointsOfTheFlock=flatten(divlength.Points),
    SearchDistance=Slider(18, range=0..40),
    Multiplier=0.1)
vdis = VectorDisplay(Anchor=cull, Vector=repulse)

# ==== cluster Cluster
crv = Curve([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])
pt = Point(Point(0, 0, 0))
panel = Panel("ambient")
rectangle = Rectangle(Plane=pt, XSize=Slider(280, range=100..400), YSize=Slider(161, range=100..400), Radius=0)  # -> Rectangle, Length
mplane = MeshPlane(Boundary=rectangle.Rectangle, WidthCount=Slider(40, range=10..50), HeightCount=Slider(35, range=10..50))  # -> Mesh, Area
demesh = DeconstructMesh(Mesh=mplane.Mesh)  # -> Vertices, Faces, Colours, Normals
crv_2 = Curve(crv)
mesh = Mesh(mplane.Mesh)
crv_cp = CurveClosestPoint(Point=simplify(graft(demesh.Vertices)), Curve=crv)  # -> Point, Parameter, Distance
explode = MeshExplode(Mesh=mesh, Interpolate=False)
sort = SortList(Keys=crv_cp.Distance)  # -> Keys, ValuesA
demesh_2 = DeconstructMesh(Mesh=explode)  # -> Vertices, Faces, Colours, Normals
item = ListItem(List=sort.Keys, Index=0, Wrap=True)
avr = Average(Input=demesh_2.Vertices)  # -> flatten(ArithmeticMean)
num = Number(flatten(item))
crv_cp_2 = CurveClosestPoint(Point=avr, Curve=simplify(graft(crv_2)))  # -> simplify(Point), Parameter, simplify(Distance)
bnd = Bounds(Numbers=num)
dedomain = DeconstructDomain(Domain=bnd)  # -> Start, End
flip = FlipMatrix(Data=crv_cp_2.Distance)
flip_2 = FlipMatrix(Data=crv_cp_2.Point)
# dai una funzione non lineare con graph mapper
gradient = Gradient(
    LowerLimit="0",
    UpperLimit=dedomain.End,
    Parameter=num,
    stops=[0: RGB(191, 8, 237), 0: RGB(255, 255, 255), 0.0974: RGB(128, 128, 128), 0.394: RGB(0, 0, 0)])
sort_2 = SortList(Keys=flip, ValuesA=flip_2)  # -> Keys, ValuesA
item_2 = ListItem(List=sort_2.Keys, Index=0, Wrap=True)
smaller = SmallerThan(FirstNumber=item_2, SecondNumber=Slider(16.52, range=0..50))  # -> SmallerThan, OrEqualTo
graft = GraftTree(Tree=explode, IncludeEmptyLists=True, IncludeNullItems=True)
conmesh = ConstructMesh(Vertices=demesh.Vertices, Faces=demesh.Faces, Colours=gradient)
cull = CullPattern(List=graft, CullPattern=invert(smaller.SmallerThan))
mjoin = MeshJoin(Meshes=flatten(cull))
wbnaked = WeaverbirdsNakedBoundary(MeshClosedPolylines=mjoin)
mblur = BlurMesh(Mesh=conmesh, Iterations=Slider(2, range=0..10))
smoothpline = SmoothPolyline(Polyline=wbnaked, Strength=Slider(1.08, range=0..3), Times=Slider(1, range=0..10))
explode_2 = Explode(Curve=wbnaked, Recursive=True)  # -> Segments, Vertices
redpline = Reduce(Polyline=smoothpline, Tolerance=Slider(0.113, range=0..2))  # -> Polyline, Reduction
hull = ConvexHull(Points=explode_2.Vertices, Plane=PlaneXY(0, 0, 0))  # -> flatten(Hull), HullZ, Indices
boundary = BoundarySurfaces(Edges=smoothpline)
fillet = Fillet(Curve=redpline.Polyline, Radius=Slider(0.6, range=0..1))
lng = ListLength(List=wbnaked)
series = Series(Start=Slider(20, range=0..100), Step=Slider(10, range=0..10), Count=lng)
jitter = Jitter(List=series, Jitter=1, Seed=2)  # -> Values, Indices
Z = UnitZ(Factor=jitter.Values)
extr = Extrude(Base=hull.Hull, Direction=Z)
cap = CapHoles(Brep=extr)
B = ClusterOutput(cap)
