# Grasshopper definition 20160405_RADBASED_02.gh (Grasshopper 0.9.76)
# plug-ins: Python Interpreter, Anemone, Boid, Noise 4D

# ----
# Environmental Analysis
# - Sunlight Hours
# - Radiation
# - Real time radiation
# - View/Optimization study
number_slider = Slider(30, range=0..100)
orientationstudypar = Ladybug_OrientationStudyParameters(divisionAngle=number_slider, totalAngle=Slider(180, range=0..1000), runTheStudy=Toggle(True))  # -> orientationStudyPar; plug-in component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

python = PythonScript(reset=Button())  # -> read_me
# ---------- python: Python ----------
import scriptcontext as sc

if `sc.doc.ModelUnitSystem`!= 'Rhino.UnitSystem.Meters':
    print 'Change the units to METERS!'
else:
    print 'Good to go!'
# ---------- end python ----------
panel = Panel(python)

# ---- group: IMPORT WEATHER DATA
path = FilePath("C:\Users\Utente\Desktop\iaac_git\GH_ws_IaaC_2016\WIP\RADBASED\data\ESP_Barcelona.081810_SWEC.epw")
importepw = Ladybug_ImportEpw(epwFile=path)  # -> readMe, latitude, location, dryBulbTemperature, dewPointTemperature, relativeHumidity, windSpeed, windDirection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; plug-in component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

# ----
ladybug = Ladybug_Ladybug()  # -> Vviiiiiiiiiizzz; plug-in component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
cluster = Cluster()

separatebynormal = Honeybee_SeparateByNormal(geometry=cluster)  # -> simplify(lookingUp), simplify(lookingDown), simplify(lookingSide); plug-in component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
brep = Brep(flatten(separatebynormal.lookingDown))
brep_2 = Brep(separatebynormal.lookingSide)
bbox = BoundingBox(Content=brep, Plane=PlaneXY(0, 0, 0), UnionBox=True)  # -> Box, Box_2
area = Area(Geometry=bbox.Box)  # -> Area, Centroid

wires = BrepWireframe(Brep=cluster, Density=-1)
bbox_2 = BoundingBox(Content=cluster, Plane=PlaneXY(0, 0, 0), UnionBox=True)  # -> Box, Box_2
brep_3 = Brep(flatten(separatebynormal.lookingUp))

series = Series(Start=Slider(1, range=0..1), Step=1, Count=Slider(24, range=0..100))

debrep = DeconstructBrep(Brep=bbox_2.Box)  # -> Faces, Edges, Vertices

# ---- group: GENERATE SKY
gencumulativeskymtx = Ladybug_GenCumulativeSkyMtx(epwFile=path, skyDensity=0, useOldRes=True, runIt=Toggle(True))  # -> readMe, cumulativeSkyMtx; plug-in component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

# ----
item = ListItem(List=debrep.Faces, Index=Slider(10, range=0..10), Wrap=True)
sunpath = Ladybug_SunPath(
    location=importepw.location,
    hour=12,
    day=series,
    month=12,
    timeStep=1,
    centerPt=area.Centroid,
    dailyOrAnnualSunPath=True)  # -> readMe, sunVectors, sunAltitudes, sunAzimuths, port, sunSpheresMesh, sunPathCrvs, legend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; plug-in component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
flip = Flip(Surface=item)  # -> Surface, Result

# ---- group: SKY
selectskymtx = Ladybug_selectSkyMtx(cumulativeSkyMtx=gencumulativeskymtx.cumulativeSkyMtx, removeDiffuse=False, removeDirect=False)  # -> readMe, selectedSkyMtx; plug-in component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

# ---- group: context blds
test_geometries = Brep(cluster)

# ----
join = BrepJoin(Breps=flatten([brep_3, brep_2]))  # -> Breps, Closed

# ---- group: sunlight hrs
toggle = BooleanToggle(True)
toggle_2 = BooleanToggle(True)
toggle_3 = BooleanToggle(False)

number_slider_2 = Slider(0.01, range=0..0.01)
number_slider_3 = Slider(4, range=0..10)

brep_4 = Brep(cluster)
sunlighthoursanalysis = Ladybug_SunlightHoursAnalysis(
    geometry=flatten(brep_4),
    context=flatten(test_geometries),
    gridSize=number_slider_3,
    disFromBase=number_slider_2,
    sunVectors=flatten(sunpath.sunVectors),
    timeStep=1,
    parallel=toggle,
    runIt=toggle_2,
    bakeIt=toggle_3)  # -> readMe, contextMesh, analysisMesh, testPts, testVec, port, sunlightHoursResult, sunlightHoursMesh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; plug-in component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
mesh = Mesh(sunlighthoursanalysis.sunlightHoursMesh)

# ----
pt = Point(area.Centroid)
pl = PlaneNormal(Origin=pt, ZAxis=Vector(0, 0, 1))
viewrose = Ladybug_viewRose(context=test_geometries, plane=pl, radius=Slider(240, range=0..1000))  # -> readMe, viewRose, blocked, visibleAngle; plug-in component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

# ---- group: radiation analysis
geometry = Brep(join.Breps)
brep_5 = Brep(flip.Surface)
radiationanalysis = Ladybug_RadiationAnalysis(
    north=0,
    geometry=flatten(geometry),
    context=flatten(brep_5),
    gridSize=Slider(4, range=0..10),
    disFromBase=Slider(0.02, range=0..0.1),
    selectedSkyMtx=flatten(selectskymtx.selectedSkyMtx),
    parallel=Toggle(True),
    runIt=Toggle(True))  # -> readMe, contextMesh, analysisMesh, testPts, testVec, port, radiationResult, radiationMesh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; plug-in component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

# ----
geometry_2 = Brep(flip.Surface)
brep_6 = Brep(cluster)
radiationanalysis_2 = Ladybug_RadiationAnalysis(
    north=0,
    geometry=flatten(geometry_2),
    context=flatten(brep_6),
    gridSize=Slider(4, range=0..10),
    disFromBase=Slider(0.02, range=0..0.1),
    selectedSkyMtx=flatten(selectskymtx.selectedSkyMtx),
    parallel=Toggle(True),
    runIt=Toggle(True))  # -> readMe, contextMesh, analysisMesh, testPts, testVec, port, radiationResult, radiationMesh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; plug-in component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

mesh_2 = Mesh(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)
disjoint = DisjointMesh(Mesh=mesh_2)
pt_2 = ConstructPoint(XCoordinate=0, YCoordinate=0, ZCoordinate=0)
Z = UnitZ(Factor=1)
contour = Contour(Shape=mesh_2, Point=pt_2, Direction=Vector(0, 0, 1), Distance=Z)  # -> flatten(Contours)
curvepoint = PointOnCurve(contour, parameter=0.5)
pdecon = Deconstruct(Point=curvepoint)  # -> XComponent, YComponent, ZComponent
lng = ListLength(List=disjoint)
sort = SortList(Keys=pdecon.ZComponent, ValuesA=contour)  # -> Keys, ValuesA
split = SplitList(List=sort.ValuesA, Index=lng)  # -> ListA, ListB
crv = Curve(split.ListA)

data = Data(Tree({0}: [1448.34026, 1448.34026, 1448.34026, 1449.133873, 1448.138388, 1448.138388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], {1}: [990.6973652, 990.6973652, 990.6973652, 990.6973652, 990.6973652, 990.6973652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], {2}: [488.0430142, 538.3650246, 537.0680934, 545.3152888, 582.3004123, 582.3004123, 538.3650246, 582.3004123, 617.4158243, 617.4158243, 617.4158243, 623.7069986, 632.6951852, 632.6951852, 623.7069986], {3}: [81.45699296, 81.45698349, 81.45719286, 69.33047081, 66.10549063, 66.10549063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], {4}: [91.92714067, 94.46608879, 96.90230926, 113.4379383, 113.4379383, 119.2898933, 122.3490647, 125.7187844, 129.0602416, 143.9081623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], {5}: [155.4384639, 160.9518565, 156.4482774, 159.6182849, 166.4995367, 181.0413093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]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))
mesh_3 = Mesh(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)
mesh_4 = Mesh(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)
data_2 = Data(Tree({0}: [990.6973652, 990.6973652, 990.6973652, 990.6973652, 990.6973652, 990.6973652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], {1}: [488.0430142, 537.0680934, 538.3650246, 538.3650246, 545.3152888, 582.3004123, 582.3004123, 582.3004123, 617.4158243, 617.4158243, 617.4158243, 623.7069986, 623.7069986, 632.6951852, 632.6951852], {2}: [96.71468855, 81.45699296, 81.45698349, 81.45719286, 69.33047081, 66.10549063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], {3}: [91.92714348, 91.92714067, 95.92733768, 91.92714348, 94.46608879, 98.46628528, 94.46609108, 96.90230926, 100.9025013, 113.4379508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], {4}: [144.6478875, 155.4384639, 160.9518565, 156.4482774, 159.6182849, 166.4995367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], {5}: [318.8448338, 318.845092, 318.8448338, 318.845092, 318.8448338, 318.845092, 335.6125809, 335.612822, 335.6128756, 335.6128756, 335.6125245, 335.6125245, 335.6125809, 335.612822, 335.6125809, 335.612822, 335.6125809, 335.612822, 335.6125809, 335.612822, 336.6537812, 338.92287, 338.9226389, 338.92287, 338.9226389, 338.92287, 338.9226389, 338.92287, 338.9226389, 338.92287]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))

mesh_5 = Mesh(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)
demesh = DeconstructMesh(Mesh=mesh_5)  # -> Vertices, Faces, Colours, Normals
argb = SplitARGB(Colour=demesh.Colours)  # -> Alpha, Red, Green, Blue
bnd = Bounds(Numbers=argb.Red)
dedomain = DeconstructDomain(Domain=bnd)  # -> Start, End
gradient = Gradient(
    LowerLimit=dedomain.Start,
    UpperLimit=dedomain.End,
    Parameter=argb.Red,
    stops=[0.306: RGB(0, 0, 0), 0.763: RGB(255, 255, 255)])
conmesh = ConstructMesh(Vertices=demesh.Vertices, Faces=demesh.Faces, Colours=gradient)

avr = Average(Input=flatten(data))
demesh_2 = DeconstructMesh(Mesh=mesh_3)  # -> Vertices, simplify(Faces), Colours, Normals
larger = LargerThan(FirstNumber=flatten(data), SecondNumber=Slider(906, range=0..1000))  # -> LargerThan, OrEqualTo
cull = CullPattern(List=flatten(demesh_2.Faces), CullPattern=larger.LargerThan)
conmesh_2 = ConstructMesh(Vertices=demesh_2.Vertices, Faces=cull, Colours=demesh_2.Colours)

facen = FaceNormals(Mesh=mesh_3)  # -> Centers, Normals
disjoint_2 = DisjointMesh(Mesh=conmesh_2)
facen_2 = FaceNormals(Mesh=disjoint_2)  # -> Centers, Normals
avr_2 = Average(Input=facen_2.Centers)
crv_2 = Curve(<curve referenced from the Rhino model>)
pop2d = Populate2D(Region=crv_2, Count=Slider(9, range=0..100), Seed=1)  # -> graft(Population)
popgeo = PopulateGeometry(Count=100, Seed=1)

lng_2 = ListLength(List=pop2d)
rndvec = RandomVector(Number=lng_2, Unit=False, RandomSeed=2, AbsoluteMultiplier=1)
devec = DeconstructVector(Vector=rndvec)  # -> XComponent, YComponent, ZComponent
vec = VectorXYZ(XComponent=devec.XComponent, YComponent=devec.YComponent, ZComponent=0)  # -> unitize(graft(Vector)), Length

number_slider_4 = Slider(500, range=0..1000)
loop_start = LoopStart(N=Slider(48, range=0..100), D0=simplify(pop2d), D1=simplify(vec.Vector))  # -> port, Counter, Data, Data_2

item_2 = ListItem(List=loop_start.Data, Index="-1", Wrap=True)

closest_mesh_vertex = Slider(1, range=0..40)
pt_3 = Point(flatten(item_2))
pt_4 = Point(facen_2.Centers)
cps = ClosestPoints(Point=pt_3, Cloud=flatten(pt_4), Count=closest_mesh_vertex)  # -> simplify(ClosestPoint), CPIndex, Distance

noise_scale = Slider(0.016, range=0..0.05)
max_angle = Slider(27.25, range=0..90)
perlin = PerlinNoise(Values=item_2, Time=0, Scale=noise_scale)
multiplication = Multiplication(A=perlin, B=max_angle)
Z_2 = UnitZ(Factor=1)
vrot = Rotate(Vector=loop_start.Data_2, Axis=Z_2, Angle=degrees(multiplication))  # -> simplify(Vector)

Y = UnitY(Factor=Slider(2, range=0..10))
lng_3 = ListLength(List=loop_start.Data_2)
repeat = RepeatData(Data=Y, Length=lng_3)  # -> simplify(Data)

adhere = AhereToTheFlockCenter(
    AgentLocationPoint=flatten(item_2),
    LocationPointsOfTheFlock=flatten(item_2),
    SearchDistance=Slider(20, range=0.2..20),
    ReferenceAgentsCount="20",
    Multiplier=Slider(0.3, range=0..1))  # -> simplify(graft(VectorToTheCenterOfTheFlock))

pt_5 = Point(pt_3)
vec2pt = Vector2Pt(PointA=simplify(graft(pt_5)), PointB=cps.ClosestPoint, Unitize="true")  # -> flatten(Vector), Length
amp = Amplitude(Vector=vec2pt.Vector, Amplitude=Slider(1, range=0..1))  # -> graft(Vector)

repulse = RepulseFromTheFlock(
    AgentLocationPoint=item_2,
    LocationPointsOfTheFlock=flatten(facen.Centers),
    SearchDistance=Slider(3, range=0..40),
    Multiplier=Slider(0.976, range=0..2))

align = AlignToTheFlockMembers(AgentMotionVector=item_2, FlockMotionVectors=item_2, Multiplier=Slider(0.005, range=0..0.01))
wander = RandomWander(AgentMotionVectors=loop_start.Data_2, AngleSpreadDomain=Domain(0, 3.141592654), RandomSeed=2, AbsoluteMultiplier=1)

crv_3 = Curve(<curve referenced from the Rhino model>)
slide = SlideOverGeometry(
    AgentLocationPoint=item_2,
    AgentMotionVector=loop_start.Data_2,
    ReferenceGeometry=crv_3,
    SearchDistance=Domain(0, 0),
    Multiplier=Slider(0.5, range=0..1))

addition = Addition(A=wander, B=repulse, C=repeat, D=adhere)  # -> simplify(Result)
move = Move(Geometry=item_2, Motion=addition)  # -> Geometry, Transform
tlist = TailList(L=loop_start.Data, it=move.Geometry, len=Slider(15, range=0..100))  # -> out, A; inputs L: list, len: Int32
# ---------- tlist: C# ----------
    Component.Name = "Tail List";
    Component.NickName = "TList";
    Component.Description = "Tail list - L list, it item to add, len tail length";

    if (L.Count() > len) {
      L.RemoveAt(0);
    }
    L.Add(it);
    A = L;
# ---------- end tlist ----------
loop_end = LoopEnd(
    port=loop_start.port,
    Exit=False,
    Data=simplify(tlist.A),
    Data_2=simplify(addition),
    pausedState=False,
    state="Constant output",
    TimeOutVal=0)  # -> D0, D1
lng_4 = ListLength(List=loop_end.D0)
max_point_size = Slider(0.25, range=0..5)
range = Range(Domain=Domain(0, 1), Steps=expr("x-1", lng_4))
gradient_2 = Gradient(LowerLimit=0, UpperLimit=1, Parameter=range, stops=[0.178: RGB(255, 130, 160), 0.826: RGB(220, 0, 40)])
multiplication_2 = Multiplication(A=range, B=max_point_size)
addition_2 = Addition(A=multiplication_2, B=1)
cloud = CloudDisplay(Points=graft(loop_end.D0), Colours=graft(gradient_2), Size=graft(addition_2), SpriteType=0)

bbox_3 = BoundingBox(Content=mesh_2, Plane=PlaneXY(0, 0, 0), UnionBox=True)  # -> Box, Box_2

pop3d = Populate3D(Region=bbox_3.Box, Count=Slider(290, range=0..1000), Seed=Slider(2, range=0..10))

incurves = PointInCurves(Point=pop3d, Curves=crv)  # -> Relationship, Index, Point
cull_2 = CullPattern(List=pop3d, CullPattern=invert(incurves.Relationship))  # -> graft(List)

# ==== cluster Cluster
crv = Curve([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])
pt = Point(Point(0, 0, 0))
panel = Panel("ambient")
rectangle = Rectangle(Plane=pt, XSize=Slider(280, range=100..400), YSize=Slider(161, range=100..400), Radius=0)  # -> Rectangle, Length
mplane = MeshPlane(Boundary=rectangle.Rectangle, WidthCount=Slider(40, range=10..50), HeightCount=Slider(35, range=10..50))  # -> Mesh, Area
demesh = DeconstructMesh(Mesh=mplane.Mesh)  # -> Vertices, Faces, Colours, Normals
crv_2 = Curve(crv)
mesh = Mesh(mplane.Mesh)
crv_cp = CurveClosestPoint(Point=simplify(graft(demesh.Vertices)), Curve=crv)  # -> Point, Parameter, Distance
explode = MeshExplode(Mesh=mesh, Interpolate=False)
sort = SortList(Keys=crv_cp.Distance)  # -> Keys, ValuesA
demesh_2 = DeconstructMesh(Mesh=explode)  # -> Vertices, Faces, Colours, Normals
item = ListItem(List=sort.Keys, Index=0, Wrap=True)
avr = Average(Input=demesh_2.Vertices)  # -> flatten(ArithmeticMean)
num = Number(flatten(item))
crv_cp_2 = CurveClosestPoint(Point=avr, Curve=simplify(graft(crv_2)))  # -> simplify(Point), Parameter, simplify(Distance)
bnd = Bounds(Numbers=num)
dedomain = DeconstructDomain(Domain=bnd)  # -> Start, End
flip = FlipMatrix(Data=crv_cp_2.Distance)
flip_2 = FlipMatrix(Data=crv_cp_2.Point)
# dai una funzione non lineare con graph mapper
gradient = Gradient(
    LowerLimit="0",
    UpperLimit=dedomain.End,
    Parameter=num,
    stops=[0: RGB(191, 8, 237), 0: RGB(255, 255, 255), 0.0974: RGB(128, 128, 128), 0.394: RGB(0, 0, 0)])
sort_2 = SortList(Keys=flip, ValuesA=flip_2)  # -> Keys, ValuesA
item_2 = ListItem(List=sort_2.Keys, Index=0, Wrap=True)
smaller = SmallerThan(FirstNumber=item_2, SecondNumber=Slider(16.52, range=0..50))  # -> SmallerThan, OrEqualTo
graft = GraftTree(Tree=explode, IncludeEmptyLists=True, IncludeNullItems=True)
conmesh = ConstructMesh(Vertices=demesh.Vertices, Faces=demesh.Faces, Colours=gradient)
cull = CullPattern(List=graft, CullPattern=invert(smaller.SmallerThan))
mjoin = MeshJoin(Meshes=flatten(cull))
wbnaked = WeaverbirdsNakedBoundary(MeshClosedPolylines=mjoin)
mblur = BlurMesh(Mesh=conmesh, Iterations=Slider(2, range=0..10))
smoothpline = SmoothPolyline(Polyline=wbnaked, Strength=Slider(1.08, range=0..3), Times=Slider(1, range=0..10))
explode_2 = Explode(Curve=wbnaked, Recursive=True)  # -> Segments, Vertices
redpline = Reduce(Polyline=smoothpline, Tolerance=Slider(0.113, range=0..2))  # -> Polyline, Reduction
hull = ConvexHull(Points=explode_2.Vertices, Plane=PlaneXY(0, 0, 0))  # -> flatten(Hull), HullZ, Indices
boundary = BoundarySurfaces(Edges=smoothpline)
fillet = Fillet(Curve=redpline.Polyline, Radius=Slider(0.6, range=0..1))
lng = ListLength(List=wbnaked)
series = Series(Start=Slider(20, range=0..100), Step=Slider(10, range=0..10), Count=lng)
jitter = Jitter(List=series, Jitter=1, Seed=2)  # -> Values, Indices
Z = UnitZ(Factor=jitter.Values)
extr = Extrude(Base=hull.Hull, Direction=Z)
cap = CapHoles(Brep=extr)
B = ClusterOutput(cap)
