# Grasshopper definition 20160406_follow color.gh (Grasshopper 0.9.76)
# plug-ins: Anemone, Kangaroo Components, Boid, HDTReference, Noise 4D

crv = Curve(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)
boundary = BoundarySurfaces(Edges=crv)
mesh_uv = MeshSurface(Surface=boundary, UCount=Slider(72, range=0..100), VCount=Slider(16, range=0..100), Overhang=True, Equalize=False)

crv_2 = Curve(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)
boundary_2 = BoundarySurfaces(Edges=crv_2)
mesh_uv_2 = MeshSurface(Surface=boundary_2, UCount=Slider(72, range=0..100), VCount=Slider(16, range=0..100), Overhang=True, Equalize=False)
demesh = DeconstructMesh(Mesh=mesh_uv_2)  # -> Vertices, Faces, Colours, Normals
perlin = PerlinNoise(Values=demesh.Vertices, Time=Slider(14.47, range=0..21), Scale=Slider(0.0454, range=0.001..0.1))
gradient = Gradient(LowerLimit="-1", UpperLimit=1, Parameter=perlin, stops=[0: RGB(255, 255, 255), 0.735: RGB(0, 0, 0)])
conmesh = ConstructMesh(Vertices=demesh.Vertices, Faces=demesh.Faces, Colours=gradient)

demesh_2 = DeconstructMesh(Mesh=mesh_uv)  # -> Vertices, Faces, Colours, Normals
perlin_2 = PerlinNoise(Values=demesh_2.Vertices, Time=Slider(14.47, range=0..21), Scale=Slider(0.0454, range=0.001..0.1))
gradient_2 = Gradient(LowerLimit="-1", UpperLimit=1, Parameter=perlin_2, stops=[0: RGB(255, 255, 255), 0.735: RGB(0, 0, 0)])

number_slider = Slider(0.2, range=0..1)
popgeo = PopulateGeometry(Geometry=mesh_uv_2, Count=Slider(23, range=0..100), Seed=1)
vec = VectorXYZ(XComponent=number_slider, YComponent=number_slider, ZComponent=0)  # -> Vector, Length
lng = ListLength(List=popgeo)
vec_2 = Vector(vec.Vector)
repeat = RepeatData(Data=vec_2, Length=lng)

start = Curve(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)
start_2 = Curve(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)
popgeo_2 = PopulateGeometry(Geometry=start, Count=Slider(23, range=0..100), Seed=1)
popgeo_3 = PopulateGeometry(Geometry=start_2, Count=Slider(23, range=0..100), Seed=1)
conmesh_2 = ConstructMesh(Vertices=demesh_2.Vertices, Faces=demesh_2.Faces, Colours=gradient_2)
popgeo_4 = PopulateGeometry(Geometry=conmesh_2, Count=Slider(23, range=0..100), Seed=1)
loop_start = LoopStart(N=Slider(500, range=0..500), D0=popgeo_4)  # -> port, Counter, Data, Data_2
demesh_3 = DeconstructMesh(Mesh=conmesh_2)  # -> Vertices, Faces, Colours, Normals
pt = Point()
pt_2 = Point(Tree({0}: [Point(68.51588095, 61.71596993, 0), Point(69.35072827, 61.87575088, 0), Point(68.51588095, 61.71596993, 0), Point(69.35072827, 61.87575088, 0), Point(70.17518492, 61.66893879, 0), Point(68.51588095, 61.71596993, 0)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], {1}: [Point(277.3785592, 38.89800057, 0), Point(277.5735911, 39.7253231, 0), Point(277.3785592, 38.89800057, 0), Point(277.5735911, 39.7253231, 0), Point(277.768623, 40.55264563, 0), Point(277.3785592, 38.89800057, 0)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], {2}: [Point(167.4603064, 17.7306909, 0), Point(168.307801, 17.79590521, 0), Point(167.4603064, 17.7306909, 0), Point(168.307801, 17.79590521, 0), Point(169.1209735, 17.54841692, 0), Point(167.4603064, 17.7306909, 0)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], {3}: [Point(20.77691976, 9.142710596, 0), Point(20.8783898, 9.986632293, 0), Point(20.77691976, 9.142710596, 0), Point(20.8783898, 9.986632293, 0), Point(20.45349494, 10.72281458, 0), Point(20.77691976, 9.142710596, 0)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], {4}: [Point(92.41525592, 3.031859868, 0), Point(92.47189131, 3.879970965, 0), Point(92.41525592, 3.031859868, 0), Point(92.47189131, 3.879970965, 0), Point(92.30222248, 4.71286501, 0), Point(92.41525592, 3.031859868, 0)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], {5}: [Point(210.2312897, 67.87495523, 0), Point(211.0480709, 68.11026013, 0), Point(210.2312897, 67.87495523, 0), Point(211.0480709, 68.11026013, 0), Point(211.8895012, 68.23065583, 0), Point(210.2312897, 67.87495523, 0)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]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))
pt_3 = Point(Tree({0}: [Point(68.51588095, 61.71596993, 0), Point(69.35072827, 61.87575088, 0), Point(68.51588095, 61.71596993, 0), Point(69.35072827, 61.87575088, 0), Point(70.17518492, 61.66893879, 0), Point(68.51588095, 61.71596993, 0)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], {1}: [Point(277.3785592, 38.89800057, 0), Point(277.5735911, 39.7253231, 0), Point(277.3785592, 38.89800057, 0), Point(277.5735911, 39.7253231, 0), Point(277.768623, 40.55264563, 0), Point(277.3785592, 38.89800057, 0)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], {2}: [Point(167.4603064, 17.7306909, 0), Point(168.307801, 17.79590521, 0), Point(167.4603064, 17.7306909, 0), Point(168.307801, 17.79590521, 0), Point(169.1553221, 17.86077466, 0), Point(167.4603064, 17.7306909, 0)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], {3}: [Point(20.77691976, 9.142710596, 0), Point(20.8783898, 9.986632293, 0), Point(20.77691976, 9.142710596, 0), Point(20.8783898, 9.986632293, 0), Point(20.45349494, 10.72281458, 0), Point(20.77691976, 9.142710596, 0)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], {4}: [Point(92.41525592, 3.031859868, 0), Point(92.47189131, 3.879970965, 0), Point(92.41525592, 3.031859868, 0), Point(92.47189131, 3.879970965, 0), Point(92.30222248, 4.71286501, 0), Point(92.41525592, 3.031859868, 0)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], {5}: [Point(210.2312897, 67.87495523, 0), Point(211.0480709, 68.11026013, 0), Point(210.2312897, 67.87495523, 0), Point(211.0480709, 68.11026013, 0), Point(211.8895012, 68.23065583, 0), Point(210.2312897, 67.87495523, 0)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]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))
cluster = Cluster(L=demesh_3.Vertices)

loop_start_2 = LoopStart(N=Slider(154, range=0..500), D0=simplify(graft(popgeo)), D1=simplify(graft(repeat)))  # -> port, Counter, Data, Data_2

visible = FindVisibleAgents(
    AgentLocationPoint=loop_start.Data,
    AgentMotionVector=flatten(loop_start.Data_2),
    LocationPointsOfTheFlock=demesh_3.Vertices,
    FlockMotionVectors=cluster,
    SearchDistance=Slider(20, range=20..50),
    SearchAngle=Slider(0.73, range=0..1))  # -> simplify(ListOfPoints), ListOfVectors, simplify(ListOfIndices)
panel = Panel(loop_start_2.Counter)
item = ListItem(List=loop_start_2.Data, Index=0, Wrap=True)  # -> Item1, Item
pt_4 = Point(flatten(item.Item1))
preview = CustomPreview(Geometry=visible.ListOfPoints, Shader=ColourSwatch(SwatchColor=RGB(25, 47, 66)))
X = UnitX(Factor=1)
lng_2 = ListLength(List=loop_start.Data)

demesh_4 = DeconstructMesh(Mesh=conmesh)  # -> Vertices, Faces, Colours, Normals
cluster_2 = Cluster(L=demesh_4.Vertices)
visible_2 = FindVisibleAgents(
    AgentLocationPoint=pt_4,
    AgentMotionVector=flatten(loop_start_2.Data_2),
    LocationPointsOfTheFlock=demesh_4.Vertices,
    FlockMotionVectors=cluster_2,
    SearchDistance=Slider(20, range=20..50),
    SearchAngle=Slider(0.71, range=0..1))  # -> simplify(ListOfPoints), ListOfVectors, simplify(ListOfIndices)
cluster_3 = Cluster_3(pt=pt_4, int=visible_2.ListOfIndices, M=conmesh, num_2=Slider(0.85, range=0..1), num=Slider(1, range=0..1))

repeat_2 = RepeatData(Data=X, Length=lng_2)
amp = Amplitude(Vector=repeat_2, Amplitude=Slider(0, range=0..2))  # -> graft(Vector)
cluster_4 = Cluster_3(pt=loop_start.Data, int=visible.ListOfIndices, M=conmesh_2, num_2=Slider(0.85, range=0..1), num=Slider(1, range=0..1))
repulse = RepulseFromTheFlock(
    AgentLocationPoint=loop_start.Data,
    LocationPointsOfTheFlock=loop_start.Data,
    SearchDistance=Slider(2.05, range=0..10),
    Multiplier=Slider(0, range=0..1))  # -> graft(VectorAwayFromTheClosestAgent)

repulse_2 = RepulseFromTheFlock(
    AgentLocationPoint=pt_4,
    LocationPointsOfTheFlock=pt_4,
    SearchDistance=Slider(2.05, range=0..10),
    Multiplier=Slider(0, range=0..1))  # -> graft(VectorAwayFromTheClosestAgent)

addition = Addition(A=amp, B=cluster_4, C=repulse)
X_2 = UnitX(Factor=1)
lng_3 = ListLength(List=pt_4)
move = Move(Geometry=loop_start.Data, Motion=flatten(addition))  # -> Geometry, Transform
repeat_3 = RepeatData(Data=X_2, Length=lng_3)
tlist = TailList(len=Slider(15, range=0..100))  # -> out, A; inputs L: list, len: Int32
# ---------- tlist: C# ----------
    Component.Name = "Tail List";
    Component.NickName = "TList";
    Component.Description = "Tail list - L list, it item to add, len tail length";

    if (L.Count() > len) {
      L.RemoveAt(0);
    }
    L.Add(it);
    A = L;
# ---------- end tlist ----------
amp_2 = Amplitude(Vector=repeat_3, Amplitude=Slider(0, range=0..2))  # -> graft(Vector)
pt_5 = Point(loop_start_2.Data)
loop_end = LoopEnd(
    port=loop_start.port,
    Exit=Toggle(False),
    Data=move.Geometry,
    Data_2=addition,
    pausedState=False,
    state="Constant output",
    TimeOutVal=0)  # -> graft(D0), D1; disabled
addition_2 = Addition(B=cluster_3, C=repulse_2)

lng_4 = ListLength(List=flatten(pt_5))
pt_6 = Point(flatten(pt_4))
vec_3 = Vector(Vector(0, 0, 0))
repeat_4 = RepeatData(Data=vec_3, Length=lng_4)
visible_3 = FindVisibleAgents(
    AgentLocationPoint=pt_6,
    AgentMotionVector=flatten(loop_start_2.Data_2),
    LocationPointsOfTheFlock=flatten(pt_5),
    FlockMotionVectors=repeat_4,
    SearchDistance=Slider(27, range=0..100),
    SearchAngle=Slider(0.73, range=0..1))  # -> ListOfPoints, ListOfVectors, ListOfIndices
cluster_5 = Cluster_2(
    agent_location=pt_6,
    agent_vector_global=flatten(addition_2),
    visible_tail=visible_3.ListOfPoints,
    phollow_tail=Slider(0.001, range=0.001..1))
move_2 = Move(Geometry=pt_6, Motion=cluster_5)  # -> Geometry, Transform
vec_4 = Vector(graft(cluster_5))

preview_2 = CustomPreview(Geometry=loop_start.Data, Shader=ColourSwatch(SwatchColor=RGB(35, 101, 158)))
pt_7 = Point(loop_end.D0)  # disabled
rec = DataRecorder(pt_7, DataLimit=-10, RecordData=True)
group = Group(Objects=rec)  # -> flatten(Group)
cull_i = CullIndex(List=group, Indices="0", Wrap=True)
ungroup = Ungroup(Group=cull_i)  # -> simplify(Objects)
duppt = RemoveDuplicatePts(Points=ungroup, Tolerance=0.01)
prune = PruneTree(Tree=duppt, Minimum="2", Maximum=0)
pline = PolyLine(Vertices=prune, Closed=False)
redpline = Reduce(Polyline=pline, Tolerance=1)  # -> Polyline, Reduction
tlist_2 = TailList(L=pt_5, it=simplify(graft(move_2.Geometry)), len=Slider(30, range=0..100))  # -> out, simplify(A); inputs L: list, len: Int32; same code as tlist
smoothpline = SmoothPolyline(Polyline=redpline.Polyline, Strength=Slider(0, range=0..1), Times=Slider(1, range=0..10))
loop_end_2 = LoopEnd(
    port=loop_start_2.port,
    Exit=Toggle(False),
    Data=simplify(tlist_2.A),
    Data_2=simplify(vec_4),
    pausedState=False,
    state="Constant output",
    TimeOutVal=0)  # -> D0, D1; disabled
previewlw = CustomPreviewLineweights(
    Geometry=smoothpline,
    Shader={ambient=RGB(0, 0, 0), diffuse=RGB(255, 105, 180), emission=RGB(76, 32, 54), shine=0.5, specular=RGB(255, 255, 255), transparency=0})
preview_3 = CustomPreview(Geometry=pt_4, Shader=ColourSwatch(SwatchColor=RGB(35, 101, 158)))
preview_4 = CustomPreview(Geometry=visible_2.ListOfPoints, Shader=ColourSwatch(SwatchColor=RGB(25, 47, 66)))
rec_2 = DataRecorder(loop_end_2.D0, DataLimit=-10, RecordData=True)
preview_5 = CustomPreview(Geometry=rec_2, Shader=ColourSwatch(SwatchColor=RGB(158, 109, 109)))  # disabled

# ==== cluster Cluster
L = ClusterInput()
lng = ListLength(List=L)
vec = Vector(Vector(0, 0, 0))
repeat = RepeatData(Data=vec, Length=lng)
D = ClusterOutput(repeat)

# ==== cluster Cluster_2
agent_location = ClusterInput()
agent_vector_global = ClusterInput()
visible_tail = ClusterInput()
phollow_tail = ClusterInput()
pt = Point(simplify(visible_tail))
motion_vector = Vector(agent_vector_global)
pt_2 = Point(agent_location)
num = Number(phollow_tail)
lng = ListLength(List=pt_2)
series = Series(Start=0, Step=1, Count=lng)  # -> simplify(graft(Series))
lng_2 = ListLength(List=pt)
repeat = RepeatData(Data=series, Length=lng_2)
prune = PruneTree(Tree=repeat, Minimum="1", Maximum=0)
item = ListItem(List=prune, Index=0, Wrap=True)  # -> flatten(Item)
prune_2 = PruneTree(Tree=pt, Minimum="1", Maximum=0)
int = Integer(item)
item_2 = ListItem(List=pt_2, Index=int, Wrap=True)  # -> graft(Item)
vec2pt = Vector2Pt(PointA=simplify(item_2), PointB=prune_2, Unitize=False)  # -> Vector, Length
sort = SortList(Keys=vec2pt.Length, ValuesA=vec2pt.Vector, ValuesB=prune_2)  # -> Keys, ValuesA, ValuesB
item_3 = ListItem(List=motion_vector, Index=int, Wrap=True)

# ---- group: vec
item_4 = ListItem(List=sort.ValuesA, Index=0, Wrap=True)

# ----
angle = Angle(VectorA=simplify(graft(item_3)), VectorB=item_4)  # -> Angle, Reflex
pl = PlaneNormal(Origin=simplify(item_2), ZAxis=simplify(graft(item_3)))
pl_2 = PlaneNormal(Origin=item_2, ZAxis=item_4)
division = Division(A="1", B=num)
deg = Degrees(Radians=angle.Angle)
ppx = PlanePlane(PlaneA=simplify(pl_2), PlaneB=simplify(graft(pl)))
division_2 = Division(A=deg, B=division)
vrot = Rotate(Vector=graft(item_3), Axis=ppx, Angle=degrees(division_2))  # -> flatten(Vector)
replace = ReplaceItems(List=motion_vector, Item=vrot, Indices=int, Wrap=False)
vector = ClusterOutput(replace)

# ==== cluster Cluster_3
num = ClusterInput()
num_2 = ClusterInput()
int = ClusterInput()
pt = ClusterInput()
M = ClusterInput()
num_3 = Number(num)
num_4 = Number(num_2)
int_2 = Integer(int)
pt_2 = Point(pt)
demesh = DeconstructMesh(Mesh=M)  # -> Vertices, Faces, Colours, Normals

color = ListItem(List=demesh.Colours, Index=int_2, Wrap=True)  # -> simplify(Item)
vertex = ListItem(List=demesh.Vertices, Index=int_2, Wrap=True)  # -> simplify(Item)

# ----
# using grayscale so each is the same
graysca = SplitARGB(Colour=color)  # -> Alpha, Red, Green, Blue

sort = SortList(Keys=graysca.Red, ValuesA=vertex)  # -> Keys, ValuesA, ValuesB
item = ListItem(List=sort.Keys, Index=0, Wrap=True)  # -> Item1, Item
item_2 = ListItem(List=sort.ValuesB, Index=0, Wrap=True)  # -> Item1, Item

item_3 = ListItem(List=sort.ValuesA, Index=0, Wrap=True)  # -> Item1, Item
panel = Panel("""follow color
i = black
-i = white""")

vec2pt = Vector2Pt(PointA=simplify(graft(pt_2)), PointB=item_3.Item1, Unitize="true")  # -> flatten(Vector), Length
amp = Amplitude(Vector=vec2pt.Vector, Amplitude=num_4)
lng = ListLength(List=amp)
vec = Vector(Vector(0, 0, 0))
larger = LargerThan(FirstNumber=item.Item1, SecondNumber=num_3)  # -> flatten(LargerThan), OrEqualTo
repeat = RepeatData(Data=vec, Length=lng)
p_n_c = PickNChoose(Pattern=larger.LargerThan, Stream0=amp, Stream1=repeat)  # -> simplify(graft(Result))

vector = ClusterOutput(p_n_c)
