# Grasshopper definition 20160331_shortest.gh (Grasshopper 0.9.76)
# plug-ins: Anemone, Kangaroo Components, Weaverbird, Mesh Pipe, Shortest Walk in Gh

number_slider = Slider(5, range=0..10)
# inspired by:
# 
# generative voxel contained
number_slider_2 = Slider(10, range=0..10)

number_slider_3 = Slider(10, range=0..100)
sqgrid = Square(Plane=PlaneXY(0, 0, 0), Size=number_slider_2, ExtentX=number_slider_3, ExtentY=number_slider_3)  # -> flatten(Cells), flatten(Points)
series = Series(Start=Slider(0, range=0..1), Step=number_slider_2, Count=number_slider_3)
flip = FlipMatrix(Data=series)
Z = UnitZ(Factor=flip)
move = Move(Geometry=sqgrid.Points, Motion=reverse(Z))  # -> flatten(Geometry), Transform

lng = ListLength(List=sqgrid.Points)
number_slider_4 = Slider(5, range=0..10)
number_slider_5 = Slider(1, range=0..1)
item = ListItem(List=move.Geometry, Index=0, Wrap=True)
voxel = Voxel(Points=item, X=number_slider_2, Y=number_slider_2, Z=number_slider_2)
vec2pt = Vector2Pt(PointA=item, PointB=move.Geometry, Unitize=False)  # -> Vector, Length
move_2 = Move(Geometry=voxel, Motion=vec2pt.Vector)  # -> Geometry, Transform
wbtriangles = WeaverbirdsSplitTrianglesSubdivision(MeshCurves=move_2.Geometry, Level=1)
medges = MeshEdges(Mesh=wbtriangles)  # -> NakedEdges, InteriorEdges, NonManifoldEdges
item_2 = ListItem(List=move.Geometry, Index=0, Wrap=True)
loop_start = LoopStart(Repeat=Slider(150, range=0..1290), Data_0=move.Geometry, Data_1=item_2)  # -> port, Counter, Data_0, Data_1, Data_2
difference = SetDifference(SetA=loop_start.Data_0, SetB=loop_start.Data_1)
duppt = RemoveDuplicatePts(Points=move.Geometry, Tolerance=0.01)
lng_2 = ListLength(List=difference)
dom = ConstructDomain(DomainStart=0, DomainEnd=lng_2)
random = Random(Range=dom, Number=1, Seed=loop_start.Counter)
item_3 = ListItem(List=difference, Index=random, Wrap=True)
pt = ConstructPoint(XCoordinate=0, YCoordinate=0, ZCoordinate=0)
ln = Line(StartPoint=pt, EndPoint=item_3)
loop_end = LoopEnd(
    port=loop_start.port,
    Exit=False,
    Data_0=flatten(difference),
    Data_1=flatten(item_3),
    Data_2=flatten(ln),
    pausedState=False,
    state="Constant & Record")  # -> Data_0, Data_1, Data_2
crv = Curve(flatten(loop_end.Data_2))
partition = PartitionList(List=crv, Size=Slider(5, range=0..5))
curvepoint = PointOnCurve(partition, parameter=0.5)
lng_3 = ListLength(List=flatten(partition))
avr = Average(Input=curvepoint)
cp = ClosestPoint(Point=flatten(avr), Cloud=flatten(curvepoint))  # -> ClosestPoint, CPIndex, Distance
crv_2 = Curve(flatten([medges.NakedEdges, medges.InteriorEdges]))
item_4 = ListItem(List=crv, Index=cp.CPIndex, Wrap=True)  # -> flatten(Item)
shortwalk = ShortestWalk(Curves=crv_2, WantedPath=item_4)  # -> ShortestWalk, Succession, Direction, Length
oct = OcTree(Square=False, Group=5)  # -> Boxes, Points
oct_2 = OcTree(Square=False, Group=5)  # -> Boxes, Points
oct_3 = OcTree(Square=False, Group=5)  # -> Boxes, Points
crv_3 = Curve(shortwalk.ShortestWalk)
curvepoint_2 = PointOnCurve(shortwalk.ShortestWalk, parameter=0.5)
cullpt = CullDuplicates(Points=curvepoint_2, Tolerance=0.1, CullMode=3)  # -> Points, Indices, Valence
cset = CreateSet(List=curvepoint_2)  # -> Set, Map
wbcatmullclark = WeaverbirdsCatmullClarkSubdivision(Level=1, SmoothNakedEdges=1)
cset_2 = CreateSet(List=cset.Map)  # -> Set, Map
item_5 = ListItem(List=curvepoint_2, Index=cullpt.Indices, Wrap=True)
mindex = MemberIndex(Set=cset.Map, Member=cset_2.Set)  # -> Index, Count
duppt_2 = RemoveDuplicatePts(Tolerance=0.01)
