# Grasshopper definition 20160408_constrained.gh (Grasshopper 0.9.76)
# Copyright: Co-de-iT
# plug-ins: Sandbox Topology, Anemone, Human, Boid, Noise 4D, Mesh Pipe

# reciproCITY
# tutors
# Aldo Sollazzo
# Alessio Erioli
# IaaC . 15-17.04.2016
number_slider = Slider(1, range=1..5)
number_slider_2 = Slider(70, range=10..200)
seed = Slider(57, range=0..100)
# basic stigmergy example
# (environment read/write)
pt = Point(flatten([Point(97.23026444, 47.18736088, 0), Point(102.9208052, 48.59891617, 0), Point(109.1723951, 44.36547091, 0), Point(101.5460938, 37.88936513, 0), Point(111.4122517, 36.20139809, 0), Point(112.988691, 52.15460782, 0), Point(89.47101574, 41.51944567, 0), Point(97.70682141, 55.38789412, 0)]))
multiplication = Multiplication(A=number_slider_2, B=2)

# ----
# environment
# noise map
B = Boundary({Plane=PlaneXY(0, 0, 0), Size=Domain2(u=0..200, v=0..100)})
noise_scale = Slider(0.016, range=0..0.05)
mplane = MeshPlane(Boundary=B, WidthCount=multiplication, HeightCount=number_slider_2)  # -> Mesh, Area
demesh = DeconstructMesh(Mesh=mplane.Mesh)  # -> Vertices, Faces, Colours, Normals
perlin = PerlinNoise(Values=demesh.Vertices, Time=0, Scale=noise_scale)
gradient = Gradient(LowerLimit="-1", UpperLimit=1, Parameter=perlin, stops=[0: RGB(255, 255, 255), 1: RGB(0, 0, 0)])
conmesh = ConstructMesh(Vertices=demesh.Vertices, Faces=demesh.Faces, Colours=gradient)

# ----
# <title>
# 
# <description>
# 
# code by <author>
# 
# v <version>
# 
# © Co-de-iT 2016 _ Creative Commons Attribution-NonCommercial-ShareAlike 4.0 International License
dup = DuplicateData(Data=pt, Number=number_slider, Order=True)
pt_2 = Point([Point(113.9236261, 48.94442181, 0), Point(155.7442897, 68.23117429, 0), Point(59.55634715, 28.12745751, 0), Point(47.90743153, 63.93224749, 0)])
lng = ListLength(List=dup)
wheel = ColourWheel(
    lng,
    ColourGrips_Style=10,
    ColourGrips_Grip=[3.410431301, 3.141592654, 1.570796327, 4.71238898],
    ColourGrips_Lum=[0.0534287417, 0.560828417],
    ColourGrips_Range=[0.2307165557, 0.2307165557, 0.2307165557, 0.2307165557],
    ColourGrips_Sat=[1, 0.8651205502])
addition = Addition(A=seed, B=1)
genes = GenePool(Decimals=2, Maximum=50, Minimum=0, Value=[16.18485296, 33.4579375, 5.948570257, 23.32569571])
random = Random(Range="1.0 to 3.0", Number=lng, Seed=seed)
random_2 = Random(Range=Domain(0, 1), Number=lng, Seed=addition)
Z = UnitZ(Factor=1)
X = UnitX(Factor=random)
tri = Triangulate(Mesh=conmesh)  # -> Mesh, Count
vrot = Rotate(Vector=X, Axis=Z, Angle=random_2)
pcharge = PointCharge(Point=pt_2, Charge=1, Decay=1)
fspin = SpinForce(Plane=pt_2, Strength=1, Radius=genes, Decay=1)
mesh_topo_vertex = MeshTopologyVertex(Mesh=tri.Mesh)  # -> ListOfMeshVertices, VertexVertexStructure, VertexFaceStructure
mergef = MergeFields(Fields=[pcharge, fspin])
# loc
pt_3 = Point(flatten(dup))
# vel
vec = Vector(flatten(vrot))
# col
col = Colour(flatten(wheel))
# tail
# < NB: always add the trail (or tail) as LAST
pt_4 = Point(dup)
Z_2 = UnitZ(Factor=1)
number_slider_3 = Slider(200, range=0..200)
pl = PlaneNormal(Origin=pt_3, ZAxis=Z_2)
item = ListItem(List=mesh_topo_vertex.ListOfMeshVertices, Index=mesh_topo_vertex.VertexVertexStructure, Wrap=True)
evf = EvaluateField(Field=mergef, Point=mesh_topo_vertex.ListOfMeshVertices)  # -> Tensor, Strength
align = AlignPlane(Plane=pl, Direction=vec)  # -> Plane, Angle
vec2pt = Vector2Pt(PointA=graft(mesh_topo_vertex.ListOfMeshVertices), PointB=item, Unitize=False)  # -> Vector, Length
demesh_2 = DeconstructMesh(Mesh=conmesh)  # -> Vertices, Faces, Colours, Normals
bpath = BranchPath(T=mesh_topo_vertex.VertexVertexStructure, i=number_slider_3)  # -> P; inputs T: tree, i: Int32; disabled
# ---------- bpath: C# ----------
    Component.Name = "Branch Path";
    Component.NickName = "BPath";
    Component.Description = "Retrieves the data tree path for a specific branch index";
    P = T.Path(i);
# ---------- end bpath ----------
# fields
merge = Merge(Data1=simplify(graft(pt_3)), Data2=simplify(graft(vec)), Data3=simplify(graft(col)), Data4=simplify(graft(pt_4)))
angle = Angle(VectorA=graft(evf.Tensor), VectorB=vec2pt.Vector)  # -> Angle, Reflex
branch = TreeBranch(Tree=mesh_topo_vertex.VertexVertexStructure, Path=bpath, MaintainPaths=True)  # disabled
item_2 = ListItem(List=demesh_2.Vertices, Index=number_slider_3, Wrap=True)  # disabled
item_3 = ListItem(List=mesh_topo_vertex.ListOfMeshVertices, Index=branch, Wrap=True)  # disabled
sort = SortList(Keys=angle.Angle, ValuesA=mesh_topo_vertex.VertexVertexStructure)  # -> Keys, ValuesA
item_4 = ListItem(List=sort.ValuesA, Index=0, Wrap=True)
item_5 = ListItem(List=mesh_topo_vertex.ListOfMeshVertices, Index=item_4, Wrap=True)  # -> flatten(Item)
multiplication_2 = Multiplication(A=evf.Tensor, B=Slider(2.32, range=0..10))
vec2pt_2 = Vector2Pt(PointA=mesh_topo_vertex.ListOfMeshVertices, PointB=item_5, Unitize=False)  # -> Vector, Length
evaporation_rate = Slider(0.97952, range=0..1)
evaporation_rate_2 = Slider(0.99488, range=0..1)
maxforce = Slider(0.582, range=0..1)
futloc = Slider(3, range=0..3)
maxvel = Slider(1.5, range=0..3)
ph_strength = Slider(0.238, range=0..1)
wandering_angle = Slider(49.21, range=0..90)
# constrained field
vdisex = VectorDisplayEx(
    Point=mesh_topo_vertex.ListOfMeshVertices,
    Vector=vec2pt_2.Vector,
    Colour=ColourSwatch(SwatchColor=RGB(117, 117, 117)),
    Width="1")
# field
vdisex_2 = VectorDisplayEx(
    Point=mesh_topo_vertex.ListOfMeshVertices,
    Vector=multiplication_2,
    Colour=ColourSwatch(SwatchColor=RGB(82, 82, 82)),
    Width="1")
button = Button()
exit = Button()
group = Group(Objects=merge)
loop_start = LoopStart(N=Slider(170, range=0..1000), T=button, D0=group, D1=demesh_2.Colours)  # -> port, Counter, Data, Data_2
panel = Panel(loop_start.Counter)
ungroup = Ungroup(Group=loop_start.Data)  # -> simplify(Objects)
split = SplitList(List=ungroup, Index="3")  # -> ListA, ListB

# ----
# steer
noise_scale_2 = Slider(0.016, range=0..0.05)  # disabled
max_angle = Slider(90, range=0..90)  # disabled
# noise follow
perlin_2 = PerlinNoise(Time=0, Scale=noise_scale_2)  # disabled
multiplication_3 = Multiplication(A=perlin_2, B=max_angle)  # disabled
Z_3 = UnitZ(Factor=1)  # disabled
vrot_2 = Rotate(Axis=Z_3, Angle=degrees(multiplication_3))  # -> simplify(Vector); disabled
maxforce_2 = Slider(0.384, range=0..1)  # disabled
noise_intensity = Slider(0, range=0..1)  # disabled
steer = Steer(des=vrot_2, maxf=maxforce_2)  # disabled
multiplication_4 = Multiplication(A=steer, B=noise_intensity)  # disabled

# ----
# loc
# vel
# col
# behaviors
item_6 = ListItem(List=split.ListA, Index=0, Wrap=True)  # -> Item, Item1, Item2

pt_5 = Point(item_6.Item)
cp = ClosestPoint(Point=pt_5, Cloud=mesh_topo_vertex.ListOfMeshVertices)  # -> ClosestPoint, simplify(CPIndex), Distance
threshold = Slider(0.16, range=0..1)
futloc_2 = Slider(2.5, range=0..3)
branch_2 = TreeBranch(Tree=mesh_topo_vertex.VertexVertexStructure, Path=cp.CPIndex, MaintainPaths=False)
rad = Radians(Degrees=wandering_angle)
list = ValueList({"brightest": 0, "darkest": 1}, selected="brightest")
item_7 = ListItem(List=mesh_topo_vertex.ListOfMeshVertices, Index=branch_2, Wrap=True)
# read environment
pt_6 = Point(item_6.Item)
vec_2 = Vector(item_6.Item1)
pt_7 = Point(demesh_2.Vertices)
col_2 = Colour(loop_start.Data_2)
neg = Negative(Value=rad)
vec2pt_3 = Vector2Pt(PointA=cp.ClosestPoint, PointB=item_7, Unitize=False)  # -> Vector, Length
pl_2 = ConstructPlane(Origin=Point(0, 0, 0), XAxis=item_6.Item1, YAxis=vec2pt_3.Vector)
lng_2 = ListLength(List=flatten(pt_6))
dom = ConstructDomain(DomainStart=neg, DomainEnd=rad)
cluster = Cluster(
    location=pt_6,
    velocity=vec_2,
    future_location_radius=futloc_2,
    points_to_search=pt_7,
    colors_to_search=col_2,
    samples=Slider(10, range=2..50),
    search_threshold_0_1=threshold,
    brightest_darkest=list)  # -> color_direction, pattern, followers_index, others_index
angle_2 = Angle(VectorA=item_6.Item1, VectorB=vec2pt_3.Vector, Plane=pl_2)  # -> Angle, Reflex
random_3 = Random(Range=dom, Number=lng_2, Seed=loop_start.Counter)  # -> simplify(graft(Random))
Z_4 = UnitZ(Factor=1)
sort_2 = SortList(Keys=angle_2.Angle, ValuesA=item_7, ValuesB=vec2pt_3.Vector)  # -> Keys, ValuesA, ValuesB
# wander
vrot_3 = Rotate(Vector=vec_2, Axis=Z_4, Angle=random_3)
item_8 = ListItem(List=sort_2.ValuesB, Index=0, Wrap=True)
# point in graph
item_9 = ListItem(List=sort_2.ValuesA, Index=0, Wrap=True)
weave = Weave(Pattern=cluster.pattern, Stream0=vrot_3, Stream1=cluster.color_direction, NullGaps=False)
item_10 = ListItem(List=cluster.followers_index, Index=cluster.others_index, Wrap=True)
# wanderers
item_11 = ListItem(List=pt_6, Index=cluster.others_index, Wrap=True)
# motion vector
vdisex_3 = VectorDisplayEx(Point=cp.ClosestPoint, Vector=item_8, Colour=RGB(0, 0, 0), Width=2)
# motion vector display
# possible directions display
vdisex_4 = VectorDisplayEx(
    Point=cp.ClosestPoint,
    Vector=vec2pt_3.Vector,
    Colour=ColourSwatch(SwatchColor=RGBA(54, 131, 255, 119)),
    Width=Slider(0.676, range=0..1))
item_12 = ListItem(List=vec2pt_2.Vector, Index=cp.CPIndex, Wrap=True)  # -> simplify(Item)
color_intensity = Slider(1, range=0..1)
color_intensity_2 = Slider(0.753, range=0..1)
field_intensity = Slider(0.657, range=0..1)
# agent update
steer_2 = Steer(vel=item_6.Item1, des=item_8, maxv=maxvel, maxf=maxforce)
steer_3 = Steer(vel=item_6.Item1, des=weave, maxv=maxvel, maxf=maxforce)
steer_4 = Steer(vel=item_6.Item1, des=item_12, maxv=maxvel, maxf=maxforce)
# write to environment
cp_2 = ClosestPoint(Point=item_6.Item, Cloud=demesh_2.Vertices)  # -> ClosestPoint, CPIndex, Distance
multiplication_5 = Multiplication(A=steer_2, B=color_intensity)
item_13 = ListItem(List=loop_start.Data_2, Index=cp_2.CPIndex, Wrap=True)  # -> simplify(Item1), Item
multiplication_6 = Multiplication(A=steer_3, B=color_intensity_2)
multiplication_7 = Multiplication(A=steer_4, B=field_intensity)
ahsv = SplitAHSV(Colour=item_13.Item1)  # -> Alpha, Hue, Saturation, Value
addition_2 = Addition(A=item_6.Item1, B=multiplication_5, C=multiplication_6, D=multiplication_7)

amp = Amplitude(Vector=item_6.Item1, Amplitude=futloc)  # disabled
# future location + mesh closest point
move = Move(Geometry=item_6.Item, Motion=amp)  # -> Geometry, Transform; disabled
cp_3 = ClosestPoint(Point=move.Geometry, Cloud=demesh_2.Vertices)  # -> ClosestPoint, CPIndex, Distance; disabled
item_14 = ListItem(List=vec2pt_2.Vector, Index=cp_3.CPIndex, Wrap=True)  # -> simplify(Item); disabled
move_2 = Move(Geometry=item_6.Item, Motion=item_14)  # -> simplify(Geometry), Transform; disabled

addition_3 = Addition(A=ahsv.Value, B=ph_strength)
# limit to maxspeed
trmvec = TrimVector(Vector=addition_2, LengthDomain=maxvel)
min = Minimum(A=addition_3, B="1")
frgb = ColourRGBF(Alpha=1, Red=min, Green=min, Blue=min)
tail_length = Slider(12, range=2..50)
replace = ReplaceItems(List=flatten(loop_start.Data_2), Item=flatten(frgb), Indices=flatten(cp_2.CPIndex), Wrap=False)
# update agent location
pt_8 = Point(simplify(item_9))
move_3 = Move(Geometry=item_6.Item, Motion=trmvec)  # -> Geometry, Transform
multiplication_8 = Multiplication(A=replace, B=evaporation_rate)
# constrain to mesh
meshcp = MeshClosestPoint(Point=move_3.Geometry, Mesh=conmesh)  # -> Point, Index, Parameter
# record tail
t_rec = TailRecorder(L=simplify(split.ListB), it=simplify(pt_8), len=tail_length)  # -> out, Lo; inputs L: list, len: Int32
# ---------- t_rec: C# ----------
    String eol = Environment.NewLine;
    Component.Name = "Tail Recorder";
    Component.NickName = "T-Rec";
    Component.Description = "Tail recorder" + eol + "L - list of tail points" + eol + "it - item to add" + eol + "len - tail max length";

    if (L.Count() > len) {
      L.RemoveAt(0);
    }
    L.Add(it);
    Lo = L;
# ---------- end t_rec ----------
merge_2 = Merge(Data1=simplify(pt_8), Data2=simplify(trmvec), Data3=simplify(item_6.Item2), Data4=simplify(t_rec.Lo))
group_2 = Group(Objects=merge_2)
loop_end = LoopEnd(
    port=loop_start.port,
    Exit=exit,
    Data=simplify(group_2),
    Data_2=simplify(multiplication_8),
    pausedState=False,
    state="Constant output",
    TimeOutVal=0)  # -> D0, D1
ungroup_2 = Ungroup(Group=loop_end.D0)
conmesh_2 = ConstructMesh(Vertices=demesh_2.Vertices, Faces=demesh_2.Faces, Colours=loop_end.D1)
split_2 = SplitList(List=ungroup_2, Index="3")  # -> ListA, ListB
interval = Slider(1, range=1..10)
interval_2 = Slider(1, range=1..10)
repeat = RepeatData(Data="0", Length=expr("x-1", interval))
merge_3 = Merge(Data1="1", Data2=repeat)  # -> flatten(Result)
repeat_2 = RepeatData(Data="0", Length=expr("x-1", interval_2))
item_15 = ListItem(List=split_2.ListA, Index=0, Wrap=True)  # -> Item, Item1, Item2
viewer = ParamViewer(split_2.ListB)
cull = CullPattern(List=split_2.ListB, CullPattern=merge_3)
merge_4 = Merge(Data1="1", Data2=repeat_2)  # -> flatten(Result)
pt_9 = Point(Tree({0;0;0}: [Point(98.57142639, 47.1428566, 0), Point(98.57142639, 47.1428566, 0), Point(100, 47.1428566, 0), Point(101.4285736, 47.1428566, 0), Point(102.8571396, 47.1428566, 0), Point(104.2857132, 47.1428566, 0)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], {1;0;0}: [Point(104.2857132, 50, 0), Point(104.2857132, 50, 0), Point(105.7142868, 50, 0), Point(107.1428604, 50, 0), Point(108.5714264, 50, 0), Point(110, 50, 0)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], {2;0;0}: [Point(110, 44.2857132, 0), Point(110, 44.2857132, 0), Point(111.4285736, 44.2857132, 0), Point(112.8571396, 44.2857132, 0), Point(114.2857132, 44.2857132, 0), Point(115.7142868, 44.2857132, 0)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], {3;0;0}: [Point(102.8571396, 40, 0), Point(102.8571396, 40, 0), Point(104.2857132, 40, 0), Point(105.7142868, 40, 0), Point(107.1428604, 40, 0), Point(108.5714264, 40, 0)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], {4;0;0}: [Point(112.8571396, 35.7142868, 0), Point(112.8571396, 35.7142868, 0), Point(114.2857132, 35.7142868, 0), Point(115.7142868, 35.7142868, 0), Point(117.1428604, 35.7142868, 0), Point(118.5714264, 35.7142868, 0)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], {5;0;0}: [Point(114.2857132, 52.8571434, 0), Point(114.2857132, 52.8571434, 0), Point(115.7142868, 52.8571434, 0), Point(117.1428604, 52.8571434, 0), Point(118.5714264, 52.8571434, 0), Point(120, 52.8571434, 0)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], {6;0;0}: [Point(91.42857361, 42.8571434, 0), Point(91.42857361, 42.8571434, 0), Point(92.85713959, 42.8571434, 0), Point(94.2857132, 42.8571434, 0), Point(95.7142868, 42.8571434, 0), Point(95.7142868, 41.42856979, 0)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], {7;0;0}: [Point(98.57142639, 57.1428566, 0), Point(98.57142639, 57.1428566, 0), Point(100, 57.1428566, 0), Point(101.4285736, 57.1428566, 0), Point(102.8571396, 57.1428566, 0), Point(104.2857132, 57.1428566, 0)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]))

# ----
# color search + vertices constraint
pt_10 = Point(Tree({0;0;0}: [Point(98.57142639, 47.1428566, 0), Point(98.57142639, 47.1428566, 0), Point(100, 47.1428566, 0), Point(101.4285736, 47.1428566, 0), Point(102.8571396, 47.1428566, 0), Point(104.2857132, 47.1428566, 0)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], {1;0;0}: [Point(104.2857132, 50, 0), Point(104.2857132, 50, 0), Point(105.7142868, 50, 0), Point(107.1428604, 50, 0), Point(108.5714264, 50, 0), Point(110, 50, 0)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], {2;0;0}: [Point(110, 44.2857132, 0), Point(110, 44.2857132, 0), Point(111.4285736, 44.2857132, 0), Point(112.8571396, 44.2857132, 0), Point(114.2857132, 44.2857132, 0), Point(115.7142868, 44.2857132, 0)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], {3;0;0}: [Point(102.8571396, 40, 0), Point(102.8571396, 40, 0), Point(104.2857132, 40, 0), Point(105.7142868, 40, 0), Point(107.1428604, 40, 0), Point(108.5714264, 40, 0)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], {4;0;0}: [Point(112.8571396, 35.7142868, 0), Point(112.8571396, 35.7142868, 0), Point(114.2857132, 35.7142868, 0), Point(115.7142868, 35.7142868, 0), Point(117.1428604, 35.7142868, 0), Point(118.5714264, 35.7142868, 0)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], {5;0;0}: [Point(114.2857132, 52.8571434, 0), Point(114.2857132, 52.8571434, 0), Point(115.7142868, 52.8571434, 0), Point(117.1428604, 52.8571434, 0), Point(118.5714264, 52.8571434, 0), Point(120, 52.8571434, 0)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], {6;0;0}: [Point(91.42857361, 42.8571434, 0), Point(91.42857361, 42.8571434, 0), Point(92.85713959, 42.8571434, 0), Point(94.2857132, 42.8571434, 0), Point(95.7142868, 42.8571434, 0), Point(97.14286041, 42.8571434, 0)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], {7;0;0}: [Point(98.57142639, 57.1428566, 0), Point(98.57142639, 57.1428566, 0), Point(100, 57.1428566, 0), Point(101.4285736, 57.1428566, 0), Point(102.8571396, 57.1428566, 0), Point(104.2857132, 57.1428566, 0)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]))

# ----
# just vertices + field
pt_11 = Point(Tree({0;0;0}: [Point(97.23026444, 45.75879109, 0), Point(97.23026444, 45.75879109, 0), Point(97.23026444, 44.33021748, 0), Point(97.23026444, 42.90164769, 0), Point(97.23026444, 41.47307789, 0), Point(97.23026444, 40.04450428, 0)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], {1;0;0}: [Point(102.9208052, 47.17034637, 0), Point(102.9208052, 47.17034637, 0), Point(102.9208052, 45.74177658, 0), Point(102.9208052, 44.31320297, 0), Point(102.9208052, 42.88463318, 0), Point(102.9208052, 41.45606338, 0)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], {2;0;0}: [Point(109.1723951, 42.9368973, 0), Point(109.1723951, 42.9368973, 0), Point(110.6009687, 42.9368973, 0), Point(112.0295423, 42.9368973, 0), Point(113.4581159, 42.9368973, 0), Point(114.8866819, 42.9368973, 0)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], {3;0;0}: [Point(101.5460938, 36.46079533, 0), Point(101.5460938, 36.46079533, 0), Point(102.9746598, 36.46079533, 0), Point(104.4032334, 36.46079533, 0), Point(105.8317994, 36.46079533, 0), Point(107.260373, 36.46079533, 0)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], {4;0;0}: [Point(112.8408253, 36.20139809, 0), Point(112.8408253, 36.20139809, 0), Point(114.2693989, 36.20139809, 0), Point(115.6979649, 36.20139809, 0), Point(117.1265385, 36.20139809, 0), Point(118.5551121, 36.20139809, 0)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], {5;0;0}: [Point(111.5601173, 52.15460782, 0), Point(111.5601173, 52.15460782, 0), Point(110.1315514, 50.72603421, 0), Point(110.1315514, 49.2974606, 0), Point(110.1315514, 47.86888699, 0), Point(110.1315514, 46.4403172, 0)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], {6;0;0}: [Point(89.47101574, 40.09087587, 0), Point(89.47101574, 40.09087587, 0), Point(90.89958935, 40.09087587, 0), Point(90.89958935, 38.66230608, 0), Point(92.32815533, 38.66230608, 0), Point(92.32815533, 37.23373247, 0)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], {7;0;0}: [Point(96.2782478, 53.95932433, 0), Point(96.2782478, 53.95932433, 0), Point(96.2782478, 52.53075453, 0), Point(96.2782478, 51.10218474, 0), Point(96.2782478, 49.67361113, 0), Point(96.2782478, 48.24504134, 0)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]))

rec = DataRecorder(item_15.Item, DataLimit=-10, RecordData=True)
lng_3 = ListLength(List=cull)
cull_2 = CullPattern(List=pt_9, CullPattern=merge_4)
lng_4 = ListLength(List=viewer)
number_slider_4 = Slider(0.4, range=0..3)
repeat_3 = RepeatData(Data=ColourSwatch(SwatchColor=RGB(0, 0, 0)), Length=lng_4)  # -> graft(Data)
pline = PolyLine(Vertices=cull_2, Closed=False)
merge_5 = Merge(Data1=simplify(repeat_3), Data2=simplify(item_15.Item2))
range = Range(Domain=Domain(0, 1), Steps=expr("x-1", lng_3))
smoothpline = SmoothPolyline(Polyline=pline, Strength=1, Times=Slider(1, range=1..30))
addition_4 = Addition(A=number_slider_4, B=1)
col_3 = Colour(merge_5)
expression = Expression(x=range, y=number_slider_4, Expression="1+x*y")
cloud = CloudDisplay(Points=item_15.Item, Colours=item_15.Item2, Size=addition_4, SpriteType=0)
interp = InterpolateData(Data=col_3, Parameter=range, Interpolation=2)
cloud_2 = CloudDisplay(Points=graft(cull), Colours=graft(interp), Size=number_slider_4, SpriteType=0)
previewlw = CustomPreviewLineweights(
    Geometry=smoothpline,
    Shader=ColourSwatch(SwatchColor=RGB(113, 162, 189)),
    Thickness=Slider(1, range=1..3),
    Absolute=False)
mpipe = MeshPipe(Curve=pline, Radius=Slider(0.178, range=0.001..3), Accuracy=0.2, Rotation=0, Segments="4", Caps="1")
previewmat = CustomPreviewMaterials(Geometry=mpipe, DiffuseColor=RGB(255, 255, 255))

# ==== cluster Steer
maxf = ClusterInput()
vel = ClusterInput()
maxv = ClusterInput()
des = ClusterInput()
amp = Amplitude(Vector=des, Amplitude=maxv)
subtraction = Subtraction(A=amp, B=vel)
multiplication = Multiplication(A=subtraction, B=maxf)
vlen = VectorLength(Vector=multiplication)
min = Minimum(A=vlen, B=maxv)
amp_2 = Amplitude(Vector=multiplication, Amplitude=min)
acc = ClusterOutput(amp_2)

# ==== cluster Cluster
future_location_radius = ClusterInput()  # amplitude for future location search
samples = ClusterInput()  # n. of point to sample
location = ClusterInput()
velocity = ClusterInput()
points_to_search = ClusterInput()
colors_to_search = ClusterInput()
search_threshold_0_1 = ClusterInput()
brightest_darkest = ClusterInput()  # 0 follow brightest, 1 follow darkest
# future location
amp = Amplitude(Vector=velocity, Amplitude=future_location_radius)
move = Move(Geometry=location, Motion=amp)  # -> Geometry, Transform
cps = ClosestPoints(Point=move.Geometry, Cloud=points_to_search, Count=samples)  # -> ClosestPoint, CPIndex, Distance
item = ListItem(List=colors_to_search, Index=cps.CPIndex, Wrap=True)
addition = Addition(A="-1", B=brightest_darkest)
ahsv = SplitAHSV(Colour=item)  # -> Alpha, Hue, Saturation, Value
sort = SortList(Keys=ahsv.Value, ValuesA=cps.ClosestPoint, ValuesB=cps.CPIndex)  # -> Keys, ValuesA, ValuesB

# ----
# -1 | brightest
# i    |  darkest
value = ListItem(List=simplify(sort.Keys), Index=addition, Wrap=True)
point = ListItem(List=simplify(sort.ValuesA), Index=addition, Wrap=True)
index = ListItem(List=simplify(sort.ValuesB), Index=addition, Wrap=True)

panel = Panel("true")
lng = ListLength(List=flatten(value))
vec2pt = Vector2Pt(PointA=location, PointB=point, Unitize=False)  # -> Vector, Length
larger = LargerThan(FirstNumber=value, SecondNumber=search_threshold_0_1)  # -> LargerThan, simplify(OrEqualTo)
vec = Vector(Vector(0, 0, 0))
not = GateNot(A=larger.OrEqualTo)
repeat = RepeatData(Data=vec, Length=lng)  # -> simplify(graft(Data))
filter = StreamFilter(Gate=brightest_darkest, Stream0=larger.OrEqualTo, Stream1=not)
weave = Weave(Pattern=filter, Stream0=repeat, Stream1=vec2pt.Vector, NullGaps=False)
dispatch = Dispatch(List=index, DispatchPattern=filter)  # -> ListA, ListB
pattern = ClusterOutput(filter)  # true/false pattern against threshold
color_direction = ClusterOutput(weave)  # color vector direction (0 vector if not within threshold)
followers_index = ClusterOutput(dispatch.ListA)
others_index = ClusterOutput(dispatch.ListB)
