# Grasshopper definition shortest_v02_AE.gh (Grasshopper 0.9.76)
# plug-ins: Anemone, Human, Weaverbird, Mesh Pipe, Shortest Walk in Gh

number_slider = Slider(5, range=0..10)
# inspired by:
# 
# generative voxel contained
number_slider_2 = Slider(10, range=0..10)

number_slider_3 = Slider(10, range=0..100)
sqgrid = Square(Plane=PlaneXY(0, 0, 0), Size=number_slider_2, ExtentX=number_slider_3, ExtentY=number_slider_3)  # -> flatten(Cells), flatten(Points)
series = Series(Start=Slider(0, range=0..1), Step=number_slider_2, Count=number_slider_3)
flip = FlipMatrix(Data=series)
Z = UnitZ(Factor=flip)
move = Move(Geometry=sqgrid.Points, Motion=reverse(Z))  # -> flatten(Geometry), Transform

lng = ListLength(List=sqgrid.Points)
number_slider_4 = Slider(5, range=0..10)
number_slider_5 = Slider(1, range=0..1)
item = ListItem(List=move.Geometry, Index=0, Wrap=True)
voxel = Voxel(Points=item, X=number_slider_2, Y=number_slider_2, Z=number_slider_2)
vec2pt = Vector2Pt(PointA=item, PointB=move.Geometry, Unitize=False)  # -> Vector, Length
move_2 = Move(Geometry=voxel, Motion=vec2pt.Vector)  # -> Geometry, Transform
wbtriangles = WeaverbirdsSplitTrianglesSubdivision(MeshCurves=move_2.Geometry, Level=1)
wbjoin = WeaverbirdsJoinMeshesAndWeld(Mesh=flatten(wbtriangles), Weld=Toggle(True))
medges = MeshEdges(Mesh=wbjoin)  # -> NakedEdges, InteriorEdges, NonManifoldEdges
panel = Panel(wbjoin)
crv = Curve(flatten([medges.NakedEdges, medges.InteriorEdges]))
item_2 = ListItem(List=move.Geometry, Index=0, Wrap=True)
loop_start = LoopStart(Repeat=Slider(150, range=0..1290), Trigger=Button(), Data_0=move.Geometry, Data_1=item_2)  # -> port, Counter, Data_0, Data_1, Data_2
difference = SetDifference(SetA=loop_start.Data_0, SetB=loop_start.Data_1)
lng_2 = ListLength(List=difference)
dom = ConstructDomain(DomainStart=0, DomainEnd=lng_2)
random = Random(Range=dom, Number=1, Seed=loop_start.Counter)
item_3 = ListItem(List=difference, Index=random, Wrap=True)
pt = ConstructPoint(XCoordinate=0, YCoordinate=0, ZCoordinate=0)
ln = Line(StartPoint=pt, EndPoint=item_3)
loop_end = LoopEnd(
    port=loop_start.port,
    Exit=False,
    Data_0=flatten(difference),
    Data_1=flatten(item_3),
    Data_2=flatten(ln),
    pausedState=False,
    state="Constant & Record")  # -> Data_0, Data_1, Data_2

# ----
# custom trajectories
crv_2 = Curve(graft([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]))
curvepoint = PointOnCurve(crv, parameter=0.5)
end = EndPoints(Curve=crv_2)  # -> Start, End
previewlw = CustomPreviewLineweights(Geometry=crv_2, Shader=ColourSwatch(SwatchColor=RGB(255, 255, 255)), Absolute=False)
crv_cp = CurveClosestPoint(Point=curvepoint, Curve=crv_2)  # -> Point, Parameter, Distance
ln_2 = Line(StartPoint=end.Start, EndPoint=end.End)
shortwalk = ShortestWalk(Curves=crv, Lengths=crv_cp.Distance, WantedPath=ln_2)  # -> ShortestWalk, Succession, Direction, Length
explode = Explode(Curve=flatten(shortwalk.ShortestWalk), Recursive=True)  # -> Segments, Vertices
curvepoint_2 = PointOnCurve(explode.Segments, parameter=0.5)
mindex = MemberIndex(Set=flatten(curvepoint_2), Member=curvepoint_2)  # -> Index, Count
_2º = PowerOf2(Value=mindex.Count)
previewlw_2 = CustomPreviewLineweights(Geometry=explode.Segments, Shader=ColourSwatch(SwatchColor=RGB(0, 0, 0)), Thickness=_2º, Absolute=False)
bar_graph = BarGraph(_2º, BarColor=RGB(255, 0, 90))

crv_3 = Curve(flatten(loop_end.Data_2))
partition = PartitionList(List=crv_3, Size=Slider(5, range=0..5))
curvepoint_3 = PointOnCurve(partition, parameter=0.5)
lng_3 = ListLength(List=flatten(partition))
avr = Average(Input=curvepoint_3)
cp = ClosestPoint(Point=flatten(avr), Cloud=flatten(curvepoint_3))  # -> ClosestPoint, CPIndex, Distance
item_4 = ListItem(List=crv_3, Index=cp.CPIndex, Wrap=True)  # -> flatten(Item)
shortwalk_2 = ShortestWalk(Curves=crv, WantedPath=item_4)  # -> ShortestWalk, Succession, Direction, Length
explode_2 = Explode(Curve=flatten(shortwalk_2.ShortestWalk), Recursive=True)  # -> Segments, Vertices

curvepoint_4 = PointOnCurve(parameter=0.5)  # disabled
cullpt = CullDuplicates(Points=curvepoint_4, Tolerance=0.1, CullMode=3)  # -> Points, Indices, Valence; disabled
cset = CreateSet(List=curvepoint_4)  # -> Set, Map; disabled
cset_2 = CreateSet(List=cset.Map)  # -> Set, Map; disabled
mindex_2 = MemberIndex(Set=cset.Map, Member=cset_2.Set)  # -> Index, Count; disabled
item_5 = ListItem(List=curvepoint_4, Index=cullpt.Indices, Wrap=True)  # disabled

curvepoint_5 = PointOnCurve(explode_2.Segments, parameter=0.5)
mindex_3 = MemberIndex(Set=flatten(curvepoint_5), Member=curvepoint_5)  # -> Index, Count
previewlw_3 = CustomPreviewLineweights(Geometry=explode_2.Segments, Shader=ColourSwatch(SwatchColor=RGB(0, 0, 0)), Thickness=mindex_3.Count, Absolute=False)
