# Grasshopper definition 20160407_basic stigmergy.gh (Grasshopper 0.9.76)
# Copyright: Co-de-iT
# plug-ins: Sandbox Topology, Anemone, Human, Boid, Noise 4D

# reciproCITY
# tutors
# Aldo Sollazzo
# Alessio Erioli
# IaaC . 15-17.04.2016
number_slider = Slider(1, range=1..5)
number_slider_2 = Slider(70, range=10..200)
seed = Slider(57, range=0..100)
# basic stigmergy example
# (environment read/write)
pt = Point(flatten([Point(97.23026444, 47.18736088, 0), Point(102.9208052, 48.59891617, 0), Point(109.1723951, 44.36547091, 0), Point(101.5460938, 37.88936513, 0), Point(111.4122517, 36.20139809, 0), Point(112.988691, 52.15460782, 0), Point(89.47101574, 41.51944567, 0), Point(97.70682141, 55.38789412, 0)]))
multiplication = Multiplication(A=number_slider_2, B=2)

# ----
# noise map
B = Boundary({Plane=PlaneXY(0, 0, 0), Size=Domain2(u=0..200, v=0..100)})
noise_scale = Slider(0.016, range=0..0.05)
mplane = MeshPlane(Boundary=B, WidthCount=multiplication, HeightCount=number_slider_2)  # -> Mesh, Area
demesh = DeconstructMesh(Mesh=mplane.Mesh)  # -> Vertices, Faces, Colours, Normals
perlin = PerlinNoise(Values=demesh.Vertices, Time=0, Scale=noise_scale)
gradient = Gradient(LowerLimit="-1", UpperLimit=1, Parameter=perlin, stops=[0: RGB(255, 255, 255), 1: RGB(0, 0, 0)])
conmesh = ConstructMesh(Vertices=demesh.Vertices, Faces=demesh.Faces, Colours=gradient)

# ----
# <title>
# 
# <description>
# 
# code by <author>
# 
# v <version>
# 
# © Co-de-iT 2016 _ Creative Commons Attribution-NonCommercial-ShareAlike 4.0 International License
dup = DuplicateData(Data=pt, Number=number_slider, Order=True)
lng = ListLength(List=dup)
wheel = ColourWheel(
    lng,
    ColourGrips_Style=10,
    ColourGrips_Grip=[3.410431301, 3.141592654, 1.570796327, 4.71238898],
    ColourGrips_Lum=[0.0534287417, 0.560828417],
    ColourGrips_Range=[0.2307165557, 0.2307165557, 0.2307165557, 0.2307165557],
    ColourGrips_Sat=[1, 0.8651205502])
addition = Addition(A=seed, B=1)
random = Random(Range="1.0 to 3.0", Number=lng, Seed=seed)
random_2 = Random(Range=Domain(0, 1), Number=lng, Seed=addition)
genes = GenePool(Decimals=2, Maximum=50, Minimum=0, Value=[16.18485296, 33.4579375, 5.948570257, 23.32569571])
Z = UnitZ(Factor=1)
X = UnitX(Factor=random)
pt_2 = Point([<point referenced from the Rhino model> x4])
tri = Triangulate(Mesh=conmesh)  # -> Mesh, Count
number_slider_3 = Slider(200, range=0..200)
vrot = Rotate(Vector=X, Axis=Z, Angle=random_2)
mesh_topo_vertex = MeshTopologyVertex(Mesh=tri.Mesh)  # -> ListOfMeshVertices, VertexVertexStructure, VertexFaceStructure
# loc
pt_3 = Point(flatten(dup))
# vel
vec = Vector(flatten(vrot))
# col
col = Colour(flatten(wheel))
# tail
# < NB: always add the trail (or tail) as LAST
pt_4 = Point(dup)
pcharge = PointCharge(Point=pt_2, Charge=1, Decay=1)
fspin = SpinForce(Plane=pt_2, Strength=1, Radius=genes, Decay=1)
bpath = BranchPath(T=mesh_topo_vertex.VertexVertexStructure, i=number_slider_3)  # -> P; inputs T: tree, i: Int32; disabled
# ---------- bpath: C# ----------
    Component.Name = "Branch Path";
    Component.NickName = "BPath";
    Component.Description = "Retrieves the data tree path for a specific branch index";
    P = T.Path(i);
# ---------- end bpath ----------
Z_2 = UnitZ(Factor=1)
mergef = MergeFields(Fields=[pcharge, fspin])
branch = TreeBranch(Tree=mesh_topo_vertex.VertexVertexStructure, Path=bpath, MaintainPaths=True)  # disabled
pl = PlaneNormal(Origin=pt_3, ZAxis=Z_2)
evf = EvaluateField(Field=mergef, Point=mesh_topo_vertex.ListOfMeshVertices)  # -> Tensor, Strength
item = ListItem(List=mesh_topo_vertex.ListOfMeshVertices, Index=mesh_topo_vertex.VertexVertexStructure, Wrap=True)
item_2 = ListItem(List=mesh_topo_vertex.ListOfMeshVertices, Index=branch, Wrap=True)  # disabled
align = AlignPlane(Plane=pl, Direction=vec)  # -> Plane, Angle
multiplication_2 = Multiplication(A=evf.Tensor, B=Slider(2.32, range=0..10))
vec2pt = Vector2Pt(PointA=graft(mesh_topo_vertex.ListOfMeshVertices), PointB=item, Unitize=False)  # -> Vector, Length
demesh_2 = DeconstructMesh(Mesh=conmesh)  # -> Vertices, Faces, Colours, Normals
item_3 = ListItem(List=demesh_2.Vertices, Index=number_slider_3, Wrap=True)  # disabled
vdisex = VectorDisplayEx(Point=mesh_topo_vertex.ListOfMeshVertices, Vector=multiplication_2, Colour=RGB(0, 0, 0), Width=2)
# fields
merge = Merge(Data1=simplify(graft(pt_3)), Data2=simplify(graft(vec)), Data3=simplify(graft(col)), Data4=simplify(graft(pt_4)))
angle = Angle(VectorA=graft(evf.Tensor), VectorB=vec2pt.Vector)  # -> Angle, Reflex
sort = SortList(Keys=angle.Angle, ValuesA=mesh_topo_vertex.VertexVertexStructure)  # -> Keys, ValuesA
button = Button()
exit = Button()
evaporation_rate = Slider(0.97952, range=0..1)
evaporation_rate_2 = Slider(0.99488, range=0..1)
maxforce = Slider(0.582, range=0..1)
futloc = Slider(2.5, range=0..3)
ph_strength = Slider(0.238, range=0..1)
maxspeed = Slider(1.5, range=0..3)
wandering_threshold = Slider(0.16, range=0..1)
wandering_angle = Slider(49.21, range=0..90)
group = Group(Objects=merge)
item_4 = ListItem(List=sort.ValuesA, Index=0, Wrap=True)
item_5 = ListItem(List=mesh_topo_vertex.ListOfMeshVertices, Index=item_4, Wrap=True)  # -> flatten(Item)
loop_start = LoopStart(N=Slider(322, range=0..1000), T=button, D0=group, D1=demesh_2.Colours)  # -> port, Counter, Data, Data_2; disabled
vec2pt_2 = Vector2Pt(PointA=mesh_topo_vertex.ListOfMeshVertices, PointB=item_5, Unitize=False)  # -> Vector, Length
panel = Panel(loop_start.Counter)
vdisex_2 = VectorDisplayEx(
    Point=mesh_topo_vertex.ListOfMeshVertices,
    Vector=vec2pt_2.Vector,
    Colour=ColourSwatch(SwatchColor=RGB(255, 255, 255)),
    Width=2)
ungroup = Ungroup(Group=loop_start.Data)  # -> simplify(Objects)
split = SplitList(List=ungroup, Index="3")  # -> ListA, ListB

# ----
# loc
# vel
# col
item_6 = ListItem(List=split.ListA, Index=0, Wrap=True)  # -> Item, Item1, Item2

threshold = Slider(0.16, range=0..1)
futloc_2 = Slider(2.5, range=0..3)
rad = Radians(Degrees=wandering_angle)
list = ValueList({"brightest": 0, "darkest": 1}, selected="brightest")
vec_2 = Vector(item_6.Item1)
# read environment
pt_5 = Point(item_6.Item)
pt_6 = Point(demesh_2.Vertices)
col_2 = Colour(loop_start.Data_2)
neg = Negative(Value=rad)
lng_2 = ListLength(List=flatten(pt_5))
dom = ConstructDomain(DomainStart=neg, DomainEnd=rad)
cluster = Cluster(
    location=pt_5,
    velocity=vec_2,
    future_location_radius=futloc_2,
    points_to_search=pt_6,
    colors_to_search=col_2,
    samples=Slider(10, range=2..50),
    search_threshold_0_1=threshold,
    brightest_darkest=list)  # -> color_direction, pattern, followers_index, others_index
random_3 = Random(Range=dom, Number=lng_2, Seed=loop_start.Counter)  # -> simplify(graft(Random))
Z_3 = UnitZ(Factor=1)
max_angle = Slider(90, range=0..90)
# wander
vrot_2 = Rotate(Vector=vec_2, Axis=Z_3, Angle=random_3)
perlin_2 = PerlinNoise(Values=item_6.Item, Time=0, Scale=noise_scale)
weave = Weave(Pattern=cluster.pattern, Stream0=vrot_2, Stream1=cluster.color_direction, NullGaps=False)
item_7 = ListItem(List=cluster.followers_index, Index=cluster.others_index, Wrap=True)
# wanderers
item_8 = ListItem(List=pt_5, Index=cluster.others_index, Wrap=True)
multiplication_3 = Multiplication(A=perlin_2, B=max_angle)
Z_4 = UnitZ(Factor=1)
vrot_3 = Rotate(Vector=item_6.Item1, Axis=Z_4, Angle=degrees(multiplication_3))  # -> simplify(Vector)
maxforce_2 = Slider(0.384, range=0..1)
color_intensity = Slider(1, range=0..1)
noise_intensity = Slider(0, range=0..1)
steer = Steer(vel=item_6.Item1, des=weave, maxv=maxspeed, maxf=maxforce)
# steer
steer_2 = Steer(vel=item_6.Item1, des=vrot_3, maxv=maxspeed, maxf=maxforce_2)
# write to environment
cp = ClosestPoint(Point=item_6.Item, Cloud=demesh_2.Vertices)  # -> ClosestPoint, CPIndex, Distance
item_9 = ListItem(List=loop_start.Data_2, Index=cp.CPIndex, Wrap=True)  # -> simplify(Item1), Item
multiplication_4 = Multiplication(A=steer_2, B=noise_intensity)
multiplication_5 = Multiplication(A=steer, B=color_intensity)
ahsv = SplitAHSV(Colour=item_9.Item1)  # -> Alpha, Hue, Saturation, Value
addition_2 = Addition(A=item_6.Item1, B=multiplication_4, C=multiplication_5)
addition_3 = Addition(A=ahsv.Value, B=ph_strength)
min = Minimum(A=addition_3, B="1")
# limit to maxspeed
trmvec = TrimVector(Vector=addition_2, LengthDomain=maxspeed)
move = Move(Geometry=item_6.Item, Motion=trmvec)  # -> Geometry, Transform
tail_length = Slider(12, range=2..50)
frgb = ColourRGBF(Alpha=1, Red=min, Green=min, Blue=min)
meshcp = MeshClosestPoint(Point=move.Geometry, Mesh=conmesh)  # -> Point, Index, Parameter
replace = ReplaceItems(List=flatten(loop_start.Data_2), Item=flatten(frgb), Indices=flatten(cp.CPIndex), Wrap=False)
# add to tail
t_rec = TailRecorder(L=simplify(split.ListB), it=simplify(meshcp.Point), len=tail_length)  # -> out, Lo; inputs L: list, len: Int32
# ---------- t_rec: C# ----------
    String eol = Environment.NewLine;
    Component.Name = "Tail Recorder";
    Component.NickName = "T-Rec";
    Component.Description = "Tail recorder" + eol + "L - list of tail points" + eol + "it - item to add" + eol + "len - tail max length";

    if (L.Count() > len) {
      L.RemoveAt(0);
    }
    L.Add(it);
    Lo = L;
# ---------- end t_rec ----------
multiplication_6 = Multiplication(A=replace, B=evaporation_rate)
merge_2 = Merge(Data1=simplify(meshcp.Point), Data2=simplify(trmvec), Data3=simplify(item_6.Item2), Data4=simplify(t_rec.Lo))
group_2 = Group(Objects=merge_2)
running = Running(
    port=loop_start.port,
    Exit=exit,
    Data=simplify(group_2),
    Data_2=simplify(multiplication_6),
    pausedState=False,
    state="Constant output",
    TimeOutVal=0)  # -> D0, D1
ungroup_2 = Ungroup(Group=running.D0)
split_2 = SplitList(List=ungroup_2, Index="3")  # -> ListA, ListB
conmesh_2 = ConstructMesh(Vertices=demesh_2.Vertices, Faces=demesh_2.Faces, Colours=running.D1)
interval = Slider(1, range=1..10)
interval_2 = Slider(1, range=1..10)
repeat = RepeatData(Data="0", Length=expr("x-1", interval))
merge_3 = Merge(Data1="1", Data2=repeat)  # -> flatten(Result)
repeat_2 = RepeatData(Data="0", Length=expr("x-1", interval_2))
item_10 = ListItem(List=split_2.ListA, Index=0, Wrap=True)  # -> Item, Item1, Item2
viewer = ParamViewer(split_2.ListB)
cull = CullPattern(List=split_2.ListB, CullPattern=merge_3)
merge_4 = Merge(Data1="1", Data2=repeat_2)  # -> flatten(Result)
lng_3 = ListLength(List=cull)
cull_2 = CullPattern(List=split_2.ListB, CullPattern=merge_4)
lng_4 = ListLength(List=viewer)
number_slider_4 = Slider(0.4, range=0..3)
repeat_3 = RepeatData(Data=ColourSwatch(SwatchColor=RGB(0, 0, 0)), Length=lng_4)  # -> graft(Data)
pline = PolyLine(Vertices=cull_2, Closed=False)
merge_5 = Merge(Data1=simplify(repeat_3), Data2=simplify(item_10.Item2))
range = Range(Domain=Domain(0, 1), Steps=expr("x-1", lng_3))
smoothpline = SmoothPolyline(Polyline=pline, Strength=1, Times=Slider(1, range=1..30))
addition_4 = Addition(A=number_slider_4, B=1)
col_3 = Colour(merge_5)
expression = Expression(x=range, y=number_slider_4, Expression="1+x*y")
cloud = CloudDisplay(Points=item_10.Item, Colours=item_10.Item2, Size=addition_4, SpriteType=0)
interp = InterpolateData(Data=col_3, Parameter=range, Interpolation=2)
cloud_2 = CloudDisplay(Points=graft(cull), Colours=graft(interp), Size=number_slider_4, SpriteType=0)
previewlw = CustomPreviewLineweights(
    Geometry=smoothpline,
    Shader=ColourSwatch(SwatchColor=RGB(113, 162, 189)),
    Thickness=Slider(1, range=1..3),
    Absolute=False)

# ==== cluster Steer
maxf = ClusterInput()
vel = ClusterInput()
maxv = ClusterInput()
des = ClusterInput()
amp = Amplitude(Vector=des, Amplitude=maxv)
subtraction = Subtraction(A=amp, B=vel)
multiplication = Multiplication(A=subtraction, B=maxf)
vlen = VectorLength(Vector=multiplication)
min = Minimum(A=vlen, B=maxv)
amp_2 = Amplitude(Vector=multiplication, Amplitude=min)
acc = ClusterOutput(amp_2)

# ==== cluster Cluster
future_location_radius = ClusterInput()  # amplitude for future location search
samples = ClusterInput()  # n. of point to sample
location = ClusterInput()
velocity = ClusterInput()
points_to_search = ClusterInput()
colors_to_search = ClusterInput()
search_threshold_0_1 = ClusterInput()
brightest_darkest = ClusterInput()  # 0 follow brightest, 1 follow darkest
# future location
amp = Amplitude(Vector=velocity, Amplitude=future_location_radius)
move = Move(Geometry=location, Motion=amp)  # -> Geometry, Transform
cps = ClosestPoints(Point=move.Geometry, Cloud=points_to_search, Count=samples)  # -> ClosestPoint, CPIndex, Distance
item = ListItem(List=colors_to_search, Index=cps.CPIndex, Wrap=True)
addition = Addition(A="-1", B=brightest_darkest)
ahsv = SplitAHSV(Colour=item)  # -> Alpha, Hue, Saturation, Value
sort = SortList(Keys=ahsv.Value, ValuesA=cps.ClosestPoint, ValuesB=cps.CPIndex)  # -> Keys, ValuesA, ValuesB

# ----
# -1 | brightest
# i    |  darkest
value = ListItem(List=simplify(sort.Keys), Index=addition, Wrap=True)
point = ListItem(List=simplify(sort.ValuesA), Index=addition, Wrap=True)
index = ListItem(List=simplify(sort.ValuesB), Index=addition, Wrap=True)

panel = Panel("true")
lng = ListLength(List=flatten(value))
vec2pt = Vector2Pt(PointA=location, PointB=point, Unitize=False)  # -> Vector, Length
larger = LargerThan(FirstNumber=value, SecondNumber=search_threshold_0_1)  # -> LargerThan, simplify(OrEqualTo)
vec = Vector(Vector(0, 0, 0))
not = GateNot(A=larger.OrEqualTo)
repeat = RepeatData(Data=vec, Length=lng)  # -> simplify(graft(Data))
filter = StreamFilter(Gate=brightest_darkest, Stream0=larger.OrEqualTo, Stream1=not)
weave = Weave(Pattern=filter, Stream0=repeat, Stream1=vec2pt.Vector, NullGaps=False)
dispatch = Dispatch(List=index, DispatchPattern=filter)  # -> ListA, ListB
pattern = ClusterOutput(filter)  # true/false pattern against threshold
color_direction = ClusterOutput(weave)  # color vector direction (0 vector if not within threshold)
followers_index = ClusterOutput(dispatch.ListA)
others_index = ClusterOutput(dispatch.ListB)
